# Grasshopper definition ModelFixing.gh (Grasshopper 1.0.7)
# plug-ins: Bifocals

# ---- group: Checks if curves are open and closes them
curve = Curve([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])
end_points = EndPoints(Curve=curve)  # -> Start, End
closed = Closed(Curve=curve)  # -> Closed, Periodic
line = Line(StartPoint=end_points.Start, EndPoint=end_points.End)
dispatch = Dispatch(List=curve, DispatchPattern=closed.Closed)  # -> ListA, ListB
join_curves = JoinCurves(Curves=[curve, line], Preserve=False)
panel = Panel(dispatch.ListB)
closed_2 = Closed(Curve=join_curves)  # -> Closed, Periodic
panel_2 = Panel(closed_2.Closed)
panel_3 = Panel(dispatch.ListA)

# ---- group: Snaps the floor to an invisible grid
geometry = Geometry([<curve referenced from the Rhino model> x10])
number_slider = Slider(0.3, range=0..1)
number_slider_2 = Slider(79, range=0..100)
vector_xyz = VectorXYZ(XComponent=0, YComponent=0, ZComponent=0)  # -> Vector, Length
explode = Explode(Curve=join_curves, Recursive=True)  # -> Segments, Vertices
rectangular = Rectangular(Plane=vector_xyz.Vector, SizeX=number_slider, SizeY=number_slider, ExtentX=number_slider_2, ExtentY=number_slider_2)  # -> Cells, flatten(Points)
geometry_2 = Geometry(explode.Vertices)
geometry_3 = Geometry(rectangular.Points)
closest_point = ClosestPoint(Point=graft(geometry_2), Cloud=geometry_3)  # -> ClosestPoint, CPIndex, Distance
geometry_4 = Geometry(simplify(closest_point.ClosestPoint))
path_mapper = PathMapper(geometry_4, source="{A;B}(i)", target="{A}(B)")
polyline = PolyLine(Vertices=path_mapper, Closed=Toggle(False))
geometry_5 = Geometry(polyline)
colour_swatch = ColourSwatch(SwatchColor=RGB(238, 255, 0))  # disabled
join_curves_2 = JoinCurves(Curves=geometry_5, Preserve=False)
geometry_6 = Geometry(join_curves_2)
custom_preview = CustomPreview(Geometry=flatten(geometry_6), Material=colour_swatch)  # disabled
