# Grasshopper definition MoebiusStrip.gh (Grasshopper 1.0.7)

number_slider = Slider(40, range=0..100)
circle = Circle(Plane=PlaneXY(0, 0, 0), Radius=Slider(7, range=0..10))
perp_frames = PerpFrames(Curve=circle, Count=number_slider, Align=True)  # -> Frames, Parameters
pi = Pi(Factor=Slider(2, range=0..10))
division = Division(A=pi, B=Slider(3, range=0..10))
polygon = Polygon(Plane=perp_frames.Frames, Radius=Slider(4.4, range=0..10), Segments=Slider(3, range=0..10), FilletRadius=0)  # -> Polygon, Length
subtraction = Subtraction(A=number_slider, B=1)
range = Range(Domain=division, Steps=subtraction)
fillet = Fillet(Curve=polygon.Polygon, Radius=Slider(1.3, range=0.5..5))
rotate = Rotate(Geometry=fillet, Angle=range, Plane=perp_frames.Frames)  # -> Geometry, Transform
division_2 = Division(A=number_slider, B=2)
construct_domain = ConstructDomain(DomainStart=0, DomainEnd=division_2)
construct_domain_2 = ConstructDomain(DomainStart=division_2, DomainEnd=subtraction)
sub_list = SubList(List=rotate.Geometry, Domain=construct_domain, Wrap=True)  # -> List, Index
list_item = ListItem(List=perp_frames.Frames, Index=0, Wrap=True)
list_item_2 = ListItem(List=rotate.Geometry, Index=0, Wrap=True)
sub_list_2 = SubList(List=rotate.Geometry, Domain=construct_domain_2, Wrap=True)  # -> List, Index
rotate_2 = Rotate(Geometry=list_item_2, Angle=division, Plane=list_item)  # -> Geometry, Transform
loft = Loft(Curves=sub_list.List, Options={Adjust=False, Closed=False, LoftEnds=0, LoftSimp=0, LoftType=0, Rebuild=10, Refit=0.01})
merge = Merge(Data1=flatten(sub_list_2.List), Data2=flatten(rotate_2.Geometry))
loft_2 = Loft(Curves=merge, Options={Adjust=False, Closed=False, LoftEnds=0, LoftSimp=0, LoftType=0, Rebuild=10, Refit=0.01})
brep_join = BrepJoin(Breps=[loft, loft_2])  # -> Breps, Closed
