# Grasshopper definition 3_D Polygon.gh (Grasshopper 1.0.7)

number_slider = Slider(5, range=5..10)
series = Series(Start=Slider(1, range=1..5), Step=Slider(1, range=1..5), Count=number_slider)
multiplication = Multiplication(A=number_slider, B=Slider(2, range=1..20))
reverse_list = ReverseList(List=series)
series_2 = Series(Start=0, Step=Slider(2.1, range=1..5), Count=multiplication)
merge = Merge(Data1=series, Data2=reverse_list)
construct_point = ConstructPoint(XCoordinate=0, YCoordinate=0, ZCoordinate=series_2)
panel = Panel(merge)
number_slider_2 = Slider(1, range=1..10)
xy_plane = XYPlane(Origin=construct_point)
polygon = Polygon(Plane=xy_plane, Radius=panel, Segments=Slider(8, range=3..8), FilletRadius=0)  # -> Polygon, Length
loft = Loft(Curves=polygon.Polygon, Options={Adjust=False, Closed=False, LoftEnds=0, LoftSimp=0, LoftType=0, Rebuild=10, Refit=0.01})
