# Grasshopper definition Boolean_Color-changing_Cube.gh (Grasshopper 1.0.7)

boolean_toggle = BooleanToggle(True)
addition = Addition(A=Toggle(True), B=Toggle(False))
stream_filter = StreamFilter(
    Gate=Slider(0, range=0..3),
    Stream0=ColourSwatch(SwatchColor=RGB(140, 107, 255)),
    Stream1=ColourSwatch(SwatchColor=RGB(134, 192, 255)),
    Stream2=ColourSwatch(SwatchColor=RGB(220, 143, 25)),
    Stream3=ColourSwatch(SwatchColor=RGB(81, 164, 0)))
geometry = Geometry(<brep referenced from the Rhino model>)
panel = Panel(addition)
custom_preview = CustomPreview(Geometry=geometry, Material=stream_filter)
