# Grasshopper definition Bug_No_CellComplex_In_Cylinders.gh (Grasshopper 1.0.7)
# plug-ins: TopologicGH

yz_plane = YZPlane(Origin=Point(0, 0, 0))
xy_plane = XYPlane(Origin=Point(0, 0, 0))
xy_plane_2 = XYPlane(Origin=Point(0, 0, 0))
xz_plane = XZPlane(Origin=Point(0, 0, 0))
rotate = Rotate(Geometry=xy_plane_2, Angle=degrees(Slider(90, range=0..100)), Plane=xz_plane)  # -> Geometry, Transform
rotate_2 = Rotate(Geometry=xy_plane, Angle=degrees(Slider(90, range=0..100)), Plane=yz_plane)  # -> Geometry, Transform
plane_surface = PlaneSurface(Plane=rotate.Geometry, XSize=Domain(-10, 10), YSize=Domain(-10, 10))
plane_surface_2 = PlaneSurface(Plane=rotate_2.Geometry, XSize=Domain(-10, 10), YSize=Domain(-10, 10))
unit_y = UnitY(Factor=Slider(4, range=0..10))
unit_x = UnitX(Factor=Slider(3, range=0..10))
move = Move(Geometry=plane_surface_2, Motion=unit_y)  # -> Geometry, Transform
move_2 = Move(Geometry=plane_surface, Motion=unit_x)  # -> Geometry, Transform
unit_z = UnitZ(Factor=Slider(5, range=0..10))
unit_z_2 = UnitZ(Factor=Slider(5, range=0..10))
move_3 = Move(Geometry=move.Geometry, Motion=unit_z)  # -> Geometry, Transform
geometry = Geometry(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)
move_4 = Move(Geometry=move_2.Geometry, Motion=unit_z_2)  # -> Geometry, Transform
split_brep = SplitBrep(Brep=geometry, Cutter=move_3.Geometry)
split_brep_2 = SplitBrep(Brep=geometry, Cutter=move_4.Geometry)
mesh_brep = MeshBrep(
    Brep=[split_brep_2, split_brep],
    Settings={GridMaxCount=0, GridMinCount=16, JaggedSeams=False, MaxEdgeLength=0, MinEdgeLength=0.0001, MinTolerance=0, Refine=True, RefineAngle=0, RelativeTolerance=0.65, SimplePlanes=True, Tolerance=0})
topology_bygeometry = TopologyByGeometry(Geometry=mesh_brep, Tolerance=0.0001)
topology_faces = TopologyFaces(Topology=topology_bygeometry)  # -> flatten(Faces)
cellcomplex_byfaces = CellComplexByFaces(Faces=topology_faces, Tolerance=0.001)
topology_geometry = TopologyGeometry(Topology=cellcomplex_byfaces, Tolerance=0.0001)
geometry_2 = Geometry(topology_geometry)
