# Grasshopper definition Srf_Drawing_Bug.gh (Grasshopper 1.0.7)

# ---- group: DOES NOT WORK
surface = Surface(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)
surface_2 = Surface(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)
c_script = CSharpScript(srfA=surface_2, srfB=surface, radius=Slider(3.6, range=0.1..10), tol="0.01")  # -> out, A; inputs srfA: Surface, srfB: Surface, radius: Double, tol: Double
# ---------- c_script: C# ----------
    //Declare an array of surfaces
    Surface[] surfaces = {};

    //Check for a valid input
    if (srfA != null && srfB != null)
    {
      //Create fillet surfaces
      surfaces = Surface.CreateRollingBallFillet(srfA, srfB, radius, tol);
    }

    A = surfaces;
# ---------- end c_script ----------
geometry = Geometry(c_script.A)

# ---- group: WORKS
surface_3 = Surface(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)
surface_4 = Surface(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)
c_script_2 = CSharpScript(srfA=surface_4, srfB=surface_3, radius=Slider(3.6, range=0.1..10), tol="0.01")  # -> out, A; inputs srfA: Surface, srfB: Surface, radius: Double, tol: Double; same code as c_script
# The only differences between these two codes, are that the surfaces are drawn differently. However, I don't quite understand why it makes a difference if I draw a surface from 4 or 2 points...
geometry_2 = Geometry(c_script_2.A)
