# Grasshopper definition Srf_Drawing_Solutions.gh (Grasshopper 1.0.7)

# ---- group: METHOD #2
surface = Surface(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)
surface_2 = Surface(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)
c_script = CSharpScript(srfA=surface, srfB=surface_2, radius=Slider(3.6, range=0.1..10), tol="0.01")  # -> out, A; inputs srfA: Surface, srfB: Surface, radius: Double, tol: Double
# ---------- c_script: C# ----------
    if (srfA != null && srfB != null)
    {
      var pA = new Point2d(srfA.Domain(0).Mid, srfB.Domain(1).Mid);
      var pB = new Point2d(srfB.Domain(0).Mid, srfB.Domain(1).Mid);
      A = Surface.CreateRollingBallFillet(srfA, pA, srfB, pB, radius, tol);
    }
# ---------- end c_script ----------
geometry = Geometry(c_script.A)

# ---- group: METHOD #1
surface_3 = Surface(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)
c_script_2 = CSharpScript(srf=surface_3, u=Toggle(True), v=Toggle(False))  # -> out, A; inputs srf: Surface, u: Boolean, v: Boolean
# ---------- c_script_2: C# ----------
    if (u)
      srf.Reverse(0, true);
    if (v)
      srf.Reverse(1, true);
    A = srf;
# ---------- end c_script_2 ----------
surface_4 = Surface(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)
c_script_3 = CSharpScript(srfA=surface_4, srfB=c_script_2.A, radius=Slider(3.6, range=0.1..10), tol="0.01")  # -> out, A; inputs srfA: Surface, srfB: Surface, radius: Double, tol: Double
# ---------- c_script_3: C# ----------
    //Declare an array of surfaces
    Surface[] surfaces = {};

    //Check for a valid input
    if (srfA != null && srfB != null)
    {
      //Create fillet surfaces
      surfaces = Surface.CreateRollingBallFillet(srfA, srfB, radius, tol);
    }

    A = surfaces;
# ---------- end c_script_3 ----------
geometry_2 = Geometry(c_script_3.A)

# ---- group: WORKS
surface_5 = Surface(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)
surface_6 = Surface(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)
c_script_4 = CSharpScript(srfA=surface_6, srfB=surface_5, radius=Slider(3.6, range=0.1..10), tol="0.01")  # -> out, A; inputs srfA: Surface, srfB: Surface, radius: Double, tol: Double; same code as c_script_3
# The only differences between these two codes, are that the surfaces are drawn differently. However, I don't quite understand why it makes a difference if I draw a surface from 4 or 2 points...
geometry_3 = Geometry(c_script_4.A)

# ---- group: DOES NOT WORK
surface_7 = Surface(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)
surface_8 = Surface(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)
c_script_5 = CSharpScript(srfA=surface_7, srfB=surface_8, radius=Slider(3.6, range=0.1..10), tol="0.01")  # -> out, A; inputs srfA: Surface, srfB: Surface, radius: Double, tol: Double; same code as c_script_3
geometry_4 = Geometry(c_script_5.A)
