# Grasshopper definition Are_Random_Numbers_Prime.gh (Grasshopper 1.0.7)

c_script = CSharpScript(branchNum=Slider(10, range=1..10), listNum=Slider(10, range=1..10))  # -> out, A; inputs branchNum: Int32, listNum: Int32
# ---------- c_script: C# ----------
    DataTree <int> treeNum = new DataTree<int> ();
    int pathIndex = 0;

    for(int branch = 0; branch < branchNum; branch++){
      List <int> listNumber = new List <int> ();
      GH_Path path = new GH_Path(pathIndex);
      pathIndex = pathIndex + 1;

      for( int i = 1 ; i <= listNum; i++) {
        listNumber.Add(i);

      }
      treeNum.AddRange(listNumber, path);
    }
    A = treeNum;
# ---------- c_script: C# additional code ----------
  bool isPrimeNum (int num, List <int> factors)
  {
    factors.Add(1);
    bool boolFlag = true;
    
    for (int i = 2; i <(num/2); i++ )
    {
      if(num % i == 0)
      {
        boolFlag = false;
        factors.Add(i);
      }
    }
    factors.Add(num);
    return boolFlag;
  }
# ---------- end c_script ----------
param_viewer = ParamViewer(c_script.A)
