# Grasshopper definition C#_Course_Day01.gh (Grasshopper 1.0.7)

# ---- group: Intro to C#
c_script = CSharpScript(x=Slider(0.4, range=0..1), y=Slider(0.1, range=0..1), z=Slider(0.5, range=0..1))  # -> out, A, B; inputs x: Double, y: Double, z: Double
# ---------- c_script: C# ----------
    A = x + y;
    B = x + y + z;
# ---------- end c_script ----------
panel = Panel(c_script.B)

# ---- group: "in range" practice
c_script_2 = CSharpScript(x=Slider(11, range=0..100))  # -> out, A; inputs x: Int32, y: Int32
# ---------- c_script_2: C# ----------
    for (int i = 0; i <= x; i++)
    {
      Print(i.ToString());
    }
    Print(" ");
    for (int i = 10; i > 0; i -= 2)
    {
      Print(i.ToString());
    }
# ---------- end c_script_2 ----------
panel_2 = Panel(c_script_2.out)

# ---- group: Creates a Point from the x, y, z values
c_script_3 = CSharpScript(x=Slider(1, range=0..10), y=Slider(2, range=0..10), z=Slider(3, range=0..10))  # -> out, A; inputs x: Int32, y: Int32, z: Int32
# ---------- c_script_3: C# ----------
    Point3d myPoint = new Point3d (x, y, 2 * z);
    A = myPoint;
# ---------- end c_script_3 ----------
panel_3 = Panel(c_script_3.A)

# ---- group: Creates a list of points going diagonally
c_script_4 = CSharpScript()  # -> out, A
# ---------- c_script_4: C# ----------
    List<Point3d> myPoints = new List <Point3d> ();

    for (int i = 0; i < 10; i++)
    {
      myPoints.Add(new Point3d (i, i, i));
    }

    A = myPoints;
# ---------- end c_script_4 ----------
panel_4 = Panel(c_script_4.A)

# ---- group: Creating circles around points
point = Point([Point(10.11308938, 1, 0), Point(22, 3, 0), Point(24.3623895, -7.671717594, 0), Point(16.16258023, -7.598666558, 0), Point(15.3606, 2.464426975, 0), Point(17.84616875, -5.377110568, 0), Point(31, 3.288791266, 0), Point(37, -4, 0), Point(10.73065251, -6.048885903, 0), Point(23.34470282, -3, 0)])
c_script_5 = CSharpScript(points=point)  # -> out, A; inputs points: list of Point3d
# ---------- c_script_5: C# ----------
    List<Circle> circles = new List <Circle> ();

    foreach(Point3d point in points)
    {
      circles.Add(new Circle(point, 2.0));
    }

    A = circles;
# ---------- end c_script_5 ----------
panel_5 = Panel(c_script_5.A)

# ---- group: How to add values to lists
c_script_6 = CSharpScript()  # -> out, A
# ---------- c_script_6: C# ----------
    List<double> myList = new List <double>(){0.1,0.2};
    myList.Add(2.15);
    myList.Add(3.25);
    Print(myList[0].ToString());
# ---------- end c_script_6 ----------
panel_6 = Panel(c_script_6.A)

# ----
point_2 = Point([Point(-48, 14, 0), Point(-40, 23, 0), Point(-35, 7, 0), Point(-26, 25, 0), Point(-20, 17, 0)])
c_script_7 = CSharpScript(controlPoints=point_2, iterationCount=Slider(4, range=0..10))  # -> out, curve; inputs controlPoints: list of Point3d, iterationCount: Int32
# ---------- c_script_7: C# ----------
    for (int j = 0; j < iterationCount; j++)
    {
      List < Point3d > newControlPoints = new List <Point3d>();

      for (int i = 0; i < controlPoints.Count - 1; i++)
      {
        Point3d oneQuarterPoint = 0.75 * controlPoints[i] + 0.25 * controlPoints[i + 1];
        newControlPoints.Add(oneQuarterPoint);

        Point3d threeQuarterPoint = 0.25 * controlPoints[i] + 0.75 * controlPoints[i + 1];
        newControlPoints.Add(threeQuarterPoint);
      }
      controlPoints = newControlPoints;
    }
    curve = new PolylineCurve(controlPoints);
# ---------- end c_script_7 ----------

# ---- group: If-else Statement with age
number_slider = Slider(17, range=1..20)
ghpython_script = GhPythonScript(age=number_slider)  # -> out, a; inputs age: Int32
# ---------- ghpython_script: Python ----------
__author__ = "micha"
__version__ = "2020.04.09"

import rhinoscriptsyntax as rs

if age < 18:
    print ("You suckersss, you're too young!!!")


elif age==18 :
    print ("Puh, just about...")

else:
    print ("No fun !")
# ---------- end ghpython_script ----------
c_script_8 = CSharpScript(age=number_slider)  # -> out, A; inputs age: Int32
# ---------- c_script_8: C# ----------
    if (age < 18){
      A = "You aren't worthy enough, to run this program!!";
    }

    else if (age == 18) {
      A = "Hmph, you barely made it you idiot!";
    }

    else {
      A = "Fine... I give up";
    }
# ---------- end c_script_8 ----------
panel_7 = Panel(c_script_8.A)
panel_8 = Panel(ghpython_script.out)
