# Grasshopper definition C#_Course_Long_Beginner.gh (Grasshopper 1.0.7)

# Day 1 - C# Scripting and Plugin Development for Grasshopper
panel = Panel("Part 1")
c_script = CSharpScript()  # -> out, A
# ---------- c_script: C# ----------
    Point3d myPoint = new Point3d(1.0, 2.0, 3.0);
    A = myPoint;
# ---------- end c_script ----------
c_script_2 = CSharpScript()  # -> out
# ---------- c_script_2: C# ----------
    for(int i = 0; i <= 5; i++)
    {
      Print(i.ToString());
    }
    
    Print(" ");
# ---------- end c_script_2 ----------
c_script_3 = CSharpScript()  # -> out
# ---------- c_script_3: C# ----------
    List <double> myNumbers = new List <double>(){1.45,5.67,7.89};
    myNumbers.Add(2.39);
    myNumbers.Add(4.12);

    Print(myNumbers[0].ToString());
# ---------- end c_script_3 ----------
c_script_4 = CSharpScript()  # -> out, A
# ---------- c_script_4: C# ----------
    List<Point3d> myPoints = new List <Point3d>();

    for(int i = 0; i < 100; i++)
      //You can remove the curly brackets if there is only 1 statement in the "for loop
    {
      myPoints.Add(new Point3d(i, i, i));
    }

    A = myPoints;
# ---------- end c_script_4 ----------
c_script_5 = CSharpScript()  # -> out, A
# ---------- c_script_5: C# ----------
    List<Point3d> myPoints = new List <Point3d>();

    for(int i = 0; i < 100; i++)
    {
      for(int j = 0; j < 20; j++)
      {
        myPoints.Add(new Point3d(i, j, 0));
      }
    }

    A = myPoints;
# ---------- end c_script_5 ----------
pt = Point([Point(-1.690546658, 9.381564862, 0), Point(6.550240874, 12.90190128, 0), Point(1.749782118, -0.6993985267, 0), Point(0.7096827206, 14.58206185, 0), Point(9.670539066, 5.301174919, 0), Point(4.630057372, -3.179635551, 0), Point(-1.290508428, 3.380991416, 0)])
panel_2 = Panel("Part 2")
c_script_6 = CSharpScript()  # -> out, A
# ---------- c_script_6: C# ----------
    double myNumber = 2.0;
    int yourNumber = 2;
    Foo(myNumber);
    Foo(ref yourNumber);
    Print(myNumber.ToString());
    Print(yourNumber.ToString());
# ---------- c_script_6: C# additional code ----------
  void Foo(double someNumber)
  {
    someNumber = someNumber + 1;
  }

  void Foo(ref int someNumber)
  {
    someNumber = someNumber + 1;
  }
# ---------- end c_script_6 ----------
c_script_7 = CSharpScript()  # -> out
# ---------- c_script_7: C# ----------
    double area;
    double volume;
    ComputeAreaAndVolume(1.0, out area, out volume);
    Print(area.ToString());
    Print(volume.ToString());
# ---------- c_script_7: C# additional code ----------
  void ComputeAreaAndVolume(double r, out double area, out double volume)
  {
    area = r * r * 4.0 * Math.PI;
    volume = 4.0 / 3.0 * Math.PI * r * r * r;
  }
# ---------- end c_script_7 ----------
c_script_8 = CSharpScript()  # -> out, A
# ---------- c_script_8: C# ----------
    Random myRandomGenerator = new Random();

    //For Integers
    for(int i = 0; i < 10; i++)
    {
      double myRandomNumber = myRandomGenerator.NextDouble();

      //The range is 6 units and we start from -3
      double a = myRandomNumber * 6 - 3;

      Print(myRandomNumber.ToString());
    }
# ---------- end c_script_8 ----------
c_script_9 = CSharpScript()  # -> out
# ---------- c_script_9: C# ----------
    double area = 0.0;
    double volume = 0.0;
    ComputeAreaAndVolume(1.0, ref area, ref volume);
    Print(area.ToString());
    Print(volume.ToString());
# ---------- c_script_9: C# additional code ----------
  void ComputeAreaAndVolume(double r, ref double area, ref double volume)
  {
    area = r * r * 4.0 * Math.PI;
    volume = 4.0 / 3.0 * Math.PI * r * r * r;
  }
# ---------- end c_script_9 ----------
c_script_10 = CSharpScript()  # -> out, A
# ---------- c_script_10: C# ----------
    //You put the seed un the parentheses in the new Random.
    Random myRandomGenerator = new Random();

    //For Decimals
    for(int i = 0; i < 10; i++)
    {
      Print(myRandomGenerator.NextDouble().ToString());
    }

    Print(" ");

    //For Integers
    for(int i = 0; i < 10; i++)
    {
      Print(myRandomGenerator.Next().ToString());
    }
# ---------- end c_script_10 ----------
timer = Timer(TimerInterval=20, Target=c_script_19)  # disabled
c_script_11 = CSharpScript(iCount="200")  # -> out, oPoints; inputs iCount: Int32
# ---------- c_script_11: C# ----------
    Random myRandomGenerator = new Random();

    List <Point3d> points = new List <Point3d>();

    for(int i = 0; i < iCount; i++)
    {
      double x = myRandomGenerator.NextDouble() * 6.0 - 3.0;
      double y = myRandomGenerator.NextDouble() * 6.0 - 3.0;
      double z = 0.0;
      Point3d Randompoint = new Point3d(x, y, z);
      points.Add(Randompoint);
    }
    oPoints = points;
# ---------- end c_script_11 ----------
c_script_12 = CSharpScript(points=pt)  # -> out, A; inputs points: list of Point3d
# ---------- c_script_12: C# ----------
    List<Circle> circles = new List <Circle>();

    foreach(Point3d point in points)
    {
      Circle circle = new Circle(point, 2.0);
      circles.Add(circle);
    }

    A = circles;
# ---------- end c_script_12 ----------
panel_3 = Panel(c_script_3)
panel_4 = Panel(c_script_8.out)
panel_5 = Panel(c_script_6.out)
panel_6 = Panel(c_script_7)
panel_7 = Panel(c_script_10.out)
panel_8 = Panel(c_script_9)
pt_2 = Point([Point(3, -27, 0), Point(11, -8, 0), Point(21, -27, 0), Point(31, -8, 0), Point(38, -26, 0)])
pt_3 = Point(c_script.A)
c_script_13 = CSharpScript(iCount="50")  # -> out, oPoints; inputs iCount: Int32
# ---------- c_script_13: C# ----------
    Random myRandomGenerator = new Random();

    List<Point3d> points = new List<Point3d>();

    for (int i = 0; i < iCount; i++)
    {
      double x = myRandomGenerator.NextDouble() * 6.0 - 3.0;
      double y = myRandomGenerator.NextDouble() * 6.0 - 3.0;
      double z = 0.0;
      Point3d myRandomPoint = new Point3d(x, y, z);
      points.Add(myRandomPoint);
    }

    oPoints = points;
# ---------- end c_script_13 ----------
panel_9 = Panel(c_script_2)
c_script_14 = CSharpScript(a=Slider(5, range=1..10), b=Slider(1, range=1..10))  # -> out, A; inputs a: Int32, b: Int32
# ---------- c_script_14: C# ----------
    if(a > b)
    {
      Print("a is bigger than b");
      Print("b is smaller than a");
    }
    else
    {
      Print("a is smaller than b");
      Print("b is bigger than a");
    }
# ---------- end c_script_14 ----------
c_script_15 = CSharpScript(r=Slider(3.57, range=1..10), h=Slider(8.52, range=1..10))  # -> out; inputs r: Double, h: Double
# ---------- c_script_15: C# ----------
    Print(ComputeCylinderVolume(r, h).ToString());
    double result = ComputeCylinderVolume(2.0, 2.0);
    Print(result.ToString());
    Print(ComputeCylinderVolume(2.0, 2.0).ToString());
    Print(ComputeCylinderVolume(8.0, 5.0).ToString());
# ---------- c_script_15: C# additional code ----------
  //Here you should define a function/method

  double ComputeCylinderVolume(double r, double h)
  {
    double baseArea = Math.PI * r * r;
    // or: double baseArea = ComputeCircleArea(r);
    double volume = baseArea * h;
    return volume;
    //or: return 3.14 * r * r * h;
  }
  
  double ComputeCircleArea(double r)
  {
    return r * r * Math.PI;
  }
# ---------- end c_script_15 ----------
geo = Geometry(c_script_12.A)
vec = VectorXYZ(XComponent=Slider(0.25, range=0..1), YComponent=Slider(0.25, range=0..1), ZComponent=0)  # -> Vector, Length
c_script_16 = CSharpScript(controlPoints=pt_2, iterationCount=Slider(7, range=0..10))  # -> out, curve; inputs controlPoints: list of Point3d, iterationCount: Int32
# ---------- c_script_16: C# ----------
    for(int j = 0; j < iterationCount; j++)
    {
      List<Point3d> newControlPoints = new List <Point3d>();
      
      for(int i = 0; i < controlPoints.Count - 1; i++)
      {
        Point3d oneQuarterPoint = 0.75 * controlPoints[i] + 0.25 * controlPoints[i + 1];
        newControlPoints.Add(oneQuarterPoint);
        
        Point3d threeQuarterPoint = 0.25 * controlPoints[i] + 0.75 * controlPoints[i + 1];
        newControlPoints.Add(threeQuarterPoint);
      }
      controlPoints = newControlPoints;
    }
    curve = new Polyline(controlPoints);
# ---------- end c_script_16 ----------
nurbs = NurbsCurve(Vertices=pt_2, Degree=2, Periodic=False)  # -> Curve, Length, Domain
c_script_17 = CSharpScript(x=Slider(1.39, range=1..4), y=Slider(3.08, range=1..4), z=Slider(2.47, range=1..4))  # -> out, A, B; inputs x: Double, y: Double, z: Double
# ---------- c_script_17: C# ----------
    A = x + y;
    B = x + y + z;
# ---------- end c_script_17 ----------
pt_4 = Point(c_script_11.oPoints)
c_script_18 = CSharpScript(iStartingPositions=c_script_13.oPoints, iIterationCount=Slider(1, range=0..200))  # -> out, oGeometry; inputs iStartingPositions: list of Point3d, iIterationCount: Int32
# ---------- c_script_18: C# usings ----------
using System.IO;
using System.Linq;
using System.Data;
using System.Drawing;
using System.Reflection;
using System.Windows.Forms;
using System.Xml;
using System.Xml.Linq;
using System.Runtime.InteropServices;

using Rhino.DocObjects;
using Rhino.Collections;
using GH_IO;
using GH_IO.Serialization;
# ---------- c_script_18: C# ----------
    List<Point3d> centers = new List<Point3d>(iStartingPositions);
# ---------- c_script_18: C# additional code ----------
  List<Point3d> centers;
# ---------- end c_script_18 ----------
c_script_19 = CSharpScript(iReset=Toggle(True), iVelocity=vec.Vector)  # -> out, A; inputs iReset: Boolean, iVelocity: Vector3d
# ---------- c_script_19: C# ----------
    if(iReset)
    {
      position = new Point3d(0, 0, 0);
      positions = new List<Point3d>();

      for(int i = 0; i < 10; i++)
        positions.Add(new Point3d(0, 0, 0));
    }

    else
    {
      double x = random.NextDouble() - 0.5;
      double y = random.NextDouble() - 0.5;
      position += new Vector3d(x, y, 0);

      positions.Add(position);
      positions.RemoveAt(0);
    }

    A = positions;
# ---------- c_script_19: C# additional code ----------
  Point3d position = new Point3d(0, 0, 0);
  Random random = new Random();
  List<Point3d> positions = new List <Point3d>();
# ---------- end c_script_19 ----------
# Notes:
# 
# - Putting "void" in front of a function specifies that the function won't return anything.
# 
# - If a function is run on a value type it WILL NOT change the original value we put in, however if it is run on a reference type the original value WILL be modified.
# 
# - The "ref" keyword means that it will influence your original value.
# 
# - If you want to return more than 1 values you just create "fake" variables with the "ref" keyword.
# 
# - A better solution is using the "out" keyword for the outputs.
# 
# - A function can evoke itself.
# 
# - Put an "i" in front of the name of the input, and an "o" in front of the name of an output. This makes it easier to know the origin of outputs in a very long code.
# 
# -Persistent data means that the vale will add on the next time you run it, as you only declare the varaible once.
panel_10 = Panel(c_script_15)
panel_11 = Panel(c_script_14.out)
panel_12 = Panel(c_script_17.B)
# Notes:
# 
# 
# - Indentation is not necessary in C#, it is simply there for us to easily read the code we wrote.
# 
# - Always try to shorten the code!
# 
# - Use the brackets even if it isn't necessary.
# 
# - Try not to copy and paste code as this can create a lot of mistakes.
# 
# - If you create two copies of a list and modify one of them the other will be automatically modified as well.
# 
# - Two data types:
# 
# Value type, this means that if you copy the same variable they will each contain their independant copy of the data. So, the data is copied by the "equal" operator.
# 
# Reference type, this means that if you copy the same variable each variable, it will copy the reference to the actual data. So, if you change one of the copies the other one will be automatically modified.
# 
# - There ALWAYS has to be a pair of brackets after a function!
# 
# -A function should also contain a verb, as this is an action.
# 
# - Variables are nouns.
# 
# - In C#, you can define two functions under the same name but with different input parameters and it will still work!!! With this, you do not need to create different names for the same function with different concepts... However you cannot define two diffeent favours of a function with the same inp ut parameters (double, string,etc.), because this will confuse the computer!
panel_13 = Panel(c_script_17.A)
geo_2 = Geometry(c_script_16.curve)
panel_14 = Panel(c_script_19.A)
pline = PolyLine(Vertices=c_script_19.A, Closed=False)
cir = Circle(Plane=c_script_18.oGeometry, Radius="1")
# Day 2 - C# Scripting and Plugin Development for Grasshopper
panel_15 = Panel("Part 1")
panel_16 = Panel("Notes:")
