# Grasshopper definition C#_Introduction.gh (Grasshopper 1.0.7)
# plug-ins: Bifocals

c_script = CSharpScript(x=Slider(10, range=0..10), y=Slider(10, range=0..10))  # -> out, A; inputs x: Int32, y: Int32
# ---------- c_script: C# ----------
    //A = x + y;
    
    int z = x + y;
    
    Point3d xyz = new Point3d (x, y, z);
   // A = xyz;
    
    List <Point3d> points = new List <Point3d>( );
    
    for (int i = 0; i <=  z; i++)
    {
      points.Add (new Point3d (x, y, i));
     
    }
    
    List <Line> lines = new List<Line>( );

    foreach (Point3d item in points)
    {
      Point3d endpoint = new Point3d( item.X + item.Z + 1, item.Y, item.Z );
      Line thisline = new Line (item, endpoint);
      lines.Add(thisline);
    }
    
    A = lines;
# ---------- end c_script ----------
panel = Panel(c_script.A)
