# Grasshopper definition C#_Practice.gh (Grasshopper 1.0.7)

panel = Panel("""Office
Office
UU
Toilet
UU
UU
OFFICE
TT
UU""")
panel_2 = Panel("""Office
Office
UU
Toilet
UU""")

c_script = CSharpScript(num=Slider(7, range=1..7))  # -> out, A; inputs num: Int32
# ---------- c_script: C# ----------
    if(num < 5)
    {
      A = ("Your number is smaller than 5!");
    }

    else if (num == 5)
    {
      A = ("Your number is equal to 5!");
    }

    else
    {
      A = ("Your number is bigger than 5!");
    }
# ---------- end c_script ----------
panel_3 = Panel(c_script.A)

# ---- group: S
c_script_2 = CSharpScript(value=Slider(3, range=1..9))  # -> out, A; inputs value: Int32
# ---------- c_script_2: C# ----------
    switch(value)
    {
      case 1: A = ("Your value is 1");
        break;
      case 2: A = ("Your value is 2");
        break;
      default: A = ("You value is very random!");
        break;
    }
# ---------- end c_script_2 ----------
panel_4 = Panel(c_script_2.A)

# ----
c_script_3 = CSharpScript()  # -> out, A
# ---------- c_script_3: C# ----------
    //For loop
    for(int i = 0; i < 5; i++)
    {
      Print(i.ToString());
    }

    int num = 0;

    //While Loop
    while(num < 5)
    {
      Print(num.ToString());
      num++;
    }

    //List operations
    List < int> numList = new List <int> (){1,2,3,4};
    numList.Add(5);
    numList.RemoveAt(1);
    A = numList;
# ---------- end c_script_3 ----------
c_script_4 = CSharpScript(i=Slider(1, range=1..5))  # -> out, A; inputs i: Int32
# ---------- c_script_4: C# ----------
   
    while(i < 5)
    {
      A = (i);
      i++;
    }
# ---------- end c_script_4 ----------
c_script_5 = CSharpScript(List=panel, y=Slider(4, range=0..10))  # -> out, A; inputs List: list of String, y: Double
# ---------- c_script_5: C# ----------
  /*
    int i = 0;
    while(i < y)
    {
      int index = List.FindIndex(x => x.StartsWith("UU"));
      List.RemoveAt(index);
      i++;
    }

    A = List;
 */

    int length = List.Capacity;
    Print(length.ToString());

    bool check = List.Contains("UU");
    //A = (List.FindAll("UU"));


    int i = 0;
    while(i < length)
    {
      if(check == true)
      {
        //int index = List.IndexOf(i);
        List.RemoveAt(i);
        i++;
      }
      else
      {
        continue;
        i++;}
    }
    A = List;
/*
    for(int i = 0; i <= length; i++)
    {
      Print(i.ToString());
      if(check == true )
      {
        List.RemoveAt(i);
      }
      else
        continue;
    }
*/
# ---------- end c_script_5 ----------
panel_5 = Panel(c_script_3.A)
panel_6 = Panel(c_script_4.A)
panel_7 = Panel(c_script_5.out)
