# Grasshopper definition Chapter1.gh (Grasshopper 1.0.7)

# ---- group: Creates a sphere to each Point in a Curve
curve = Curve([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])
divide_curve = DivideCurve(Curve=curve, Count=Slider(2, range=0..10), Kinks=False)  # -> Points, Tangents, Parameters
param_viewer = ParamViewer(divide_curve.Points)
c_script = CSharpScript(pt=divide_curve.Points)  # -> out, Sphere; inputs pt: Point3d
# ---------- c_script: C# ----------
    Sphere ptSphere = new Sphere (pt, 0.5);

    Print("Run #" + Iteration);
    Sphere = ptSphere;
# ---------- end c_script ----------
panel = Panel(c_script.out)

# ---- group: Checks if numbers are even
random = Random(Range="1 to 100", Number=Slider(6, range=0..10), Seed=2)
integer = Integer(random)
c_script_2 = CSharpScript(num=integer)  # -> out, isEven; inputs num: Int32
# ---------- c_script_2: C# ----------
   /*First method, pretty unintelligable
  if (num % 2 == 0){
      isEven = "True";
    }
    else{
      isEven = "False";
    }
*/
    /* Second method, in one line
    string y;

    y = (num % 2 == 0) ? "True" : "False";
    isEven = y;
    */ 
    
    int mod = num % 2;
    isEven = (mod == 0 ? true : false);
# ---------- end c_script_2 ----------
panel_2 = Panel(integer)
panel_3 = Panel(c_script_2.isEven)

# ---- group: Adds 10 to each number, and outputs how mnay times the code ran
series = Series(Start="1.5", Step="1.5", Count="6")
c_script_3 = CSharpScript(x=series)  # -> out, A; inputs x: Double
# ---------- c_script_3: C# ----------
    A = x + 10;
    Print("Run #" + Iteration);
# ---------- end c_script_3 ----------
panel_4 = Panel(series)
panel_5 = Panel(c_script_3.A)
panel_6 = Panel(c_script_3.out)

# ---- group: Creates sphere for each item in list, which was created from the branches
curve_2 = Curve([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])
divide_curve_2 = DivideCurve(Curve=curve_2, Count=Slider(2, range=0..10), Kinks=False)  # -> Points, Tangents, Parameters
c_script_4 = CSharpScript(ptList=divide_curve_2.Points)  # -> out, Sphere; inputs ptList: list of Point3d
# ---------- c_script_4: C# ----------
    List <Sphere> sphereList = new List <Sphere> ();

    foreach (Point3d pt in ptList){
      Sphere sphere = new Sphere (pt, 0.5);
      sphereList.Add(sphere);}

    Print("Run #" + Iteration);
    Sphere = sphereList;
# ---------- end c_script_4 ----------
param_viewer_2 = ParamViewer(divide_curve_2.Points)
panel_7 = Panel(c_script_4.out)

# ---- group: Creates sphere for the curves from the Tree
curve_3 = Curve([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])
divide_curve_3 = DivideCurve(Curve=curve_3, Count=Slider(2, range=0..10), Kinks=False)  # -> Points, Tangents, Parameters
param_viewer_3 = ParamViewer(divide_curve_3.Points)
c_script_5 = CSharpScript(ptTree=divide_curve_3.Points)  # -> out, Spheres; inputs ptTree: tree of Point3d
# ---------- c_script_5: C# ----------
    DataTree <Sphere> sphereTree = new DataTree<Sphere> ();
    int pathIndex = 0;

    foreach (List <Point3d> branch in ptTree.Branches){
      List <Sphere> sphereList = new List <Sphere> ();
      GH_Path path = new GH_Path (pathIndex);
      pathIndex = pathIndex + 1;
      foreach (Point3d pt in branch)
      {
        Sphere sphere = new Sphere (pt, 0.5);
        sphereList.Add(sphere);
      }
      sphereTree.AddRange(sphereList, path);
    }
    Print("Run #" + Iteration);
    Spheres = sphereTree;
# ---------- end c_script_5 ----------
panel_8 = Panel(c_script_5.out)

# ---- group: Add 10 to each List item, and outputs how many times it ran
series_2 = Series(Start="1.5", Step="1.5", Count="6")
c_script_6 = CSharpScript(xList=series_2)  # -> out, A; inputs xList: list of Double
# ---------- c_script_6: C# ----------
    List < double > newList = new List <double>();
    foreach (var x in xList)
      newList.Add(x + 10);
    
    Print("Run #" + Iteration);
    A = newList;
# ---------- end c_script_6 ----------
panel_9 = Panel(series_2)
panel_10 = Panel(c_script_6.A)
panel_11 = Panel(c_script_6.out)

# ---- group: Sums all numbers in a List
series_3 = Series(Start="1.5", Step="1.5", Count="6")
c_script_7 = CSharpScript(xList=series_3)  # -> out, Sum; inputs xList: list of Double
# ---------- c_script_7: C# ----------
    double xSum = 0;
    foreach (var x in xList)
      xSum = xSum + x;

    Sum = xSum;

    Print("Run #" + Iteration);
# ---------- end c_script_7 ----------
panel_12 = Panel(series_3)
panel_13 = Panel(c_script_7.Sum)
panel_14 = Panel(c_script_7.out)

# ---- group: Sums all of the items in a tree
number = Number(Tree({0}: [10, 10, 10], {1}: [10, 10, 10]))
c_script_8 = CSharpScript(x=number)  # -> out, Sum; inputs x: tree of Int32
# ---------- c_script_8: C# ----------
    DataTree <int> sumTree = new DataTree<int> ();
    int pathIndex = 0;
    int xSum = 0;

    foreach (List <int> branch in x.Branches){
      GH_Path path = new GH_Path (pathIndex);
      pathIndex = pathIndex + 1;
      foreach(int i in branch){
        xSum = xSum + i;
      }
    }
    Sum = xSum;

    Print("Run #" + Iteration);

    /* Second method :
 double xSum = 0;
 foreach (List<double> branch in x.Branches){
 foreach (double num in branch){
 xSum = xSum + num:
 }
 }
 Sum = xSum
 */
# ---------- end c_script_8 ----------
panel_15 = Panel(c_script_8.out)
panel_16 = Panel(c_script_8.Sum)
param_viewer_4 = ParamViewer(c_script_8.Sum)

# ---- group: Creating 2 Branches with 3 items in a Tree with the same values
c_script_9 = CSharpScript()  # -> out, Numbers
# ---------- c_script_9: C# ----------
    DataTree <int> trNumbers = new DataTree<int> ();
    int pathIndex = 0;

    for (int i = 0; i <= 1; i++){
      List <int> liNumbers = new List <int> ();
      GH_Path path = new GH_Path (pathIndex);
      pathIndex = pathIndex + 1;

      for ( int j = 0; j <= 2; j++){
        liNumbers.Add(10);
      }
      trNumbers.AddRange(liNumbers, path);
    }
    Numbers = trNumbers;

    Print("Run #" + Iteration);
# ---------- end c_script_9 ----------
panel_17 = Panel(c_script_9.out)
param_viewer_5 = ParamViewer(c_script_9.Numbers)
panel_18 = Panel(c_script_9.Numbers)

# ----
curve_4 = Curve([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])
divide_curve_4 = DivideCurve(Curve=curve_4, Count=Slider(2, range=0..10), Kinks=False)  # -> Points, Tangents, Parameters
c_script_10 = CSharpScript(ptTree=divide_curve_4.Points)  # -> out, Sphere; inputs ptTree: tree of Point3d
# ---------- c_script_10: C# ----------
    DataTree <Sphere> spTree = new DataTree<Sphere> ();
    int pathIndex = 0;

    foreach(List<Point3d> ptBranch in ptTree.Branches){
      List <Sphere> Spheres = new List <Sphere>();
      GH_Path path = new GH_Path(pathIndex);
      pathIndex = pathIndex + 1;

      foreach (Point3d pt in ptBranch){
        Sphere sphere = new Sphere (pt, 0.5);
        Spheres.Add(sphere);
      }
      spTree.AddRange(Spheres, path);
    }

    Sphere = spTree;

    Print("Run #" + Iteration);
# ---------- end c_script_10 ----------
param_viewer_6 = ParamViewer(divide_curve_4.Points)
panel_19 = Panel(c_script_10.out)
