# Grasshopper definition Chapter2.gh (Grasshopper 1.0.7)

# ---- group: Creating a rotating line using the recursive function
number_slider = Slider(8, range=1..10)  # disabled
number_slider_2 = Slider(1, range=1..10)  # disabled
radians = Radians(Degrees=number_slider)  # disabled
line = Line(StartPoint=Point(0, -4, 0), EndPoint=Point(12, -4, 0))  # disabled
c_script = CSharpScript(inputLine=line, angle=radians, minLength=number_slider_2)  # -> out, Lines; inputs inputLine: Line, angle: Double, minLength: Double; disabled
# ---------- c_script: C# ----------
    List <Line> allLines = new List <Line>();
    allLines.Add(inputLine);

    DivideAndRotate(inputLine, ref allLines, angle, minLength);

    Lines = allLines;
# ---------- c_script: C# additional code ----------
  public void DivideAndRotate(Line currLine, ref List<Line> allLines, double angle, double minLength)
  {
    //check the stopping condition
    if (currLine.Length < minLength)
      return;

    //take a portion of the line
    Line newLine = new Line();
    newLine = currLine;

    Point3d endPt = new Point3d();
    endPt = newLine.PointAt(0.95);

    newLine.To = endPt;

    //rotate
    Transform xform = default(Transform);
    xform = Transform.Rotation(angle, Vector3d.ZAxis, newLine.From);
    newLine.Transform(xform);

    allLines.Add(newLine);

    //call self
    DivideAndRotate(newLine, ref allLines, angle, minLength);
  }
# ---------- end c_script ----------
length = Length(Curve=c_script.Lines)  # disabled
panel = Panel(c_script.out)  # disabled
bounds = Bounds(Numbers=length)  # disabled
remap_numbers = RemapNumbers(Value=length, Source=bounds, Target=Domain(0, 1))  # -> Mapped, Clipped; disabled
gradient = Gradient(
    LowerLimit=0,
    UpperLimit=1,
    Parameter=remap_numbers.Mapped,
    stops=[0: RGB(243, 57, 0), 0.1: RGB(236, 27, 60), 0.2: RGB(210, 0, 118), 0.3: RGB(103, 0, 120), 0.4: RGB(39, 72, 161), 0.5: RGB(1, 192, 229), 0.6: RGB(18, 178, 90), 0.7: RGB(79, 186, 8), 0.8: RGB(220, 237, 32), 0.9: RGB(247, 159, 20), 1: RGB(243, 57, 0)])  # disabled
custom_preview = CustomPreview(Geometry=c_script.Lines, Material=gradient)  # disabled

# ---- group: Compares (value and color) 2 points together
# Reference (ref) changes the value of your object. Whilst without the ref it just writes these values for one run.
number_slider_3 = Slider(1, range=0..1)  # disabled
number_slider_4 = Slider(5, range=0..10)  # disabled
colour_swatch = ColourSwatch(SwatchColor=RGB(132, 169, 210))  # disabled
colour_swatch_2 = ColourSwatch(SwatchColor=RGB(255, 255, 255))  # disabled
c_script_2 = CSharpScript(
    x=number_slider_3,
    y=number_slider_3,
    z=number_slider_3,
    c=colour_swatch,
    x1=number_slider_4,
    y1=number_slider_4,
    z1=number_slider_4,
    c1=colour_swatch_2)  # -> out, averagePt, MatchLoc, MatchColor, Saturation, isEqualLocation, isEqualColour; inputs x: Double, y: Double, z: Double, c: Color, x1: Double, y1: Double, z1: Double, c1: Color; disabled
# ---------- c_script_2: C# usings ----------
using System.Drawing;
# ---------- c_script_2: C# ----------
    ColorPoint cp0 = new ColorPoint();
    Print("Default ColoPoint 0: X = " + cp0.X + ", Y = " + cp0.Y + ", Z = " + cp0.Z + ", Color = " + cp0.C.Name);

    cp0.X = x;
    cp0.Y = y;
    cp0.Z = z;
    cp0.C = c;
    Print("ColorPoint 0: X = " + cp0.X + ", Y = " + cp0.Y + ", Z = " + cp0.Z + ", Color = " + cp0.C.Name);

    ColorPoint cp1 = new ColorPoint();

    cp1.X = x1;
    cp1.Y = y1;
    cp1.Z = z1;
    cp1.C = c1;
    Print("ColorPoint 1: X = " + cp1.X + ", Y = " + cp1.Y + ", Z = " + cp1.Z + ", Color = " + cp1.C.Name);

    MatchLoc = false;
    if(cp0.X == cp1.X && cp0.Y == cp1.Y && cp0.Z == cp1.Z)
      MatchLoc = true;

    MatchColor = cp0.C.Equals(cp1.C);
    Saturation = cp0.Saturation.Equals(cp1.Saturation);
    isEqualLocation = ColorPoint.isEqualLocation(cp0, cp1);
    isEqualColour = ColorPoint.isEqualColour(cp0, cp1);

    changeByValue(cp0);
    changeByValue(cp1);
    changeByReference(ref cp0);

    ColorPoint cp3 = new  ColorPoint(1, 1, 1, System.Drawing.Color.Red);
    ColorPoint cp4 = new ColorPoint (1, 1, 1, System.Drawing.Color.Blue);

    bool matchLoc = ColorPoint.isEqualLocation(cp3, cp4);
    bool matchColor = ColorPoint.isEqualColour(cp3, cp4);

    ColorPoint avPt = ColorPoint.Average(cp3, cp4);
    averagePt = new Point3d (avPt.X, avPt.Y, avPt.Z);
# ---------- c_script_2: C# additional code ----------
  struct ColorPoint
  {
    private double _x;
    private double _y;
    private double _z;
    private System.Drawing.Color _c;

    public ColorPoint(double x, double y, double z, System.Drawing.Color c)
    {
      _x = x;
      _y = y;
      _z = z;
      _c = c;
    }


    public double X {get{ return _x;}set {_x = value;}}
    public double Y {get{ return _y;}set {_y = value;}}
    public double Z {get{ return _z;}set {_z = value;}}
    public System.Drawing.Color C {get{ return _c;} set {_c = value;}}

    public double Saturation {get{return _c.GetSaturation();}}


    public static ColorPoint Average (ColorPoint a, ColorPoint b){
      ColorPoint avPt = new ColorPoint ();
      avPt.X = (a.X + b.X) / 2;
      avPt.Y = (a.Y + b.Y) / 2;
      avPt.Z = (a.Z + b.Z) / 2;

      avPt.C = System.Drawing.Color.FromArgb((a.C.A + b.C.A) / 2, (a.C.R + b.C.R) / 2, (a.C.G + a.C.G) / 2, (a.C.B + a.C.B) / 2);
      return avPt;
    }

    public static bool isEqualLocation (ColorPoint a, ColorPoint b){
      if (a.X == b.X && a.Y == b.Y && a.Z == b.Z)
        return true;
      else
        return false;
    }

    public static bool isEqualColour (ColorPoint a, ColorPoint b){
      if (a.C == b.C)
        return true;
      else
        return false;
    }
  }

  void changeByValue (ColorPoint a){
    a.X += 10;
    a.Y += 10;
    a.Z += 10;
    Print("This point has the x-value of, " + a.X + ", the y-value, " + a.Y + ", and then z-value, " + a.Z);
  }

  void changeByReference (ref ColorPoint a){
    a.X += 10;
    a.Y += 10;
    a.Z += 10;
    Print("This point has the x-value of, " + a.X + ", the y-value, " + a.Y + ", and then z-value: " + a.Z);
  }
# ---------- end c_script_2 ----------
panel_2 = Panel(c_script_2.isEqualColour)  # disabled
panel_3 = Panel(c_script_2.isEqualLocation)  # disabled
panel_4 = Panel(c_script_2.out)  # disabled
panel_5 = Panel(c_script_2.Saturation)  # disabled
panel_6 = Panel(c_script_2.MatchLoc)  # disabled
panel_7 = Panel(c_script_2.MatchColor)  # disabled

# ---- group: Creating a rotating line using the while loop
radians_2 = Radians(Degrees=Slider(8, range=1..10))
line_2 = Line(StartPoint=Point(0, -4, 0), EndPoint=Point(12, -4, 0))
c_script_3 = CSharpScript(inputLine=line_2, angle=radians_2, minLength=Slider(1, range=1..10))  # -> out, Lines, Length, Domain; inputs inputLine: Line, angle: Double, minLength: Double
# ---------- c_script_3: C# usings ----------
using System.Linq;
# ---------- c_script_3: C# ----------
    //declare all lines
    var allLines = new List<Line> ();

    //find current length
    double length = inputLine.Length;
    Line newLine = default(Line);
    newLine = inputLine;

    //loop until length is less than the min length
    while (length > minLength)
    {

      //generate the new Line
      newLine = DivideAndRotate(newLine, angle);

      //add to list
      allLines.Add(newLine);

      //stop condition
      length = newLine.Length;

    }
    //assign the return value
    Lines = allLines;

    List <double> lengths = new List <double> ();

    foreach(Line tempValue in allLines)
    {
      lengths.Add(tempValue.Length);
    }

    Length = lengths;

    double minValueBounds = lengths.Min();
    double maxValueBounds = lengths.Max();

    Interval bounds = new Interval (minValueBounds, maxValueBounds);
    Domain = bounds;
# ---------- c_script_3: C# additional code ----------
  public Line DivideAndRotate (Line currLine, double angle)
  {
    //take a portion of the line
    Line newLine = new Line ();
    newLine = currLine;
    Point3d endPt = new Point3d();
    endPt = new Point3d ();
    endPt = newLine.PointAt(0.95);
    newLine.To = endPt;

    //rotate
    newLine.Transform(Transform.Rotation(angle, Vector3d.ZAxis, newLine.From));

    //function return
    return newLine;
  }
# ---------- end c_script_3 ----------
remap_numbers_2 = RemapNumbers(Value=c_script_3.Length, Source=c_script_3.Domain, Target=Domain(0, 1))  # -> Mapped, Clipped
gradient_2 = Gradient(
    LowerLimit=0,
    UpperLimit=1,
    Parameter=remap_numbers_2.Mapped,
    stops=[0: RGB(243, 57, 0), 0.1: RGB(236, 27, 60), 0.2: RGB(210, 0, 118), 0.3: RGB(103, 0, 120), 0.4: RGB(39, 72, 161), 0.5: RGB(1, 192, 229), 0.6: RGB(18, 178, 90), 0.7: RGB(79, 186, 8), 0.8: RGB(220, 237, 32), 0.9: RGB(247, 159, 20), 1: RGB(243, 57, 0)])
custom_preview_2 = CustomPreview(Geometry=c_script_3.Lines, Material=gradient_2)

# ---- group: Using function "System"
number_slider_5 = Slider(8, range=0..10)  # disabled
c_script_4 = CSharpScript(x=number_slider_5)  # -> out, A; inputs x: Double; disabled
# ---------- c_script_4: C# ----------
    /*double num = x;
    double sqrNum = System.Math.Sqrt(num);
    A = sqrNum;*/

    A = System.Math.Sqrt(x);
# ---------- end c_script_4 ----------
panel_8 = Panel(c_script_4.A)  # disabled

# ---- group: Divides two numbers by each other
number_slider_6 = Slider(16, range=0..100)  # disabled
number_slider_7 = Slider(100, range=0..100)  # disabled
c_script_5 = CSharpScript(x=number_slider_7, y=number_slider_6)  # -> out, A; inputs x: Double, y: Double; disabled
# ---------- c_script_5: C# ----------
    double rc = 0.0;
    bool valid = Divide(x, y, ref rc);

    if (valid == true)
    {
      A = "Look at your answer " + rc;
    }
    else
    {
      A = "You idiot ";
    }
# ---------- c_script_5: C# additional code ----------
  public bool Divide (double x, double y, ref double rc)
  {
    if (Math.Abs(y) < 1e-100)
      return false;
    else
      rc = x / y;
    return true;
  }
# ---------- end c_script_5 ----------
panel_9 = Panel(c_script_5.A)  # disabled

# ---- group: Points from file (with coordinates)
boolean_toggle = BooleanToggle(True)  # disabled
file_path = FilePath()  # disabled
points = FilePath("C:\Users\micha\OneDrive\Documents\GitHub\Grasshopper_Rhino\Projects\C#\C#_Scripting_Book\points.txt")  # disabled
c_script_6 = CSharpScript(path=points, read=boolean_toggle)  # -> out, points; inputs path: String, read: Boolean; disabled
# ---------- c_script_6: C# usings ----------
using System.IO;
# ---------- c_script_6: C# ----------
    if ((!File.Exists(path)))
    {
      //show the message box
      System.Windows.Forms.MessageBox.Show("Unfortunately, the file does not exist or could not be read");
      //give the feedback in the component out parameter
      Print("Exit without reading");
    }

    //read the file
    string[] lines = File.ReadAllLines(path);

    //check that the file is not empty
    if (lines == null || String.IsNullOrEmpty(lines[0]))
    {
      Print("This file has no content. Please put in some text!");
      return;
    }

    //declare list of points (Point3d is a data type in Rhinocommon SDK)
    List<Point3d> pts = new List <Point3d>();

    //declare a list of points
    var charsToRemove = new string [] {" ", ")", "(", "[", "]", "{", "}"};

    //loop through lines
    foreach (string line in lines)
    {
      //trim invalid lines
      var tLine = line;

      foreach (var c in charsToRemove)
      {
        tLine = tLine.Replace(c, string.Empty);
      }

      if(String.IsNullOrEmpty(line)) continue;

      //tokenize line into array og strings separated by ","
      string [] parts = line.Split(",".ToCharArray());

      //make sure that each line has exactly 3 values
      if (parts.Length != 3)
        continue;

      //convert each coordinate from string to double
      double x = Convert.ToDouble(parts[0]);
      double y = Convert.ToDouble(parts[1]);
      double z = Convert.ToDouble(parts[2]);

      pts.Add(new Point3d(x, y, z));
    }

    points = pts;
# ---------- end c_script_6 ----------
nurbs_curve = NurbsCurve(Vertices=c_script_6.points, Degree=3, Periodic=False)  # -> Curve, Length, Domain; disabled
panel_10 = Panel(c_script_6.points)  # disabled

# ---- group: Finds all the factor from num, and sees if its a prime number
number_slider_8 = Slider(50, range=0..100)  # disabled
c_script_7 = CSharpScript(num=number_slider_8)  # -> out, Factors, IsPrime; inputs num: Int32; disabled
# ---------- c_script_7: C# ----------
    List <int> factors = new List <int>();
    IsPrime = isPrimeNum(num, ref factors);
    Factors = factors;
# ---------- c_script_7: C# additional code ----------
  bool isPrimeNum (int num, ref List <int> factors)
  {
    factors.Add(1);
    bool primeFlag = true;

    for(int i = 2; i < (num / 2); i++)
    {
      if(num % i == 0)
      {
        primeFlag = false;
        factors.Add(i);
      }
    }
    factors.Add(num);

    return primeFlag;
  }
# ---------- end c_script_7 ----------
panel_11 = Panel(c_script_7.Factors)  # disabled
panel_12 = Panel(c_script_7.IsPrime)  # disabled

# ---- group: Using the break statement to exit a loop
c_script_8 = CSharpScript()  # -> out, A; disabled
# ---------- c_script_8: C# ----------
    string [] Fritas = {"mango","apple","orange","strawberry"};

    foreach (string fruit in Fritas) {
      if (fruit == "orange"){
        Print("Found an orange!!!!!");
        break;
      }
    }

    int count = 0;

    foreach (string f in Fritas){
      foreach (char letter in f){
        if (letter == 'r'){
          count = count + 1;
        }
      }
    }

    Print("The letter 'r' is in this list " + count + " times");
# ---------- end c_script_8 ----------
panel_13 = Panel(c_script_8.out)  # disabled

# ---- group: Checks if x is a prime number, outputs a boolean
number_slider_9 = Slider(50, range=0..100)  # disabled
c_script_9 = CSharpScript(x=number_slider_9)  # -> out, A; inputs x: Int32; disabled
# ---------- c_script_9: C# ----------
    A = isPrimeNum(x);
# ---------- c_script_9: C# additional code ----------
  bool isPrimeNum (int x)
  {
    bool primeFlag = true;

    for(int i = 2; i < (x / 2); i++)
    {
      if(x % 1 == 0)
      {
        primeFlag = false;
        break;
      }
    }
    return primeFlag;
  }
# ---------- end c_script_9 ----------
panel_14 = Panel(c_script_9.A)  # disabled

# ---- group: While loop
c_script_10 = CSharpScript()  # -> out, A; disabled
# ---------- c_script_10: C# ----------
    int sum = 0;
    int counter = 0;
    int number = 2;

    //Loop
    while (sum < 1000)
    {
      sum = sum + number;
      // Make sure increment the counter and the number
      counter = counter + 1;
      number = number + 2;
    }

    //Remove lat number
    sum -= number;
    counter--;
    Print("Count = " + counter);
    Print("Sum = " + sum);
# ---------- end c_script_10 ----------
panel_15 = Panel(c_script_10.out)  # disabled

# ---- group: Create Points out of a file Review
points_2 = FilePath("C:\Users\micha\OneDrive\Documents\GitHub\Grasshopper_Rhino\Projects\C#\C#_Scripting_Book\points.txt")  # disabled
c_script_11 = CSharpScript(path=points_2)  # -> out, A; inputs path: String; disabled
# ---------- c_script_11: C# ----------
    string[] lines = File.ReadAllLines(path);

    List <Point3d> pts = new List <Point3d> ();

    foreach (string line in lines)
    {
      string [] part = line.Split(',');

      if (part.Length != 3)
        continue;

      double x = Convert.ToDouble(part[0]);
      double y = Convert.ToDouble(part[1]);
      double z = Convert.ToDouble(part[2]);

      pts.Add(new Point3d(x, y, z));
    }

    A = pts;
# ---------- end c_script_11 ----------
nurbs_curve_2 = NurbsCurve(Vertices=c_script_11.A, Degree=3, Periodic=False)  # -> Curve, Length, Domain; disabled
panel_16 = Panel(c_script_11.A)  # disabled

# ---- group: Count the letter "a" in an array
c_script_12 = CSharpScript()  # -> out, A; disabled
# ---------- c_script_12: C# ----------
    string [] Fruits = {"bananas","apples","strawberries","oranges"};
    int count = 0;

    foreach (string f in Fruits) {

      foreach (char letter in f){
        if (letter == 'a'){
          count = count + 1;}
      }
    }

    Print("The letter 'a' repeats " + count + " times");
# ---------- end c_script_12 ----------
panel_17 = Panel(c_script_12.out)  # disabled

# ---- group: Creating a list of workdays
c_script_13 = CSharpScript()  # -> out, A; disabled
# ---------- c_script_13: C# ----------
    List <string> myWorkDays = new List <string> ();

    myWorkDays.Add("Tuesday");
    myWorkDays.Add("Wednesday");
    myWorkDays.Add("Thursday");
    myWorkDays.Add("Friday");

    A = myWorkDays;
# ---------- end c_script_13 ----------
panel_18 = Panel(c_script_13.A)  # disabled

# ---- group: Collatz Conjecture
c_script_14 = CSharpScript()  # -> out, A; disabled
# ---------- c_script_14: C# ----------
    int x = 46;
    
    Print(x.ToString());
    
    while (x > 1) {
      if (x % 2 == 0){
        x = x / 2;
      }
      else {
        x = x * 3 + 1;
      }
      Print(x.ToString());
    }
# ---------- end c_script_14 ----------
panel_19 = Panel(c_script_14.out)  # disabled

# ---- group: Using arrays to display the days of the week
c_script_15 = CSharpScript()  # -> out, A; disabled
# ---------- c_script_15: C# ----------
    // Declare and initialize the days of the week array
    string [] weekdays1 = {"Sunday", "Monday","Tuesday","Wednesday","Thursday","Friday","Saturday"};
    A = weekdays1;

    // Declare the days of the week in one statement then assign thr values later

    string [] weekdays = new string [7];
    weekdays[0] = "Sunday";
    weekdays[1] = "Monday";
    weekdays[2] = "Tuesday";
    weekdays[3] = "Wednesday";
    weekdays[4] = "Thursday";
    weekdays[5] = "Friday";
    weekdays[6] = "Saturday";

    A = weekdays;
# ---------- end c_script_15 ----------
panel_20 = Panel(c_script_15.A)  # disabled

# ---- group: Using enumerator to output a message for each traffic colour
c_script_16 = CSharpScript()  # -> out, A; disabled
# ---------- c_script_16: C# ----------
    Traffic signal = Traffic.green;

    if(signal == Traffic.red)
      Print("STOP!");
    else if(signal == Traffic.yellow)
      Print("Wait.");
    else if (signal == Traffic.green)
      Print("GO!");
    else
      Print("Think twice, this is NOT a traffic colour, you nutcase...");
# ---------- c_script_16: C# additional code ----------
  enum Traffic {
    red = 1,
    yellow = 2,
    green = 3
  }
# ---------- end c_script_16 ----------
panel_21 = Panel(c_script_16.out)  # disabled

# ---- group: Classes
c_script_17 = CSharpScript()  # -> out, A; disabled
# ---------- c_script_17: C# additional code ----------
  class CPoint
  {
    private double _x;
    private double _y;
    private double _z;

    public CPoint(): this(0, 0, 0)
    {
    }

    public CPoint (double x, double y, double z)
    {
      _x = x;
      _y = y;
      _z = z;
    }

    public double X {get{return _x;} set {_x = value;}}
    public double Y {get{return _y;} set {_y = value;}}
    public double Z {get {return _z;}set {_z = value;}}

    public static bool isEqualLocation (CColorPoint a, CColorPoint b)
    {
      return (a.X == b.X && a.Y == b.Y && a.Z == b.Z);
    }
  }

  class CColorPoint: CPoint
  {
    //fields
    private System.Drawing.Color _c;

    //constructors
    public CColorPoint(): base () //default
    {
      _c = System.Drawing.Color.White;
    }

    public CColorPoint (double x, double y, double z, System.Drawing.Color c): base (x, y, z)
    {
      _c = c;
    }

    //properties
    public System.Drawing.Color C {get {return _c;} set {_c = value;}}

    //static methods
    public static bool isEqualColor (CColorPoint a, CColorPoint b)
    {
      return a.C.Equals(b.C);
    }

    //method
    public static CColorPoint Average (CColorPoint a, CColorPoint b)
    {
      CColorPoint avPt = new CColorPoint ();
      avPt.X = (a.X + b.X) / 2;
      avPt.Y = (a.Y + b.Y) / 2;
      avPt.Z = (a.Z + b.Z) / 2;

      avPt.C = System.Drawing.Color.FromArgb((a.C.A + b.C.A) / 2, (a.C.R + b.C.R) / 2, (a.C.G + b.C.G) / 2, (a.C.B + b.C.B) / 2);
      return avPt;
    }
  }
# ---------- end c_script_17 ----------

# ----
panel_22 = Panel(c_script_2.averagePt)  # disabled
point = Point(c_script_2.averagePt)  # disabled
