# Grasshopper definition Chapter4.gh (Grasshopper 1.0.7)

# ---- group: Fractal Tree
panel = Panel("FF")  # disabled
panel_2 = Panel("F-[[X]+X]+F[+FX]-X")  # disabled
number_slider = Slider(4, range=0..10)  # disabled
number_slider_2 = Slider(1, range=0..1)  # disabled
panel_3 = Panel("X")  # disabled
c_script = CSharpScript(startString=panel_3, ruleX=panel_2, ruleY=panel, num=number_slider, length=number_slider_2)  # -> out, FractalLines; inputs startString: String, ruleX: String, ruleY: String, num: Int32, length: Double; disabled
# ---------- c_script: C# ----------
    //Declare the string
    string fractalString = startString;
    //Generate the string
    GrowString(ref num, ref fractalString, ruleX, ruleY);

    //Generate th points
    List<Line> fractalLines = new List <Line>();

    ParsefractalString(fractalString, length, ref fractalLines);
    //Assign the output
    

    FractalLines = fractalLines;
# ---------- c_script: C# additional code ----------
  void GrowString(ref int num, ref string finalString, string ruleX, string ruleF)
  {
    num = num - 1;
    char rule;
    //Create a new string
    string newString = "";
    for(int i = 0; i < finalString.Length; i++)
    {
      rule = finalString[i];
      if(rule == 'X')
        newString = newString + ruleX;
      if(rule == 'F')
        newString = newString + ruleF;
      if(rule == '[' || rule == ']' || rule == '+' || rule == '-')
        newString = newString + rule;
    }
    finalString = newString;


    //Stopper condition
    if(num == 0)
      return;
    //Grow again

    GrowString(ref num, ref finalString, ruleX, ruleF);

  }

  void ParsefractalString(string fractalString, double length, ref List<Line> fractalLines)
  {


    /*Parse instruction string to generate points
    Let the base point be  world origin*/
    Point3d pt = Point3d.Origin;

    //Declare the points array
    //Vector rotates with (+,-), instructions by 30 degrees
    List<Point3d> arrPoints = new List<Point3d>();

    //Draw forward direction
    //Vector direction ewill be rotated depending on (+,-) instructions
    Vector3d vec = new Vector3d(0.0, 1.0, 0.0);

    //Stacks of points and vectors
    List<Point3d> ptStack = new List<Point3d>();
    List<Vector3d> vStack = new List<Vector3d>();

    //Declare the loop variables
    char rule;
    for (int i = 0; i < fractalString.Length; i++)
    {
      //Always start ;for 1 and length 1 to get one hcar at a time
      rule = fractalString[i];

      //Rotate Left
      if(rule == '+')
        vec.Rotate(Math.PI / 6, Vector3d.ZAxis);

      //Rotate Right
      if(rule == '-')
        vec.Rotate(-Math.PI / 6, Vector3d.ZAxis);

      //Draw forward by direction
      if (rule == 'F')
      {
        //Add the current points
        Point3d newPt1 = new Point3d(pt);
        arrPoints.Add(newPt1);

        //Calaculate the next point
        Point3d newPt2 = new Point3d(pt);
        newPt2 = newPt2 + (vec * length);

        //Add the next points
        arrPoints.Add(newPt2);

        //Save the new location
        pt = newPt2;
      }

      //Save the point location
      if(rule == '[')
      {
        //Save the current point and direction
        Point3d newPt = new Point3d(pt);
        ptStack.Add(newPt);

        Vector3d newV = new Vector3d(vec);
        vStack.Add(newV);
      }

      //Retrieve the points and direction
      if(rule == ']')
      {
        pt = ptStack[ptStack.Count - 1];
        vec = vStack[vStack.Count - 1];

        //Remove from the stack
        ptStack.RemoveAt(ptStack.Count - 1);
        vStack.RemoveAt(vStack.Count - 1);
      }

      //Generate lines
      List<Line> allLines = new List<Line>();
      for(int x = 1; x < arrPoints.Count; x = x + 2)
      {
        Line line = new Line(arrPoints[x - 1], arrPoints[x]);
        allLines.Add(line);
        //Print(line.ToString());

      }
      fractalLines = allLines;

    }
  }
# ---------- end c_script ----------
geometry = Geometry(c_script.FractalLines)  # disabled

# ---- group: De Casteljau algorithm to draw a Bezier Curve with 2, 4, 8, and 16 segments
number_slider_3 = Slider(16, range=2..16)  # disabled
point = Point(Point(-40, 13, 0))  # disabled
point_2 = Point(Point(-17, 0, 0))  # disabled
point_3 = Point(Point(-40, 0, 0))  # disabled
point_4 = Point(Point(-25, 11, 0))  # disabled
c_script_2 = CSharpScript(pt0=point_3, pt1=point, pt2=point_4, pt3=point_2, segments=number_slider_3)  # -> out, BezierCrv; inputs pt0: Point3d, pt1: Point3d, pt2: Point3d, pt3: Point3d, segments: Int32; disabled
# ---------- c_script_2: C# ----------
    if (segments < 2)
      segments = 2;

    List <Point3d> bezierPts = new List<Point3d>();
    bezierPts.Add(pt0);
    bezierPts.Add(pt1);
    bezierPts.Add(pt2);
    bezierPts.Add(pt3);

    List<Point3d> evalPts = new List<Point3d>();
    double step = 1 / (double) segments;
    for(int i = 0;i <= segments;i++)
    {
      double t = i * step;
      Point3d pt = Point3d.Unset;
      EvalPoint(bezierPts, t, ref pt);

      if(pt.IsValid)
        evalPts.Add(pt);
    }

    Polyline pline = new Polyline(evalPts);
    BezierCrv = pline;
# ---------- c_script_2: C# additional code ----------
  void EvalPoint(List<Point3d> points, double t, ref Point3d evalPt)
  {
    //Stopping condition - point at parameter "t" is found
    if(points.Count < 2)
      return;
    List <Point3d> tPoints = new List<Point3d>();
    for(int i = 1; i < points.Count; i++)
    {
      Line line = new Line(points[i - 1], points[i]);
      Point3d pt = line.PointAt(t);
      tPoints.Add(pt);
    }

    if(tPoints.Count == 1)
      evalPt = tPoints[0];
    EvalPoint(tPoints, t, ref evalPt);
  }
# ---------- end c_script_2 ----------
geometry_2 = Geometry(c_script_2.BezierCrv)  # disabled

# ---- group: Drawing a dragon Curve
number_slider_4 = Slider(8, range=0..100)  # disabled
panel_4 = Panel("X+YF+")  # disabled
panel_5 = Panel("-FX-Y")  # disabled
panel_6 = Panel("FX")  # disabled
number_slider_5 = Slider(1.2448, range=0..10)  # disabled
c_script_3 = CSharpScript(startString=panel_6, ruleX=panel_4, ruleY=panel_5, Num=number_slider_4)  # -> out, DragonString; inputs startString: String, ruleX: String, ruleY: String, Num: Int32; disabled
# ---------- c_script_3: C# ----------
                    /*
    //Declare the string
    string dragonString = startString;
    //Generate the string
    GrowString(ref Num, ref dragonString, ruleX, ruleY);
    //Generate the points
    List<Point3d> dragonPoints = new List<Point3d>();
    ParseDeagonString(dragonString, Length, ref dragonPoints);
    //Create the curve
    PolylineCurve dragonCrv = new PolylineCurve(dragonPoints);
    //Assign the output
    DragonCurve = dragonCrv; */

    string dragonString = startString;
    GrowString(ref Num, ref dragonString, ruleX, ruleY);
    DragonString = dragonString;
# ---------- c_script_3: C# additional code ----------
  void GrowString(ref int Num, ref string finalString, string ruleX, string ruleY)
  {
    //Decrement the count with each new execution of the grow function
    Num = Num - 1;
    char rule;
    //Create a new string
    string newString = "";
    for(int i = 0; i < finalString.Length; i++)
    {
      rule = finalString[i];
      if(rule == 'X')
        newString = newString + ruleX;
      if(rule == 'Y')
        newString = newString + ruleY;
      if(rule == 'F' | rule == '+' | rule == '-')
        newString = newString + rule;
    }
    finalString = newString;
    //Stopper condition
    if(Num == 0)
      return;
    //Grow again
    GrowString(ref Num, ref finalString, ruleX, ruleY);
  }
# ---------- end c_script_3 ----------
c_script_4 = CSharpScript(dragonString=c_script_3.DragonString, length=number_slider_5)  # -> out, DragonPoints; inputs dragonString: String, length: Double; disabled
# ---------- c_script_4: C# ----------
                                                     /*Parse instruction string to generate the points
    Let the base point be the world origin*/
    Point3d pt = Point3d.Origin;

    //Declare the points array
    var arrPoints = new List<Point3d>();
    arrPoints.Add(pt);

    /* Drawing the direction of a vector - starts along the x-axis
    Vector direction will be rotated depending on the (+, -) instructions*/
    var vec = new Vector3d(1.0, 0.0, 0.0);

    //Declare the loop variables
    char rule;
    for(int i = 0; i < dragonString.Length; i++)
    {
      //Always start for 1 to get the one char at a time
      rule = dragonString[i];

      //Move forward using the direction vector
      if(rule == 'F')
      {
        pt = pt + (vec * length);
        arrPoints.Add(pt);
      }
      //Rotate to the left
      if(rule == '+')
        vec.Rotate(Math.PI / 2, Vector3d.ZAxis);

      //Rotate to the right
      if(rule == '-')
        vec.Rotate(-Math.PI / 2, Vector3d.ZAxis);
    }

    DragonPoints = arrPoints;
# ---------- end c_script_4 ----------
polyline = PolyLine(Vertices=c_script_4.DragonPoints, Closed=False)  # disabled

# ---- group: Create curves and surfaces using the sine equation
number_slider_6 = Slider(45, range=1..100)  # disabled
c_script_5 = CSharpScript(num=number_slider_6)  # -> out, OutCurves, OutSurface, OutLoft; inputs num: Int32; disabled
# ---------- c_script_5: C# ----------
    //List of all points
    List<Point3d> allPoints = new List<Point3d>();
    //List of curves
    List<Curve> curves = new List<Curve>();

    for(int y = 0; y < num; y++)
    {
      //Curve points
      List<Point3d> crvPoints = new List<Point3d>();
      for(int x = 0; x < num; x++)
      {
        double z = Math.Sin(Math.PI / 180 + (x + y));
        Point3d pt = new Point3d(x, y, z);
        crvPoints.Add(pt);
        allPoints.Add(pt);
      }

      //Create a degree 3 nurbs curve from control points
      Curve crv = Curve.CreateControlPointCurve(crvPoints, 3);
      curves.Add(crv);
    }

    //Create a nurbs surface from control points
    NurbsSurface srf = NurbsSurface.CreateFromPoints(allPoints, num, num, 3, 3);
    //Create a loft brep from curves
    Brep[] breps = Brep.CreateFromLoft(curves, Point3d.Unset, Point3d.Unset, LoftType.Tight, false);

    //Assign the outputs
    OutCurves = curves;
    OutSurface = srf;
    OutLoft = breps;
# ---------- end c_script_5 ----------
geometry_3 = Geometry(c_script_5.OutCurves)  # disabled
geometry_4 = Geometry(c_script_5.OutLoft)  # disabled
geometry_5 = Geometry(c_script_5.OutSurface)  # disabled

# ---- group: Simple subdivision
number_slider_7 = Slider(3, range=0..10)  # disabled
curve = Curve(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)  # disabled
surface = Surface(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)  # disabled
c_script_6 = CSharpScript(srf=surface, inPolylines=curve, degree=number_slider_7)  # -> out, OutPolylines, OutMesh; inputs srf: Surface, inPolylines: list of Polyline, degree: Int32; disabled
# ---------- c_script_6: C# ----------
    //Instantiate the collection of all panels
    List<Polyline> outPanels = new List<Polyline>();

    //Limit to 6 subdivisions
    if(degree > 6)
      degree = 6;

    for(int i = 0; i < degree; i++)
    {
      //Outer polylines
      List<Polyline> plines = new List<Polyline>();

      //Mid polylines
      List <Polyline> midPlines = new List<Polyline>();

      //Generate the subdivided panels
      bool result = SubPanelOnSurface(srf, inPolylines.ToArray(), ref plines, ref midPlines);
      if(result == false)
        break;

      //Add outer panels
      outPanels.AddRange(plines);

      //Add mid panels only in the last iteration
      if(i == degree - 1)
        outPanels.AddRange(midPlines);
      else//subdivide mid panels only
        inPolylines = midPlines;
    }

    //Create a mesh from all of the polylines
    Mesh joinedMesh = new Mesh();
    for(int i = 0; i < outPanels.Count; i++)
    {
      Mesh mesh = Mesh.CreateFromClosedPolyline(outPanels[i]);
      joinedMesh.Append(mesh);
    }

    //Make sure that all of the mesh face normals are in the same general direction
    joinedMesh.UnifyNormals();

    //Assign the outputs
    OutPolylines = outPanels;
    OutMesh = joinedMesh;
# ---------- c_script_6: C# additional code ----------
  bool SubPanelOnSurface(Surface srf, Polyline[] inputPanels, ref List<Polyline> outPanels, ref List<Polyline> midPanels)
  {
    //Check for a valid input
    if(inputPanels.Length == 0 || null == srf)
      return false;
    for(int i = 0; i < inputPanels.Length; i++)
    {
      Polyline ipline = inputPanels[i];
      if(!ipline.IsValid || !ipline.IsClosed)
        continue;

      //Stack of points
      List<Point3d> stack = new List<Point3d> ();
      Polyline newPline = new Polyline();
      for(int j = 1; j < ipline.Count; j++)
      {
        Line line = new Line(ipline[j - 1], ipline[j]);

        if(line.IsValid)
        {
          Point3d mid = line.PointAt(0.5);
          double s, t;
          srf.ClosestPoint(mid, out s, out t);
          mid = srf.PointAt(s, t);
          newPline.Add(mid);
          stack.Add(ipline[j - 1]);
          stack.Add(mid);
        }
      }
      //Add the first 2 points to close the last triangle
      stack.Add(stack[0]);
      stack.Add(stack[1]);

      //Close
      newPline.Add(newPline[0]);
      midPanels.Add(newPline);

      for(int j = 2; j < stack.Count; j = j + 1)
      {
        Polyline pl = new Polyline{ stack[j - 2], stack[j - 1], stack[j], stack[j - 2]};
        outPanels.Add(pl);
      }
    }
    return true;
  }
# ---------- end c_script_6 ----------
geometry_6 = Geometry(c_script_6.OutPolylines)  # disabled
mesh = Mesh(c_script_6.OutMesh)  # disabled

# ---- group: Penrose tiling
panel_7 = Panel("[7]++[7]++[7]++[7]++[7]")  # disabled
panel_8 = Panel("81++91----71[-81----61]++")  # disabled
panel_9 = Panel("+81--91[----61--71]+")  # disabled
panel_10 = Panel("-61++71[+++81++91]-")  # disabled
panel_11 = Panel("--81++++61[+91++++71]--71")  # disabled
number_slider_8 = Slider(2, range=0..10)  # disabled
number_slider_9 = Slider(4.2846, range=0..10)  # disabled
c_script_7 = CSharpScript(startString=panel_7, rule6=panel_8, rule7=panel_9, rule8=panel_10, rule9=panel_11, num=number_slider_8)  # -> out, PenroseString; inputs startString: String, rule6: String, rule7: String, rule8: String, rule9: String, num: Int32; disabled
# ---------- c_script_7: C# ----------
    string finalString;
    finalString = startString;

    //Generate the string
    GrowString(ref num, ref finalString, rule6, rule7, rule8, rule9);
    PenroseString = finalString;
# ---------- c_script_7: C# additional code ----------
  void GrowString(ref int num, ref string finalString, string rule6, string rule7, string rule8, string rule9)
  {
    //Decrement the count with each new execution of the grow function
    num = num - 1;
    char rule;

    //Create a new string
    string newString = "";
    for(int i = 0; i < finalString.Length; i++)
    {
      rule = finalString[i];
      if(rule == '6')
        newString = newString + rule6;
      if(rule == '7')
        newString = newString + rule7;
      if(rule == '8')
        newString = newString + rule8;
      if(rule == '9')
        newString = newString + rule9;

      if(rule == '[' || rule == ']' || rule == '+' || rule == '-')
        newString = newString + rule;
    }
    finalString = newString;

    //Stopper condition
    if(num == 0)
      return;
    //Grow again
    GrowString(ref num, ref finalString, rule6, rule7, rule8, rule9);
  }
# ---------- end c_script_7 ----------
c_script_8 = CSharpScript(penroseString=c_script_7.PenroseString, length=number_slider_9)  # -> out, PenroseLines; inputs penroseString: String, length: Double; disabled
# ---------- c_script_8: C# ----------
     /*Parse instruction string to generate points
    Let the base point be the worl origin point*/
    Point3d pt = Point3d.Origin;

    /*Declare the points array
    Vector rotates with (+, -) instructions by 36 degrees*/
    List <Point3d> arrPoints = new List <Point3d>();

    /* Draw forward direction
    Vector direction will be rotated depending on the (+, -) instructions*/
    Vector3d vec = new Vector3d(1.0, 0.0, 0.0);

    //Stacks of points and vectors
    List<Point3d> ptStack = new List<Point3d>();
    List<Vector3d> vStack = new List<Vector3d>();

    //Declare the loop variable
    char rule;
    for(int i = 0; i < penroseString.Length; i++)
    {
      //Always start for 1 and length 1 to get one character at a time
      rule = penroseString[i];
      //Rotate left
      if(rule == '+')
        vec.Rotate(36 * (Math.PI / 180), Vector3d.ZAxis);
      //Rotate right
      if(rule == '-')
        vec.Rotate(-36 * (Math.PI / 180), Vector3d.ZAxis);
      //Draw forward by direction
      if(rule == '1')
      {
        //Add the current points
        Point3d newPt1 = new Point3d(pt);
        arrPoints.Add(newPt1);
        //Calculate the next point
        Point3d newPt2 = pt + (vec * length);
        //Add the next point
        arrPoints.Add(newPt2);
        //Save the new location
        pt = newPt2;
      }

      //Save the point location
      if(rule == '[')
      {
        //Save the current point and direction
        Point3d newPt = new Point3d(pt);
        ptStack.Add(newPt);

        Vector3d newVec = new Vector3d(vec);
        vStack.Add(newVec);
      }

      //Retrieve the point and direction
      if(rule == ']')
      {
        pt = ptStack[ptStack.Count - 1];
        vec = vStack[vStack.Count - 1];

        //Remove from the stack
        ptStack.RemoveAt(ptStack.Count - 1);
        vStack.RemoveAt(vStack.Count - 1);
      }
    }

    //Generate the lines
    List<Line> allLines = new List<Line>();
    for(int i = 1; i < arrPoints.Count; i = i + 2)
    {
      Line line = new Line(arrPoints[i - 1], arrPoints[i]);
      allLines.Add(line);
    }
    PenroseLines = allLines;
# ---------- end c_script_8 ----------
geometry_7 = Geometry(c_script_8.PenroseLines)  # disabled

# ---- group: Conway game of live
c_script_9 = CSharpScript()  # -> PointGrid, StateGrid; inputs srf: Surface, uNum: Int32, vNum: Int32, seed: Int32
# ---------- c_script_9: C# ----------
    if(uNum < 2)
      uNum = 2;
    if(vNum < 2)
      vNum = 2;

    double uStep = srf.Domain(0).Length / uNum;
    double vStep = srf.Domain(1).Length / vNum;
    double uMin = srf.Domain(0).Min;
    double vMin = srf.Domain(1).Min;

    //Create a grid of points and a grid fo states
    DataTree<Point3d> pointsTree = new DataTree<Point3d>();
    DataTree<int> statesTree = new DataTree<int>();
    int pathIndex = 0;
    Random rand = new Random(seed);
    for(int i = 0; i <= uNum; i++)
    {
      List<Point3d> ptList = new List<Point3d>();
      List<int> stateList = new List<int>();
      GH_Path path = new GH_Path(pathIndex);
      pathIndex = pathIndex + 1;
      for(int j = 0; j <= vNum; j++)
      {
        Point3d srfPt = srf.PointAt(uMin + i * uStep, vMin + j * vStep);
        ptList.Add(srfPt);
        int randState = rand.Next(0, 2);
        stateList.Add(randState);
      }
      pointsTree.AddRange(ptList, path);
      statesTree.AddRange(stateList, path);

      PointGrid = pointsTree;
      StateGrid = statesTree;
    }
# ---------- c_script_9: C# additional code ----------
  private void RunScript(DataTree <int> grid, int gen, ref object OutGrid)
  {
    //Get state at the defined generation
    for(int i = 0; i < gen; i++)
      grid = NewGeneration(grid);

    OutGrid = grid;
  }

  public DataTree <int> NewGeneration(DataTree <int> inStates)
  {
    int i,j,c,nc;
    List<int> prvBranch;
    List<int> nxtBranch;
    List<int> branch;
    DataTree<int> states = new DataTree<int>();
    states = inStates;

    for(i = 0; i <= states.Branches.Count - 1; i++)
    {
      branch = states.Branches[i];
      for(j = 0; j <= branch.Count - 1; j++)
      {
        c = branch[j];
        nc = 0;

        //Check the neighbouring states
        //next
        nc = nc + branch[(j + 1 + branch.Count) % branch.Count];

        //prv
        nc = nc + branch[(j - 1 + branch.Count) % branch.Count];

        //top
        nxtBranch = states.Branches[(i + 1 + states.Branches.Count) % states.Branches.Count];
        nc = nc + nxtBranch[(j + 1 + nxtBranch.Count) % nxtBranch.Count];
        nc = nc + nxtBranch[(j + nxtBranch.Count) % nxtBranch.Count];
        nc = nc + nxtBranch[(j - 1 + nxtBranch.Count) % nxtBranch.Count];

        //bottom
        prvBranch = states.Branches[(i - 1 + states.Branches.Count) % states.Branches.Count];
        nc = nc + prvBranch[(j + 1 + prvBranch.Count) % prvBranch.Count];
        nc = nc + prvBranch[(j + prvBranch.Count) % prvBranch.Count];
        nc = nc + prvBranch[(j - 1 + prvBranch.Count) % prvBranch.Count];

        //set the new state
        if(c == 1)
        {
          if(nc < 2 | nc > 3)
            c = 0;
        }

        else if(c == 0)
        {
          if(nc == 3)
            c = 1;
        }

        branch[j] = c;
      }
    }
    return states;
  }
# ---------- end c_script_9 ----------
