# Grasshopper definition Do-While_Loop.gh (Grasshopper 1.0.7)

c_script = CSharpScript(num=Slider(1, range=1..5))  # -> out, A; inputs num: Int32
# ---------- c_script: C# ----------
    List <int> numbers = new List <int> ();

    do {
      //A = "Hi, bla bla bla";
      numbers.Add(num);
      num += 2;
    }while(num < 5);

    A = numbers;
# ---------- end c_script ----------
panel = Panel(c_script.A)
