# Grasshopper definition Facade_ Design_For_ the_Triangles.gh (Grasshopper 1.0.7)

xy_plane = XYPlane(Origin=Point(0, 0, 0))
xy_plane_2 = XYPlane(Origin=Point(0, 0, 0))
curve = Curve(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)
rectangle = Rectangle({Plane=PlaneXY(-25, 0, 0), Size=Domain2(u=-5..5, v=-5..5)})
polygon = Polygon(Plane=xy_plane, Radius=Slider(10, range=0..10), Segments=Slider(3, range=0..10), FilletRadius=0)  # -> Polygon, Length
polygon_2 = Polygon(Plane=xy_plane_2, Radius=Slider(5, range=0..10), Segments=Slider(3, range=0..10), FilletRadius=0)  # -> Polygon, Length
xy_plane_3 = XYPlane(Origin=Point(0, 0, 0))
rectangular_array = RectangularArray(Geometry=curve, Cell=rectangle, XCount=Slider(10, range=5..25), YCount=Slider(15, range=5..25))  # -> Geometry, Transform
xy_plane_4 = XYPlane(Origin=Point(0, 0, 0))
rotate = Rotate(Geometry=polygon.Polygon, Angle=degrees(Slider(90, range=0..100)), Plane=xy_plane_3)  # -> Geometry, Transform
rotate_2 = Rotate(Geometry=polygon_2.Polygon, Angle=degrees(Slider(90, range=0..100)), Plane=xy_plane_4)  # -> Geometry, Transform
area = Area(Geometry=rectangular_array.Geometry)  # -> Area, Centroid

# ---- group: Magnet Curve
curve_2 = Curve(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)

# ----
explode = Explode(Curve=rotate.Geometry, Recursive=True)  # -> Segments, Vertices
curve_closest_point = CurveClosestPoint(Point=area.Centroid, Curve=curve_2)  # -> Point, Parameter, Distance
area_2 = Area(Geometry=rotate.Geometry)  # -> Area, Centroid
construct_domain = ConstructDomain(DomainStart=Slider(1, range=0.2..1), DomainEnd=Slider(0.2, range=0.2..1))
bounds = Bounds(Numbers=curve_closest_point.Distance)
centroid = Centroid(PointA=explode.Vertices, PointB=explode.Vertices, PointC=explode.Vertices)  # -> Centroid, MedianAB, MedianBC, MedianCA
curve_3 = Curve(<curve referenced from the Rhino model>)
rectangular_array_2 = RectangularArray(Geometry=rotate_2.Geometry, Cell=rotate.Geometry, XCount=6, YCount=3)  # -> Geometry, Transform
bounds_2 = Bounds(Numbers=rotate.Geometry)
remap_numbers = RemapNumbers(Value=curve_closest_point.Distance, Source=bounds, Target=construct_domain)  # -> Mapped, Clipped
curve_closest_point_2 = CurveClosestPoint(Point=area_2.Centroid, Curve=curve_3)  # -> Point, Parameter, Distance
construct_domain_2 = ConstructDomain(DomainStart=Slider(1, range=0..10), DomainEnd=Slider(0.2, range=0..1))
scale = Scale(Geometry=rectangular_array.Geometry, Center=area.Centroid, Factor=remap_numbers.Mapped)  # -> Geometry, Transform
remap_numbers_2 = RemapNumbers(Value=curve_closest_point_2.Point, Source=bounds_2, Target=construct_domain_2)  # -> Mapped, Clipped
scale_2 = Scale(Geometry=rectangular_array_2.Geometry, Center=area_2.Centroid, Factor=remap_numbers_2.Mapped)  # -> Geometry, Transform
curve_array = CurveArray(Geometry=scale.Geometry, Count=10)  # -> Geometry, Transform
merge = Merge(Data1=rotate_2.Geometry, Data2=scale_2.Geometry)
curve_array_2 = CurveArray(Geometry=merge, Curve=rotate.Geometry, Count=10)  # -> Geometry, Transform
