# Grasshopper definition Fibonacci re.gh (Grasshopper 1.0.7)

c_script = CSharpScript(number=Slider(10, range=0..100))  # -> R, A; inputs number: Int32
# ---------- c_script: C# ----------
    List<int> FibonacciNumbers = FibonacciSeriesNumber(number);
    List<Rectangle3d> rects = new List<Rectangle3d>();

    for(int i = 0; i < number; i++){
      if(i == 0){rects.Add(new Rectangle3d(Rhino.Geometry.Plane.WorldXY, FibonacciNumbers[i], FibonacciNumbers[i]));}
      else{
        Rhino.Geometry.Point3d BR = rects[i - 1].Corner(1);
        Rhino.Geometry.Point3d BL = rects[i - 1].Corner(0);
        Rhino.Geometry.Vector3d V = BR - BL;
        V.Unitize();
        V *= FibonacciNumbers[i];
        BR -= V;
        Rhino.Geometry.Plane plane = new Plane(BR, Vector3d.CrossProduct(V, Vector3d.ZAxis), V);
        rects.Add(new Rectangle3d(plane, FibonacciNumbers[i], FibonacciNumbers[i]));
      }
    }

    List<Arc> arcs = new List<Arc>();

    foreach(Rectangle3d rect in rects){
      arcs.Add(new Arc(rect.Corner(1), (rect.Corner(2) - rect.Corner(1)), rect.Corner(3)));
    }

    R = rects;
    A = arcs;
# ---------- c_script: C# additional code ----------
  List<int> FibonacciSeriesNumber(int number){
    int firstNumber = 1;
    int secondNumber = 1;
    List<int> Fibonacci = new List<int>();

    if(number > 0)Fibonacci.Add(firstNumber);
    if(number > 1)Fibonacci.Add(secondNumber);

    for(int i = 2; i < number; i++){
      int indexLast = Fibonacci.Count - 1;
      int indexPenultimate = Fibonacci.Count - 2;
      Fibonacci.Add(Fibonacci[indexLast] + Fibonacci[indexPenultimate]);
    }

    return Fibonacci;
  }
# ---------- end c_script ----------
