# Grasshopper definition Fibonacci.gh (Grasshopper 1.0.7)

xy_plane = XYPlane(Origin=Point(0, 0, 0))
c_script = CSharpScript(number=Slider(8, range=0..10), plane=xy_plane)  # -> out, A; inputs number: Int32, plane: Plane
# ---------- c_script: C# ----------
    List <int> FibonacciNumbers = FibonacciSeriesNumber(number);
    List <Rectangle3d> rects = new List <Rectangle3d> ();

    for(int i = 1; i < FibonacciNumbers.Count; i++)
    {
      Rectangle3d rect = new Rectangle3d(plane, FibonacciNumbers[i], FibonacciNumbers[i]);
      rects.Add(rect);
    }
    A = rects;
# ---------- c_script: C# additional code ----------
  List <int> FibonacciSeriesNumber(int number)
  {
    int firstNumber = 0;
    int secondNumber = 1;
    int nextNumber = 0;

    List <int> Fibonacci = new List<int>();
    for(int i = 2; i <= number; i++)
    {
      nextNumber = firstNumber + secondNumber;
      firstNumber = secondNumber;
      secondNumber = nextNumber;

      Fibonacci.Add(secondNumber);
    }

    Fibonacci.Insert(0, 0);
    Fibonacci.Insert(1, 1);
    return Fibonacci;
  }
# ---------- end c_script ----------
geometry = Geometry(c_script.A)
