# Grasshopper definition For_Loops.gh (Grasshopper 1.0.7)

# ---- group: Substituting variables outside the code
c_script = CSharpScript(x=Slider(1, range=1..5))  # -> out, A; inputs x: Int32
# ---------- c_script: C# ----------
    List <int> numbers = new List <int> ();

    for ( ;x < 5;) {
      numbers.Add(x);
      x += 2;
    }

    A = numbers;
# ---------- end c_script ----------
panel = Panel(c_script.A)

# ---- group: Declaring the variable inside the code
c_script_2 = CSharpScript()  # -> out, A
# ---------- c_script_2: C# ----------
    List <int> numbers = new List <int> ();

    for (int x = 0; x < 5; x += 2) {
      numbers.Add(x);
    }

    A = numbers;
# ---------- end c_script_2 ----------
panel_2 = Panel(c_script_2.A)
