# Grasshopper definition GoldenSpiral_EntryLevel_V1.gh (Grasshopper 1.0.7)

number_slider = Slider(12, range=1..22)
c_fib_numbers = CSharpScript(fCount=number_slider)  # -> out, A; inputs fCount: Int32
# ---------- c_fib_numbers: C# ----------
    List<int> fibNumbers = new List<int>();

    foreach (int fib in Fibs(fCount))fibNumbers.Add(fib);
    A = fibNumbers;
# ---------- c_fib_numbers: C# additional code ----------
  public static IEnumerable<int> Fibs (int fibCount){
    for (int i = 0, prevFib = 1, curFib = 1; i < fibCount; i++){
      yield return prevFib;
      int newFib = prevFib + curFib;
      prevFib = curFib;
      curFib = newFib;
    }
  }
# ---------- end c_fib_numbers ----------
sketch = LookHere2()
fibo_numbers = Panel(c_fib_numbers.A)

# ----
# byThe Lord
# called Golden because any given
# sum of rectangles ( n >=3 ) - i.e. parent
# plus childs - it is inscribed into a golden
# rectangle (that's Deep Space stuff friends)
image = ImageSampler(Filter="Colour", Interpolate=False, Umax=380, Umin=1, Vmax=406, Vmin=1, Wrap=1)
# Golden Spiral
c_goldenspiral = CSharpScript(
    enable=Toggle(True),
    autoZoom=Toggle(True),
    N=number_slider,
    Scale=Slider(1, range=1..22),
    Offset=Slider(17, range=12..200),
    TDotColor=ColourSwatch(SwatchColor=RGB(139, 122, 255)),
    TDotDisplay=Toggle(True),
    goldenSpiralDeg=Slider(1, range=1..5),
    addMidPts=Toggle(True))  # -> out, SysRectangle, ArcList, Area, GoldenSpiral; inputs enable: Boolean, autoZoom: Boolean, N: Int32, Scale: Int32, Offset: Int32, TDotColor: Color, TDotDisplay: Boolean, goldenSpiralDeg: Int32, addMidPts: Boolean
# ---------- c_goldenspiral: C# ----------
    // by The Lord of Darkness due to a BIG crisis of stupidity.
    // Note: I hate computers, fat/ugly girls, GinTonic and any Harley Davidson.

    ClearTextDots();

    if(!enable)return;

    //------------------------------------------------------------------------------- arcs look better
    Solve(N, Scale, Offset, TDotDisplay);
    SysRectangle = rset;          // >> out
    ArcList = arcList;            // >> out
    Area = tdotList;              // >> out

    //------------------------------------------------------------------------------- arcs look better
    List<Point3d> cPts;
    Curve goldenSpiral = InterpolateArcPoints(arcList, addMidPts, goldenSpiralDeg, out cPts);
    GoldenSpiral = goldenSpiral;  // >> out

    if(autoZoom) ZoomAtTheThing(cPts);

    //------------------------------------------------------------ extra stupid stuff that one - avoid
    if(TDotDisplay){
      Rhino.DocObjects.ObjectAttributes attr = new Rhino.DocObjects.ObjectAttributes();
      attr.ColorSource = Rhino.DocObjects.ObjectColorSource.ColorFromObject;
      attr.ObjectColor = TDotColor;
      attr.SetUserString("TextDot", Component.ComponentGuid.ToString());
      for(int i = 0;i < tdotList.Count;i++){
        doc.Objects.AddTextDot(tdotList.ElementAt(i), attr);
      }
    }
    else ClearTextDots();
# ---------- c_goldenspiral: C# additional code ----------
  private void ClearTextDots(){
    RhinoObject[] objsPrev = RhinoDocument.Objects.FindByUserString("TextDot", Component.ComponentGuid.ToString(), false, false, true, ObjectType.TextDot);
    if (objsPrev != null){
      foreach (RhinoObject obj in objsPrev)RhinoDocument.Objects.Delete(obj, true);
    }
  }

  public List<Rectangle> rset;
  public List<Arc> arcList;
  public List<TextDot> tdotList;

  public void Solve(int N, int Scale, int Offset, bool TDotDisplay){
    rset = new List<Rectangle>();
    arcList = new List<Arc>();
    tdotList = new List<TextDot>();

    int left = 0; int right = 1; int top = 0; int bottom = 0; int current = 1; int previous = 0;

    for (int i = 0; i < N; i++) {
      switch (i % 4) {
        case 0: // attach to bottom of current rectangle
          createRectangle(left, right, bottom, bottom + current, Scale, Offset);
          ArcMode = 0;
          bottom += current;
          break;
        case 1: // attach to right of current rectangle
          createRectangle(right, right + current, top, bottom, Scale, Offset);
          ArcMode = 1;
          right += current;
          break;
        case 2: // attach to top of current rectangle
          createRectangle(left, right, top - current, top, Scale, Offset);
          ArcMode = 2;
          top -= current;
          break;
        case 3: // attach to left of current rectangle
          createRectangle(left - current, left, top, bottom, Scale, Offset);
          ArcMode = 3;
          left -= current;
          break;
      }

      rset.Add(rect);     
      arcList.Add(CreateArc(rect, ArcMode, TDotDisplay));     

      // update fibonacci number
      int temp = current;  current += previous; previous = temp;
    }
  }


  public int ArcMode;
  public Point3d center;
  public Plane plane;

  private Arc CreateArc(Rectangle rect, int mode, bool TDotDisplay){

    GH_Rectangle C = new GH_Rectangle();  C.CastFrom(rect);
    Rectangle3d rFromC; C.CastTo(out rFromC);

    Print("Rectangle area: {0}m2", rFromC.Area);
    Print("Rectangle edge: {0}m", Math.Sqrt(rFromC.Area));
    Print("                    ");

    if(TDotDisplay){
      TextDot tdot = new TextDot(rFromC.Area.ToString(), rFromC.Center);
      tdotList.Add(tdot);
    }

    Point3d[] bpoints = C.Boundingbox.GetCorners();

    Point3d LL = bpoints[0]; Point3d LR = bpoints[1];
    Point3d UR = bpoints[2]; Point3d UL = bpoints[3];

    double radius = LL.DistanceTo(LR);
    switch (mode) {
      case 0:  plane = new Plane(LR, UR, LL);break;
      case 1:  plane = new Plane(LL, LR, UL);break;
      case 2:  plane = new Plane(UL, LL, UR);break;
      case 3:  plane = new Plane(UR, LR, UL);break;
    }

    Arc arc = new Arc(plane, plane.Origin, radius, Math.PI / 2.0);
    return arc;
  }

  public  Rectangle rect;

  private void createRectangle(int left, int right, int top, int bottom, int Scale, int Offset)
  {
    rect = new Rectangle(Scale * left + Offset,
      Scale * top + Offset,
      Scale * (right - left),
      Scale * (bottom - top));
  }

  public Curve InterpolateArcPoints(List<Arc> arcList, bool addMidPts, int degree, out List<Point3d> cPtsOut){
    List<Point3d> cPts = new List<Point3d>();
    for (int i = 0; i < arcList.Count; i++){
      Point3d pstart = arcList.ElementAt(i).StartPoint;
      Point3d pend = arcList.ElementAt(i).EndPoint;
      switch (i % 4) {
        case 0: cPts.Add(pend);break;
        case 1: cPts.Add(pend);break;
        case 2: cPts.Add(pend);break;
        case 3: cPts.Add(pstart);break;
      }
      if(addMidPts)cPts.Add(arcList.ElementAt(i).MidPoint);
      if(i == arcList.Count - 1){
        switch (i % 4) {
          case 0: cPts.Add(pstart);break;
          case 1: cPts.Add(pstart);break;
          case 2: cPts.Add(pstart);break;
          case 3: cPts.Add(pend);break;
        }
      }
    }
    Curve goldenSpiral = Curve.CreateInterpolatedCurve(cPts, degree);
    cPtsOut = cPts;
    return goldenSpiral;
  }

  public void ZoomAtTheThing(List<Point3d> points){
    BoundingBox bb = new BoundingBox(points);
    Transform scale = Rhino.Geometry.Transform.Scale(bb.Center, 1.1);
    bb.Transform(scale);
    if (bb.IsValid)
    {
      RhinoDocument.Views.ActiveView.ActiveViewport.ZoomBoundingBox(bb);
    }
  }
# ---------- end c_goldenspiral ----------
fibo_rectangle_data = Panel(c_goldenspiral.out)

rec = Rectangle(c_goldenspiral.SysRectangle)
arc = CircularArc(c_goldenspiral.ArcList)
preview = CustomPreview(Geometry=c_goldenspiral.GoldenSpiral, Shader=ColourSwatch(SwatchColor=RGB(0, 0, 0)))
preview_2 = CustomPreview(Geometry=arc, Shader=ColourSwatch(SwatchColor=RGB(23, 0, 255)))
preview_3 = CustomPreview(Geometry=rec, Shader=ColourSwatch(SwatchColor=RGB(255, 255, 255)))
