# Grasshopper definition IT_selective_Geometries.gh (Grasshopper 1.0.7)

# ---- group: Sierpinski Triangle
curve = Curve(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)
c_script = CSharpScript(poly=curve, levels=Slider(2, range=0..10))  # -> out, sierpinski; inputs poly: Polyline, levels: Int32
# ---------- c_script: C# ----------
    sierpinski = SierpinskiTriangle(poly, levels);
# ---------- c_script: C# additional code ----------
  List<Polyline> SierpinskiTriangle(Polyline pol, int levels)
  {
    List<Polyline> triangles = new List<Polyline>();
    triangles.Add(pol);

    for(int i = 0; i < levels; i++)
    {
      List<Polyline> subdivisions = new List <Polyline>();

      foreach(Polyline p in triangles)
      {
        List<Polyline> subs = SierpinskiSubdivision(p);
        subdivisions.AddRange(subs);
      }

      triangles = subdivisions;
    }
    return triangles;
  }

  List <Polyline> SierpinskiSubdivision(Polyline pol)
  {
    List<Polyline> subdivisions = new List <Polyline>();

    for(int i = 0; i < pol.Count - 1; i++)
    {
      Polyline p1 = new Polyline();

      //Retrieve meaningful points for this triangle
      Point3d current = pol[i];
      Point3d next = pol[i + 1];
      Point3d prev;
      if(i != 0)
        prev = pol[i - 1];
      else
        prev = pol[pol.Count - 2];

      //Add the current vertex
      p1.Add(current);

      //Add middle points
      Point3d midNext = PointAlongLineRelative(current, next, 0.5);
      p1.Add(midNext);

      Point3d midPrev = PointAlongLineRelative(current, prev, 0.5);
      p1.Add(midPrev);

      //Close the polyline by addding the same point afain
      p1.Add(current);

      subdivisions.Add(p1);
    }
    return subdivisions;
  }

  //Point Along Line(Geometry Gem #7)
  Point3d PointAlongLineRelative(Point3d a, Point3d b, double t)
  {
    Vector3d AB = b - a;
    Vector3d AC = t * AB;
    Point3d c = a + AC;

    return c;
  }
# ---------- end c_script ----------
panel = Panel(c_script.out)
geometry = Geometry(c_script.sierpinski)
boundary_surfaces = BoundarySurfaces(Edges=geometry)

# ---- group: Fibonacci Sequence
c_script_2 = CSharpScript(number=Slider(10, range=0..100))  # -> R, A; inputs number: Int32
# ---------- c_script_2: C# ----------
    List<int> FibonacciNumbers = FibonacciSeriesNumber(number);
    List<Rectangle3d> rects = new List<Rectangle3d>();

    for(int i = 0; i < number; i++){
      if(i == 0){rects.Add(new Rectangle3d(Rhino.Geometry.Plane.WorldXY, FibonacciNumbers[i], FibonacciNumbers[i]));}
      else{
        Rhino.Geometry.Point3d BR = rects[i - 1].Corner(1);
        Rhino.Geometry.Point3d BL = rects[i - 1].Corner(0);
        Rhino.Geometry.Vector3d V = BR - BL;
        V.Unitize();
        V *= FibonacciNumbers[i];
        BR -= V;
        Rhino.Geometry.Plane plane = new Plane(BR, Vector3d.CrossProduct(V, Vector3d.ZAxis), V);
        rects.Add(new Rectangle3d(plane, FibonacciNumbers[i], FibonacciNumbers[i]));
      }
    }

    List<Arc> arcs = new List<Arc>();

    foreach(Rectangle3d rect in rects){
      arcs.Add(new Arc(rect.Corner(1), (rect.Corner(2) - rect.Corner(1)), rect.Corner(3)));
    }

    R = rects;
    A = arcs;
# ---------- c_script_2: C# additional code ----------
  List<int> FibonacciSeriesNumber(int number){
    int firstNumber = 1;
    int secondNumber = 1;
    List<int> Fibonacci = new List<int>();

    if(number > 0)Fibonacci.Add(firstNumber);
    if(number > 1)Fibonacci.Add(secondNumber);

    for(int i = 2; i < number; i++){
      int indexLast = Fibonacci.Count - 1;
      int indexPenultimate = Fibonacci.Count - 2;
      Fibonacci.Add(Fibonacci[indexLast] + Fibonacci[indexPenultimate]);
    }

    return Fibonacci;
  }
# ---------- end c_script_2 ----------
geometry_2 = Geometry(c_script_2.R)
geometry_3 = Geometry(c_script_2.A)

# ---- group: Fractal Tree
panel_2 = Panel("F ->")
panel_3 = Panel("X ->")
num = Slider(3, range=1..20)
c_script_3 = CSharpScript(startString="X", ruleX="F-[[X]+X]+F[+FX]-X", ruleY="FF", num=num)  # -> FractalString; inputs startString: String, ruleX: String, ruleY: String, num: Int32, length: Double
# ---------- c_script_3: C# ----------
        /*
    string fractalString = startString;
    GrowString(ref num, ref fractalString, ruleX, ruleY);
    List<Line> fractalLines = new List<Line>();
    ParsefractalString(fractalString, length, ref fractalLines);

    FractalTree = fractalLines;
*/

    // Declare string
    string fractalString = startString;

    // Generate the string
    GrowString(ref num, ref fractalString, ruleX, ruleY);

    // Return the string
    FractalString = fractalString;
# ---------- c_script_3: C# additional code ----------
  void GrowString(ref int num, ref string finalString, string ruleX, string ruleF)
  {
    num = num - 1;
    char rule;

    string newString = "";
    for(int i = 0; i < finalString.Length;i++)
    {
      rule = finalString[i];
      if(rule == 'X')
        newString = newString + ruleX;
      if(rule == 'F')
        newString = newString + ruleF;
      if(rule == '[' || rule == ']' || rule == '+' || rule == '-')
        newString = newString + rule;
    }

    finalString = newString;

    if(num == 0)
      return;
    GrowString(ref num, ref finalString, ruleX, ruleF);
  }
/*
  void ParsefractalString(string fractalString, double length, ref List<Line> fractalLines)
  {

  }*/
# ---------- end c_script_3 ----------
length = Slider(1.3218, range=1..10)
c_script_4 = CSharpScript(fractalString=c_script_3, length=length)  # -> out, FractalLines; inputs fractalString: String, length: Double
# ---------- c_script_4: C# ----------
    //Parse instruction string to generate points
    //Let base point be world origin
    Point3d pt = Point3d.Origin;

    //Declare points array
    //Vector rotates with (+,-) instructions by 30 degrees
    List<Point3d> arrPoints = new List<Point3d>();

    //Draw forward direction
    //Vector direction will be rotated depending on (+,-) instructions
    Vector3d vec = new Vector3d(0.0, 1.0, 0.0);

    //Stacks of points and vectors
    List<Point3d> ptStack = new List<Point3d>();
    List<Vector3d> vStack = new List<Vector3d>();

    //Declare loop variables
    char rule;
    for(int i = 0 ; i < fractalString.Length; i++)
    {
      //Always start for 1 and length 1 to get one char at a time
      rule = fractalString[i];

      //Rotate Left
      if( rule == '+')
        vec.Rotate(Math.PI / 6, Vector3d.ZAxis);

      //Rotate Right
      if( rule == '-')
        vec.Rotate(-Math.PI / 6, Vector3d.ZAxis);


      //Draw Forward by direction
      if( rule == 'F')
      {
        //Add current points
        Point3d newPt1 = new Point3d(pt);
        arrPoints.Add(newPt1);

        //Calculate next point
        Point3d newPt2 = new Point3d(pt);
        newPt2 = newPt2 + (vec * length);
        //Add next point
        arrPoints.Add(newPt2);

        //Save new location
        pt = newPt2;
      }

      //Save point location
      if( rule == '[')
      {
        //Save current point and direction
        Point3d newPt = new Point3d(pt);
        ptStack.Add(newPt);

        Vector3d newV = new Vector3d(vec);
        vStack.Add(newV);
      }

      //Retrieve point and direction
      if( rule == ']')
      {
        pt = ptStack[ptStack.Count - 1];
        vec = vStack[vStack.Count - 1];

        //Remove from stack
        ptStack.RemoveAt(ptStack.Count - 1);
        vStack.RemoveAt(vStack.Count - 1);
      }
    }

    //Generate lines
    List<Line> allLines = new List<Line>();
    for(int i = 1; i < arrPoints.Count; i = i + 2)
    {
      Line line = new Line(arrPoints[i - 1], arrPoints[i]);
      allLines.Add(line);
    }


    FractalLines = allLines;
# ---------- end c_script_4 ----------

# ---- group: Koch Snowflake
unit_z = UnitZ(Factor=1)
curve_2 = Curve(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)
curve_3 = Curve(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)
c_script_5 = CSharpScript(poly=curve_3, levels=Slider(6, range=1..10), normal=unit_z)  # -> out, koch; inputs poly: Polyline, levels: Int32, normal: Vector3d
# ---------- c_script_5: C# ----------
    koch = Kochstar(poly, levels, normal);
# ---------- c_script_5: C# additional code ----------
  Polyline Kochstar(Polyline pol, int levels, Vector3d normal)
  {
    Polyline star = pol;

    for(int i = 0; i < levels; i++)
      star = KochSubdivision(star, normal);

    return star;
  }

  Polyline KochSubdivision(Polyline pol, Vector3d normal)
  {
    int pointCount = pol.Count;

    //Create a new empty Polyline
    Polyline sub = new Polyline();
    sub.Add(pol.First);

    //Iterate over each segment of the Polyline
    for(int i = 1; i < pointCount; i++)
    {
      //Get the end points of this segment
      Point3d start = pol[i - 1];// square brackets used in list access, poly is list of points
      Point3d end = pol[i];

      //Compute first and third point
      Point3d p13 = PointAlongLineRelative(start, end, 1 / 3.0);
      sub.Add(p13);

      //Comput the tip point of the subdivision
      Vector3d axis = end - start;
      axis.Unitize();
      Vector3d norm = normal;
      Vector3d perp = Vector3d.CrossProduct(axis, norm);

      double a = Distance(start, end);
      double a3 = a / 3.0;
      double h = a3 * Math.Sqrt(3) / 2.0;

      perp = perp * h;
      Point3d mid = PointAlongLineRelative(start, end, 0.5);
      mid += perp;
      sub.Add(mid);

      //Compute second third point
      Point3d p23 = PointAlongLineRelative(start, end, 2 / 3.0);
      sub.Add(p23);

      sub.Add(end);

    }

    return sub;
  }


  //Point Along Line(Geometry Gem #7)
  Point3d PointAlongLineRelative(Point3d a, Point3d b, double t)
  {
    Vector3d AB = b - a;
    Vector3d AC = t * AB;
    Point3d c = a + AC;

    return c;
  }

  //Distance between 2 points (Geometry Gem #4)
  double Distance(Point3d a, Point3d b)
  {
    //Calculate the sides of the triangle
    double dx = b.X - a.X;
    double dy = b.Y - a.Y;
    double dz = b.Z - a.Z;

    //Calculate the length of the larger side of the triangle
    double d = Math.Sqrt(dx * dx + dy * dy + dz * dz);

    return d;
  }
# ---------- end c_script_5 ----------
panel_4 = Panel(c_script_5.out)
geometry_4 = Geometry(c_script_5.koch)

# ---- group: Subdivision curve
point = Point([Point(-10, 6, 0), Point(-4, 15, 0), Point(7, 8, 0), Point(10, -1, 0), Point(17, 5, 0), Point(14, 10, 0), Point(18, 14, 0)])
c_script_6 = CSharpScript(controlPoints=point, iterationCount=Slider(0, range=0..10))  # -> out, curve; inputs controlPoints: list of Point3d, iterationCount: Int32
# ---------- c_script_6: C# ----------
    for(int j = 0;j < iterationCount;j++)
    {
      List<Point3d> newControlPoints = new List <Point3d> ();

      for(int i = 0; i < controlPoints.Count - 1; i++)
      {
        Point3d oneQuarterPoint = 0.75 * controlPoints[i] + 0.25 * controlPoints[i + 1];
        newControlPoints.Add(oneQuarterPoint);

        Point3d threeQuarterPoint = 0.25 * controlPoints[i] + 0.75 * controlPoints[i + 1];
        newControlPoints.Add(threeQuarterPoint);
      }

      controlPoints = newControlPoints;
    }
    
    curve = new PolylineCurve(controlPoints);
# ---------- end c_script_6 ----------
geometry_5 = Geometry(c_script_6.curve)

# ----
curve_4 = Curve(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)
divide_curve = DivideCurve(Curve=curve_4, Count=Slider(6, range=0..10), Kinks=False)  # -> Points, Tangents, Parameters
c_script_7 = CSharpScript(ptList=divide_curve.Points)  # -> out, Spheres; inputs ptList: list of Point3d
# ---------- c_script_7: C# ----------
    System.Random random = new System.Random();
    List <Sphere> sphereList = new List <Sphere>();
    foreach(Point3d pt in ptList)
    {
      int num = random.Next(0, 15);
      Sphere sphere = new Sphere(pt, num);
      sphereList.Add(sphere);
    }
    Print("Run#" + Iteration);
    Spheres = sphereList;
# ---------- end c_script_7 ----------
geometry_6 = Geometry(c_script_7.Spheres)

# ---- group: Penrose Tiling
num_2 = Slider(4, range=1..20)
c_script_8 = CSharpScript(
    startString="[7]++[7]++[7]++[7]++[7]",
    rule6="81++91----71[-81----61]++",
    rule7="+81--91[---61--71]+",
    rule8="-61++71[+++81++91]-",
    rule9="--81++++61[+91++++71]--71",
    num=num_2)  # -> out, PenroseString; inputs startString: String, rule6: String, rule7: String, rule8: String, rule9: String, num: Int32
# ---------- c_script_8: C# ----------
    string finalString;
    finalString = startString;
    GrowString(ref num, ref finalString, rule6, rule7, rule8, rule9);
    PenroseString = finalString;
# ---------- c_script_8: C# additional code ----------
  void GrowString(ref int num, ref string finalString, string rule6, string rule7, string rule8, string rule9)
  {
    num = num - 1;
    char rule;
    string newString = "";
    
    for (int i = 0; i < finalString.Length; i++)
    {
      rule = finalString[i];
      if (rule == '6')
        newString = newString + rule6;
      if (rule == '7')
        newString = newString + rule7;
      if (rule == '8')
        newString = newString + rule8;
      if (rule == '9')
        newString = newString + rule9;

      if (rule == '[' || rule == ']' || rule == '+' || rule == '-')
        newString = newString + rule;
    }

    finalString = newString;

    if (num == 0)
      return;

    GrowString(ref num, ref finalString, rule6, rule7, rule8, rule9);
  }
# ---------- end c_script_8 ----------
length_2 = Slider(6.3134, range=1..10)
c_script_9 = CSharpScript(penroseString=c_script_8.PenroseString, length=length_2)  # -> out, PenroseLines; inputs penroseString: String, length: Double
# ---------- c_script_9: C# ----------
    Point3d pt = Point3d.Origin;

    List<Point3d> arrPoints = new List<Point3d>();

    Vector3d vec = new Vector3d(1.0, 0.0, 0.0);

    List<Point3d> ptStack = new List<Point3d>();
    List<Vector3d> vStack = new List<Vector3d>();

    char rule;
    for(int i = 0 ; i < penroseString.Length; i++)
    {
      rule = penroseString[i];

      if( rule == '+')
        vec.Rotate(36 * (Math.PI / 180), Vector3d.ZAxis);

      if( rule == '-')
        vec.Rotate(-36 * (Math.PI / 180), Vector3d.ZAxis);
      
      if( rule == '1')
      {
        Point3d newPt1 = new Point3d(pt);
        arrPoints.Add(newPt1);

        Point3d newPt2 = pt + (vec * length);
        arrPoints.Add(newPt2);

        pt = newPt2;
      }

      if( rule == '[')
      {
        Point3d newPt = new Point3d(pt);
        ptStack.Add(newPt);

        Vector3d newVec = new Vector3d(vec);
        vStack.Add(newVec);
      }

      if( rule == ']')
      {
        pt = ptStack[ptStack.Count - 1];
        vec = vStack[vStack.Count - 1];

        ptStack.RemoveAt(ptStack.Count - 1);
        vStack.RemoveAt(vStack.Count - 1);
      }
    }
    
    List<Line> allLines = new List<Line>();
    for(int i = 1; i < arrPoints.Count; i = i + 2)
    {
      Line line = new Line(arrPoints[i - 1], arrPoints[i]);
      allLines.Add(line);
    }

    PenroseLines = allLines;
# ---------- end c_script_9 ----------

# ----
xy_plane = XYPlane(Origin=Point(0, 0, 0))
c_script_10 = CSharpScript(number=Slider(8, range=0..10), plane=xy_plane)  # -> out, A; inputs number: Int32, plane: Plane
# ---------- c_script_10: C# ----------
    List <int> FibonacciNumbers = FibonacciSeriesNumber(number);
    List <Rectangle3d> rects = new List <Rectangle3d> ();

    for(int i = 1; i < FibonacciNumbers.Count; i++)
    {
      Rectangle3d rect = new Rectangle3d(plane, FibonacciNumbers[i], FibonacciNumbers[i]);
      rects.Add(rect);
    }
    A = rects;
# ---------- c_script_10: C# additional code ----------
  List <int> FibonacciSeriesNumber(int number)
  {
    int firstNumber = 0;
    int secondNumber = 1;
    int nextNumber = 0;

    List <int> Fibonacci = new List<int>();
    for(int i = 2; i <= number; i++)
    {
      nextNumber = firstNumber + secondNumber;
      firstNumber = secondNumber;
      secondNumber = nextNumber;

      Fibonacci.Add(secondNumber);
    }

    Fibonacci.Insert(0, 0);
    Fibonacci.Insert(1, 1);
    return Fibonacci;
  }
# ---------- end c_script_10 ----------
geometry_7 = Geometry(c_script_10.A)
panel_5 = Panel(c_script_10.A)
number_slider = Slider(2, range=0..10)  # disabled
number_slider_2 = Slider(6, range=0..10)  # disabled
number_slider_3 = Slider(6, range=0..10)  # disabled
number_slider_4 = Slider(500, range=0..1000)  # disabled
line = Line()  # disabled
curve_5 = Curve(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)  # disabled
panel_6 = Panel("1 to 100")  # disabled
curve_6 = Curve(<curve referenced from the Rhino model>)  # disabled
curve_7 = Curve(<curve referenced from the Rhino model>)  # disabled
divide_curve_2 = DivideCurve(Curve=curve_6, Count=number_slider, Kinks=False)  # -> Points, Tangents, Parameters; disabled
divide_curve_3 = DivideCurve(Curve=curve_5, Count=number_slider_2, Kinks=False)  # -> Points, Tangents, Parameters; disabled
divide_curve_4 = DivideCurve(Curve=curve_5, Count=10, Kinks=False)  # -> Points, Tangents, Parameters; disabled
random = Random(Range=panel_6, Number=number_slider_3, Seed=2)  # disabled
radians = Radians()  # disabled
divide_curve_5 = DivideCurve(Curve=curve_7, Count=number_slider_4, Kinks=False)  # -> Points, Tangents, Parameters; disabled
number_slider_5 = Slider(7, range=0..10)  # disabled
c_script_11 = CSharpScript(ptTree=divide_curve_2.Points)  # -> out, Spheres; inputs ptTree: tree of Point3d; disabled
# ---------- c_script_11: C# ----------
    DataTree<Sphere> sphereTree = new DataTree<Sphere>();
    int pathIndex = 0;

    foreach(List<Point3d> branch in ptTree.Branches){
      List<Sphere> sphereList = new List<Sphere>();
      GH_Path path = new GH_Path(pathIndex);
      pathIndex = pathIndex + 1;
      foreach(Point3d pt in branch){
        Sphere ptSphere = new Sphere(pt, 3.5);
        sphereList.Add(ptSphere);
      }
      sphereTree.AddRange(sphereList, path);
    }
    Print("Run#" + Iteration);
    Spheres = sphereTree;
# ---------- end c_script_11 ----------
c_script_12 = CSharpScript(pt=divide_curve_4.Points)  # -> out, A; inputs pt: Point3d; disabled
# ---------- c_script_12: C# ----------
    System.Random random = new System.Random();

    Sphere ptSphere = new Sphere(pt, num);
    A = ptSphere;
# ---------- end c_script_12 ----------
c_script_13 = CSharpScript(ptList=divide_curve_3.Points)  # -> out, Spheres; inputs ptList: list of Point3d; disabled; same code as c_script_7
integer = Integer(random)  # disabled
panel_7 = Panel(integer)  # disabled
c_script_14 = CSharpScript()  # -> out, A; disabled
# ---------- c_script_14: C# ----------
    List <Line> allLines = new List<Line>();
    allLines.Add(inputLine);
    DivideAndRotate(inputLine, ref allLine, angle, minLength);
    Lines = allLines;
# ---------- c_script_14: C# additional code ----------
  public void RunScript(Line currLine, ref List <Line> allLines, double angle, double minLength)
  {

    if(currLine.Length > minLength)
      return;
    Line newLine = new Line();
    newLine = currLine;

    Point3d endPt new Point3d();
    endPt = newLine.PointAt(0.95);
    newLine.To = endPt;

    Transform xform = default(Transform);
    xform = Transform.Rotation(angle, Vector.ZAxis, newLine.From);

    allLines.Add(newLine);

    DivideAndRotate(newLine, ref allLines, angle, minLength);
  }
# ---------- end c_script_14 ----------
geometry_8 = Geometry(c_script_12.A)  # disabled
c_script_15 = CSharpScript(IterationCount=number_slider_5)  # -> Out, A; disabled
c_script_16 = CSharpScript(num=integer)  # -> out, isEven; inputs num: Int32; disabled
# ---------- c_script_16: C# ----------
    /* Creating a variable that finds
    the rest of a number when it is divided by 2*/
    int rest = num % 2;
    // Checks if the rest is equal to 0, and outputs if it is true or false in isEven.
    isEven = (rest == 0 ? true : false);
# ---------- end c_script_16 ----------
geometry_9 = Geometry(c_script_13.Spheres)  # disabled
geometry_10 = Geometry(c_script_11.Spheres)  # disabled
c_script_17 = CSharpScript()  # -> out, A; disabled
# ---------- c_script_17: C# ----------
    Rhino.Geometry.Collections.BrepFaceList faces = brep.Faces;
    for(int fi = 0; fi < faces.Count; fi++)
    {
    
      BrepFace face = faces[fi];
      //Get Adjacent 
    }
# ---------- end c_script_17 ----------
c_script_18 = CSharpScript()  # -> out, A; inputs x: Curve
# ---------- c_script_18: C# ----------
    crv.DuplicateCurve();
    crv.
# ---------- end c_script_18 ----------
panel_8 = Panel(c_script_12.out)  # disabled
c_script_19 = CSharpScript()  # -> out, A; disabled
# ---------- c_script_19: C# ----------
    double angle = 0.01;
    int ellipseCount = 20; 
    double x = 1.5;
    
    List<Ellipse> ellipseList = new List<Ellipse>();
    
    Plane plane = Plane.WorldXY;
    
    for(int i = 1; i <= ellipseCount;i++){
      Point3d pt = new Point3d(x, 0, 0);
      Vector3d y = new Vector3d(0, 1, 0);
      plane.Rotate(angle * i, y, pt);
      
      Ellipse ellipse = new Ellipse(plane, (double) i / 2, i);
      
      ellipseList.Add(ellipse);
    }
# ---------- end c_script_19 ----------
panel_9 = Panel(c_script_16.isEven)
geometry_11 = Geometry(c_script_18.A)  # disabled
# Randomly make some spheres small, some big. Move the curve by vector
c_script_20 = CSharpScript()  # -> out, A
# ---------- c_script_20: C# ----------
    DataTree<double> numTree = new DataTree<double>();
    int pathIndex = 0;
    for(int i = 0;i <= 1;i++){
      List<double> numList = new List<double>();
      GH_Path path = new GH_Path(pathIndex);
      pathIndex = pathIndex++
    }
# ---------- end c_script_20 ----------
