# Grasshopper definition Interlaced_Moebius_final.gh (Grasshopper 0.9.76)

basic_radius = Slider(44.05, range=0..60)
number_holes = Slider(15, range=0..100)
number_slider = Slider(27, range=0..100)
cir = Circle(Plane=PlaneXY(0, 0, 0), Radius=basic_radius)
division = Division(A="360", B=number_slider)
number_slider_2 = Slider(8.7, range=0..10)
pframes = PerpFrames(Curve=cir, Count=number_slider, Align=True)  # -> Frames, Parameters
pdecon = Deconstruct(Point=pframes.Frames)  # -> XComponent, YComponent, ZComponent
series = Series(Start=0, Step=division, Count=number_slider)
crv = Curve(cir)
neg = Negative(Value=number_slider_2)
pt = ConstructPoint(XCoordinate=pdecon.XComponent, YCoordinate=pdecon.YComponent, ZCoordinate=number_slider_2)
pt_2 = ConstructPoint(XCoordinate=pdecon.XComponent, YCoordinate=pdecon.YComponent, ZCoordinate=neg)
ln = Line(StartPoint=pt, EndPoint=pt_2)
rotate = Rotate(Geometry=ln, Angle=degrees(series), Plane=pframes.Frames)  # -> Geometry, Transform
rotate_2 = Rotate(Geometry=ln, Angle=expr("x+90", degrees(series)), Plane=pframes.Frames)  # -> Geometry, Transform
multiplication = Multiplication(A=number_holes, B=2)
loft = Loft(Curves=rotate.Geometry, Options={Adjust=False, Closed=True, LoftEnds=0, LoftSimp=0, LoftType=0, Rebuild=10, Refit=0.01})
loft_2 = Loft(
    Curves=rotate_2.Geometry,
    Options={Adjust=False, Closed=True, LoftEnds=0, LoftSimp=0, LoftType=0, Rebuild=10, Refit=0.01})
divide = DivideCurve(Curve=crv, Count=multiplication, Kinks=False)  # -> Points, Tangents, Parameters
srf_cp = SurfaceClosestPoint(Point=divide.Points, Surface=loft)  # -> Point, UVPoint, Distance
srf_cp_2 = SurfaceClosestPoint(Point=divide.Points, Surface=loft_2)  # -> Point, UVPoint, Distance
evalsrf = EvaluateSurface(Surface=loft, Point=srf_cp.UVPoint)  # -> Point, Normal, Frame
evalsrf_2 = EvaluateSurface(Surface=loft_2, Point=srf_cp_2.UVPoint)  # -> Point, Normal, Frame
basic_shape_y = Slider(15, range=0..60)
basic_shape_x = Slider(4, range=0..60)
lng = ListLength(List=evalsrf_2.Frame)
lng_2 = ListLength(List=evalsrf.Frame)
division_2 = Division(A=lng, B=2)
division_3 = Division(A=lng_2, B=2)
neg_2 = Negative(Value=basic_shape_x)
neg_3 = Negative(Value=basic_shape_y)
number_slider_3 = Slider(11.502, range=0..50)
dom = ConstructDomain(DomainStart=basic_shape_x, DomainEnd=neg_2)
dom_2 = ConstructDomain(DomainStart=basic_shape_y, DomainEnd=neg_3)
series_2 = Series(Start=1, Step=2, Count=division_2)
series_3 = Series(Start=0, Step=2, Count=division_3)
number_slider_4 = Slider(8, range=0..50)
number_slider_5 = Slider(11.45, range=0..50)
rectangle = Rectangle(Plane=pframes.Frames, XSize=dom, YSize=dom_2, Radius=0)  # -> Rectangle, Length
item = ListItem(List=evalsrf_2.Frame, Index=series_2, Wrap=True)  # -> flatten(Item)
item_2 = ListItem(List=evalsrf.Frame, Index=series_3, Wrap=True)  # -> flatten(Item)
deplane = DeconstructPlane(Plane=item_2)  # -> Origin, XAxis, YAxis, ZAxis
deplane_2 = DeconstructPlane(Plane=item)  # -> Origin, XAxis, YAxis, ZAxis
rotate_3 = Rotate(Geometry=rectangle.Rectangle, Angle=expr("x+90", degrees(series)), Plane=pframes.Frames)  # -> Geometry, Transform
neg_4 = Negative(Value=deplane.ZAxis)
neg_5 = Negative(Value=deplane_2.ZAxis)
rotate_4 = Rotate(Geometry=rectangle.Rectangle, Angle=degrees(series), Plane=pframes.Frames)  # -> Geometry, Transform
ellipse = Ellipse(Plane=item, Radius1=number_slider_4, Radius2=number_slider_5)  # -> Ellipse, Focus1, Focus2
line = LineSDL(Start=item_2, Direction=neg_4, Length=number_slider_3)
line_2 = LineSDL(Start=item, Direction=neg_5, Length=number_slider_3)
ellipse_2 = Ellipse(Plane=item_2, Radius1=number_slider_4, Radius2=number_slider_5)  # -> Ellipse, Focus1, Focus2
loft_3 = Loft(
    Curves=rotate_4.Geometry,
    Options={Adjust=False, Closed=True, LoftEnds=0, LoftSimp=0, LoftType=0, Rebuild=10, Refit=0.01})
loft_4 = Loft(
    Curves=rotate_3.Geometry,
    Options={Adjust=False, Closed=True, LoftEnds=0, LoftSimp=0, LoftType=0, Rebuild=10, Refit=0.01})
move = Move(Geometry=ellipse_2.Ellipse, Motion=line)  # -> Geometry, Transform
move_2 = Move(Geometry=ellipse.Ellipse, Motion=line_2)  # -> Geometry, Transform
multiplication_2 = Multiplication(A=number_slider_3, B=2)
multiplication_3 = Multiplication(A=number_slider_3, B=2)
line_3 = LineSDL(Start=item_2, Direction=deplane.ZAxis, Length=multiplication_2)
line_4 = LineSDL(Start=item, Direction=deplane_2.ZAxis, Length=multiplication_3)
extr = Extrude(Base=move.Geometry, Direction=line_3)
extr_2 = Extrude(Base=move_2.Geometry, Direction=line_4)
cap = CapHoles(Brep=extr_2)
cap_2 = CapHoles(Brep=extr)
sdiff = SolidDifference(BrepsA=loft_3, BrepsB=cap_2)
sdiff_2 = SolidDifference(BrepsA=loft_4, BrepsB=cap)
