# Grasshopper definition Larger_Than_Input.gh (Grasshopper 1.0.7)

panel = Panel(""" 
5
0.2""")
c_script = CSharpScript(A=panel, B="0.4")  # -> out, T, F; inputs A: Double, B: Double
# ---------- c_script: C# ----------
    if (A > B){
      T = A;
    }
    else if (A <= B) {
      F = A;
    }

    else {
      F = A;
    }
# ---------- end c_script ----------
panel_2 = Panel(c_script.T)
panel_3 = Panel(c_script.F)
