# Grasshopper definition Larger_Than_Input02.gh (Grasshopper 1.0.7)

double = Panel("-1")
empty = Panel("")
space = Panel(" ")
double_2 = Panel("0.5")
integer = Panel("""5
0.2

 """)
string = Panel("Michalina")
c_script = CSharpScript(slider=Slider(5, range=0..5), zero=double, one=empty, two=string, three=space, four=double_2, five=integer)  # -> out, A; inputs slider: Int32
# ---------- c_script: C# ----------
    switch (slider)
    {

      case 0:
        A = zero;
        break;

      case 1:
        A = one;
        break;

      case 2:
        A = two;
        break;

      case 3:
        A = three;
        break;

      case 4:
        A = four;
        break;

      case 5:
        A = five;
        break;

      default:
        A = "You, there, what's your name, you forgot to write an input";
        break;

    }
# ---------- end c_script ----------
c_script_2 = CSharpScript(num=c_script.A, min_num=Slider(0.6, range=0..1))  # -> out, T, F; inputs min_num: Double
# ---------- c_script_2: C# ----------
    double a;

    if (GH_Convert.ToDouble(num, out a, GH_Conversion.Both) && a > min_num)
    {
      T = a;
    }

    else
    {
      if(a == 0)
        F = null;
      else if(a < min_num)
        F = a;
      else
        F = null;

    }
# ---------- end c_script_2 ----------
panel = Panel(c_script_2.F)
panel_2 = Panel(c_script_2.T)
