# Grasshopper definition Larger_Than_Input_Discourse_Solution.gh (Grasshopper 1.0.7)

panel = Panel(""" 
5
0.2""")
c_script = CSharpScript(A=panel, B="0.4")  # -> out, T, F; inputs B: Double
# ---------- c_script: C# ----------
    double a;
    if (GH_Convert.ToDouble(A, out a, GH_Conversion.Both) && a > B)
      T = a;
    else
      F = A;
# ---------- end c_script ----------
panel_2 = Panel(c_script.T)
panel_3 = Panel(c_script.F)
