# Grasshopper definition C#_Course_Long_Beginner.gh (Grasshopper 1.0.7)

# Day 1 - C# Scripting and Plugin Development for Grasshopper
panel = Panel("Part 1")
c_script = CSharpScript()  # -> out
# ---------- c_script: C# ----------
    for(int i = 0; i <= 5; i++)
    {
      Print(i.ToString());
    }
    
    Print(" ");
# ---------- end c_script ----------
c_script_2 = CSharpScript()  # -> out
# ---------- c_script_2: C# ----------
    List <double> myNumbers = new List <double>(){1.45,5.67,7.89};
    myNumbers.Add(2.39);
    myNumbers.Add(4.12);

    Print(myNumbers[0].ToString());
# ---------- end c_script_2 ----------
c_script_3 = CSharpScript()  # -> out, A
# ---------- c_script_3: C# ----------
    List<Point3d> myPoints = new List <Point3d>();

    for(int i = 0; i < 100; i++)
      //You can remove the curly brackets if there is only 1 statement in the "for loop
    {
      myPoints.Add(new Point3d(i, i, i));
    }

    A = myPoints;
# ---------- end c_script_3 ----------
c_script_4 = CSharpScript()  # -> out, A
# ---------- c_script_4: C# ----------
    List<Point3d> myPoints = new List <Point3d>();

    for(int i = 0; i < 100; i++)
    {
      for(int j = 0; j < 20; j++)
      {
        myPoints.Add(new Point3d(i, j, 0));
      }
    }

    A = myPoints;
# ---------- end c_script_4 ----------
c_script_5 = CSharpScript()  # -> out, A
# ---------- c_script_5: C# ----------
    Point3d myPoint = new Point3d(1.0, 2.0, 3.0);
    A = myPoint;
# ---------- end c_script_5 ----------
pt = Point([Point(-1.690546658, 9.381564862, 0), Point(6.550240874, 12.90190128, 0), Point(1.749782118, -0.6993985267, 0), Point(0.7096827206, 14.58206185, 0), Point(9.670539066, 5.301174919, 0), Point(4.630057372, -3.179635551, 0), Point(-1.290508428, 3.380991416, 0)])
c_script_6 = CSharpScript()  # -> Out, A
c_script_7 = CSharpScript(points=pt)  # -> out, A; inputs points: list of Point3d
# ---------- c_script_7: C# ----------
    List<Circle> circles = new List <Circle>();

    foreach(Point3d point in points)
    {
      Circle circle = new Circle(point, 2.0);
      circles.Add(circle);
    }

    A = circles;
# ---------- end c_script_7 ----------
panel_2 = Panel(c_script_2)
pt_2 = Point(c_script_5.A)
panel_3 = Panel(c_script)
c_script_8 = CSharpScript(a=Slider(5, range=1..10), b=Slider(1, range=1..10))  # -> out, A; inputs a: Int32, b: Int32
# ---------- c_script_8: C# ----------
    if(a > b)
    {
      Print("a is bigger than b");
      Print("b is smaller than a");
    }
    else
    {
      Print("a is smaller than b");
      Print("b is bigger than a");
    }
# ---------- end c_script_8 ----------
geo = Geometry(c_script_7.A)
c_script_9 = CSharpScript(x=Slider(1.39, range=1..4), y=Slider(3.08, range=1..4), z=Slider(2.47, range=1..4))  # -> out, A, B; inputs x: Double, y: Double, z: Double
# ---------- c_script_9: C# ----------
    A = x + y;
    B = x + y + z;
# ---------- end c_script_9 ----------
panel_4 = Panel(c_script_8.out)
panel_5 = Panel(c_script_9.B)
# Notes:
# - Indentation is not necessary in C#, it is simply there for us to easily read the code we wrote.
# 
# - Always try to shorten the code!
# 
# - Use the brackets even if it isn't necessary.
# 
# - Try not to copy and paste code as this can create a lot of mistakes
panel_6 = Panel(c_script_9.A)
