# Grasshopper definition Questionmark_Operator.gh (Grasshopper 1.0.7)

c_script = CSharpScript(age=Slider(35, range=0..100))  # -> out, A; inputs age: Int32, msg: String
# ---------- c_script: C# ----------
   
    msg = (age >= 18) ? "You're okay, I guess" : "LOSER!!!";
    A = msg;
# ---------- end c_script ----------
panel = Panel(c_script.A)
