# Grasshopper definition Responding_Facade_Real_Version.gh (Grasshopper 1.0.7)
# plug-ins: Bifocals

number_slider = Slider(16000, range=0..100000)
number_slider_2 = Slider(8000, range=0..100000)
number_slider_3 = Slider(40, range=0..100)
number_slider_4 = Slider(20, range=0..100)
c_script = CSharpScript(x=Slider(7, range=0..10), y=Slider(9, range=0..10))  # -> out, A; inputs x: Int32, y: Int32
# ---------- c_script: C# ----------
    //A = x + y;
    //Point3d xyz = new Point3d(x, y, z);
    // A = xyz;

    int z = x + y;
    List<Point3d> points = new List<Point3d>();

    for (int i = 0; i <= z; i++)
    {
      points.Add(new Point3d(x, y, i));
    }
    
    List<Line> lines = new List<Line>(); 
    
    foreach (Point3d item in points)
    {
      Point3d endpoint = new Point3d(item.X + item.Z + 1, item.Y, item.Z); 
      Line thisline = new Line(item, endpoint);
      lines.Add(thisline); 
    }

    A = lines;
# ---------- end c_script ----------
panel = Panel(c_script.A)

rectangle = Rectangle(Plane=PlaneXY(0, 0, 0), XSize=number_slider, YSize=number_slider_2, Radius=0)  # -> Rectangle, Length
mesh_plane = MeshPlane(Boundary=rectangle.Rectangle, WidthCount=number_slider_3, HeightCount=number_slider_4)  # -> Mesh, Area

deconstruct_mesh = DeconstructMesh(Mesh=mesh_plane.Mesh)  # -> Vertices, Faces, Colours, Normals
point = Point([Point(2575.445061, 2243.947803, 0), Point(5360.735709, 6202.817754, 0), Point(9369.939043, 3719.684521, 0), Point(11191.73981, 6132.020294, 0), Point(13182.28694, 1647.813308, 0)])
graft_tree = GraftTree(Tree=deconstruct_mesh.Vertices, IncludeEmptyLists=True, IncludeNullItems=True)
distance = Distance(PointA=graft_tree, PointB=point)
power = Power(A=distance, B=Slider(0.01, range=0..0.1))
one_over_x = OneOverX(Value=power)
mass_addition = MassAddition(Input=one_over_x)  # -> Result, PartialResults

create_grid = CSharpScript(Width=number_slider, Height=number_slider_2, x=number_slider_3, y=number_slider_4)  # -> out, A; inputs Width: Int32, Height: Int32, x: Int32, y: Int32
# ---------- create_grid: C# ----------
    
    Interval xint = new Interval(0, Width);
    Interval yint = new Interval(0, Height); 
    Mesh outputmesh = Mesh.CreateFromPlane(Plane.WorldXY, xint, yint, x, y);
    A = outputmesh;
# ---------- end create_grid ----------
vert_values = CSharpScript(M=create_grid.A, P=point)  # -> out, A; inputs M: Mesh, P: list of Point3d
# ---------- vert_values: C# ----------
    List<double> vertexvalues = new List<double>(); 
    
    //for each vertex in the mesh 
    for (int i = 0; i < M.Vertices.Count; i++)
    {
      Point3d vert = M.Vertices[i];
      double sum = 0;
      
      //for each attactor in the P list
      foreach (Point3d attractor in P)
      {
        double distance = attractor.DistanceTo(vert);
        distance = Math.Pow(distance, 0.01);
        distance = 1 / distance; 
        
        //also possible
        //double distance = 1/(Math.Pow(att.DistanceTo(vert),0.01));
        
        sum += distance;
      }
      
      vertexvalues.Add(sum); 
    }

    A = vertexvalues;
# ---------- end vert_values ----------
comp_vectors = CSharpScript(V=vert_values.A, D=Slider(500, range=0..1000), P=Slider(5, range=0..10))  # -> out, A; inputs V: list of Double, D: Double, P: Double
# ---------- comp_vectors: C# ----------
    //V is vertex values
    //D is Target distance (the longest vector length)
    //P is a sine wave multiplier (sine wave period modifier)

    A = ComputeVectors(V, D, P);
# ---------- comp_vectors: C# additional code ----------
  public List<Vector3d> ComputeVectors(
    List<double> Values,
    double TargetDistance,
    double SineWave
  ) {

    //find the lowest and highest values
    double minv = double.MaxValue;
    int mini = -1;
    double maxv = 0;
    int maxi = 0;

    for (int i = 0; i < Values.Count; i++){
      double thisv = Values[i];

      if(thisv < minv) {
        minv = thisv;
        mini = i;
      }

      if(thisv > maxv) {
        maxv = thisv;
        maxi = i;
      }
    }

    //create a range to remap the values to 0 to 1 domain (normalized parameter)
    Interval range = new Interval(minv, maxv);

    //remap numbers and multiply by the TargetDistance
    for (int i = 0; i < Values.Count; i++)
      Values[i] = TargetDistance * Math.Sin(SineWave * range.NormalizedParameterAt(Values[i]));

    //create a list to store the vectors
    List<Vector3d> vectors = new List<Vector3d>();

    //create the final vectors
    for (int i = 0; i < Values.Count; i++)
      vectors.Add(new Vector3d(Values[i], 0, 0));

    //also possible: 
    //List<Vector3d> vectors = new List<Vector3d>(); 
    //for (int i = 0; i < Values.Count; i++)
    //  vectors.Add(new Vector3d(TargetDistance * Math.Sin(SineWave * range.NormalizedParameterAt(Values[i])), 0, 0));

    return vectors;
  }
# ---------- end comp_vectors ----------
number_slider_5 = Slider(10, range=0..10)
c_script_2 = CSharpScript(M=create_grid.A, V=comp_vectors.A, S=number_slider_5)  # -> out, A; inputs M: Mesh, V: list of Vector3d, S: Int32
# ---------- c_script_2: C# ----------
    Mesh msh = new Mesh(); 
    
    for (int i = 0; i < M.Vertices.Count; i++)
    {
      Point3d vert = M.Vertices[i]; 
      msh.Vertices.Add(vert + V[i]); 
    }
    
    foreach (MeshFace item in M.Faces)
    {
      msh.Faces.AddFace(item); 
    }

    for (int i = 0; i < S; i++)
    {
      msh.Smooth(0.1, true, false, false, false, SmoothingCoordinateSystem.World);
    }
    
    List<Polyline> triangles = new List<Polyline>();
    
    foreach (MeshFace item in msh.Faces)
    {
      Point3d pa = msh.Vertices[item.A];
      Point3d pb = msh.Vertices[item.B];
      Point3d pc = msh.Vertices[item.C];
      Point3d pd = msh.Vertices[item.D];
      
      Polyline poly = new Polyline(); 
      poly.Add(pa); 
      poly.Add(pb); 
      poly.Add((pc+pd)/2);
      poly.Add(pa); 
      
      triangles.Add(poly); 
    }
    
    A = triangles;
# ---------- end c_script_2 ----------

_3 = Integer(3)
multiplication = Multiplication(A=number_slider_3, B=_3)
panel_2 = Panel("""0
-1""")
panel_3 = Panel("""{0;0}
{0;1}
{0;4}""")
_3_2 = Integer(3)
c_script_3 = CSharpScript(M=create_grid.A, V=comp_vectors.A, S=number_slider_5)  # -> out, A, B; inputs M: Mesh, V: list of Vector3d, S: Int32
# ---------- c_script_3: C# ----------
    Mesh msh = new Mesh();



    for (int i = 0; i < M.Vertices.Count; i++)
    {
      Point3d vert = M.Vertices[i];
      msh.Vertices.Add(vert + V[i]);

    }

    foreach (MeshFace item in M.Faces)
    {
      msh.Faces.AddFace(item);
    }

    for (int i = 0; i < S; i++)
    {
      msh.Smooth(0.1, true, false, false, false, SmoothingCoordinateSystem.World);
    }

    List<Polyline> triangles = new List<Polyline>();
    List<Point3d> vertices = new List<Point3d>();

    foreach (MeshFace item in msh.Faces)
    {
      Point3d pa = msh.Vertices[item.A];
      Point3d pb = msh.Vertices[item.B];
      Point3d pc = msh.Vertices[item.C];
      Point3d pd = msh.Vertices[item.D];

      Polyline poly = new Polyline();
      poly.Add(pa);
      poly.Add(pb);
      poly.Add((pc + pd) / 2);
      poly.Add(pa);

      triangles.Add(poly);
      vertices.Add(pa);
      vertices.Add(pb);
      vertices.Add((pc+pd)/2);
      
    }

    A = triangles;
    B = vertices;
# ---------- end c_script_3 ----------
partition_list = PartitionList(List=c_script_3.B, Size=multiplication)
cull_index = CullIndex(List=partition_list, Indices=panel_2, Wrap=True)
relative_item = RelativeItem(Tree=simplify(graft(cull_index)), Offset=panel_3, WrapPaths=False, WrapItems=False)  # -> ItemA, ItemB
split_tree = SplitTree(Data=relative_item.ItemB, Masks=flatten("{?;0,3,...}"))  # -> Positive, Negative
prune_tree = PruneTree(Tree=split_tree.Positive, Minimum=_3_2, Maximum=0)
polyline = PolyLine(Vertices=prune_tree, Closed=invert(False))
surface = Surface(polyline)

flatten_tree = FlattenTree(Tree=mass_addition.Result, Path="{0}")
bounds = Bounds(Numbers=flatten_tree)
remap_numbers = RemapNumbers(Value=mass_addition.Result, Source=bounds, Target=Domain(0, 1))  # -> Mapped, Clipped
graph_mapper = GraphMapper(
    remap_numbers.Mapped,
    x0=0,
    x1=1,
    y0=0,
    y1=1,
    container_name="Sine",
    Equation_px=[0, 0.2880048454],
    Equation_py=[0, 0.982976079])
unit_x = UnitX(Factor=1)
remap_numbers_2 = RemapNumbers(Value=graph_mapper, Source=Domain(0, 1), Target="0 to 500")  # -> Mapped, Clipped
multiplication_2 = Multiplication(A=unit_x, B=remap_numbers_2.Mapped)
deconstruct_vector = DeconstructVector(Vector=multiplication_2)  # -> XComponent, YComponent, ZComponent
vector_xyz = VectorXYZ(XComponent=deconstruct_vector.XComponent, YComponent=0, ZComponent=0)  # -> Vector, Length

move = Move(Geometry=flatten(graft_tree), Motion=comp_vectors.A)  # -> Geometry, Transform
construct_mesh = ConstructMesh(Vertices=move.Geometry, Faces=deconstruct_mesh.Faces)
vb_script = VBScript(x=construct_mesh)  # -> out, A; inputs x: Mesh
# ---------- vb_script: VB ----------
    For i As Integer = 0 To 10
      x.Smooth(0.2, True, False, False, False, SmoothingCoordinateSystem.World)

    Next

    a = x
# ---------- end vb_script ----------

unit_z = UnitZ(Factor=1)
unit_y = UnitY(Factor=1)
xz_plane = XZPlane(Origin=Point(0, 0, 0))
list_item = ListItem(List=flatten(surface), Index=0, Wrap=True)
orient = Orient(Geometry=list_item, Source=PlaneXY(0, 0, 0), Target=xz_plane)  # -> Geometry, Transform
rotate = Rotate(Vector=unit_y, Axis=unit_z, Angle=degrees(Slider(0, range=-45..45)))
negative = Negative(Value=Slider(32, range=0..90))
unit_x_2 = UnitX(Factor=1)
explode = Explode(Curve=orient.Geometry, Recursive=True)  # -> Segments, Vertices
merge = Merge(Data1=Slider(41, range=0..90), Data2=negative)
list_item_2 = ListItem(List=explode.Segments, Index=0, Wrap=True)
rotate_2 = Rotate(Vector=rotate, Axis=unit_x_2, Angle=degrees(merge))
list_item_3 = ListItem(List=explode.Vertices, Index=0, Wrap=True)  # -> Item, Item1, Item2
point_on_curve = PointOnCurve(list_item_2, parameter=0.5)
list_item_4 = ListItem(List=rotate_2, Index=0, Wrap=True)  # -> Item, Item1
line_sdl = LineSDL(Start=list_item_3.Item2, Direction=list_item_4.Item, Length=1)
construct_plane = ConstructPlane(Origin=point_on_curve, XAxis=list_item_2, YAxis=list_item_4.Item1)
line_plane = LinePlane(Line=line_sdl, Plane=construct_plane)  # -> Point, ParamL, ParamP
extrude_point = ExtrudePoint(Base=orient.Geometry, Point=line_plane.Point)

move_2 = Move(Geometry=graft_tree, Motion=vector_xyz.Vector)  # -> Geometry, Transform
flatten_tree_2 = FlattenTree(Tree=move_2.Geometry, Path="{0}")

# ---- group: C# Version (MAYBE WORKING?)
list_item_5 = ListItem(List=flatten(surface), Index=Slider(123, range=0..1000), Wrap=True)
xy_plane = XYPlane(Origin=Point(0, 0, 0))
orient_2 = Orient(Geometry=list_item_5, Source=PlaneXY(0, 0, 0), Target=xy_plane)  # -> Geometry, Transform
negative_2 = Negative(Value=Slider(53, range=0..100))
curve = Curve(orient_2.Geometry)
c_script_4 = CSharpScript(Triangle=curve, TopAngle=negative_2, BottomAngle=Slider(50, range=0..100))  # -> out, A, B, C; inputs Triangle: Polyline, TopAngle: Double, BottomAngle: Double
# ---------- c_script_4: C# ----------
    //find horizontal edge
    Line horizontal = new Line();

    foreach (Line segment in Triangle.GetSegments())
    {
      if(segment.Direction.Z == 0) {
        horizontal = segment;
      }
    }

    //get the plane for intersection
    Plane plane = new Plane(horizontal.PointAt(0.5), Vector3d.XAxis, Vector3d.YAxis);

    //rotate the plane
    double angle1 = Rhino.RhinoMath.ToRadians(TopAngle);
    Transform transform = Transform.Rotation(angle1, plane.XAxis, plane.Origin);
    plane.Transform(transform);

    //find the line for intersection
    double angle2 = Rhino.RhinoMath.ToRadians(BottomAngle);
    Transform transform2 = Transform.Rotation(angle2, plane.XAxis, plane.Origin);
    Vector3d linevector = Vector3d.YAxis;
    linevector.Transform(transform2);

    Point3d origin = new Point3d();

    //find the line origin
    foreach (Point3d pt in Triangle)
    {
      if(horizontal.DistanceTo(pt, false) > 0.001)
        origin = pt;
    }

    Line intersectline = new Line(origin, linevector, 100);

    //find intersection
    double param = 0;
    Rhino.Geometry.Intersect.Intersection.LinePlane(intersectline, plane, out param);
    A = intersectline.PointAt(param);
    B = horizontal;
    C = origin;
# ---------- end c_script_4 ----------
xz_plane_2 = XZPlane(Origin=c_script_4.C)
orient_3 = Orient(Geometry=curve, Source=xz_plane_2, Target=PlaneXY(0, 0, 0))  # -> Geometry, Transform
orient_4 = Orient(Geometry=c_script_4.A, Source=xz_plane_2, Target=PlaneXY(0, 0, 0))  # -> Geometry, Transform
orient_5 = Orient(Geometry=c_script_4.B, Source=xz_plane_2, Target=PlaneXY(0, 0, 0))  # -> Geometry, Transform
number_slider_6 = Slider(63, range=0..100)
geometry = Geometry(orient_5.Geometry)
c_script_5 = CSharpScript(L=geometry, Length=number_slider_6)  # -> out, Polygon, Factor; inputs L: Line, Length: Double
# ---------- c_script_5: C# ----------
    double currentLength = L.Length;
    double scaling = Length / currentLength;

    Factor = scaling;

    Transform scale = Transform.Scale(Point3d.Origin, scaling);

    Line bottomline = new Line(L.From, L.To);
    bottomline.Transform(scale);

    Polyline poly = new Polyline();

    poly.Add(bottomline.To);
    poly.Add(bottomline.From);
    poly.Add(L.From);
    poly.Add(L.To);
    poly.Add(poly.First);

    Polygon = poly;
# ---------- end c_script_5 ----------
c_script_6 = CSharpScript(Triangle=orient_3.Geometry, Tip=orient_4.Geometry)  # -> out, A; inputs Triangle: Polyline, Tip: Point3d
# ---------- c_script_6: C# ----------
    List <Polyline> sides = new List<Polyline>();

    foreach (Line segment in Triangle.GetSegments())
    {
      Vector3d xaxis = segment.To - segment.From;
      Vector3d yaxis = xaxis;
      yaxis.Transform(Transform.Rotation(Math.PI / 2, Point3d.Origin));
      Plane targetplane = new Plane(segment.From, xaxis, yaxis);
      yaxis = Tip - segment.From;
      Plane sourceplane = new Plane(segment.From, xaxis, yaxis);

      Point3d thistip = Tip;
      thistip.Transform(Transform.PlaneToPlane(sourceplane, targetplane));

      Polyline side = new Polyline();

      side.Add(segment.From);
      side.Add(thistip);
      side.Add(segment.To);
      side.Add(side.First);

      sides.Add(side);
    }

    A = sides;
# ---------- end c_script_6 ----------
curve_2 = Curve(c_script_5.Polygon)
number = Number(c_script_5.Factor)
list_item_6 = ListItem(List=c_script_6.A, Index=0, Wrap=True)  # -> Item, Item1, Item2
subtraction = Subtraction(A=Slider(1, range=0..1), B=number)
geometry_2 = Geometry(list_item_6.Item1)
geometry_3 = Geometry(list_item_6.Item2)
number_slider_7 = Slider(15, range=0..100)
geometry_4 = Geometry(list_item_6.Item)
explode_2 = Explode(Curve=geometry_2, Recursive=True)  # -> Segments, Vertices
explode_3 = Explode(Curve=geometry_3, Recursive=True)  # -> Segments, Vertices
list_item_7 = ListItem(List=explode_2.Vertices, Index=0, Wrap=True)
list_item_8 = ListItem(List=explode_3.Vertices, Index=0, Wrap=True)
offset_curve = OffsetCurve(Curve=curve_2, Distance=number_slider_7, Plane=PlaneXY(0, 0, 0), Corners=1)
offset_curve_2 = OffsetCurve(Curve=geometry_4, Distance=number_slider_7, Plane=PlaneXY(0, 0, 0), Corners=1)
scale = Scale(Geometry=geometry_2, Center=list_item_7, Factor=subtraction)  # -> Geometry, Transform
scale_2 = Scale(Geometry=geometry_3, Center=list_item_8, Factor=subtraction)  # -> Geometry, Transform
number_2 = Number(number_slider_6)
explode_4 = Explode(Curve=scale.Geometry, Recursive=True)  # -> Segments, Vertices
explode_5 = Explode(Curve=scale_2.Geometry, Recursive=True)  # -> Segments, Vertices
number_slider_8 = Slider(0.61, range=0..1)
list_item_9 = ListItem(List=explode_4.Vertices, Index="1", Wrap=True)  # -> Item, Item1, Item2, Item3
list_item_10 = ListItem(List=explode_4.Segments, Index=0, Wrap=True)
list_item_11 = ListItem(List=explode_5.Segments, Index="0", Wrap=True)
list_item_12 = ListItem(List=explode_5.Vertices, Index=0, Wrap=True)  # -> Item, Item1, Item2, Item3
flip_curve = FlipCurve(Curve=list_item_11)  # -> Curve, Flag
geometry_5 = Geometry(list_item_12.Item)
geometry_6 = Geometry(list_item_12.Item1)
unit_z_2 = UnitZ(Factor=1)
vector_2pt = Vector2Pt(PointA=geometry_5, PointB=geometry_6, Unitize=geometry_6)  # -> Vector, Length
c_script_7 = CSharpScript(Tip=list_item_9.Item, L=list_item_10, P=number_slider_8)  # -> out, A; inputs Tip: Point3d, L: Line, P: Double
# ---------- c_script_7: C# ----------
    Polyline poly = new Polyline();
    poly.Add(Tip);
    poly.Add(L.From);
    poly.Add(L.PointAt(P));
    poly.Add(poly.First);

    A = poly;
# ---------- end c_script_7 ----------
c_script_8 = CSharpScript(Tip=list_item_12.Item2, L=flip_curve.Curve, P=number_slider_8)  # -> out, A; inputs Tip: Point3d, L: Line, P: Double; same code as c_script_7
number_3 = Number(number_slider_7)
geometry_7 = Geometry(c_script_8.A)
geometry_8 = Geometry(c_script_7.A)
rotate_3 = Rotate(Vector=vector_2pt.Vector, Axis=unit_z_2, Angle="pi/2")
flip_curve_2 = FlipCurve(Curve=geometry_7)  # -> Curve, Flag
number_4 = Number(number_slider_7)
offset_curve_3 = OffsetCurve(Curve=geometry_8, Distance=number_3, Plane=PlaneXY(0, 0, 0), Corners=1)
amplitude = Amplitude(Vector=rotate_3, Amplitude=number_2)
offset_curve_4 = OffsetCurve(Curve=flip_curve_2.Curve, Distance=number_4, Plane=PlaneXY(0, 0, 0), Corners=1)
move_3 = Move(Geometry=geometry_6, Motion=amplitude)  # -> Geometry, Transform
move_4 = Move(Geometry=geometry_5, Motion=amplitude)  # -> Geometry, Transform
merge_2 = Merge(Data1=geometry_5, Data2=move_4.Geometry, Data3=move_3.Geometry, Data4=move_3.Transform)
polyline_2 = PolyLine(Vertices=merge_2, Closed=False)

# ----
construct_mesh_2 = ConstructMesh(Vertices=flatten_tree_2, Faces=deconstruct_mesh.Faces)
vb_script_2 = VBScript(x=construct_mesh_2)  # -> out, A; inputs x: Mesh; same code as vb_script
xz_plane_3 = XZPlane(Origin=line_plane.Point)
xz_plane_4 = XZPlane(Origin=line_plane.Point)
scale_3 = Scale(Geometry=extrude_point, Center=xz_plane_3, Factor=Slider(0.45, range=0..1))  # -> Geometry, Transform
plane_offset = PlaneOffset(BasePlane=xz_plane_4, Offset=Slider(211, range=0..500))
merge_3 = Merge(Data1=extrude_point, Data2=scale_3.Geometry)
unit_y_2 = UnitY(Factor=1)
deconstruct_brep = DeconstructBrep(Brep=merge_3)  # -> Faces, Edges, Vertices
unit_x_3 = UnitX(Factor=1)
list_item_13 = ListItem(List=deconstruct_brep.Vertices, Index=0, Wrap=True)
list_item_14 = ListItem(List=flatten(list_item_13), Index=0, Wrap=True)  # -> Item, Item1
rotate_4 = Rotate(Vector=unit_y_2, Axis=unit_x_3, Angle=degrees(Slider(-12, range=-45..45)))
cull_index_2 = CullIndex(List=deconstruct_brep.Faces, Indices=Slider(0, range=0..3), Wrap=True)
line = Line(StartPoint=list_item_14.Item, EndPoint=list_item_14.Item1)
adjust_plane = AdjustPlane(Plane=plane_offset, Normal=rotate_4)
explode_tree = ExplodeTree(Data=cull_index_2)  # -> _0000, _0010
length = Length(Curve=line)
simple_mesh = SimpleMesh(Brep=explode_tree._0000)
mesh_split_plane = MeshSplitPlane(Mesh=simple_mesh, Plane=adjust_plane)  # -> Above, Below
face_boundaries = FaceBoundaries(Mesh=mesh_split_plane.Above)
md_slider = MDSlider(SliderMode=0, slider_value=Point(0.5, 0.5, 0.5), x_domain=Domain(0, 1), y_domain=Domain(0, 1), z_domain=Domain(0, 1))
boundary_surfaces = BoundarySurfaces(Edges=face_boundaries)
evaluate_surface = EvaluateSurface(Surface=reparameterize(explode_tree._0010), Point=md_slider)  # -> Point, Normal, UDirection, VDirection, Frame
offset_on_srf = OffsetOnSrf(Curve=face_boundaries, Distance=Slider(24, range=0..1000), Surface=boundary_surfaces)
brep_join = BrepJoin(Breps=explode_tree._0000)  # -> Breps, Closed
plane_surface = PlaneSurface(Plane=adjust_plane, XSize="-500 to 500", YSize="-500 to 500")
scale_4 = Scale(Geometry=explode_tree._0000, Center=evaluate_surface.Frame, Factor=Slider(0.68, range=0..1))  # -> Geometry, Transform
split_brep = SplitBrep(Brep=brep_join.Breps, Cutter=plane_surface)
remap_numbers_3 = RemapNumbers(Value=Slider(0, range=0..1), Source=Domain(0, 1), Target=length)  # -> Mapped, Clipped
amplitude_2 = Amplitude(Vector=line, Amplitude=remap_numbers_3.Mapped)
reverse = Reverse(Vector=amplitude_2)
move_5 = Move(Geometry=scale_3.Geometry, Motion=reverse)  # -> Geometry, Transform
list_item_15 = ListItem(List=split_brep, Index=0, Wrap=True)
number_slider_9 = Slider(38, range=0..1000)
deconstruct_brep_2 = DeconstructBrep(Brep=list_item_15)  # -> Faces, Edges, Vertices
negative_3 = Negative(Value=number_slider_9)
merge_4 = Merge(Data1=number_slider_9, Data2=negative_3)
offset_curve_5 = OffsetCurve(Curve=graft(deconstruct_brep_2.Faces), Distance=merge_4, Plane=PlaneXY(0, 0, 0), Corners=1)
trim_tree = TrimTree(Tree=offset_curve_5, Depth=1)
length_2 = Length(Curve=trim_tree)
sort_list = SortList(Keys=length_2, ValuesValuesA=trim_tree)  # -> Keys, ValuesValuesA
list_item_16 = ListItem(List=sort_list.ValuesValuesA, Index=0, Wrap=True)
c_script_9 = CSharpScript(Gap=Slider(30, range=0..100))  # -> out, A; inputs C: list of Curve, Gap: Double
# ---------- c_script_9: C# ----------
    double maxw = 0;
    double maxh = 0;

    foreach (Curve crv in C)
    {
      BoundingBox = crv.GetBoundingBox ( false );
      bb.Inflate(Gap / 2);
      maxw = Math.Max ( bb.Diagonal.X, maxw );
      maxh = Math.Max ( bb.Diagonal.Y, maxh );
    }

    int rows =  ( int ) Math.Ceiling(Math.Sqrt (C.Count));
    int cnt = 0;
    
    List < Transform >  trans = new List  < Transform > ( );
    
    for (int i = 0;  i < rows;  i++);
    {
      for(int j  = 0 ; j < rows; j++)
      {
        Print(i.ToString ( ) + " " + j.ToString ( ) );
        double x =  j * maxw;
        double y =  i * maxh;
        
        BoundingBox bb = C [ cnt ].GetBoundingBox ( false );
        Vector3d = new Point3d ( x,  y,  0 ) - bb.Min;
        
        trans.Add ( Transform.Translation( vec ) );
        
        cnt += 1;
        if (cnt  ==  C.Count) break;
        
      }
       if  ( cnt  ==  C.Count ) break;
    }
    
    A = trans;
# ---------- end c_script_9 ----------

list_item_17 = ListItem(List=flatten(surface), Index=Slider(123, range=0..1000), Wrap=True)
xz_plane_5 = XZPlane(Origin=Point(0, 0, 0))
unit_y_3 = UnitY(Factor=1)
unit_z_3 = UnitZ(Factor=1)
curve_3 = Curve(list_item_17)
orient_6 = Orient(Geometry=curve_3, Source=PlaneXY(0, 0, 0), Target=xz_plane_5)  # -> Geometry, Transform
negative_4 = Negative(Value=Slider(34, range=0..90))
rotate_5 = Rotate(Vector=unit_y_3, Axis=unit_z_3, Angle=degrees(Slider(0, range=-45..45)))
explode_6 = Explode(Curve=orient_6.Geometry, Recursive=True)  # -> Segments, Vertices
merge_5 = Merge(Data1=Slider(31, range=0..90), Data2=negative_4)
unit_x_4 = UnitX(Factor=1)
curve_4 = Curve(orient_6.Geometry)
negative_5 = Negative(Value=Slider(41, range=0..100))
list_item_18 = ListItem(List=explode_6.Segments, Index=0, Wrap=True)
rotate_6 = Rotate(Vector=rotate_5, Axis=unit_x_4, Angle=degrees(merge_5))
list_item_19 = ListItem(List=explode_6.Vertices, Index=0, Wrap=True)  # -> Item, Item1, Item2
point_on_curve_2 = PointOnCurve(list_item_18, parameter=0.5)
c_script_10 = CSharpScript(TopAngle=negative_5, Triangle=curve_4, BottomAngle=Slider(57, range=0..100))  # -> out, A, B, C; inputs TopAngle: Double, Triangle: Polyline, BottomAngle: Double
# ---------- c_script_10: C# ----------
    // find horizontal edge
    Line horizontal = new Line ();
    foreach (Line segment in Triangle.GetSegments() )
    {
      if ( segment.Direction.Z == 0) {
        horizontal = segment;
      }
    }

    // get the plane for intersection
    Plane plane = new Plane (horizontal.PointAt(0.5), Vector3d.XAxis, Vector3d.YAxis);

    //rotate the plane
    double angle1 = Rhino.RhinoMath.ToRadians(TopAngle);
    Transform transform = Transform.Rotation(angle1, plane.XAxis, plane.Origin);
    plane.Transform(transform);

    //find the line for intersection
    double angle2 = Rhino.RhinoMath.ToRadians(BottomAngle);
    Transform transform2 = Transform.Rotation(angle2, plane.XAxis, plane.Origin);
    Vector3d linevector = Vector3d.YAxis;
    linevector.Transform(transform2);

    Point3d origin = new Point3d();

    //find the line origin
    foreach (Point3d pt in Triangle)
    {
      if (horizontal.DistanceTo(pt, false) > 0.001)
        origin = pt;
    }

    Line intersectline = new Line (origin, linevector, 100);

    // find the intersection
    double param = 0;
    Rhino.Geometry.Intersect.Intersection.LinePlane(intersectline, plane, out param);
    
    A = intersectline.PointAt(param);
    B = horizontal;
    C = origin;
# ---------- end c_script_10 ----------
list_item_20 = ListItem(List=rotate_6, Index=0, Wrap=True)  # -> Item, Item1
xz_plane_6 = XZPlane(Origin=c_script_10.C)
line_sdl_2 = LineSDL(Start=list_item_19.Item2, Direction=list_item_20.Item, Length=1)
construct_plane_2 = ConstructPlane(Origin=point_on_curve_2, XAxis=list_item_18, YAxis=list_item_20.Item1)
orient_7 = Orient(Geometry=c_script_10.B, Source=xz_plane_6, Target=PlaneXY(0, 0, 0))  # -> Geometry, Transform
orient_8 = Orient(Geometry=curve_4, Source=c_script_10.A, Target=PlaneXY(0, 0, 0))  # -> Geometry, Transform
line_plane_2 = LinePlane(Line=line_sdl_2, Plane=construct_plane_2)  # -> Point, ParamL, ParamP
orient_9 = Orient(Geometry=c_script_10.A, Source=xz_plane_6, Target=PlaneXY(0, 0, 0))  # -> Geometry, Transform
geometry_9 = Geometry(orient_7.Geometry)
number_slider_10 = Slider(50, range=0..100)
extrude_point_2 = ExtrudePoint(Base=orient_6.Geometry, Point=line_plane_2.Point)
length_3 = Length(Curve=geometry_9)
explode_7 = Explode(Curve=orient_8.Geometry, Recursive=True)  # -> Segments, Vertices
unit_z_4 = UnitZ(Factor=1)
division = Division(A=number_slider_10, B=length_3)
end_points = EndPoints(Curve=explode_7.Segments)  # -> Start, End
scale_5 = Scale(Geometry=geometry_9, Center=Point(0, 0, 0), Factor=division)  # -> Geometry, Transform
rotate_7 = Rotate(Vector=orient_8.Geometry, Axis=unit_z_4, Angle="pi/2")
end_points_2 = EndPoints(Curve=geometry_9)  # -> Start, End
c_script_11 = CSharpScript(L=geometry_9, Length=number_slider_10)  # -> out, Polygon, Factor; inputs L: Line, Length: Double
# ---------- c_script_11: C# ----------
    {


      double currentLength = L.Length;
      double scaling = Length / currentLength;

      Factor = scaling;

      Transform scale = Transform.Scale(Point3d.Origin, scaling);

      Line bottomline = new Line(L.From, L.To);
      bottomline.Transform(scale);

      Polyline poly = new Polyline();

      poly.Add(bottomline.To);
      poly.Add(bottomline.From);
      poly.Add(L.From);
      poly.Add(L.To);
      poly.Add(poly.First);

      Polygon = poly;
    }
# ---------- end c_script_11 ----------
end_points_3 = EndPoints(Curve=scale_5.Geometry)  # -> Start, End
merge_6 = Merge(Data1=end_points_2.Start, Data2=end_points_2.End, Data3=end_points_3.End, Data4=end_points_3.Start)
polyline_3 = PolyLine(Vertices=merge_6, Closed=False)
geometry_10 = Geometry(polyline_3)
offset_curve_6 = OffsetCurve(Curve=geometry_10, Distance=Slider(15, range=0..100), Plane=PlaneXY(0, 0, 0), Corners=1)
c_script_12 = CSharpScript()  # -> out, A; inputs Triangle: Polyline, Tip: Point3d
# ---------- c_script_12: C# ----------
    List <Polyline> sides = new List <Polyline> ( );
    
    foreach (Line segment in Triangle.GetSegments( ) )
    {
      Vector3d xaxis = segment.To - segment.From;
      Vector3d yaxis = xaxis;
      
      yaxis.Transform (Transform.Rotation (Math.PI/2, Point3d.Origin ) );
      
      Plane targetplane = new Plane (segment.From, xaxis, yaxis);
      
      yaxis = Tip - segment.From;
      
      Plane sourceplane = new Plane (segment.From, xaxis, yaxis);
      
      Point thistip = Tip;
      thistip.Transform (Transform.PlaneToPlane (sourceplane, targetplane) );
      
      Polyline side = new Polyline();
      
      side.Add(segment.From);
      side.Add( thistip );
      side.Add(segment.To);
      side.Add(side.First);
      
      sides.Add(side);
      
    }
    
    A =  sides;
# ---------- end c_script_12 ----------
offset = Number(offset_curve_6)
offset_curve_7 = OffsetCurve(Curve=geometry_10, Distance=offset, Plane=PlaneXY(0, 0, 0), Corners=1)
division_2 = Number(division)
xy_plane_2 = XYPlane(Origin=Point(0, 0, 0))
xy_plane_3 = XYPlane(Origin=Point(0, 0, 0))
number_slider_11 = Slider(0.622, range=0..1)
offset_2 = Number(offset_curve_6)
offset_3 = Number(offset_curve_6)

# ---- group: Orient
plane_3pt = Plane3Pt(PointA=end_points.Start, PointB=end_points.End, PointC=orient_9.Geometry)
construct_plane_3 = ConstructPlane(Origin=end_points.Start, XAxis=explode_7.Segments, YAxis=rotate_7)
orient_10 = Orient(Geometry=orient_9.Geometry, Source=plane_3pt, Target=construct_plane_3)  # -> Geometry, Transform
graft_tree_2 = GraftTree(Tree=end_points.Start, IncludeEmptyLists=True, IncludeNullItems=True)
graft_tree_3 = GraftTree(Tree=end_points.End, IncludeEmptyLists=True, IncludeNullItems=True)
graft_tree_4 = GraftTree(Tree=orient_10.Geometry, IncludeEmptyLists=True, IncludeNullItems=True)
merge_7 = Merge(Data1=graft_tree_2, Data2=graft_tree_3, Data3=graft_tree_4)
polyline_4 = PolyLine(Vertices=merge_7, Closed=True)
curve_5 = Curve(orient_8.Geometry)
offset_curve_8 = OffsetCurve(Curve=curve_5, Distance=Slider(13, range=0..100), Plane=PlaneXY(0, 0, 0), Corners=1)

# ----
flatten_tree_3 = FlattenTree(Tree=polyline_4, Path="{0}")
list_item_21 = ListItem(List=flatten_tree_3, Index=0, Wrap=True)
geometry_11 = Geometry(list_item_21)
geometry_12 = Geometry(list_item_21)
explode_8 = Explode(Curve=geometry_11, Recursive=True)  # -> Segments, Vertices
explode_9 = Explode(Curve=geometry_12, Recursive=True)  # -> Segments, Vertices
scale_6 = Scale(Geometry=geometry_11, Center=Point(0, 0, 0), Factor=division_2)  # -> Geometry, Transform
scale_7 = Scale(Geometry=geometry_12, Center=Point(0, 0, 0), Factor=division_2)  # -> Geometry, Transform
list_item_22 = ListItem(List=explode_8.Segments, Index="0", Wrap=True)
list_item_23 = ListItem(List=explode_9.Segments, Index="1", Wrap=True)
region_difference = RegionDifference(CurvesA=geometry_12, CurvesB=scale_7.Geometry, Plane=xy_plane_3)
region_difference_2 = RegionDifference(CurvesA=geometry_11, CurvesB=scale_6.Geometry, Plane=xy_plane_2)
flip_curve_3 = FlipCurve(Curve=list_item_23)  # -> Curve, Flag
list_item_24 = ListItem(List=explode_8.Vertices, Index=0, Wrap=True)  # -> Item, Item1, Item2, Item3
list_item_25 = ListItem(List=explode_9.Vertices, Index=0, Wrap=True)  # -> Item, Item1, Item2, Item3
evaluate_curve = EvaluateCurve(Curve=reparameterize(list_item_22), Parameter=number_slider_11)  # -> Point, Tangent, Angle
evaluate_curve_2 = EvaluateCurve(Curve=reparameterize(flip_curve_3.Curve), Parameter=number_slider_11)  # -> Point, Tangent, Angle
geometry_13 = Geometry(list_item_24.Item)
merge_8 = Merge(Data1=evaluate_curve.Point, Data2=list_item_24.Item1, Data3=list_item_24.Item2)
merge_9 = Merge(Data1=evaluate_curve_2.Point, Data2=list_item_25.Item1, Data3=list_item_25.Item2)
c_script_13 = CSharpScript(Tip=geometry_13)  # -> out, A; inputs Tip: Point3d, L: Line, P: Double; same code as c_script_7
polyline_5 = PolyLine(Vertices=merge_8, Closed=False)
polyline_6 = PolyLine(Vertices=merge_9, Closed=False)
geometry_14 = Geometry(polyline_5)
geometry_15 = Geometry(polyline_6)
offset_curve_9 = OffsetCurve(Curve=geometry_14, Distance=offset_2, Plane=PlaneXY(0, 0, 0), Corners=1)
offset_curve_10 = OffsetCurve(Curve=geometry_15, Distance=offset_3, Plane=PlaneXY(0, 0, 0), Corners=1)
