# Grasshopper definition Responsive_Facade.gh (Grasshopper 1.0.7)
# plug-ins: Bifocals

number_slider = Slider(8000, range=0..10000)
number_slider_2 = Slider(16000, range=0..100000)
number_slider_3 = Slider(51, range=0..100)
number_slider_4 = Slider(20, range=0..100)
rectangle = Rectangle(Plane=PlaneXY(0, 0, 0), XSize=number_slider_2, YSize=number_slider, Radius=0)  # -> Rectangle, Length
mesh_plane = MeshPlane(Boundary=rectangle.Rectangle, WidthCount=number_slider_3, HeightCount=number_slider_4)  # -> Mesh, Area
c_script = CSharpScript(Width=number_slider_2, Height=number_slider, x=number_slider_3, y=number_slider_4)  # -> out, A; inputs Width: Int32, Height: Int32, x: Int32, y: Int32
# ---------- c_script: C# ----------
    Interval xint = new Interval ( 0, Width);
    Interval yint = new Interval ( 0,  Height );
    Mesh outputmesh = Mesh.CreateFromPlane (Plane.WorldXY, xint, yint, x, y);
    A = outputmesh;
# ---------- end c_script ----------
point = Point([Point(3185, 2420, 0), Point(6013, 5547.577925, 0), Point(7601, 2378, 0), Point(10870, 4964.484799, 0), Point(12751, 1980, 0)])
deconstruct_mesh = DeconstructMesh(Mesh=mesh_plane.Mesh)  # -> Vertices, Faces, Colours, Normals
c_script_2 = CSharpScript(Mesh=c_script.A, P=point)  # -> out, A; inputs Mesh: Mesh, P: list
# ---------- c_script_2: C# ----------
    List < double > vertexvalues  new < ouble  >  );
    // for each vertex in the mesh
    for ( int ; i < M.Vertices.Count; i++>);
    //for each attractor in the P list
    {
      
      Point3d vert = M.Vertices[i];
      double sum = 0;
      foreach (Point3d attractor in P)
      {
        double distance = attractor.DistanceTo(vert);
        distance = Math.Pow(distance, 0.01);
        distance = 1 / distance;
        sume += ;
      }
      vertexvalues.Add(sum);
    }
    A = vertexvalues;
    
    // also possible in one line:
    //double distance = 1/ (Math.Pow (att. DistanceTo(vert), 0.01))
# ---------- end c_script_2 ----------
c_script_3 = CSharpScript(P=Slider(500, range=0..1000), D=Slider(5000, range=0..10000))  # -> out, A; inputs P: Double, D: Double
# ---------- c_script_3: C# additional code ----------
  public List <Vector3d> ComputeVectors(
  List<double>Values,
  double TargetDistance,
  double Sinewave
  ){
    double minv = double.MaxValue;
    int mini = -1;
    
    double maxv = 0;
    int maxi = 0;
    
    for (int i = 0; i < Values.Count; i++)
    {
      double thisv = Values[i];
      
      if (this < minv){
        maxv = thisv;
        maxi = i;
      }
    } 
    Print(maxv.ToString());
    Print(minv.ToString());
    // Craete a range to remao the values to 0 to 1 domain (normalized parameter)
    Interval range = new Interval(minv, maxv);
    //remap numbers and multiply by the TargetDistance
    for (int i = 0; i< Values.Count; i++)
      Values[i] = Math.Sin(SineWave * range.NormalizedParameterAt(Values[i]));
# ---------- end c_script_3 ----------
graft_tree = GraftTree(Tree=deconstruct_mesh.Vertices, IncludeEmptyLists=True, IncludeNullItems=True)
c_script_4 = CSharpScript(M=c_script_2.A, V=c_script_3.A, S=Slider(10, range=0..10))  # -> out, A; inputs M: Mesh, S: Int32
# ---------- c_script_4: C# ----------
    Mesh msh = new Mesh ();

    for ( int i = 0;  i < M.Vertices.Count; i++)
    {
      Point3d vert = M.Vertices[i];
      msh.Vertices.Add(vert + V[i]);
    }

    foreach (MeshFace item in M.Faces)
    {
      msh.Faces.AddFace(item);
    }
    for (int i = 0; i < S; i++)
    {
      msh.Smooth(0.1, true, false, false, false, SmoothingCoordinateSystem.World);
    }

    List<Polyline> triangels = new List <Polyline>();

    foreach (MeshFace item in msh.Faces)
    {
      Point3d pa = msh.Vertices[item.A];
      Point3d pb = msh.Vertices[item.B];
      Point3d pc = msh.Vertices[item.C];
      Point3d pd = msh.Vertices[item.D];

      Polyline poly = new Polyline ();
      poly.Add(pa);
      poly.Add(pb);
      poly.Add((pc + pd) / 2);
      poly.Add(pa);

      triangles.Add(poly);

    }
    A = triangles;
# ---------- end c_script_4 ----------
distance = Distance(PointA=graft_tree, PointB=point)
vector_2pt = Vector2Pt(PointA=graft_tree, PointB=point, Unitize=False)  # -> Vector, Length
power = Power(A=distance, B=Slider(0.309, range=0..10))
unit_vector = UnitVector(Vector=vector_2pt.Vector)
one_over_x = OneOverX(Value=power)
multiplication = Multiplication(A=one_over_x, B=unit_vector)
mass_addition = MassAddition(Input=one_over_x)  # -> Result, PartialResults
unit_x = UnitX(Factor=1)
unit_z = UnitZ(Factor=1)
flatten_tree = FlattenTree(Tree=mass_addition.Result, Path="{0}")
multiplication_2 = Multiplication(A=mass_addition.Result, B=Slider(28.621, range=0..100))
bounds = Bounds(Numbers=flatten_tree)
rotate = Rotate(Vector=unit_x, Axis=unit_z, Angle=multiplication_2)
remap_numbers = RemapNumbers(Value=mass_addition.Result, Source=bounds, Target="0 to 500")  # -> Mapped, Clipped
graph_mapper = GraphMapper(remap_numbers.Mapped, x0=0, x1=1, y0=0, y1=1, container_name="Sine", Equation_px=[0, 1], Equation_py=[0, 0.6762319803])
remap_numbers_2 = RemapNumbers(Value=graph_mapper, Source=Domain(0, 1), Target="0 to 500")  # -> Mapped, Clipped
unit_x_2 = UnitX(Factor=1)
multiplication_3 = Multiplication(A=unit_x_2, B=remap_numbers_2.Mapped)
deconstruct_vector = DeconstructVector(Vector=multiplication_3)  # -> XComponent, YComponent, ZComponent
vector_xyz = VectorXYZ(XComponent=deconstruct_vector.XComponent, YComponent=0, ZComponent=0)  # -> Vector, Length
move = Move(Geometry=graft_tree, Motion=vector_xyz.Vector)  # -> Geometry, Transform
flatten_tree_2 = FlattenTree(Tree=move.Geometry, Path="{0}")
construct_mesh = ConstructMesh(Vertices=flatten(flatten_tree_2), Faces=deconstruct_mesh.Faces)
vb_script = VBScript(Y=construct_mesh)  # -> Out, A
