# Grasshopper definition While_Loops.gh (Grasshopper 1.0.7)

c_script = CSharpScript(num=Slider(3, range=0..10))  # -> out, A; inputs num: Int32
# ---------- c_script: C# ----------
    List<int> numbers = new List <int>();
    while (num <= 10 && (num+2)<11){
      num += 2;
      numbers.Add(num);
    }
    A = numbers;
# ---------- end c_script ----------
panel = Panel(c_script.A)
