# Grasshopper definition Official_Chernobyl.gh (Grasshopper 1.0.7)
# plug-ins: TopologicGH, SAM

# ---- group: Left Wing
construct_point = ConstructPoint(
    XCoordinate=Slider(0, range=-100..100),
    YCoordinate=Slider(0, range=-100..100),
    ZCoordinate=Slider(-6.2, range=-100..100))
construct_point_2 = ConstructPoint(XCoordinate=Slider(51, range=-100..100), YCoordinate=0, ZCoordinate=Slider(32.7, range=-100..100))
box_2pt = Box2Pt(PointA=construct_point, PointB=construct_point_2, Plane=PlaneXY(0, 0, 0))
brep = Brep(box_2pt)
box_rectangle = BoxRectangle(Rectangle=brep, Height=Slider(11, range=0..100))

# ---- group: Middle Wing
construct_point_3 = ConstructPoint(XCoordinate=Slider(70, range=-100..100), YCoordinate=Slider(0, range=-100..100), ZCoordinate=Slider(0, range=-100..100))
construct_point_4 = ConstructPoint(XCoordinate=Slider(143.45, range=-100..300), YCoordinate=0, ZCoordinate=Slider(49.6, range=-100..100))
box_2pt_2 = Box2Pt(PointA=construct_point_3, PointB=construct_point_4, Plane=PlaneXY(0, 0, 0))
brep_2 = Brep(box_2pt_2)
box_rectangle_2 = BoxRectangle(Rectangle=brep_2, Height=Slider(22, range=0..30))

# ---- group: Right compound
construct_point_5 = ConstructPoint(XCoordinate=Slider(225, range=-100..300), YCoordinate=Slider(0, range=-100..100), ZCoordinate=Slider(0, range=-100..100))
construct_point_6 = ConstructPoint(XCoordinate=Slider(143.45, range=-100..300), YCoordinate=0, ZCoordinate=Slider(26.5, range=-100..100))
box_2pt_3 = Box2Pt(PointA=construct_point_5, PointB=construct_point_6, Plane=PlaneXY(0, 0, 0))
brep_3 = Brep(box_2pt_3)
box_rectangle_3 = BoxRectangle(Rectangle=brep_3, Height=Slider(11, range=0..30))

# ---- group: Last part of the right compound
construct_point_7 = ConstructPoint(
    XCoordinate=Slider(191.45, range=-100..300),
    YCoordinate=Slider(0, range=-100..100),
    ZCoordinate=Slider(0, range=-100..100))
construct_point_8 = ConstructPoint(XCoordinate=Slider(184.28, range=-100..300), YCoordinate=0, ZCoordinate=Slider(-1.5, range=-100..100))
box_2pt_4 = Box2Pt(PointA=construct_point_7, PointB=construct_point_8, Plane=PlaneXY(0, 0, 0))
brep_4 = Brep(box_2pt_4)
box_rectangle_4 = BoxRectangle(Rectangle=brep_4, Height=Slider(5, range=0..30))

# ---- group: Next to Middle Wing part with triangle
construct_point_9 = ConstructPoint(
    XCoordinate=Slider(64, range=-100..100),
    YCoordinate=Slider(0, range=-100..100),
    ZCoordinate=Slider(-6.2, range=-100..100))
construct_point_10 = ConstructPoint(XCoordinate=Slider(70, range=-100..100), YCoordinate=0, ZCoordinate=Slider(37.9, range=-100..100))
box_2pt_5 = Box2Pt(PointA=construct_point_9, PointB=construct_point_10, Plane=PlaneXY(0, 0, 0))
brep_5 = Brep(box_2pt_5)
box_rectangle_5 = BoxRectangle(Rectangle=brep_5, Height=Slider(23, range=0..30))

# ---- group: Top Part
construct_point_11 = ConstructPoint(
    XCoordinate=Slider(96.89, range=-100..300),
    YCoordinate=Slider(0, range=-100..100),
    ZCoordinate=Slider(49.6, range=-100..100))
construct_point_12 = ConstructPoint(XCoordinate=Slider(118.01, range=-100..300), YCoordinate=0, ZCoordinate=Slider(71.5, range=-100..100))
box_2pt_6 = Box2Pt(PointA=construct_point_11, PointB=construct_point_12, Plane=PlaneXY(0, 0, 0))
brep_6 = Brep(box_2pt_6)
box_rectangle_6 = BoxRectangle(Rectangle=brep_6, Height=Slider(17, range=0..30))

# ---- group: Part of the downer right compound
construct_point_13 = ConstructPoint(
    XCoordinate=Slider(174.3, range=-100..300),
    YCoordinate=Slider(0, range=-100..100),
    ZCoordinate=Slider(0, range=-100..100))
construct_point_14 = ConstructPoint(XCoordinate=Slider(184.28, range=-100..300), YCoordinate=0, ZCoordinate=Slider(-4, range=-100..100))
box_2pt_7 = Box2Pt(PointA=construct_point_13, PointB=construct_point_14, Plane=PlaneXY(0, 0, 0))
brep_7 = Brep(box_2pt_7)
box_rectangle_7 = BoxRectangle(Rectangle=brep_7, Height=Slider(5, range=0..30))

# ---- group: Compound on the Left Wing
construct_point_15 = ConstructPoint(XCoordinate=Slider(37, range=-100..100), YCoordinate=Slider(0, range=-100..100), ZCoordinate=Slider(0, range=-100..100))
construct_point_16 = ConstructPoint(XCoordinate=Slider(51, range=-100..100), YCoordinate=0, ZCoordinate=Slider(10, range=-100..100))
box_2pt_8 = Box2Pt(PointA=construct_point_15, PointB=construct_point_16, Plane=PlaneXY(0, 0, 0))
brep_8 = Brep(box_2pt_8)
box_rectangle_8 = BoxRectangle(Rectangle=brep_8, Height=Slider(21, range=0..100))

# ---- group: The compound on the Right Wing, which is closest to the viewer
construct_point_17 = ConstructPoint(
    XCoordinate=Slider(191.45, range=-100..300),
    YCoordinate=Slider(0, range=-100..100),
    ZCoordinate=Slider(0, range=-100..100))
construct_point_18 = ConstructPoint(XCoordinate=Slider(128.39, range=-100..300), YCoordinate=0, ZCoordinate=Slider(13.971, range=-100..100))
box_2pt_9 = Box2Pt(PointA=construct_point_17, PointB=construct_point_18, Plane=PlaneXY(0, 0, 0))
brep_9 = Brep(box_2pt_9)
box_rectangle_9 = BoxRectangle(Rectangle=brep_9, Height=Slider(45, range=0..100))

# ---- group: Downer Compound in the middle of the Middle Wing
construct_point_19 = ConstructPoint(
    XCoordinate=Slider(85.45, range=-100..300),
    YCoordinate=Slider(0, range=-100..100),
    ZCoordinate=Slider(16.35, range=-100..100))
construct_point_20 = ConstructPoint(XCoordinate=Slider(128.45, range=-100..300), YCoordinate=0, ZCoordinate=Slider(0, range=-100..100))
box_2pt_10 = Box2Pt(PointA=construct_point_19, PointB=construct_point_20, Plane=PlaneXY(0, 0, 0))
brep_10 = Brep(box_2pt_10)
box_rectangle_10 = BoxRectangle(Rectangle=brep_10, Height=Slider(53, range=0..100))

# ---- group: Compound on the Right Wing, which is furthest from the viewer.
construct_point_21 = ConstructPoint(
    XCoordinate=Slider(182.592, range=-100..300),
    YCoordinate=Slider(0, range=-100..100),
    ZCoordinate=Slider(0, range=-100..100))
construct_point_22 = ConstructPoint(XCoordinate=Slider(123.961, range=-100..300), YCoordinate=0, ZCoordinate=Slider(17, range=-100..100))
box_2pt_11 = Box2Pt(PointA=construct_point_21, PointB=construct_point_22, Plane=PlaneXY(0, 0, 0))
brep_11 = Brep(box_2pt_11)
box_rectangle_11 = BoxRectangle(Rectangle=brep_11, Height=Slider(39, range=0..100))

# ---- group: Compound in the middle of the Middle Wing
construct_point_23 = ConstructPoint(
    XCoordinate=Slider(91.45, range=-100..300),
    YCoordinate=Slider(0, range=-100..100),
    ZCoordinate=Slider(49.6, range=-100..100))
construct_point_24 = ConstructPoint(XCoordinate=Slider(123.45, range=-100..300), YCoordinate=0, ZCoordinate=Slider(0, range=-100..100))
box_2pt_12 = Box2Pt(PointA=construct_point_23, PointB=construct_point_24, Plane=PlaneXY(0, 0, 0))
brep_12 = Brep(box_2pt_12)
box_rectangle_12 = BoxRectangle(Rectangle=brep_12, Height=Slider(34, range=0..100))

# ---- group: Middle Left Wing
construct_point_25 = ConstructPoint(
    XCoordinate=Slider(51, range=-100..100),
    YCoordinate=Slider(0, range=-100..100),
    ZCoordinate=Slider(-6.2, range=-100..100))
construct_point_26 = ConstructPoint(XCoordinate=Slider(64, range=-100..100), YCoordinate=0, ZCoordinate=Slider(37.9, range=-100..100))
box_2pt_13 = Box2Pt(PointA=construct_point_25, PointB=construct_point_26, Plane=PlaneXY(0, 0, 0))
brep_13 = Brep(box_2pt_13)
box_rectangle_13 = BoxRectangle(Rectangle=brep_13, Height=Slider(15, range=0..100))

# ----
xy_plane = XYPlane(Origin=Point(0, 0, 0))
xz_plane = XZPlane(Origin=Point(0, 0, 0))
rotate = Rotate(Geometry=xy_plane, Angle=degrees(Slider(141, range=0..300)), Plane=xz_plane)  # -> Geometry, Transform
unit_x = UnitX(Factor=Slider(146, range=0..300))
plane_surface = PlaneSurface(Plane=rotate.Geometry, XSize=Domain(-10, 10), YSize=Domain(-10, 10))
move = Move(Geometry=plane_surface, Motion=unit_x)  # -> Geometry, Transform
unit_z = UnitZ(Factor=Slider(-2, range=-10..10))
move_2 = Move(Geometry=move.Geometry, Motion=unit_z)  # -> Geometry, Transform

# ---- group: Cutter
xy_plane_2 = XYPlane(Origin=Point(0, 0, 0))
xz_plane_2 = XZPlane(Origin=Point(0, 0, 0))
rotate_2 = Rotate(Geometry=xy_plane_2, Angle=degrees(Slider(31, range=0..100)), Plane=xz_plane_2)  # -> Geometry, Transform
unit_x_2 = UnitX(Factor=Slider(77, range=0..100))
plane_surface_2 = PlaneSurface(Plane=rotate_2.Geometry, XSize=Domain(-10, 10), YSize=Domain(-10, 10))
move_3 = Move(Geometry=plane_surface_2, Motion=unit_x_2)  # -> Geometry, Transform
unit_z_2 = UnitZ(Factor=Slider(-2, range=-10..10))
move_4 = Move(Geometry=move_3.Geometry, Motion=unit_z_2)  # -> Geometry, Transform

# ----
merge = Merge(Data1=box_rectangle_8, Data2=box_rectangle_12, Data3=box_rectangle_10, Data4=box_rectangle_9, Data5=box_rectangle_11)

# ---- group: 2/5 of Downer Right Wing
construct_point_27 = ConstructPoint(
    XCoordinate=Slider(174.3, range=-100..300),
    YCoordinate=Slider(0, range=-100..100),
    ZCoordinate=Slider(0, range=-100..100))
construct_point_28 = ConstructPoint(XCoordinate=Slider(143.45, range=-100..300), YCoordinate=0, ZCoordinate=Slider(-6.2, range=-100..100))
box_2pt_14 = Box2Pt(PointA=construct_point_27, PointB=construct_point_28, Plane=PlaneXY(0, 0, 0))

# ---- group: Rectangle to be cut
construct_point_29 = ConstructPoint(
    XCoordinate=Slider(70, range=-100..300),
    YCoordinate=Slider(0, range=-100..100),
    ZCoordinate=Slider(-6.2, range=-100..100))
construct_point_30 = ConstructPoint(XCoordinate=Slider(80.4, range=-100..300), YCoordinate=0, ZCoordinate=Slider(0, range=-100..100))
box_2pt_15 = Box2Pt(PointA=construct_point_29, PointB=construct_point_30, Plane=PlaneXY(0, 0, 0))

# ----
merge_2 = Merge(
    Data1=box_rectangle,
    Data2=box_rectangle_13,
    Data3=box_rectangle_5,
    Data4=box_rectangle_6,
    Data5=box_rectangle_2,
    Data6=box_rectangle_3,
    Data7=box_rectangle_7,
    Data9=box_rectangle_4)
brep_14 = Brep(box_2pt_14)
brep_15 = Brep(box_2pt_15)
box_rectangle_14 = BoxRectangle(Rectangle=brep_15, Height=Slider(5, range=0..10))
box_rectangle_15 = BoxRectangle(Rectangle=brep_14, Height=Slider(5, range=0..10))
split_brep = SplitBrep(Brep=box_rectangle_14, Cutter=move_4.Geometry)
split_brep_2 = SplitBrep(Brep=box_rectangle_15, Cutter=move_2.Geometry)
dispatch = Dispatch(List=split_brep, DispatchPattern=[True, False])  # -> ListA, ListB
dispatch_2 = Dispatch(List=split_brep_2, DispatchPattern=[True, False])  # -> ListA, ListB

# ---- group: DO NOT USE WRONG PART
geometry = Geometry(dispatch.ListB)

# ----
geometry_2 = Geometry(dispatch.ListA)

# ---- group: WRONG ONE DO NOT USE
geometry_3 = Geometry(dispatch_2.ListA)

# ----
geometry_4 = Geometry(dispatch_2.ListB)

# ---- group: Top Tower
cylinder = Cylinder(Base=PlaneXY(0, 0, 0), Radius=Slider(7, range=0..10), Length=Slider(88, range=0..100))
unit_x_3 = UnitX(Factor=Slider(107.5, range=0..1000))
move_5 = Move(Geometry=cylinder, Motion=unit_x_3)  # -> Geometry, Transform
unit_z_3 = UnitZ(Factor=Slider(71.5, range=0..100))
move_6 = Move(Geometry=move_5.Geometry, Motion=unit_z_3)  # -> Geometry, Transform
unit_y = UnitY(Factor=Slider(-8.5, range=-8.5..10))
move_7 = Move(Geometry=move_6.Geometry, Motion=unit_y)  # -> Geometry, Transform

# ---- group: Cylinder num. 1# from Right
unit_x_4 = UnitX(Factor=Slider(179, range=0..1000))
cylinder_2 = Cylinder(Base=PlaneXY(0, 0, 0), Radius=Slider(0.75, range=0.01..10), Length=Slider(5, range=0..100))
move_8 = Move(Geometry=cylinder_2, Motion=unit_x_4)  # -> Geometry, Transform
unit_z_4 = UnitZ(Factor=Slider(17, range=0..100))
move_9 = Move(Geometry=move_8.Geometry, Motion=unit_z_4)  # -> Geometry, Transform
unit_y_2 = UnitY(Factor=Slider(-15, range=-40..1000))
move_10 = Move(Geometry=move_9.Geometry, Motion=unit_y_2)  # -> Geometry, Transform

# ---- group: Cylinder num. #2 from Right
unit_x_5 = UnitX(Factor=Slider(175, range=0..1000))
cylinder_3 = Cylinder(Base=PlaneXY(0, 0, 0), Radius=Slider(0.75, range=0.01..10), Length=Slider(6, range=0..100))
move_11 = Move(Geometry=cylinder_3, Motion=unit_x_5)  # -> Geometry, Transform
unit_z_5 = UnitZ(Factor=Slider(17, range=0..100))
move_12 = Move(Geometry=move_11.Geometry, Motion=unit_z_5)  # -> Geometry, Transform
unit_y_3 = UnitY(Factor=Slider(-15, range=-40..1000))
move_13 = Move(Geometry=move_12.Geometry, Motion=unit_y_3)  # -> Geometry, Transform

# ---- group: Cylinder num. #3 from Right
unit_x_6 = UnitX(Factor=Slider(171, range=0..1000))
cylinder_4 = Cylinder(Base=PlaneXY(0, 0, 0), Radius=Slider(0.75, range=0.01..10), Length=Slider(10, range=0..100))
move_14 = Move(Geometry=cylinder_4, Motion=unit_x_6)  # -> Geometry, Transform
unit_z_6 = UnitZ(Factor=Slider(17, range=0..100))
move_15 = Move(Geometry=move_14.Geometry, Motion=unit_z_6)  # -> Geometry, Transform
unit_y_4 = UnitY(Factor=Slider(-15, range=-40..1000))
move_16 = Move(Geometry=move_15.Geometry, Motion=unit_y_4)  # -> Geometry, Transform

# ---- group: Cylinder num. #4 from Right
unit_x_7 = UnitX(Factor=Slider(167, range=0..1000))
cylinder_5 = Cylinder(Base=PlaneXY(0, 0, 0), Radius=Slider(0.75, range=0.01..10), Length=Slider(8.5, range=0..10))
move_17 = Move(Geometry=cylinder_5, Motion=unit_x_7)  # -> Geometry, Transform
unit_z_7 = UnitZ(Factor=Slider(17, range=0..100))
move_18 = Move(Geometry=move_17.Geometry, Motion=unit_z_7)  # -> Geometry, Transform
unit_y_5 = UnitY(Factor=Slider(-15, range=-40..1000))
move_19 = Move(Geometry=move_18.Geometry, Motion=unit_y_5)  # -> Geometry, Transform

# ---- group: Cylinder num. #2 form Left
unit_x_8 = UnitX(Factor=Slider(151, range=0..1000))
cylinder_6 = Cylinder(Base=PlaneXY(0, 0, 0), Radius=Slider(0.75, range=0.01..10), Length=Slider(8, range=0..10))
move_20 = Move(Geometry=cylinder_6, Motion=unit_x_8)  # -> Geometry, Transform
unit_z_8 = UnitZ(Factor=Slider(17, range=0..100))
move_21 = Move(Geometry=move_20.Geometry, Motion=unit_z_8)  # -> Geometry, Transform
unit_y_6 = UnitY(Factor=Slider(-15, range=-40..1000))
move_22 = Move(Geometry=move_21.Geometry, Motion=unit_y_6)  # -> Geometry, Transform

# ---- group: Cylinder num.#4 from Left
unit_x_9 = UnitX(Factor=Slider(159, range=0..1000))
cylinder_7 = Cylinder(Base=PlaneXY(0, 0, 0), Radius=Slider(0.75, range=0.01..10), Length=Slider(10, range=0..10))
move_23 = Move(Geometry=cylinder_7, Motion=unit_x_9)  # -> Geometry, Transform
unit_z_9 = UnitZ(Factor=Slider(17, range=0..100))
move_24 = Move(Geometry=move_23.Geometry, Motion=unit_z_9)  # -> Geometry, Transform
unit_y_7 = UnitY(Factor=Slider(-15, range=-40..1000))
move_25 = Move(Geometry=move_24.Geometry, Motion=unit_y_7)  # -> Geometry, Transform

# ---- group: Middle Cylinder
unit_x_10 = UnitX(Factor=Slider(163, range=0..1000))
cylinder_8 = Cylinder(Base=PlaneXY(0, 0, 0), Radius=Slider(0.75, range=0.01..10), Length=Slider(7.5, range=0..10))
move_26 = Move(Geometry=cylinder_8, Motion=unit_x_10)  # -> Geometry, Transform
unit_z_10 = UnitZ(Factor=Slider(17, range=0..100))
move_27 = Move(Geometry=move_26.Geometry, Motion=unit_z_10)  # -> Geometry, Transform
unit_y_8 = UnitY(Factor=Slider(-15, range=-40..1000))
move_28 = Move(Geometry=move_27.Geometry, Motion=unit_y_8)  # -> Geometry, Transform

# ---- group: Cylinder num. #3 from Left
unit_x_11 = UnitX(Factor=Slider(155, range=0..1000))
cylinder_9 = Cylinder(Base=PlaneXY(0, 0, 0), Radius=Slider(0.75, range=0.01..10), Length=Slider(9, range=0..10))
move_29 = Move(Geometry=cylinder_9, Motion=unit_x_11)  # -> Geometry, Transform
unit_z_11 = UnitZ(Factor=Slider(17, range=0..100))
move_30 = Move(Geometry=move_29.Geometry, Motion=unit_z_11)  # -> Geometry, Transform
unit_y_9 = UnitY(Factor=Slider(-15, range=-40..1000))
move_31 = Move(Geometry=move_30.Geometry, Motion=unit_y_9)  # -> Geometry, Transform

# ---- group: Cylinder num. #1 form Left
unit_x_12 = UnitX(Factor=Slider(147, range=0..1000))
cylinder_10 = Cylinder(Base=PlaneXY(0, 0, 0), Radius=Slider(0.75, range=0.01..10), Length=Slider(3.5, range=0..10))
move_32 = Move(Geometry=cylinder_10, Motion=unit_x_12)  # -> Geometry, Transform
unit_z_12 = UnitZ(Factor=Slider(17, range=0..100))
move_33 = Move(Geometry=move_32.Geometry, Motion=unit_z_12)  # -> Geometry, Transform
unit_y_10 = UnitY(Factor=Slider(-15, range=-40..1000))
move_34 = Move(Geometry=move_33.Geometry, Motion=unit_y_10)  # -> Geometry, Transform

# ----
merge_3 = Merge(Data1=merge_2, Data2=geometry_2, Data3=geometry_4, Data4=merge)
merge_4 = Merge(
    Data1=move_7.Geometry,
    Data2=move_10.Geometry,
    Data3=move_13.Geometry,
    Data4=move_16.Geometry,
    Data5=move_19.Geometry,
    Data6=move_28.Geometry,
    Data7=move_25.Geometry,
    Data8=move_31.Geometry,
    Data9=move_22.Geometry,
    Data10=move_34.Geometry)
merge_5 = Merge(Data1=merge_4, Data2=merge_3)
cap_holes = CapHoles(Brep=flatten(merge_5))
brep_join = BrepJoin(Breps=cap_holes)  # -> Breps, Closed
# I am checking here if my model is watertight!
mesh_brep = MeshBrep(
    Brep=cap_holes,
    Settings={GridMaxCount=0, GridMinCount=16, JaggedSeams=False, MaxEdgeLength=0, MinEdgeLength=0.0001, MinTolerance=0, Refine=True, RefineAngle=0, RelativeTolerance=0.65, SimplePlanes=True, Tolerance=0})
geometry_5 = Geometry(brep_join.Breps)
topology_bygeometry = TopologyByGeometry(Geometry=mesh_brep, Tolerance=0.0001)
mesh_brep_2 = MeshBrep(
    Brep=geometry_5,
    Settings={GridMaxCount=0, GridMinCount=16, JaggedSeams=False, MaxEdgeLength=0, MinEdgeLength=0.0001, MinTolerance=0, Refine=True, RefineAngle=0, RelativeTolerance=0.65, SimplePlanes=True, Tolerance=0})
geometry_samgeometry = GeometrySAMGeometry(_geometry=geometry_5, SAM_ComponentVersion="1.0.0")  # -> flatten(SAMGeometries)
panel = Panel(geometry_5)
topology_faces = TopologyFaces(Topology=topology_bygeometry)  # -> flatten(Faces)
geometry_meshreduce = GeometryMeshReduce(_mesh=mesh_brep_2, _distortion_=True, _count_=44, _accuracy_=10, _normalizedSize_=False, SAM_ComponentVersion="1.0.0")
panel_2 = Panel(geometry_samgeometry)
cellcomplex_byfaces = CellComplexByFaces(Faces=topology_faces, Tolerance=0.001)
samanalytical_createpanelsbyshell = SAMAnalyticalCreatePanelsByShell(_shell=geometry_samgeometry, SAM_ComponentVersion="1.0.0")  # -> Walls, Floors, Roofs, Others
geometry_createshell = GeometryCreateShell(_mesh=geometry_meshreduce, _simplify_=True, Tolerance_=0.001, SAM_ComponentVersion="1.0.2")
topology_geometry = TopologyGeometry(Topology=cellcomplex_byfaces, Tolerance=0.0001)
panel_3 = Panel(flatten(samanalytical_createpanelsbyshell.Walls), SAM_Analytical_Grasshopper_GooPanelParam=True)
solver = Solver(_panels=panel_3, SAM_ComponentVersion="1.0.0")
geometry_6 = Geometry(topology_geometry)
samanalytical_createshells = SAMAnalyticalCreateShells(_panels=flatten(panel_3), SAM_ComponentVersion="1.0.1")
boolean_toggle = BooleanToggle(True)
samanalytical_createpanelsbyshell_2 = SAMAnalyticalCreatePanelsByShell(_shell=samanalytical_createshells, SAM_ComponentVersion="1.0.0")  # -> Walls, Floors, Roofs, Others
samanalytical_mergeoverlappanels = SAMAnalyticalMergeOverlapPanels(
    _analyticalObject=flatten([samanalytical_createpanelsbyshell_2.Floors, samanalytical_createpanelsbyshell_2.Roofs]),
    _offset_=1e-06,
    _defaultConstruction_=boolean_toggle,
    _tolerance_=1e-06,
    _run=boolean_toggle,
    SAM_ComponentVersion="1.0.0")  # -> AnalyticalObject, RedundantPanels
samanalytical_mergeoverlappanels_2 = SAMAnalyticalMergeOverlapPanels(
    _analyticalObject=flatten(samanalytical_createpanelsbyshell_2.Walls),
    _offset_=1e-06,
    _defaultConstruction_=boolean_toggle,
    _tolerance_=1e-06,
    _run=boolean_toggle,
    SAM_ComponentVersion="1.0.0")  # -> AnalyticalObject, RedundantPanels
merge_6 = Merge(Data1=samanalytical_mergeoverlappanels_2.AnalyticalObject, Data2=samanalytical_mergeoverlappanels.AnalyticalObject)
samanalytical_createadjacencyclusterbysh = SAMAnalyticalCreateAdjacencyClusterByShells(_shells=flatten(samanalytical_createshells), _panels=flatten(merge_6), Tolerance_=1e-06, SAM_ComponentVersion="1.0.4")
file_path = FilePath("C:\Users\micha\Downloads\UKR_Kiev.333450_IWEC\UKR_Kiev.333450_IWEC.epw")
samadjacencycluster_updatepaneltypes = SAMAdjacencyClusterUpdatePanelTypes(_adjacencyCluster=samanalytical_createadjacencyclusterbysh, SAM_ComponentVersion="1.0.1")
samanalytical_loadweatherdata = SAMAnalyticalLoadWeatherData(_epwPath=file_path, SAM_ComponentVersion="1.0.1")  # -> WeatherData, CoolingDesignDay, HeatingDesignDay
samanalytical_mapinternalconditions = SAMAnalyticalMapInternalConditions(_analytical=samadjacencycluster_updatepaneltypes, SAM_ComponentVersion="1.0.4")
samanalytical_createanalyticalmodelbyadj = SAMAnalyticalCreateAnalyticalModelByAdjacencyCluster(
    _name_="000000_SAM_AnalyticalModel",
    _description_="Delivered by SAM https://github.com/HoareLea/SAM [2022/06/28]",
    _location_=samanalytical_loadweatherdata.WeatherData,
    _adjacencyCluster=samanalytical_mapinternalconditions,
    SAM_ComponentVersion="1.0.4")
samanalytical_paths = SAMAnalyticalPaths(
    _directory_="C:\Users\micha\SAMSimulation",
    _projectName_="000000",
    _modelName_="000000_SAM_AnalyticalModel",
    SAM_ComponentVersion="1.0.1")  # -> ModelName, Json, T3d, Tbd
inspect = Inspect(_object=samanalytical_createanalyticalmodelbyadj, SAM_ComponentVersion="1.0.0")  # -> Address, AdjacencyCluster, AnalyticalModelSimulationResults, Description, Guid, HashCode, InternalConditions, Location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
samanalytical_workflow = SAMAnalyticalWorkflow(
    _analyticalModel=samanalytical_createanalyticalmodelbyadj,
    _path_TBD=samanalytical_paths.Tbd,
    WeatherData_=samanalytical_loadweatherdata.WeatherData,
    CoolingDesignDays_=samanalytical_loadweatherdata.CoolingDesignDay,
    HeatingDesignDays_=samanalytical_loadweatherdata.HeatingDesignDay,
    _run=Toggle(False),
    SAM_ComponentVersion="1.0.3")  # -> AnalyticalModel, Successful
panel_4 = Panel(inspect.Panels, SAM_Analytical_Grasshopper_GooPanelParam=True)
space = Space(inspect.Spaces)
tas_workflow_v3 = TasWorkflowV3(
    designdays=[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],
    run_sizing=False)

# ==== cluster TasWorkflowV3

# ---- group: B
outputsurfacedata = ClusterInput()

# ----
run_simulation = ClusterInput()

# ---- group: B
updatedesigndays = ClusterInput()

# ---- group: Data
designdays = ClusterInput()

# ----
run_sizing = ClusterInput()
analyticalmodel = ClusterInput()
weatherdata = ClusterInput()
t3d_file_path = ClusterInput()
outputsurfacedata_2 = Data(outputsurfacedata)
t3d_file_path_2 = Data(t3d_file_path)
updatedesigndays_2 = Data(updatedesigndays)
replace_text = ReplaceText(Text=t3d_file_path_2, Find=".t3d", Replace=".xml", RecursiveReplace=False)
togbxml = TogbXML(
    _analyticalModel=analyticalmodel,
    _path=replace_text,
    _tolerance_=1e-05,
    _runSizing_=run_sizing,
    SAM_ComponentVersion="1.0.1")  # -> String, Successful
replace_text_2 = ReplaceText(Text=t3d_file_path_2, Find=".t3d", Replace=".tbd", RecursiveReplace=False)
replace_text_3 = ReplaceText(Text=t3d_file_path_2, Find=".t3d", Replace=".tsd", RecursiveReplace=False)
panel = Panel(replace_text_2)
gbxml_tast3d = GbXMLTasT3D(
    _pathTasT3D=t3d_file_path_2,
    _pathgbXML=replace_text,
    _override_=True,
    _fixNormals_=False,
    _zonesFromSpaces_=True,
    _useBEWidth_=Toggle(False),
    _run=togbxml.Successful,
    SAM_ComponentVersion="1.0.2")
panel_2 = Panel("C:\Users\DengusiakM\Desktop\SAM\2020-09-09_testConstruction\000000_SAM_Live_945.xml")
panel_3 = Panel("C:\Users\DengusiakM\Desktop\SAM\2020-09-09_testConstruction\000000_SAM_Live_945.t3d")
panel_4 = Panel("C:\Users\DengusiakM\Desktop\SAM\2020-09-09_testConstruction\000000_SAM_Live_945.tbd")
panel_5 = Panel("C:\Users\DengusiakM\Desktop\SAM\2020-09-09_testConstruction\000000_SAM_Live_945.tsd")
tas_updatet3d = TasUpdateT3D(_pathTasT3D=t3d_file_path_2, _analyticalModel=analyticalmodel, _run=gbxml_tast3d, SAM_ComponentVersion="1.0.1")  # -> AnalyticalModel, Successful
tas_updateweather = TasUpdateWeather(_pathTasTBD=replace_text_2, _weatherData=weatherdata, _run=tas_updatet3d.Successful, SAM_ComponentVersion="1.0.1")  # -> WeatherData, Successful
data_dam = DataDam(DataDataA=tas_updatet3d.Successful, BufferDelay=10000000, BufferMode=0)
tas_t3dtotbd = TasT3DtoTBD(
    _pathTasT3D=t3d_file_path_2,
    _pathTasTBD=replace_text_2,
    _dayFirst_=1,
    _dayLast_=365,
    _step_=15,
    _autoAssignConstructions_=True,
    _run=tas_updateweather.Successful,
    SAM_ComponentVersion="1.0.1")
tas_updatefacingexternal = TasUpdateFacingExternal(
    _pathTasTBD=replace_text_2,
    _analyticalModel=tas_updatet3d.AnalyticalModel,
    _run=tas_t3dtotbd,
    SAM_ComponentVersion="1.0.1")  # -> AnalyticalModel, Successful
tas_assignadiabaticconstruction = TasAssignAdiabaticConstruction(
    _pathTasTBD=replace_text_2,
    _adiabaticConstructionName_="Adiabatic",
    _constructionNameSuffixes_=["-unzoned", "-internal", "-exposed"],
    _caseSensitive_=False,
    _trim_=True,
    _run=tas_updatefacingexternal.Successful,
    SAM_ComponentVersion="1.0.1")  # -> Guids, Successful
samcore_textcomparisontype = SAMCoreTextComparisonType(TextComparisonType=2, SAM_ComponentVersion="1.0.1")
designdays_2 = SAMObject(designdays)
tas_updatebuildingelements = TasUpdateBuildingElements(
    _pathTasTBD=replace_text_2,
    _analyticalModel=tas_updatefacingexternal.AnalyticalModel,
    _run=tas_assignadiabaticconstruction.Successful,
    SAM_ComponentVersion="1.0.1")  # -> AnalyticalModel, Successful
getvaluefilter = GetValueFilter(
    _objects=designdays_2,
    _name="Name",
    _value="HTG",
    _comparisonType_=samcore_textcomparisontype,
    SAM_ComponentVersion="1.0.0")  # -> In, Out
boolean_toggle = BooleanToggle(True)
tas_updatezones = TasUpdateZones(
    _pathTasTBD=replace_text_2,
    _analyticalModel=tas_updatebuildingelements.AnalyticalModel,
    _run=tas_updatebuildingelements.Successful,
    SAM_ComponentVersion="1.0.1")
gate_and = GateAnd(A=tas_updatezones, _updateDesignDays_=updatedesigndays_2)
tas_updatedesigndays = TasUpdateDesignDays(
    _pathTasTBD=replace_text_2,
    _coolingDesignDays_=flatten(getvaluefilter.Out),
    _heatingDesignDays_=flatten(getvaluefilter.In),
    _repetitions_=30,
    _run=gate_and,
    SAM_ComponentVersion="1.0.1")  # -> Guids, Successful
gate_or = GateOr(A=tas_updatedesigndays.Successful, B=tas_updatezones)
tas_sizing = TasSizing(
    _pathTasTBD=replace_text_2,
    _analyticalModel_=tas_updatebuildingelements.AnalyticalModel,
    _excludeOutdoorAir_=False,
    _excludePositiveInternalGains_=True,
    _run=gate_or,
    SAM_ComponentVersion="1.0.2")
tas_updatedesignloads = TasUpdateDesignLoads(
    _pathTasTBD=replace_text_2,
    _analyticalModel=tas_updatebuildingelements.AnalyticalModel,
    _run=tas_sizing,
    SAM_ComponentVersion="1.0.2")  # -> AnalyticalModel, Spaces, SpaceSimulationResultsCooling, SpaceSimulationResultsHeating, Successful
tas_simulate = TasSimulate(
    _pathTasTBD=replace_text_2,
    _path_TasTSD=replace_text_3,
    _dayFirst_="1",
    _dayLast_="1",
    _run=tas_updatedesignloads.Successful,
    SAM_ComponentVersion="1.0.2")
gate_and_2 = GateAnd(A=tas_simulate, _runSimulation_=run_simulation)
tas_simulate_2 = TasSimulate(
    _pathTasTBD=replace_text_2,
    _path_TasTSD=replace_text_3,
    _surfaceOutputSpec=outputsurfacedata_2,
    _dayFirst_=1,
    _dayLast_=365,
    _run=gate_and_2,
    SAM_ComponentVersion="1.0.2")
tas_tsdaddresults = TasTSDAddResults(
    _analyticalObject=tas_updatedesignloads.AnalyticalModel,
    _pathTasTSD=replace_text_3,
    _pathTasTBD=replace_text_2,
    _runUnmetHours_=False,
    _run=tas_simulate,
    SAM_ComponentVersion="1.0.6")  # -> AnalyticalObject, SpaceSimulationResultsHeating, SpaceSimulationResultsCooling, Successful
tas_tsdaddresults_2 = TasTSDAddResults(
    _analyticalObject=tas_updatedesignloads.AnalyticalModel,
    _pathTasTSD=replace_text_3,
    _pathTasTBD=replace_text_2,
    _runUnmetHours_=Toggle(False),
    _run=tas_simulate_2,
    SAM_ComponentVersion="1.0.6")  # -> AnalyticalObject, SpaceSimulationResultsHeating, SpaceSimulationResultsCooling, Successful
pick_n_choose = PickNChoose(Pattern=gate_and_2, Stream0=tas_tsdaddresults.AnalyticalObject, Stream1=tas_tsdaddresults_2.AnalyticalObject)
analyticalmodel_2 = AnalyticalModel(pick_n_choose)
analyticalmodel_3 = ClusterOutput(analyticalmodel_2)
