# Grasshopper definition Chernobyl_Building.gh (Grasshopper 1.0.7)

# ---- group: Compound on the Left Wing
construct_point = ConstructPoint(XCoordinate=Slider(37, range=-100..100), YCoordinate=Slider(0, range=-100..100), ZCoordinate=Slider(0, range=-100..100))
construct_point_2 = ConstructPoint(XCoordinate=Slider(51, range=-100..100), YCoordinate=0, ZCoordinate=Slider(10, range=-100..100))
box_2pt = Box2Pt(PointA=construct_point, PointB=construct_point_2, Plane=PlaneXY(0, 0, 0))
brep = Brep(box_2pt)
box_rectangle = BoxRectangle(Rectangle=brep, Height=Slider(5, range=0..10))

# ---- group: The compound on the Right Wing, which is closest to the viewer
construct_point_3 = ConstructPoint(
    XCoordinate=Slider(191.45, range=-100..300),
    YCoordinate=Slider(0, range=-100..100),
    ZCoordinate=Slider(0, range=-100..100))
construct_point_4 = ConstructPoint(XCoordinate=Slider(128.39, range=-100..300), YCoordinate=0, ZCoordinate=Slider(13.971, range=-100..100))
box_2pt_2 = Box2Pt(PointA=construct_point_3, PointB=construct_point_4, Plane=PlaneXY(0, 0, 0))
brep_2 = Brep(box_2pt_2)
box_rectangle_2 = BoxRectangle(Rectangle=brep_2, Height=Slider(24, range=0..100))

# ---- group: Downer Compound in the middle of the Middle Wing
construct_point_5 = ConstructPoint(
    XCoordinate=Slider(85.45, range=-100..300),
    YCoordinate=Slider(0, range=-100..100),
    ZCoordinate=Slider(16.35, range=-100..100))
construct_point_6 = ConstructPoint(XCoordinate=Slider(128.45, range=-100..300), YCoordinate=0, ZCoordinate=Slider(0, range=-100..100))
box_2pt_3 = Box2Pt(PointA=construct_point_5, PointB=construct_point_6, Plane=PlaneXY(0, 0, 0))
brep_3 = Brep(box_2pt_3)
box_rectangle_3 = BoxRectangle(Rectangle=brep_3, Height=Slider(34, range=0..100))

# ---- group: Compound on the Right Wing, which is furthest from the viewer.
construct_point_7 = ConstructPoint(
    XCoordinate=Slider(182.592, range=-100..300),
    YCoordinate=Slider(0, range=-100..100),
    ZCoordinate=Slider(0, range=-100..100))
construct_point_8 = ConstructPoint(XCoordinate=Slider(123.961, range=-100..300), YCoordinate=0, ZCoordinate=Slider(18.4, range=-100..100))
box_2pt_4 = Box2Pt(PointA=construct_point_7, PointB=construct_point_8, Plane=PlaneXY(0, 0, 0))
brep_4 = Brep(box_2pt_4)
box_rectangle_4 = BoxRectangle(Rectangle=brep_4, Height=Slider(14, range=0..100))

# ---- group: Compound in the middle of the Middle Wing
construct_point_9 = ConstructPoint(
    XCoordinate=Slider(91.45, range=-100..300),
    YCoordinate=Slider(0, range=-100..100),
    ZCoordinate=Slider(49.6, range=-100..100))
construct_point_10 = ConstructPoint(XCoordinate=Slider(123.45, range=-100..300), YCoordinate=0, ZCoordinate=Slider(0, range=-100..100))
box_2pt_5 = Box2Pt(PointA=construct_point_9, PointB=construct_point_10, Plane=PlaneXY(0, 0, 0))
brep_5 = Brep(box_2pt_5)
box_rectangle_5 = BoxRectangle(Rectangle=brep_5, Height=Slider(18, range=0..100))

# ----
merge = Merge(Data1=box_rectangle, Data2=box_rectangle_5, Data3=box_rectangle_3, Data4=box_rectangle_2, Data5=box_rectangle_4)

xy_plane = XYPlane(Origin=Point(0, 0, 0))
xz_plane = XZPlane(Origin=Point(0, 0, 0))
rotate = Rotate(Geometry=xy_plane, Angle=degrees(Slider(141, range=0..300)), Plane=xz_plane)  # -> Geometry, Transform
unit_x = UnitX(Factor=Slider(146, range=0..300))
plane_surface = PlaneSurface(Plane=rotate.Geometry, XSize=Domain(-10, 10), YSize=Domain(-10, 10))
move = Move(Geometry=plane_surface, Motion=unit_x)  # -> Geometry, Transform
unit_z = UnitZ(Factor=Slider(-2, range=-10..10))
move_2 = Move(Geometry=move.Geometry, Motion=unit_z)  # -> Geometry, Transform

# ---- group: Cutter
xy_plane_2 = XYPlane(Origin=Point(0, 0, 0))
xz_plane_2 = XZPlane(Origin=Point(0, 0, 0))
rotate_2 = Rotate(Geometry=xy_plane_2, Angle=degrees(Slider(31, range=0..100)), Plane=xz_plane_2)  # -> Geometry, Transform
unit_x_2 = UnitX(Factor=Slider(77, range=0..100))
plane_surface_2 = PlaneSurface(Plane=rotate_2.Geometry, XSize=Domain(-10, 10), YSize=Domain(-10, 10))
move_3 = Move(Geometry=plane_surface_2, Motion=unit_x_2)  # -> Geometry, Transform
unit_z_2 = UnitZ(Factor=Slider(-2, range=-10..10))
move_4 = Move(Geometry=move_3.Geometry, Motion=unit_z_2)  # -> Geometry, Transform

# ---- group: Left Wing
construct_point_11 = ConstructPoint(
    XCoordinate=Slider(0, range=-100..100),
    YCoordinate=Slider(0, range=-100..100),
    ZCoordinate=Slider(-6.2, range=-100..100))
construct_point_12 = ConstructPoint(XCoordinate=Slider(51, range=-100..100), YCoordinate=0, ZCoordinate=Slider(32.7, range=-100..100))
box_2pt_6 = Box2Pt(PointA=construct_point_11, PointB=construct_point_12, Plane=PlaneXY(0, 0, 0))
brep_6 = Brep(box_2pt_6)
box_rectangle_6 = BoxRectangle(Rectangle=brep_6, Height=Slider(5, range=0..10))

# ---- group: Top Part
construct_point_13 = ConstructPoint(
    XCoordinate=Slider(96.89, range=-100..300),
    YCoordinate=Slider(0, range=-100..100),
    ZCoordinate=Slider(49.6, range=-100..100))
construct_point_14 = ConstructPoint(XCoordinate=Slider(118.01, range=-100..300), YCoordinate=0, ZCoordinate=Slider(71.5, range=-100..100))
box_2pt_7 = Box2Pt(PointA=construct_point_13, PointB=construct_point_14, Plane=PlaneXY(0, 0, 0))
brep_7 = Brep(box_2pt_7)
box_rectangle_7 = BoxRectangle(Rectangle=brep_7, Height=Slider(10, range=0..30))

# ---- group: Middle Wing
construct_point_15 = ConstructPoint(XCoordinate=Slider(70, range=-100..100), YCoordinate=Slider(0, range=-100..100), ZCoordinate=Slider(0, range=-100..100))
construct_point_16 = ConstructPoint(XCoordinate=Slider(143.45, range=-100..300), YCoordinate=0, ZCoordinate=Slider(49.6, range=-100..100))
box_2pt_8 = Box2Pt(PointA=construct_point_15, PointB=construct_point_16, Plane=PlaneXY(0, 0, 0))
brep_8 = Brep(box_2pt_8)
box_rectangle_8 = BoxRectangle(Rectangle=brep_8, Height=Slider(12, range=0..30))

# ---- group: Right compound
construct_point_17 = ConstructPoint(
    XCoordinate=Slider(191.45, range=-100..300),
    YCoordinate=Slider(0, range=-100..100),
    ZCoordinate=Slider(0, range=-100..100))
construct_point_18 = ConstructPoint(XCoordinate=Slider(143.45, range=-100..300), YCoordinate=0, ZCoordinate=Slider(21.5, range=-100..100))
box_2pt_9 = Box2Pt(PointA=construct_point_17, PointB=construct_point_18, Plane=PlaneXY(0, 0, 0))
brep_9 = Brep(box_2pt_9)
box_rectangle_9 = BoxRectangle(Rectangle=brep_9, Height=Slider(5, range=0..30))

# ---- group: Middle Left Wing
construct_point_19 = ConstructPoint(
    XCoordinate=Slider(51, range=-100..100),
    YCoordinate=Slider(0, range=-100..100),
    ZCoordinate=Slider(-6.2, range=-100..100))
construct_point_20 = ConstructPoint(XCoordinate=Slider(64, range=-100..100), YCoordinate=0, ZCoordinate=Slider(37.9, range=-100..100))
box_2pt_10 = Box2Pt(PointA=construct_point_19, PointB=construct_point_20, Plane=PlaneXY(0, 0, 0))
brep_10 = Brep(box_2pt_10)
box_rectangle_10 = BoxRectangle(Rectangle=brep_10, Height=Slider(7, range=0..10))

# ---- group: Last part of the right compound
construct_point_21 = ConstructPoint(
    XCoordinate=Slider(191.45, range=-100..300),
    YCoordinate=Slider(0, range=-100..100),
    ZCoordinate=Slider(0, range=-100..100))
construct_point_22 = ConstructPoint(XCoordinate=Slider(184.28, range=-100..300), YCoordinate=0, ZCoordinate=Slider(-1.5, range=-100..100))
box_2pt_11 = Box2Pt(PointA=construct_point_21, PointB=construct_point_22, Plane=PlaneXY(0, 0, 0))
brep_11 = Brep(box_2pt_11)
box_rectangle_11 = BoxRectangle(Rectangle=brep_11, Height=Slider(5, range=0..30))

# ---- group: Next to Middle Wing part with triangle
construct_point_23 = ConstructPoint(
    XCoordinate=Slider(64, range=-100..100),
    YCoordinate=Slider(0, range=-100..100),
    ZCoordinate=Slider(-6.2, range=-100..100))
construct_point_24 = ConstructPoint(XCoordinate=Slider(70, range=-100..100), YCoordinate=0, ZCoordinate=Slider(37.9, range=-100..100))
box_2pt_12 = Box2Pt(PointA=construct_point_23, PointB=construct_point_24, Plane=PlaneXY(0, 0, 0))
brep_12 = Brep(box_2pt_12)
box_rectangle_12 = BoxRectangle(Rectangle=brep_12, Height=Slider(16, range=0..30))

# ---- group: Part of the downer right compound
construct_point_25 = ConstructPoint(
    XCoordinate=Slider(174.3, range=-100..300),
    YCoordinate=Slider(0, range=-100..100),
    ZCoordinate=Slider(0, range=-100..100))
construct_point_26 = ConstructPoint(XCoordinate=Slider(184.28, range=-100..300), YCoordinate=0, ZCoordinate=Slider(-4, range=-100..100))
box_2pt_13 = Box2Pt(PointA=construct_point_25, PointB=construct_point_26, Plane=PlaneXY(0, 0, 0))
brep_13 = Brep(box_2pt_13)
box_rectangle_13 = BoxRectangle(Rectangle=brep_13, Height=Slider(5, range=0..30))

# ---- group: 2/5 of Downer Right Wing
construct_point_27 = ConstructPoint(
    XCoordinate=Slider(174.3, range=-100..300),
    YCoordinate=Slider(0, range=-100..100),
    ZCoordinate=Slider(0, range=-100..100))
construct_point_28 = ConstructPoint(XCoordinate=Slider(143.45, range=-100..300), YCoordinate=0, ZCoordinate=Slider(-6.2, range=-100..100))
box_2pt_14 = Box2Pt(PointA=construct_point_27, PointB=construct_point_28, Plane=PlaneXY(0, 0, 0))

# ---- group: Rectangle to be cut
construct_point_29 = ConstructPoint(
    XCoordinate=Slider(70, range=-100..300),
    YCoordinate=Slider(0, range=-100..100),
    ZCoordinate=Slider(-6.2, range=-100..100))
construct_point_30 = ConstructPoint(XCoordinate=Slider(80.4, range=-100..300), YCoordinate=0, ZCoordinate=Slider(0, range=-100..100))
box_2pt_15 = Box2Pt(PointA=construct_point_29, PointB=construct_point_30, Plane=PlaneXY(0, 0, 0))

# ----
brep_14 = Brep(box_2pt_14)
brep_15 = Brep(box_2pt_15)
box_rectangle_14 = BoxRectangle(Rectangle=brep_15, Height=Slider(5, range=0..10))
box_rectangle_15 = BoxRectangle(Rectangle=brep_14, Height=Slider(5, range=0..10))
split_brep = SplitBrep(Brep=box_rectangle_14, Cutter=move_4.Geometry)
split_brep_2 = SplitBrep(Brep=box_rectangle_15, Cutter=move_2.Geometry)
dispatch = Dispatch(List=split_brep, DispatchPattern=[True, False])  # -> ListA, ListB
dispatch_2 = Dispatch(List=split_brep_2, DispatchPattern=[True, False])  # -> ListA, ListB

# ---- group: DO NOT USE WRONG PART
geometry = Geometry(dispatch.ListB)

# ----
geometry_2 = Geometry(dispatch.ListA)

# ---- group: WRONG ONE DO NOT USE
geometry_3 = Geometry(dispatch_2.ListA)

# ----
geometry_4 = Geometry(dispatch_2.ListB)
merge_2 = Merge(
    Data1=box_rectangle_6,
    Data2=box_rectangle_10,
    Data3=box_rectangle_12,
    Data4=box_rectangle_7,
    Data5=box_rectangle_8,
    Data6=box_rectangle_9,
    Data7=box_rectangle_13,
    Data9=box_rectangle_11)
merge_3 = Merge(Data1=merge_2, Data2=geometry_2, Data3=geometry_4, Data4=merge)
