# Grasshopper definition Chernobyl_Building_Possible_Barrier_Bug.gh (Grasshopper 1.0.7)
# plug-ins: TopologicGH, Kangaroo2 Components

# ---- group: Left Wing
construct_point = ConstructPoint(
    XCoordinate=Slider(0, range=-100..100),
    YCoordinate=Slider(0, range=-100..100),
    ZCoordinate=Slider(-6.2, range=-100..100))
construct_point_2 = ConstructPoint(XCoordinate=Slider(51, range=-100..100), YCoordinate=0, ZCoordinate=Slider(32.7, range=-100..100))
box_2pt = Box2Pt(PointA=construct_point, PointB=construct_point_2, Plane=PlaneXY(0, 0, 0))
brep = Brep(box_2pt)
# What are naked edges?
box_rectangle = BoxRectangle(Rectangle=brep, Height=Slider(11, range=0..100))

# ---- group: Top Part
construct_point_3 = ConstructPoint(
    XCoordinate=Slider(96.89, range=-100..300),
    YCoordinate=Slider(0, range=-100..100),
    ZCoordinate=Slider(49.6, range=-100..100))
construct_point_4 = ConstructPoint(XCoordinate=Slider(118.01, range=-100..300), YCoordinate=0, ZCoordinate=Slider(71.5, range=-100..100))
box_2pt_2 = Box2Pt(PointA=construct_point_3, PointB=construct_point_4, Plane=PlaneXY(0, 0, 0))
brep_2 = Brep(box_2pt_2)
box_rectangle_2 = BoxRectangle(Rectangle=brep_2, Height=Slider(17, range=0..30))

# ---- group: Middle Wing
construct_point_5 = ConstructPoint(XCoordinate=Slider(70, range=-100..100), YCoordinate=Slider(0, range=-100..100), ZCoordinate=Slider(0, range=-100..100))
construct_point_6 = ConstructPoint(XCoordinate=Slider(143.45, range=-100..300), YCoordinate=0, ZCoordinate=Slider(49.6, range=-100..100))
box_2pt_3 = Box2Pt(PointA=construct_point_5, PointB=construct_point_6, Plane=PlaneXY(0, 0, 0))
brep_3 = Brep(box_2pt_3)
box_rectangle_3 = BoxRectangle(Rectangle=brep_3, Height=Slider(22, range=0..30))

# ---- group: Right compound
construct_point_7 = ConstructPoint(XCoordinate=Slider(225, range=-100..300), YCoordinate=Slider(0, range=-100..100), ZCoordinate=Slider(0, range=-100..100))
construct_point_8 = ConstructPoint(XCoordinate=Slider(143.45, range=-100..300), YCoordinate=0, ZCoordinate=Slider(26.5, range=-100..100))
box_2pt_4 = Box2Pt(PointA=construct_point_7, PointB=construct_point_8, Plane=PlaneXY(0, 0, 0))
brep_4 = Brep(box_2pt_4)
box_rectangle_4 = BoxRectangle(Rectangle=brep_4, Height=Slider(11, range=0..30))

# ---- group: Last part of the right compound
construct_point_9 = ConstructPoint(
    XCoordinate=Slider(191.45, range=-100..300),
    YCoordinate=Slider(0, range=-100..100),
    ZCoordinate=Slider(0, range=-100..100))
construct_point_10 = ConstructPoint(XCoordinate=Slider(184.28, range=-100..300), YCoordinate=0, ZCoordinate=Slider(-1.5, range=-100..100))
box_2pt_5 = Box2Pt(PointA=construct_point_9, PointB=construct_point_10, Plane=PlaneXY(0, 0, 0))
brep_5 = Brep(box_2pt_5)
box_rectangle_5 = BoxRectangle(Rectangle=brep_5, Height=Slider(5, range=0..30))

# ---- group: Next to Middle Wing part with triangle
construct_point_11 = ConstructPoint(
    XCoordinate=Slider(64, range=-100..100),
    YCoordinate=Slider(0, range=-100..100),
    ZCoordinate=Slider(-6.2, range=-100..100))
construct_point_12 = ConstructPoint(XCoordinate=Slider(70, range=-100..100), YCoordinate=0, ZCoordinate=Slider(37.9, range=-100..100))
box_2pt_6 = Box2Pt(PointA=construct_point_11, PointB=construct_point_12, Plane=PlaneXY(0, 0, 0))
brep_6 = Brep(box_2pt_6)
box_rectangle_6 = BoxRectangle(Rectangle=brep_6, Height=Slider(23, range=0..30))

# ---- group: Part of the downer right compound
construct_point_13 = ConstructPoint(
    XCoordinate=Slider(174.3, range=-100..300),
    YCoordinate=Slider(0, range=-100..100),
    ZCoordinate=Slider(0, range=-100..100))
construct_point_14 = ConstructPoint(XCoordinate=Slider(184.28, range=-100..300), YCoordinate=0, ZCoordinate=Slider(-4, range=-100..100))
box_2pt_7 = Box2Pt(PointA=construct_point_13, PointB=construct_point_14, Plane=PlaneXY(0, 0, 0))
brep_7 = Brep(box_2pt_7)
box_rectangle_7 = BoxRectangle(Rectangle=brep_7, Height=Slider(5, range=0..30))

# ---- group: Compound on the Left Wing
construct_point_15 = ConstructPoint(XCoordinate=Slider(37, range=-100..100), YCoordinate=Slider(0, range=-100..100), ZCoordinate=Slider(0, range=-100..100))
construct_point_16 = ConstructPoint(XCoordinate=Slider(51, range=-100..100), YCoordinate=0, ZCoordinate=Slider(10, range=-100..100))
box_2pt_8 = Box2Pt(PointA=construct_point_15, PointB=construct_point_16, Plane=PlaneXY(0, 0, 0))
brep_8 = Brep(box_2pt_8)
box_rectangle_8 = BoxRectangle(Rectangle=brep_8, Height=Slider(21, range=0..100))

# ---- group: The compound on the Right Wing, which is closest to the viewer
construct_point_17 = ConstructPoint(
    XCoordinate=Slider(191.45, range=-100..300),
    YCoordinate=Slider(0, range=-100..100),
    ZCoordinate=Slider(0, range=-100..100))
construct_point_18 = ConstructPoint(XCoordinate=Slider(128.39, range=-100..300), YCoordinate=0, ZCoordinate=Slider(13.971, range=-100..100))
box_2pt_9 = Box2Pt(PointA=construct_point_17, PointB=construct_point_18, Plane=PlaneXY(0, 0, 0))
brep_9 = Brep(box_2pt_9)
box_rectangle_9 = BoxRectangle(Rectangle=brep_9, Height=Slider(45, range=0..100))

# ---- group: Downer Compound in the middle of the Middle Wing
construct_point_19 = ConstructPoint(
    XCoordinate=Slider(85.45, range=-100..300),
    YCoordinate=Slider(0, range=-100..100),
    ZCoordinate=Slider(16.35, range=-100..100))
construct_point_20 = ConstructPoint(XCoordinate=Slider(128.45, range=-100..300), YCoordinate=0, ZCoordinate=Slider(0, range=-100..100))
box_2pt_10 = Box2Pt(PointA=construct_point_19, PointB=construct_point_20, Plane=PlaneXY(0, 0, 0))
brep_10 = Brep(box_2pt_10)
box_rectangle_10 = BoxRectangle(Rectangle=brep_10, Height=Slider(53, range=0..100))

# ---- group: Compound on the Right Wing, which is furthest from the viewer.
construct_point_21 = ConstructPoint(
    XCoordinate=Slider(182.592, range=-100..300),
    YCoordinate=Slider(0, range=-100..100),
    ZCoordinate=Slider(0, range=-100..100))
construct_point_22 = ConstructPoint(XCoordinate=Slider(123.961, range=-100..300), YCoordinate=0, ZCoordinate=Slider(17, range=-100..100))
box_2pt_11 = Box2Pt(PointA=construct_point_21, PointB=construct_point_22, Plane=PlaneXY(0, 0, 0))
brep_11 = Brep(box_2pt_11)
box_rectangle_11 = BoxRectangle(Rectangle=brep_11, Height=Slider(39, range=0..100))

# ---- group: Compound in the middle of the Middle Wing
construct_point_23 = ConstructPoint(
    XCoordinate=Slider(91.45, range=-100..300),
    YCoordinate=Slider(0, range=-100..100),
    ZCoordinate=Slider(49.6, range=-100..100))
construct_point_24 = ConstructPoint(XCoordinate=Slider(123.45, range=-100..300), YCoordinate=0, ZCoordinate=Slider(0, range=-100..100))
box_2pt_12 = Box2Pt(PointA=construct_point_23, PointB=construct_point_24, Plane=PlaneXY(0, 0, 0))
brep_12 = Brep(box_2pt_12)
box_rectangle_12 = BoxRectangle(Rectangle=brep_12, Height=Slider(34, range=0..100))

# ----
geometry = Geometry([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])  # disabled
brep_edges = BrepEdges()  # -> Naked, Interior, NonManifold; disabled
deconstruct_brep = DeconstructBrep(Brep=geometry)  # -> Faces, Edges, Vertices; disabled
topology_bygeometry = TopologyByGeometry(Geometry=flatten(deconstruct_brep.Faces), Tolerance=0.0001)  # disabled
cellcomplex_byfaces = CellComplexByFaces(Faces=topology_bygeometry, Tolerance=0.001)  # disabled
number_slider = Slider(10, range=0..10)  # disabled
topology_cells = TopologyCells(Topology=cellcomplex_byfaces)  # disabled
topology_analyze = TopologyAnalyze(Topology=cellcomplex_byfaces)  # disabled
list_item = ListItem(List=topology_cells, Index=number_slider, Wrap=True)  # disabled
topology_geometry = TopologyGeometry(Tolerance=0.0001)  # disabled

# ---- group: Middle Left Wing
construct_point_25 = ConstructPoint(
    XCoordinate=Slider(51, range=-100..100),
    YCoordinate=Slider(0, range=-100..100),
    ZCoordinate=Slider(-6.2, range=-100..100))
construct_point_26 = ConstructPoint(XCoordinate=Slider(64, range=-100..100), YCoordinate=0, ZCoordinate=Slider(37.9, range=-100..100))
box_2pt_13 = Box2Pt(PointA=construct_point_25, PointB=construct_point_26, Plane=PlaneXY(0, 0, 0))
brep_13 = Brep(box_2pt_13)
box_rectangle_13 = BoxRectangle(Rectangle=brep_13, Height=Slider(15, range=0..100))

# ----
xy_plane = XYPlane(Origin=Point(0, 0, 0))
xz_plane = XZPlane(Origin=Point(0, 0, 0))
rotate = Rotate(Geometry=xy_plane, Angle=degrees(Slider(141, range=0..300)), Plane=xz_plane)  # -> Geometry, Transform
unit_x = UnitX(Factor=Slider(146, range=0..300))
plane_surface = PlaneSurface(Plane=rotate.Geometry, XSize=Domain(-10, 10), YSize=Domain(-10, 10))
move = Move(Geometry=plane_surface, Motion=unit_x)  # -> Geometry, Transform
unit_z = UnitZ(Factor=Slider(-2, range=-10..10))
move_2 = Move(Geometry=move.Geometry, Motion=unit_z)  # -> Geometry, Transform

# ---- group: Cutter
xy_plane_2 = XYPlane(Origin=Point(0, 0, 0))
xz_plane_2 = XZPlane(Origin=Point(0, 0, 0))
rotate_2 = Rotate(Geometry=xy_plane_2, Angle=degrees(Slider(31, range=0..100)), Plane=xz_plane_2)  # -> Geometry, Transform
unit_x_2 = UnitX(Factor=Slider(77, range=0..100))
plane_surface_2 = PlaneSurface(Plane=rotate_2.Geometry, XSize=Domain(-10, 10), YSize=Domain(-10, 10))
move_3 = Move(Geometry=plane_surface_2, Motion=unit_x_2)  # -> Geometry, Transform
unit_z_2 = UnitZ(Factor=Slider(-2, range=-10..10))
move_4 = Move(Geometry=move_3.Geometry, Motion=unit_z_2)  # -> Geometry, Transform

# ----
merge = Merge(Data1=box_rectangle_8, Data2=box_rectangle_12, Data3=box_rectangle_10, Data4=box_rectangle_9, Data5=box_rectangle_11)

# ---- group: 2/5 of Downer Right Wing
construct_point_27 = ConstructPoint(
    XCoordinate=Slider(174.3, range=-100..300),
    YCoordinate=Slider(0, range=-100..100),
    ZCoordinate=Slider(0, range=-100..100))
construct_point_28 = ConstructPoint(XCoordinate=Slider(143.45, range=-100..300), YCoordinate=0, ZCoordinate=Slider(-6.2, range=-100..100))
box_2pt_14 = Box2Pt(PointA=construct_point_27, PointB=construct_point_28, Plane=PlaneXY(0, 0, 0))

# ---- group: Rectangle to be cut
construct_point_29 = ConstructPoint(
    XCoordinate=Slider(70, range=-100..300),
    YCoordinate=Slider(0, range=-100..100),
    ZCoordinate=Slider(-6.2, range=-100..100))
construct_point_30 = ConstructPoint(XCoordinate=Slider(80.4, range=-100..300), YCoordinate=0, ZCoordinate=Slider(0, range=-100..100))
box_2pt_15 = Box2Pt(PointA=construct_point_29, PointB=construct_point_30, Plane=PlaneXY(0, 0, 0))

# ----
merge_2 = Merge(
    Data1=box_rectangle,
    Data2=box_rectangle_13,
    Data3=box_rectangle_6,
    Data4=box_rectangle_2,
    Data5=box_rectangle_3,
    Data6=box_rectangle_4,
    Data7=box_rectangle_7,
    Data9=box_rectangle_5)
brep_14 = Brep(box_2pt_14)
brep_15 = Brep(box_2pt_15)
box_rectangle_14 = BoxRectangle(Rectangle=brep_15, Height=Slider(5, range=0..10))
box_rectangle_15 = BoxRectangle(Rectangle=brep_14, Height=Slider(5, range=0..10))
split_brep = SplitBrep(Brep=box_rectangle_14, Cutter=move_4.Geometry)
brep_16 = Brep()
split_brep_2 = SplitBrep(Brep=box_rectangle_15, Cutter=move_2.Geometry)
dispatch = Dispatch(List=split_brep, DispatchPattern=[True, False])  # -> ListA, ListB
dispatch_2 = Dispatch(List=split_brep_2, DispatchPattern=[True, False])  # -> ListA, ListB

# ---- group: DO NOT USE WRONG PART
geometry_2 = Geometry(dispatch.ListB)

# ----
geometry_3 = Geometry(dispatch.ListA)

# ---- group: WRONG ONE DO NOT USE
geometry_4 = Geometry(dispatch_2.ListA)

# ----
geometry_5 = Geometry(dispatch_2.ListB)

# ---- group: Top Tower
cylinder = Cylinder(Base=PlaneXY(0, 0, 0), Radius=Slider(7, range=0..10), Length=Slider(88, range=0..100))
unit_x_3 = UnitX(Factor=Slider(107.5, range=0..1000))
move_5 = Move(Geometry=cylinder, Motion=unit_x_3)  # -> Geometry, Transform
unit_z_3 = UnitZ(Factor=Slider(71.5, range=0..100))
move_6 = Move(Geometry=move_5.Geometry, Motion=unit_z_3)  # -> Geometry, Transform
unit_y = UnitY(Factor=Slider(-8.5, range=-8.5..10))
move_7 = Move(Geometry=move_6.Geometry, Motion=unit_y)  # -> Geometry, Transform

# ---- group: Cylinder num. 1# from Right
unit_x_4 = UnitX(Factor=Slider(179, range=0..1000))
cylinder_2 = Cylinder(Base=PlaneXY(0, 0, 0), Radius=Slider(0.75, range=0.01..10), Length=Slider(5, range=0..100))
move_8 = Move(Geometry=cylinder_2, Motion=unit_x_4)  # -> Geometry, Transform
unit_z_4 = UnitZ(Factor=Slider(17, range=0..100))
move_9 = Move(Geometry=move_8.Geometry, Motion=unit_z_4)  # -> Geometry, Transform
unit_y_2 = UnitY(Factor=Slider(-15, range=-40..1000))
move_10 = Move(Geometry=move_9.Geometry, Motion=unit_y_2)  # -> Geometry, Transform

# ---- group: Cylinder num. #2 from Right
unit_x_5 = UnitX(Factor=Slider(175, range=0..1000))
cylinder_3 = Cylinder(Base=PlaneXY(0, 0, 0), Radius=Slider(0.75, range=0.01..10), Length=Slider(6, range=0..100))
move_11 = Move(Geometry=cylinder_3, Motion=unit_x_5)  # -> Geometry, Transform
unit_z_5 = UnitZ(Factor=Slider(17, range=0..100))
move_12 = Move(Geometry=move_11.Geometry, Motion=unit_z_5)  # -> Geometry, Transform
unit_y_3 = UnitY(Factor=Slider(-15, range=-40..1000))
move_13 = Move(Geometry=move_12.Geometry, Motion=unit_y_3)  # -> Geometry, Transform

# ---- group: Cylinder num. #3 from Right
unit_x_6 = UnitX(Factor=Slider(171, range=0..1000))
cylinder_4 = Cylinder(Base=PlaneXY(0, 0, 0), Radius=Slider(0.75, range=0.01..10), Length=Slider(10, range=0..100))
move_14 = Move(Geometry=cylinder_4, Motion=unit_x_6)  # -> Geometry, Transform
unit_z_6 = UnitZ(Factor=Slider(17, range=0..100))
move_15 = Move(Geometry=move_14.Geometry, Motion=unit_z_6)  # -> Geometry, Transform
unit_y_4 = UnitY(Factor=Slider(-15, range=-40..1000))
move_16 = Move(Geometry=move_15.Geometry, Motion=unit_y_4)  # -> Geometry, Transform

# ---- group: Cylinder num. #4 from Right
unit_x_7 = UnitX(Factor=Slider(167, range=0..1000))
cylinder_5 = Cylinder(Base=PlaneXY(0, 0, 0), Radius=Slider(0.75, range=0.01..10), Length=Slider(8.5, range=0..10))
move_17 = Move(Geometry=cylinder_5, Motion=unit_x_7)  # -> Geometry, Transform
unit_z_7 = UnitZ(Factor=Slider(17, range=0..100))
move_18 = Move(Geometry=move_17.Geometry, Motion=unit_z_7)  # -> Geometry, Transform
unit_y_5 = UnitY(Factor=Slider(-15, range=-40..1000))
move_19 = Move(Geometry=move_18.Geometry, Motion=unit_y_5)  # -> Geometry, Transform

# ---- group: Cylinder num. #2 form Left
unit_x_8 = UnitX(Factor=Slider(151, range=0..1000))
cylinder_6 = Cylinder(Base=PlaneXY(0, 0, 0), Radius=Slider(0.75, range=0.01..10), Length=Slider(8, range=0..10))
move_20 = Move(Geometry=cylinder_6, Motion=unit_x_8)  # -> Geometry, Transform
unit_z_8 = UnitZ(Factor=Slider(17, range=0..100))
move_21 = Move(Geometry=move_20.Geometry, Motion=unit_z_8)  # -> Geometry, Transform
unit_y_6 = UnitY(Factor=Slider(-15, range=-40..1000))
move_22 = Move(Geometry=move_21.Geometry, Motion=unit_y_6)  # -> Geometry, Transform

# ---- group: Cylinder num.#4 from Left
unit_x_9 = UnitX(Factor=Slider(159, range=0..1000))
cylinder_7 = Cylinder(Base=PlaneXY(0, 0, 0), Radius=Slider(0.75, range=0.01..10), Length=Slider(10, range=0..10))
move_23 = Move(Geometry=cylinder_7, Motion=unit_x_9)  # -> Geometry, Transform
unit_z_9 = UnitZ(Factor=Slider(17, range=0..100))
move_24 = Move(Geometry=move_23.Geometry, Motion=unit_z_9)  # -> Geometry, Transform
unit_y_7 = UnitY(Factor=Slider(-15, range=-40..1000))
move_25 = Move(Geometry=move_24.Geometry, Motion=unit_y_7)  # -> Geometry, Transform

# ---- group: Middle Cylinder
unit_x_10 = UnitX(Factor=Slider(163, range=0..1000))
cylinder_8 = Cylinder(Base=PlaneXY(0, 0, 0), Radius=Slider(0.75, range=0.01..10), Length=Slider(7.5, range=0..10))
move_26 = Move(Geometry=cylinder_8, Motion=unit_x_10)  # -> Geometry, Transform
unit_z_10 = UnitZ(Factor=Slider(17, range=0..100))
move_27 = Move(Geometry=move_26.Geometry, Motion=unit_z_10)  # -> Geometry, Transform
unit_y_8 = UnitY(Factor=Slider(-15, range=-40..1000))
move_28 = Move(Geometry=move_27.Geometry, Motion=unit_y_8)  # -> Geometry, Transform

# ---- group: Cylinder num. #3 from Left
unit_x_11 = UnitX(Factor=Slider(155, range=0..1000))
cylinder_9 = Cylinder(Base=PlaneXY(0, 0, 0), Radius=Slider(0.75, range=0.01..10), Length=Slider(9, range=0..10))
move_29 = Move(Geometry=cylinder_9, Motion=unit_x_11)  # -> Geometry, Transform
unit_z_11 = UnitZ(Factor=Slider(17, range=0..100))
move_30 = Move(Geometry=move_29.Geometry, Motion=unit_z_11)  # -> Geometry, Transform
unit_y_9 = UnitY(Factor=Slider(-15, range=-40..1000))
move_31 = Move(Geometry=move_30.Geometry, Motion=unit_y_9)  # -> Geometry, Transform

# ---- group: Cylinder num. #1 form Left
unit_x_12 = UnitX(Factor=Slider(147, range=0..1000))
cylinder_10 = Cylinder(Base=PlaneXY(0, 0, 0), Radius=Slider(0.75, range=0.01..10), Length=Slider(3.5, range=0..10))
move_32 = Move(Geometry=cylinder_10, Motion=unit_x_12)  # -> Geometry, Transform
unit_z_12 = UnitZ(Factor=Slider(17, range=0..100))
move_33 = Move(Geometry=move_32.Geometry, Motion=unit_z_12)  # -> Geometry, Transform
unit_y_10 = UnitY(Factor=Slider(-15, range=-40..1000))
move_34 = Move(Geometry=move_33.Geometry, Motion=unit_y_10)  # -> Geometry, Transform

# ----
merge_3 = Merge(Data1=merge_2, Data2=geometry_3, Data3=geometry_5, Data4=merge)
brep_17 = Brep(move_7.Geometry)
merge_4 = Merge(
    Data1=move_7.Geometry,
    Data2=move_10.Geometry,
    Data3=move_13.Geometry,
    Data4=move_16.Geometry,
    Data5=move_19.Geometry,
    Data6=move_28.Geometry,
    Data7=move_25.Geometry,
    Data8=move_31.Geometry,
    Data9=move_22.Geometry,
    Data10=move_34.Geometry)
bomb = Bomb(DetonationTime=100, Strength=5)
geometry_6 = Geometry(<brep referenced from the Rhino model>)
deconstruct_brep_2 = DeconstructBrep(Brep=geometry_6)  # -> Faces, Edges, Vertices
merge_5 = Merge(Data1=merge_4, Data2=merge_3)
mesh_brep = MeshBrep(
    Brep=deconstruct_brep_2.Faces,
    Settings={GridMaxCount=0, GridMinCount=16, JaggedSeams=False, MaxEdgeLength=0, MinEdgeLength=0.0001, MinTolerance=0, Refine=True, RefineAngle=0, RelativeTolerance=0.65, SimplePlanes=True, Tolerance=0})
cap_holes = CapHoles(Brep=flatten(merge_5))
cap_holes_2 = CapHoles(Brep=flatten(merge_5))
topology_bygeometry_2 = TopologyByGeometry(Geometry=mesh_brep, Tolerance=0.0001)
mesh_brep_2 = MeshBrep(
    Brep=cap_holes,
    Settings={GridMaxCount=0, GridMinCount=16, JaggedSeams=False, MaxEdgeLength=0, MinEdgeLength=0.0001, MinTolerance=0, Refine=True, RefineAngle=0, RelativeTolerance=0.65, SimplePlanes=True, Tolerance=0})
mesh_brep_3 = MeshBrep(
    Brep=cap_holes_2,
    Settings={GridMaxCount=0, GridMinCount=16, JaggedSeams=False, MaxEdgeLength=0, MinEdgeLength=0.0001, MinTolerance=0, Refine=True, RefineAngle=0, RelativeTolerance=0.65, SimplePlanes=True, Tolerance=0})
brep_join = BrepJoin(Breps=cap_holes)  # -> Breps, Closed
brep_join_2 = BrepJoin(Breps=cap_holes_2)  # -> Breps, Closed
geometry_7 = Geometry(brep_join.Breps)
geometry_8 = Geometry(brep_join_2.Breps)
topology_selfmerge = TopologySelfMerge(Topology=topology_bygeometry_2)
topology_bygeometry_3 = TopologyByGeometry(Geometry=mesh_brep_2, Tolerance=0.0001)
topology_bygeometry_4 = TopologyByGeometry(Geometry=mesh_brep_3, Tolerance=0.0001)
topology_faces = TopologyFaces(Topology=topology_selfmerge)  # -> flatten(Faces)
topology_faces_2 = TopologyFaces(Topology=topology_bygeometry_3)  # -> flatten(Faces)
topology_faces_3 = TopologyFaces(Topology=topology_bygeometry_4)  # -> flatten(Faces)
cellcomplex_byfaces_2 = CellComplexByFaces(Faces=topology_faces, Tolerance=0.001)
cellcomplex_byfaces_3 = CellComplexByFaces(Faces=topology_faces_2, Tolerance=0.001)
cellcomplex_byfaces_4 = CellComplexByFaces(Faces=topology_faces_3, Tolerance=0.001)
topology_geometry_2 = TopologyGeometry(Topology=cellcomplex_byfaces_2, Tolerance=0.0001)
topology_geometry_3 = TopologyGeometry(Topology=cellcomplex_byfaces_3, Tolerance=0.0001)
topology_geometry_4 = TopologyGeometry(Topology=cellcomplex_byfaces_4, Tolerance=0.0001)
geometry_9 = Geometry(topology_geometry_3)
geometry_10 = Geometry(topology_geometry_4)
