# Grasshopper definition Circle_Split_Experiment.gh (Grasshopper 1.0.7)

# ---- group: Divide Curve Day 1 Session 2
number_slider = Slider(27, range=8..50)
curve = Curve(<curve referenced from the Rhino model>)
curve_2 = Curve(<curve referenced from the Rhino model>)
divide_curve = DivideCurve(Curve=curve, Count=number_slider, Kinks=False)  # -> Points, Tangents, Parameters
divide_curve_2 = DivideCurve(Curve=curve_2, Count=number_slider, Kinks=False)  # -> Points, Tangents, Parameters
line = Line(StartPoint=divide_curve.Points, EndPoint=divide_curve_2.Points)
length = Length(Curve=line)
panel = Panel(length)
