# Grasshopper definition Closed_Dispatch.gh (Grasshopper 1.0.7)

curve = Curve([<curve referenced from the Rhino model> x8])
closed = Closed(Curve=curve)  # -> Closed, Periodic
panel = Panel(closed.Closed)
dispatch = Dispatch(List=curve, DispatchPattern=panel)  # -> ListA, ListB
boundary_surfaces = BoundarySurfaces(Edges=dispatch.ListA)
