# Grasshopper definition CurvesToPolygon_Solution.gh (Grasshopper 1.0.7)
# plug-ins: Kangaroo2 Components

# ---- group: Starting Geometry
curve = Curve([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])

# ----
curve_2 = Curve([<curve referenced from the Rhino model> x8])

# ---- group: End result
curve_3 = Curve([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])
join_curves = JoinCurves(Curves=curve_3, Preserve=False)
# 0. Input geometry
# 1. Trim open ends
# 2. Remove lines with open ends
# 3. Join curves
panel = Panel(join_curves)

# ----
curve_4 = Curve([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])

crv = Curve(curve_2)
bbox = BoundingBox(Content=crv, Plane=PlaneXY(0, 0, 0), UnionBox=True)  # -> Box, Box_2
debrep = DeconstructBrep(Brep=bbox.Box)  # -> Faces, Edges, Vertices
panel_2 = Panel("""5
8
9""")
srfsplit = SurfaceSplit(Surface=debrep.Faces, Curves=crv)
item = ListItem(List=srfsplit, Index=panel_2, Wrap=True)
item_2 = ListItem(List=item, Index=0, Wrap=True)  # -> Item, Item1, Item2
runion = RegionUnion(Curves=[item_2.Item, item_2.Item2])
runion_2 = RegionUnion(Curves=[item_2.Item1, item_2.Item2])
crv_2 = Curve([runion, runion_2])

bbox_2 = BoundingBox(Content=curve_4, Plane=PlaneXY(0, 0, 0), UnionBox=True)  # -> Box, Box_2
project = Project(Geometry=bbox_2.Box, Plane=PlaneXY(0, 0, 0))  # -> Geometry, Transform
offset = OffsetCurve(Curve=project.Geometry, Distance=Slider(10, range=0..10), Plane=project.Geometry, Corners=1)
srfsplit_2 = SurfaceSplit(Surface=offset, Curves=curve_4)
sort = SortList(Keys=srfsplit_2, ValuesA=srfsplit_2)  # -> Keys, reverse(ValuesA)
cull_i = CullIndex(List=sort.ValuesA, Indices="0", Wrap=True)
explode = Explode(Curve=cull_i, Recursive=True)  # -> flatten(Segments), Vertices
X = UnitX(Factor=1)
dupln = RemoveDuplicateLines(Lines=explode.Segments, Tolerance=0.01)
angle = Angle(VectorA=dupln, VectorB=X)  # -> Angle, Reflex
expression = Expression(x=angle.Angle, Expression="Abs(Sin (x))")
cset = CreateSet(List=expression)  # -> Set, Map
mindex = MemberIndex(Set=expression, Member=cset.Set)  # -> Index, Count
item_3 = ListItem(List=dupln, Index=mindex.Index, Wrap=True)
join = JoinCurves(Curves=flatten(item_3), Preserve=False)
item_4 = ListItem(List=reverse(join), Index=0, Wrap=True)

explode_2 = Explode(Curve=curve, Recursive=True)  # -> flatten(Segments), Vertices
X_2 = UnitX(Factor=1)
dupln_2 = RemoveDuplicateLines(Lines=explode_2.Segments, Tolerance=0.01)
angle_2 = Angle(VectorA=dupln_2, VectorB=X_2)  # -> Angle, Reflex
expression_2 = Expression(x=angle_2.Angle, Expression="Abs(Sin (x))")
cset_2 = CreateSet(List=expression_2)  # -> Set, Map
mindex_2 = MemberIndex(Set=expression_2, Member=cset_2.Set)  # -> Index, Count
item_5 = ListItem(List=dupln_2, Index=mindex_2.Index, Wrap=True)
join_2 = JoinCurves(Curves=flatten(item_5), Preserve=False)
item_6 = ListItem(List=join_2, Index=0, Wrap=True)

mcx = MultipleCurves(Curves=curve_2)  # -> Points, IndexA, IndexB, ParamA, ParamB
crv_cp = CurveClosestPoint(Point=mcx.Points, Curve=graft(curve_2))  # -> Point, Parameter, Distance
smaller = SmallerThan(FirstNumber=crv_cp.Distance, SecondNumber=0.01)  # -> SmallerThan, OrEqualTo
cull = CullPattern(List=crv_cp.Parameter, CullPattern=smaller.SmallerThan)
sort_2 = SortList(Keys=cull)  # -> Keys, ValuesA
shatter = Shatter(Curve=graft(curve_2), Parameters=sort_2.Keys)
panel_3 = Panel("""0
-1""")
cull_i_2 = CullIndex(List=shatter, Indices=panel_3, Wrap=True)
join_3 = JoinCurves(Curves=cull_i_2, Preserve=False)
join_4 = JoinCurves(Curves=flatten(join_3), Preserve=False)
item_7 = ListItem(List=reverse(join_4), Index=0, Wrap=True)
