# Grasshopper definition CurvesToPolygon_Solution01.gh (Grasshopper 1.0.7)
# plug-ins: Heteroptera, Kangaroo2 Components

# ---- group: End result
curve = Curve([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])
join_curves = JoinCurves(Curves=curve, Preserve=False)
# 0. Input geometry
# 1. Trim open ends
# 2. Remove lines with open ends
# 3. Join curves
panel = Panel(join_curves)

# ---- group: Starting Geometry
curve_2 = Curve([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])

# ----
georegion = GeometricRegion(Curves=curve_2)
explode = Explode(Curve=georegion, Recursive=True)  # -> flatten(Segments), Vertices
X = UnitX(Factor=1)
dupln = RemoveDuplicateLines(Lines=explode.Segments, Tolerance=0.01)
angle = Angle(VectorA=dupln, VectorB=X)  # -> Angle, Reflex
expression = Expression(x=angle.Angle, Expression="Abs(Sin (x))")
cset = CreateSet(List=expression)  # -> Set, Map
mindex = MemberIndex(Set=expression, Member=cset.Set)  # -> Index, Count
item = ListItem(List=dupln, Index=mindex.Index, Wrap=True)
join = JoinCurves(Curves=flatten(item), Preserve=False)
