# Grasshopper definition CurvesToPolygon_Solution02.gh (Grasshopper 1.0.7)
# plug-ins: Heteroptera, Kangaroo2 Components, Bifocals

# ---- group: Starting Geometry
curve = Curve([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])

# ---- group: End result
curve_2 = Curve([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])
join_curves = JoinCurves(Curves=curve_2, Preserve=False)
# 0. Input geometry
# 1. Trim open ends
# 2. Remove lines with open ends
# 3. Join curves
panel = Panel(join_curves)

# ----
georegion = GeometricRegion(Curves=curve)
explode = Explode(Curve=georegion, Recursive=True)  # -> flatten(Segments), Vertices
unit_x = UnitX(Factor=1)
removeduplicatelines = RemoveDuplicateLines(Lines=explode.Segments, Tolerance=0.01)
angle = Angle(VectorA=removeduplicatelines, VectorB=unit_x)  # -> Angle, Reflex
expression = Expression(Variable_x=angle.Angle, Expression="Abs(Sin (x))")
create_set = CreateSet(List=expression)  # -> Set, Map
member_index = MemberIndex(Set=expression, Member=create_set.Set)  # -> Index, Count
list_item = ListItem(List=removeduplicatelines, Index=member_index.Index, Wrap=True)
join_curves_2 = JoinCurves(Curves=flatten(list_item), Preserve=False)
list_item_2 = ListItem(List=join_curves_2, Index=0, Wrap=True)

multiple_curves = MultipleCurves(Curves=curve)  # -> Points, IndexA, IndexB, ParamA, ParamB
curve_closest_point = CurveClosestPoint(Point=multiple_curves.Points, Curve=graft(curve))  # -> Point, Parameter, Distance
smaller_than = SmallerThan(FirstNumber=curve_closest_point.Distance, SecondNumber=0.01)  # -> SmallerThan, OrEqualTo
cull_pattern = CullPattern(List=curve_closest_point.Parameter, CullPattern=smaller_than.SmallerThan)
sort_list = SortList(Keys=cull_pattern)  # -> Keys, ValuesA
shatter = Shatter(Curve=graft(curve), Parameters=sort_list.Keys)
panel_2 = Panel("""0
-1""")
cull_index = CullIndex(List=shatter, Indices=panel_2, Wrap=True)
join_curves_3 = JoinCurves(Curves=cull_index, Preserve=False)
join_curves_4 = JoinCurves(Curves=flatten(join_curves_3), Preserve=False)
list_item_3 = ListItem(List=reverse(join_curves_4), Index=0, Wrap=True)

# ----
# We're creating a bounding box.
bounding_box = BoundingBox(Content=curve, Plane=PlaneXY(0, 0, 0), UnionBox=True)  # -> Box, Box_2
# Then we're taking the outline of the bounding box
project = Project(Geometry=bounding_box.Box, Plane=PlaneXY(0, 0, 0))  # -> Geometry, Transform
offset_curve = OffsetCurve(Curve=project.Geometry, Distance=Slider(10, range=0..10), Plane=project.Geometry, Corners=1)
surface_split = SurfaceSplit(Surface=offset_curve, Curves=curve)
sort_list_2 = SortList(Keys=surface_split, ValuesA=surface_split)  # -> Keys, reverse(ValuesA)
cull_index_2 = CullIndex(List=sort_list_2.ValuesA, Indices="0", Wrap=True)
explode_2 = Explode(Curve=cull_index_2, Recursive=True)  # -> flatten(Segments), Vertices
removeduplicatelines_2 = RemoveDuplicateLines(Lines=explode_2.Segments, Tolerance=0.01)
unit_x_2 = UnitX(Factor=1)
angle_2 = Angle(VectorA=removeduplicatelines_2, VectorB=unit_x_2)  # -> Angle, Reflex
expression_2 = Expression(Variable_x=angle_2.Angle, Expression="Abs(Sin (x))")
create_set_2 = CreateSet(List=expression_2)  # -> Set, Map
member_index_2 = MemberIndex(Set=expression_2, Member=create_set_2.Set)  # -> Index, Count
list_item_4 = ListItem(List=removeduplicatelines_2, Index=member_index_2.Index, Wrap=True)
join_curves_5 = JoinCurves(Curves=flatten(list_item_4), Preserve=False)
list_item_5 = ListItem(List=reverse(join_curves_5), Index=0, Wrap=True)
