# Grasshopper definition CurvesToPolygon_V02.gh (Grasshopper 1.0.7)
# plug-ins: Python

crv = Curve([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])
crv_2 = Curve(crv)
crv_3 = Curve(crv)
crv_4 = Curve(reparameterize(crv_2))
group = Group(Objects=crv_3)
box_corners = BoxCorners(Box=group)  # -> CornerA, CornerB, CornerC, CornerD, CornerE, CornerF, CornerG, CornerH
mcx = MultipleCurves(Curves=crv_4)  # -> Points, IndexA, IndexB, ParamA, ParamB
pt = Point([box_corners.CornerA, box_corners.CornerB, box_corners.CornerC, box_corners.CornerD])
merge = Merge(Data1=mcx.IndexA, Data2=mcx.IndexB)
merge_2 = Merge(Data1=mcx.ParamA, Data2=mcx.ParamB)
pline = PolyLine(Vertices=pt, Closed=invert(False))
sort = SortList(Keys=merge, ValuesA=merge_2)  # -> Keys, ValuesA
offset = OffsetCurve(Curve=pline, Distance=1, Plane=PlaneXY(0, 0, 0), Corners=1)
cset = CreateSet(List=sort.Keys)  # -> Set, Map
srfsplit = SurfaceSplit(Surface=offset, Curves=crv_3)
mindex = MemberIndex(Set=sort.Keys, Member=cset.Set)  # -> Index, Count
sort_2 = SortList(Keys=srfsplit, ValuesA=srfsplit)  # -> Keys, ValuesA
partition = PartitionList(List=sort.ValuesA, Size=mindex.Count)
cull_i = CullIndex(List=sort_2.ValuesA, Indices=-1, Wrap=True)
sort_3 = SortList(Keys=partition)  # -> Keys, ValuesA
# Result Polylines
borders = BrepBorders(Brep=cull_i)  # -> flatten(Crv)
item = ListItem(List=sort_3.Keys, Index=0, Wrap=True)
item_2 = ListItem(List=sort_3.Keys, Index=-1, Wrap=True)
python = GhPythonScript(x=item, y=item_2)  # -> out, a, b; inputs x: Boolean
# ---------- python: Python ----------
if x == 0:
    a = -1
else:
    a = 0
    
if y == 1:
    b = 0
else:
    b = -1
# ---------- end python ----------
shatter = Shatter(Curve=graft(crv_4), Parameters=sort_3.Keys)  # -> simplify(Segments)
merge_3 = Merge(Data1=python.a, Data2=python.b)  # -> simplify(Result)
index = ItemIndex(List=crv_4, Item=crv_4)
cls = Closed(Curve=crv_4)  # -> Closed, Periodic
dispatch = Dispatch(List=index, DispatchPattern=cls.Closed)  # -> ListA, ListB
branch = TreeBranch(Tree=shatter, Path=dispatch.ListB, MaintainPaths=True)
branch_2 = TreeBranch(Tree=merge_3, Path=dispatch.ListB, MaintainPaths=True)
cull_i_2 = CullIndex(List=branch, Indices=branch_2, Wrap=True)  # -> simplify(List)
branch_3 = TreeBranch(Tree=shatter, Path=dispatch.ListA, MaintainPaths=True)
group_2 = Group(Objects=branch_3)  # -> flatten(Group)
group_3 = Group(Objects=cull_i_2)  # -> flatten(Group)
panel = Panel(group_3)
ins = InsertItems(List=group_3, Item=group_2, Indices=dispatch.ListA, Wrap=True)  # -> graft(List)
# Result curves
ungroup = Ungroup(Group=ins)  # -> simplify(Objects)
