# Grasshopper definition End_Points_On_Curve.gh (Grasshopper 1.0.7)
# plug-ins: Bifocals

curve = Curve([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])
curve_2 = Curve(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)
length = Length(Curve=curve_2)
end_points = EndPoints(Curve=curve)  # -> Start, End
end_points_2 = EndPoints(Curve=curve_2)  # -> Start, End
point_on_curve = PointOnCurve(curve_2, parameter=0.75)
panel = Panel(length)
deconstruct = Deconstruct(Point=end_points.Start)  # -> XComponent, YComponent, ZComponent
deconstruct_2 = Deconstruct(Point=end_points_2.Start)  # -> XComponent, YComponent, ZComponent
sort_list = SortList(Keys=deconstruct.XComponent, ValuesA=curve)  # -> Keys, ValuesA
loft = Loft(
    Curves=sort_list.ValuesA,
    Options={Adjust=False, Closed=False, LoftEnds=0, LoftSimp=0, LoftType=0, Rebuild=10, Refit=0.01})
custom_preview = CustomPreview(Geometry=loft, Material=ColourSwatch(SwatchColor=RGB(122, 118, 155)))
