# Grasshopper definition Experimenting_With_Capholesgh.gh (Grasshopper 1.0.7)

xz_plane = XZPlane(Origin=Point(0, 0, 0))
xy_plane = XYPlane(Origin=Point(0, 0, 0))
rotate = Rotate(Geometry=xy_plane, Angle=degrees(Slider(45, range=0..100)), Plane=xz_plane)  # -> Geometry, Transform
construct_point = ConstructPoint(XCoordinate=Slider(10, range=0..100), YCoordinate=Slider(15, range=0..100), ZCoordinate=0)
construct_point_2 = ConstructPoint(XCoordinate=Slider(15, range=0..100), YCoordinate=Slider(10, range=0..100), ZCoordinate=0)
construct_point_3 = ConstructPoint(XCoordinate=Slider(20, range=0..100), YCoordinate=Slider(10, range=0..100), ZCoordinate=0)
construct_point_4 = ConstructPoint(XCoordinate=Slider(10, range=0..100), YCoordinate=Slider(20, range=0..100), ZCoordinate=0)
plane_surface = PlaneSurface(Plane=rotate.Geometry, XSize=Domain(-10, 10), YSize=Domain(-10, 10))
unit_y = UnitY(Factor=Slider(11, range=0..100))
box_2pt = Box2Pt(PointA=construct_point_3, PointB=construct_point_4, Plane=PlaneXY(0, 0, 0))
box_2pt_2 = Box2Pt(PointA=construct_point, PointB=construct_point_2, Plane=PlaneXY(0, 0, 0))
move = Move(Geometry=plane_surface, Motion=unit_y)  # -> Geometry, Transform
box_rectangle = BoxRectangle(Rectangle=box_2pt, Height=Slider(2, range=0..10))
box_rectangle_2 = BoxRectangle(Rectangle=box_2pt_2, Height=Slider(5, range=0..10))
unit_y_2 = UnitY(Factor=Slider(-7, range=-10..10))
unit_x = UnitX(Factor=Slider(12, range=0..100))
move_2 = Move(Geometry=box_rectangle, Motion=unit_y_2)  # -> Geometry, Transform
move_3 = Move(Geometry=move.Geometry, Motion=unit_x)  # -> Geometry, Transform
brep = Brep([box_rectangle_2, move_2.Geometry])
split_brep = SplitBrep(Brep=brep, Cutter=move_3.Geometry)
panel = Panel(split_brep)
dispatch = Dispatch(List=split_brep, DispatchPattern=[True, False])  # -> ListA, ListB
geometry = Geometry(dispatch.ListA)
geometry_2 = Geometry(dispatch.ListB)
cap_holes = CapHoles(Brep=geometry)
cap_holes_2 = CapHoles(Brep=geometry_2)
