# Grasshopper definition Gradiant.gh (Grasshopper 1.0.7)

ln = Line(StartPoint=Point(0, 0, 0), EndPoint=Point(2, -1, 0))
rad = Radians(Degrees=Slider(8, range=0..180))
c_script = CSharpScript(inputLine=ln, angle=rad, minLength=Slider(1, range=1..10), Reference="C:\Program Files\Rhino 7 WIP\System\Rhino.UI.dll")  # -> out, Lines, Lengths, Domain, Remap; inputs inputLine: Line, angle: Double, minLength: Double
# ---------- c_script: C# usings ----------
using System.Linq;
# ---------- c_script: C# ----------
    var lines = new List<Line>(){inputLine};
    DivideAndRotate(inputLine, lines, angle, minLength);
    Lines = lines;

    //Substituting the length component
    var lengths = lines.Select(line => line.Length).ToList();
    Lengths = lengths;

    //substituting the Bounds component
    var bounds = new Interval(lengths.Min(), lengths.Max());
    Domain = bounds;

    //substituting the remap component
    var remap = lengths.Select(len => RemapValues(len, bounds.Min, bounds.Max)).ToList();
    Remap = remap;

    _lines = lines;
    _parameters = remap;
# ---------- c_script: C# additional code ----------
  private static void DivideAndRotate(Line line, List<Line> lines, double angle, double minLength)
  {
    if(line.Length < minLength) return;

    var endpt = line.PointAt(0.95);
    line.To = endpt;

    var xform = Transform.Rotation(angle, Vector3d.ZAxis, line.From);
    line.Transform(xform);

    lines.Add(line);
    DivideAndRotate(line, lines, angle, minLength);
  }
  private static double RemapValues (double aValue, double leftMin, double leftMax)
  {
    var leftSpan = leftMax - leftMin;
    return (aValue - leftMin) / leftSpan;
  }

  List<double> _parameters;
  List<Line> _lines;
  public override void DrawViewportWires(IGH_PreviewArgs args)
  {
    var gradiant = Grasshopper.GUI.Gradient.GH_Gradient.Heat();
    if (_lines == null) return;
    for (var i = 0; i < _lines.Count; i++)
      args.Display.DrawLine(_lines[i], gradiant.ColourAt(_parameters[i]), 2);
  }
# ---------- end c_script ----------
