# Grasshopper definition House_Building_Experiment.gh (Grasshopper 1.0.7)

# ---- group: Base Building
xz_plane = XZPlane(Origin=Point(0, 0, 0))
yz_plane = YZPlane(Origin=Point(0, 0, 0))
xz_plane_2 = XZPlane(Origin=Point(0, 0, 0))
yz_plane_2 = YZPlane(Origin=Point(0, 0, 0))
square = Square(Plane=PlaneXY(0, 0, 0), Size=1, ExtentX=Slider(29, range=0..100), ExtentY=Slider(23, range=0..100))  # -> Cells, Points
square_2 = Square(Plane=xz_plane, Size=1, ExtentX=Slider(29, range=0..100), ExtentY=Slider(5, range=0..100))  # -> Cells, Points
square_3 = Square(Plane=yz_plane, Size=1, ExtentX=Slider(23, range=0..100), ExtentY=Slider(5, range=0..10))  # -> Cells, Points
square_4 = Square(Plane=xz_plane_2, Size=1, ExtentX=Slider(29, range=0..100), ExtentY=Slider(5, range=0..100))  # -> Cells, Points
vector_xyz = VectorXYZ(XComponent=0, YComponent=Slider(23, range=0..100), ZComponent=0)  # -> Vector, Length
square_5 = Square(Plane=yz_plane_2, Size=1, ExtentX=Slider(23, range=0..100), ExtentY=Slider(5, range=0..10))  # -> Cells, Points
vector_xyz_2 = VectorXYZ(XComponent=Slider(29, range=0..100), YComponent=0, ZComponent=0)  # -> Vector, Length
square_6 = Square(Plane=PlaneXY(0, 0, 0), Size=1, ExtentX=Slider(29, range=0..100), ExtentY=Slider(23, range=0..100))  # -> Cells, Points
vector_xyz_3 = VectorXYZ(XComponent=0, YComponent=0, ZComponent=Slider(5, range=0..10))  # -> Vector, Length
move = Move(Geometry=square_5.Cells, Motion=vector_xyz_2.Vector)  # -> Geometry, Transform
move_2 = Move(Geometry=square_6.Cells, Motion=vector_xyz_3.Vector)  # -> Geometry, Transform

# ----
move_3 = Move(Geometry=square_4.Cells, Motion=vector_xyz.Vector)  # -> Geometry, Transform

# ---- group: Arc
arc = Arc(Plane=PlaneXY(0, 0, 0), Radius=Slider(14.6, range=0..100), Angle=Domain(0, 3.141592654))  # -> Arc, Length
unit_x = UnitX(Factor=Slider(14.51, range=0..100))
move_4 = Move(Geometry=arc.Arc, Motion=unit_x)  # -> Geometry, Transform
rotate = Rotate(Geometry=move_4.Geometry, Angle=degrees(Slider(180, range=0..1000)), Plane=PlaneXY(0, 0, 0))  # -> Geometry, Transform
unit_x_2 = UnitX(Factor=Slider(29, range=0..100))
move_5 = Move(Geometry=rotate.Geometry, Motion=unit_x_2)  # -> Geometry, Transform

# ----
construct_point = ConstructPoint(XCoordinate=Slider(27, range=-100..100), YCoordinate=Slider(6, range=-100..100), ZCoordinate=Slider(9, range=-100..100))
construct_point_2 = ConstructPoint(XCoordinate=Slider(11, range=-100..100), YCoordinate=Slider(6, range=-100..100), ZCoordinate=Slider(9, range=-100..100))
construct_point_3 = ConstructPoint(XCoordinate=Slider(27, range=-100..100), YCoordinate=Slider(20, range=-100..100), ZCoordinate=Slider(9, range=-100..100))
construct_point_4 = ConstructPoint(XCoordinate=Slider(11, range=-100..100), YCoordinate=Slider(20, range=-100..100), ZCoordinate=Slider(9, range=-100..100))
line = Line(StartPoint=construct_point_3, EndPoint=construct_point)
line_2 = Line(StartPoint=construct_point, EndPoint=construct_point_2)
line_3 = Line(StartPoint=construct_point_3, EndPoint=construct_point_4)
line_4 = Line(StartPoint=construct_point_2, EndPoint=construct_point_4)
construct_point_5 = ConstructPoint(XCoordinate=Slider(-3, range=-100..100), YCoordinate=Slider(20, range=-100..100), ZCoordinate=Slider(5, range=-100..100))
construct_point_6 = ConstructPoint(XCoordinate=Slider(-3, range=-100..100), YCoordinate=Slider(-3, range=-100..100), ZCoordinate=Slider(5, range=-100..100))
construct_point_7 = ConstructPoint(XCoordinate=Slider(20, range=-100..100), YCoordinate=Slider(-3, range=-100..100), ZCoordinate=Slider(5, range=-100..100))
construct_point_8 = ConstructPoint(XCoordinate=Slider(20, range=-100..100), YCoordinate=Slider(20, range=-100..100), ZCoordinate=Slider(5, range=-100..100))
join_curves = JoinCurves(Curves=[line, line_2, line_3, line_4], Preserve=False)
unit_z = UnitZ(Factor=Slider(4, range=0..10))
line_5 = Line(StartPoint=construct_point_5, EndPoint=construct_point_6)
line_6 = Line(StartPoint=construct_point_5, EndPoint=construct_point_8)
line_7 = Line(StartPoint=construct_point_6, EndPoint=construct_point_7)
line_8 = Line(StartPoint=construct_point_7, EndPoint=construct_point_8)
move_6 = Move(Geometry=join_curves, Motion=unit_z)  # -> Geometry, Transform
join_curves_2 = JoinCurves(Curves=[line_5, line_6, line_7, line_8], Preserve=False)
data = Data(join_curves)
data_2 = Data(move_6.Geometry)
unit_z_2 = UnitZ(Factor=Slider(4, range=0..10))
loft = Loft(Curves=[data, data_2], Options={Adjust=False, Closed=False, LoftEnds=0, LoftSimp=0, LoftType=0, Rebuild=10, Refit=0.01})
move_7 = Move(Geometry=join_curves_2, Motion=unit_z_2)  # -> Geometry, Transform
cap_holes = CapHoles(Brep=loft)
data_3 = Data(join_curves_2)
data_4 = Data(move_7.Geometry)
loft_2 = Loft(
    Curves=[data_3, data_4],
    Options={Adjust=False, Closed=False, LoftEnds=0, LoftSimp=0, LoftType=0, Rebuild=10, Refit=0.01})
cap_holes_2 = CapHoles(Brep=loft_2)
