# Grasshopper definition Ladybug_Sunpath_with_house.gh (Grasshopper 1.0.7)

polygon = Polygon(Plane=PlaneXY(0, 0, 0), Radius=Slider(6000, range=1..1000000), Segments=Slider(4, range=1..10), FilletRadius=0)  # -> Polygon, Length
panel = Panel("https://www.energyplus.net/weather-download/asia_wmo_region_2/TWN//TWN_Taipei.466960_IWEC/all")
rotate = Rotate(Geometry=polygon.Polygon, Angle=degrees(Slider(45, range=0..1000)), Plane=PlaneXY(0, 0, 0))  # -> Geometry, Transform
geometry = Geometry(rotate.Geometry)
ladybug = Ladybug_Ladybug()  # -> out; plug-in component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
explode = Explode(Curve=geometry, Recursive=True)  # -> Segments, Vertices
unit_z = UnitZ(Factor=Slider(3000, range=0..10000))
list_item = ListItem(List=explode.Segments, Index=Slider(4, range=1..4), Wrap=True)
unit_z_2 = UnitZ(Factor=Slider(2500, range=0..10000))
unit_z_3 = UnitZ(Factor=Slider(500, range=0..10000))
move = Move(Geometry=rotate.Geometry, Motion=unit_z)  # -> Geometry, Transform
move_2 = Move(Geometry=list_item, Motion=unit_z_2)  # -> Geometry, Transform
move_3 = Move(Geometry=list_item, Motion=unit_z_3)  # -> Geometry, Transform
boundary_surfaces = BoundarySurfaces(Edges=rotate.Geometry)
boundary_surfaces_2 = BoundarySurfaces(Edges=move.Geometry)
loft = Loft(
    Curves=[move.Geometry, rotate.Geometry],
    Options={Adjust=False, Closed=False, LoftEnds=0, LoftSimp=0, LoftType=0, Rebuild=10, Refit=0.01})
loft_2 = Loft(
    Curves=[move_2.Geometry, move_3.Geometry],
    Options={Adjust=False, Closed=False, LoftEnds=0, LoftSimp=0, LoftType=0, Rebuild=10, Refit=0.01})
cap_holes = CapHoles(Brep=loft)
merge = Merge(Data1=boundary_surfaces_2, Data2=loft, Data3=boundary_surfaces)
downloadepw = Ladybug_downloadEPWWeatherFile(download=Toggle(True))  # -> Output; plug-in component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
epw_stat = Ladybug_OpenEPWAndSTATWeatherFiles(weatherFileURL=panel)  # -> epwFile, statFile; plug-in component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
solid_difference = SolidDifference(BrepsA=cap_holes, BrepsB=loft_2)
importepw = Ladybug_ImportEpw(epwFile=epw_stat.epwFile)  # -> Output, latitude, location, dryBulbTemperature, dewPointTemperature, relativeHumidity, windSpeed, windDirection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; plug-in component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
month = Slider(5, range=1..12)
hour = Slider(12, range=1..24)
day = Slider(31, range=1..31)
sunpath = Ladybug_SunPath(
    location=importepw.location,
    hour=hour,
    day=day,
    month=month,
    timeStep=1,
    sunPathScale=Slider(0.2, range=0..1),
    dailyOrAnnualSunPath=True)  # -> out, sunVectors, sunAltitudes, sunAzimuths, port, sunSpheresMesh, sunPathCrvs, compassCrvs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; plug-in component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
line = Line(StartPoint=sunpath.sunPathCenPts, EndPoint=sunpath.sunPositions)
