# Grasshopper definition Problem_with_meshes.gh (Grasshopper 1.0.7)
# plug-ins: TopologicGH, SAM, Pufferfish

settings_speed = SettingsSpeed()  # disabled
closed_brep_with_curved_roof = Geometry(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)  # disabled
# Example of a "correctly" meshed brep (the desirable result):
number_slider = Slider(3, range=0..10)  # disabled

# ---- group: 4 closed breps
geometry = Geometry([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])  # disabled

# ----
mesh_brep = MeshBrep(Brep=closed_brep_with_curved_roof, Settings=settings_speed)  # disabled
panel = Panel(closed_brep_with_curved_roof)  # disabled
volume = Volume(Geometry=mesh_brep)  # -> Volume, Centroid; disabled
is_mesh_closed = IsMeshClosed(Mesh=mesh_brep)
panel_2 = Panel(geometry)  # disabled
unit_x = UnitX(Factor=number_slider)  # disabled
face_boundaries = FaceBoundaries(Mesh=mesh_brep)  # -> flatten(Boundaries); disabled
panel_3 = Panel("25")  # disabled
area = Area(Geometry=geometry)  # -> Area, Centroid; disabled
panel_4 = Panel(is_mesh_closed)  # disabled
panel_5 = Panel(volume.Volume)  # disabled
move = Move(Motion=unit_x)  # -> Geometry, Transform; disabled
square = Square(Value=panel_3)  # disabled
boolean_toggle = BooleanToggle(True)  # disabled
geometry_2 = Geometry(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)  # disabled
geometry_3 = Geometry([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])  # disabled
division = Division(A=area.Area, B=square)  # disabled
transform = Transform(Geometry=geometry_2, Transform=move.Transform)  # disabled
number_slider_2 = Slider(1, range=0..1)  # disabled
boolean_toggle_2 = BooleanToggle(True)  # disabled
settings_custom = SettingsCustom(
    StitchSeams=boolean_toggle,
    SimplePlanes=boolean_toggle,
    Refine=True,
    MinCount=16,
    MaxCount=400,
    AspectRatio=20,
    MaxDistance=0,
    MaxAngle=20,
    MinEdge=0,
    MaxEdge=0)  # disabled

# ---- group: duble box, with different curved walls
merge = Merge(Data1=geometry_2, Data2=transform)  # -> flatten(Result); disabled

# ----
number_slider_3 = Slider(110, range=0..1000)  # disabled

number_slider_4 = Slider(256, range=0..1000)  # disabled
# How can we decide on how many parts we need to mesh the geometry?
# Are there any special inputs I should change?
number_slider_5 = Slider(32, range=0..100)  # disabled

number_slider_6 = Slider(90, range=0..100)  # disabled
number_slider_7 = Slider(1, range=0..1)  # disabled
boolean_toggle_3 = BooleanToggle(True)  # disabled
number_slider_8 = Slider(1, range=0..1)  # disabled
number_slider_9 = Slider(32, range=0..100)  # disabled
quad_remesh_settings = QuadRemeshSettings(
    TargetCount=division,
    AdaptiveSize=0,
    AdaptiveCount=boolean_toggle_2,
    HardEdges=boolean_toggle_2,
    SeamEdges=number_slider_2,
    Symmetry=0,
    GuideCurves=0)  # disabled
boolean_toggle_4 = BooleanToggle(True)  # disabled
mesh_brep_2 = MeshBrep(Brep=geometry_3, Settings=settings_custom)  # disabled
number_slider_10 = Slider(10, range=0..10)  # disabled
boolean_toggle_5 = BooleanToggle(False)  # disabled
quad_remesh_settings_2 = QuadRemeshSettings(
    TargetCount=number_slider_5,
    AdaptiveSize=number_slider_6,
    AdaptiveCount=boolean_toggle_3,
    HardEdges=boolean_toggle_3,
    SeamEdges=number_slider_7,
    Symmetry=0,
    GuideCurves=0)  # disabled
quad_remesh_settings_3 = QuadRemeshSettings(
    TargetCount=number_slider_9,
    AdaptiveSize=0,
    AdaptiveCount=boolean_toggle_4,
    HardEdges=boolean_toggle_4,
    SeamEdges=number_slider_8,
    Symmetry=0,
    GuideCurves=0)  # disabled
reduce_mesh = ReduceMesh(Mesh=mesh_brep_2, FaceCount=20, Accuracy=number_slider_10, FaceType=0, Distort=boolean_toggle_5, Normalize=False)  # -> Reduced, CountDifference
quad_remesh = QuadRemesh(Mesh=geometry, Settings=quad_remesh_settings)  # disabled
quad_remesh_2 = QuadRemesh(Mesh=merge, Settings=quad_remesh_settings_3)  # disabled
triangulate = Triangulate(Mesh=quad_remesh)  # -> Mesh, Count; disabled
face_boundaries_2 = FaceBoundaries(Mesh=quad_remesh)  # disabled
quad_remesh_3 = QuadRemesh(Mesh=closed_brep_with_curved_roof, Settings=quad_remesh_settings_2)  # disabled
triangulate_2 = Triangulate(Mesh=quad_remesh_2)  # -> Mesh, Count; disabled
face_boundaries_3 = FaceBoundaries(Mesh=quad_remesh_2)  # disabled
# unequal division of roof
face_boundaries_4 = FaceBoundaries(Mesh=triangulate.Mesh)  # -> simplify(Boundaries); disabled
face_boundaries_5 = FaceBoundaries(Mesh=reduce_mesh.Reduced)  # -> simplify(Boundaries); disabled
volume_2 = Volume(Geometry=geometry_3)  # -> Volume, Centroid; disabled
volume_3 = Volume(Geometry=reduce_mesh.Reduced)  # -> Volume, Centroid; disabled
is_mesh_closed_2 = IsMeshClosed(Mesh=reduce_mesh.Reduced)
face_boundaries_6 = FaceBoundaries(Mesh=triangulate_2.Mesh)  # -> simplify(Boundaries); disabled
triangulate_3 = Triangulate(Mesh=quad_remesh_3)  # -> Mesh, Count; disabled
# unequal division of roof
face_boundaries_7 = FaceBoundaries(Mesh=quad_remesh_3)  # disabled
# Geometry is broken, by the meshing process
# (does not represent the original geometry)
brep_join = BrepJoin(Breps=face_boundaries_4)  # -> flatten(Breps), Closed; disabled
brep_join_2 = BrepJoin(Breps=face_boundaries_5)  # -> flatten(Breps), Closed; disabled
# Volume difference
panel_6 = Panel(volume_2.Volume)  # disabled
panel_7 = Panel(volume_3.Volume)  # disabled
panel_8 = Panel(is_mesh_closed_2)  # disabled
brep_join_3 = BrepJoin(Breps=face_boundaries_6)  # -> flatten(Breps), Closed; disabled
face_boundaries_8 = FaceBoundaries(Mesh=triangulate_3.Mesh)  # -> simplify(Boundaries); disabled
merge_faces = MergeFaces(Brep=brep_join.Breps)  # -> Breps, Before, After; disabled
merge_faces_2 = MergeFaces(Brep=brep_join_2.Breps)  # -> Breps, Before, After; disabled
merge_faces_3 = MergeFaces(Brep=brep_join_3.Breps)  # -> Breps, Before, After; disabled

volume_4 = Volume(Geometry=geometry)  # -> Volume, Centroid; disabled
volume_5 = Volume(Geometry=brep_join.Breps)  # -> Volume, Centroid; disabled
panel_9 = Panel(volume_4.Volume)  # disabled
subtraction = Subtraction(A=volume_5.Volume, B=panel_9)  # disabled
# Volume difference
panel_10 = Panel(volume_5.Volume)  # disabled
number_slider_11 = Slider(100, range=0..100)  # disabled
division_2 = Division(A=subtraction, B=panel_9)  # disabled
multiplication = Multiplication(A=division_2, B=number_slider_11)  # disabled
panel_11 = Panel(multiplication)  # disabled

# ----
# Geometry is broken, by the meshing process
# (does not represent the original geometry)
brep_join_4 = BrepJoin(Breps=face_boundaries_8)  # -> flatten(Breps), Closed; disabled
brep = Brep(merge_faces_2.Breps)  # disabled
panel_12 = Panel(merge_faces.Breps)  # disabled
panel_13 = Panel(merge_faces_3.Breps)  # disabled
subtraction_2 = Subtraction(A=panel_7, B=panel_6)  # disabled
brep_2 = Brep(merge_faces.Breps)  # disabled
brep_3 = Brep(merge_faces_3.Breps)  # disabled
merge_faces_4 = MergeFaces(Brep=brep_join_4.Breps)  # -> Breps, Before, After; disabled
volume_6 = Volume(Geometry=brep)  # -> Volume, Centroid; disabled
number_slider_12 = Slider(100, range=0..100)  # disabled
panel_14 = Panel(merge_faces_4.Breps)  # disabled
division_3 = Division(A=subtraction_2, B=panel_6)  # disabled
panel_15 = Panel(volume_6.Volume)  # disabled
brep_4 = Brep(merge_faces_4.Breps)  # disabled

volume_7 = Volume(Geometry=merge)  # -> Volume, Centroid; disabled
# Volume difference
# Target is <2.5%
volume_8 = Volume(Geometry=brep_3)  # -> Volume, Centroid; disabled
panel_16 = Panel(volume_7.Volume)  # disabled
subtraction_3 = Subtraction(A=volume_8.Volume, B=panel_16)  # disabled
panel_17 = Panel(volume_8.Volume)  # disabled
number_slider_13 = Slider(100, range=0..100)  # disabled
division_4 = Division(A=subtraction_3, B=panel_16)  # disabled
multiplication_2 = Multiplication(A=division_4, B=number_slider_13)  # disabled
panel_18 = Panel(multiplication_2)  # disabled

topology_bygeometry = TopologyByGeometry(Geometry=brep_3, Tolerance=0.0001)  # disabled
# External plug-ins
samanalytical_createadjacencyclusterbybr = SAMAnalyticalCreateAdjacencyClusterByBreps(_breps=flatten(brep_3), Tolerance_=1e-06, SAM_ComponentVersion="1.0.1")  # disabled
samanalytical_createpanelby3dgeometry = SAMAnalyticalCreatePanelBy3DGeometry(_3Dgeometry=flatten(brep_3), Simplify_=True, MinArea_=0.001, Tolerance_=1e-06, SAM_ComponentVersion="1.0.1")  # disabled
cellcomplex_bycells = CellComplexByCells(Cells=topology_bygeometry)  # disabled
samadjacencycluster_updatepaneltypes = SAMAdjacencyClusterUpdatePanelTypes(_adjacencyCluster=samanalytical_createadjacencyclusterbybr, SAM_ComponentVersion="1.0.1")  # disabled
create_samadjacencycluster = CreateSAMAdjacencyCluster(
    _panels=flatten(samanalytical_createpanelby3dgeometry),
    Tolerance_=0.0001,
    TryCellComplexByCells_=False,
    MinArea_=0.001,
    SilverSpacing_=0.001,
    _run=invert(False),
    SAM_ComponentVersion="1.0.0")  # -> AdjacencyCluster, Topologies, Panels, Spaces, InternalPanels, ExternalPanels, ShadingPanels, RedundantPanels, Log, Sucessfull; disabled
samadjacencycluster_updatepaneltypes_2 = SAMAdjacencyClusterUpdatePanelTypes(_adjacencyCluster=create_samadjacencycluster.AdjacencyCluster, SAM_ComponentVersion="1.0.1")  # disabled

multiplication_3 = Multiplication(A=division_3, B=number_slider_12)  # disabled

topology_bygeometry_2 = TopologyByGeometry(Geometry=brep_2, Tolerance=0.0001)  # disabled
# External plug-ins
samanalytical_createpanelby3dgeometry_2 = SAMAnalyticalCreatePanelBy3DGeometry(_3Dgeometry=flatten(brep_2), Simplify_=True, MinArea_=0.001, Tolerance_=1e-06, SAM_ComponentVersion="1.0.1")  # disabled
cellcomplex_bycells_2 = CellComplexByCells(Cells=topology_bygeometry_2)  # disabled
create_samadjacencycluster_2 = CreateSAMAdjacencyCluster(
    _panels=flatten(samanalytical_createpanelby3dgeometry_2),
    Tolerance_=0.0001,
    TryCellComplexByCells_=False,
    MinArea_=0.001,
    SilverSpacing_=0.001,
    _run=invert(False),
    SAM_ComponentVersion="1.0.0")  # -> AdjacencyCluster, Topologies, Panels, Spaces, InternalPanels, ExternalPanels, ShadingPanels, RedundantPanels, Log, Sucessfull; disabled
samadjacencycluster_updatepaneltypes_3 = SAMAdjacencyClusterUpdatePanelTypes(_adjacencyCluster=create_samadjacencycluster_2.AdjacencyCluster, SAM_ComponentVersion="1.0.1")  # disabled

subtraction_4 = Subtraction(A=volume_6.Volume, B=panel_6)  # disabled

# ---- group: Volume difference
volume_9 = Volume(Geometry=closed_brep_with_curved_roof)  # -> Volume, Centroid; disabled
volume_10 = Volume(Geometry=brep_4)  # -> Volume, Centroid; disabled
panel_19 = Panel(volume_9.Volume)  # disabled
subtraction_5 = Subtraction(A=volume_10.Volume, B=panel_19)  # disabled
# Target is <2.5%
# Volume difference
panel_20 = Panel(volume_10.Volume)  # disabled
number_slider_14 = Slider(100, range=0..100)  # disabled
division_5 = Division(A=subtraction_5, B=panel_19)  # disabled
multiplication_4 = Multiplication(A=division_5, B=number_slider_14)  # disabled
panel_21 = Panel(multiplication_4)  # disabled

# ----
topology_bygeometry_3 = TopologyByGeometry(Geometry=brep_4, Tolerance=0.0001)  # disabled
samanalytical_createpanelby3dgeometry_3 = SAMAnalyticalCreatePanelBy3DGeometry(_3Dgeometry=flatten(brep_4), Simplify_=True, MinArea_=0.001, Tolerance_=1e-06, SAM_ComponentVersion="1.0.1")  # disabled
# External plug-ins
samanalytical_createadjacencyclusterbybr_2 = SAMAnalyticalCreateAdjacencyClusterByBreps(_breps=flatten(brep_4), Tolerance_=1e-06, SAM_ComponentVersion="1.0.1")  # disabled
cellcomplex_bycells_3 = CellComplexByCells(Cells=topology_bygeometry_3)  # disabled
create_samadjacencycluster_3 = CreateSAMAdjacencyCluster(
    _panels=flatten(samanalytical_createpanelby3dgeometry_3),
    Tolerance_=0.0001,
    TryCellComplexByCells_=False,
    MinArea_=0.001,
    SilverSpacing_=0.001,
    _run=invert(False),
    SAM_ComponentVersion="1.0.0")  # -> AdjacencyCluster, Topologies, Panels, Spaces, InternalPanels, ExternalPanels, ShadingPanels, RedundantPanels, Log, Sucessfull; disabled
samadjacencycluster_updatepaneltypes_4 = SAMAdjacencyClusterUpdatePanelTypes(_adjacencyCluster=samanalytical_createadjacencyclusterbybr_2, SAM_ComponentVersion="1.0.1")  # disabled
samadjacencycluster_updatepaneltypes_5 = SAMAdjacencyClusterUpdatePanelTypes(_adjacencyCluster=create_samadjacencycluster_3.AdjacencyCluster, SAM_ComponentVersion="1.0.1")  # disabled

number_slider_15 = Slider(100, range=0..100)  # disabled
panel_22 = Panel(multiplication_3)  # disabled
division_6 = Division(A=subtraction_4, B=panel_6)  # disabled
multiplication_5 = Multiplication(A=division_6, B=number_slider_15)  # disabled
panel_23 = Panel(multiplication_5)  # disabled
geometry_4 = Geometry(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)
geometry_5 = Geometry(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)
topology_bygeometry_4 = TopologyByGeometry(Geometry=geometry_5, Tolerance=0.0001)
topology_bygeometry_5 = TopologyByGeometry(Geometry=geometry_4, Tolerance=0.0001)
topology_union = TopologyUnion(Topology=topology_bygeometry_4, Topology_2=topology_bygeometry_5, TransferDictionary=False)
topology_merge = TopologyMerge(Topology=topology_bygeometry_4, Topology_2=topology_bygeometry_5, TransferDictionary=False)
topology_geometry = TopologyGeometry(Topology=topology_union, Tolerance=0.0001)
topology_geometry_2 = TopologyGeometry(Topology=topology_merge, Tolerance=0.0001)
geometry_6 = Geometry(topology_geometry_2)
samgeometry_mergeoverlaps = SAMGeometryMergeOverlaps(SAM_ComponentVersion="1.0.0")  # -> Face3Ds, Successful
samgeometry_mergeoverlaps_2 = SAMGeometryMergeOverlaps(_face3Ds=topology_geometry_2, SAM_ComponentVersion="1.0.0")  # -> Face3Ds, Successful
samgeometry_mergeoverlaps_3 = SAMGeometryMergeOverlaps(SAM_ComponentVersion="1.0.0")  # -> Face3Ds, Successful
panel_24 = Panel(geometry_6, SAM_Analytical_Grasshopper_GooPanelParam=True)
samanalytical_mergeoverlappanels = SAMAnalyticalMergeOverlapPanels(
    _analyticalObject=flatten(geometry_6),
    _offset_=1e-06,
    _defaultConstruction_=False,
    _tolerance_=1e-06,
    _run=False,
    SAM_ComponentVersion="1.0.0")  # -> AnalyticalObject, RedundantPanels
create_samadjacencycluster_4 = CreateSAMAdjacencyCluster(
    Tolerance_=0.0001,
    TryCellComplexByCells_=False,
    MinArea_=0.001,
    SilverSpacing_=0.001,
    _run=False,
    SAM_ComponentVersion="1.0.0")  # -> AdjacencyCluster, Topologies, Panels, Spaces, InternalPanels, ExternalPanels, ShadingPanels, RedundantPanels, Log, Sucessfull
