# Grasshopper definition Problem_with_meshes_not_solved.gh (Grasshopper 1.0.7)
# plug-ins: TopologicGH, SAM, Pufferfish

settings_speed = SettingsSpeed()
closed_brep_with_curved_roof = Geometry(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)
# Example of a "correctly" meshed brep (the desirable result):
number_slider = Slider(3, range=0..10)

# ---- group: 4 closed breps
geometry = Geometry([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])

# ----
mesh_brep = MeshBrep(Brep=closed_brep_with_curved_roof, Settings=settings_speed)
panel = Panel(closed_brep_with_curved_roof)
volume = Volume(Geometry=mesh_brep)  # -> Volume, Centroid
is_mesh_closed = IsMeshClosed(Mesh=mesh_brep)
panel_2 = Panel(geometry)
unit_x = UnitX(Factor=number_slider)
face_boundaries = FaceBoundaries(Mesh=mesh_brep)  # -> flatten(Boundaries)
area = Area(Geometry=geometry)  # -> Area, Centroid
panel_3 = Panel(is_mesh_closed)
panel_4 = Panel(volume.Volume)
move = Move(Motion=unit_x)  # -> Geometry, Transform
square = Square(Value="25")
boolean_toggle = BooleanToggle(True)
geometry_2 = Geometry(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)
geometry_3 = Geometry([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])
division = Division(A=area.Area, B=square)
transform = Transform(Geometry=geometry_2, Transform=move.Transform)
boolean_toggle_2 = BooleanToggle(True)
settings_custom = SettingsCustom(
    StitchSeams=boolean_toggle,
    SimplePlanes=boolean_toggle,
    Refine=True,
    MinCount=16,
    MaxCount=400,
    AspectRatio=20,
    MaxDistance=0,
    MaxAngle=20,
    MinEdge=0,
    MaxEdge=0)

# ---- group: duble box, with different curved walls
merge = Merge(Data1=geometry_2, Data2=transform)  # -> flatten(Result)

# ----
number_slider_2 = Slider(110, range=0..1000)

number_slider_3 = Slider(256, range=0..1000)
# How can we decide on how many parts we need to mesh the geometry?
# Are there any special inputs I should change?
number_slider_4 = Slider(32, range=0..100)

boolean_toggle_3 = BooleanToggle(True)
quad_remesh_settings = QuadRemeshSettings(
    TargetCount=division,
    AdaptiveSize=0,
    AdaptiveCount=boolean_toggle_2,
    HardEdges=boolean_toggle_2,
    SeamEdges=Slider(1, range=0..1),
    Symmetry=0,
    GuideCurves=0)
boolean_toggle_4 = BooleanToggle(True)
mesh_brep_2 = MeshBrep(Brep=geometry_3, Settings=settings_custom)
quad_remesh_settings_2 = QuadRemeshSettings(
    TargetCount=number_slider_4,
    AdaptiveSize=Slider(90, range=0..100),
    AdaptiveCount=boolean_toggle_3,
    HardEdges=boolean_toggle_3,
    SeamEdges=Slider(1, range=0..1),
    Symmetry=0,
    GuideCurves=0)
quad_remesh_settings_3 = QuadRemeshSettings(
    TargetCount=Slider(32, range=0..100),
    AdaptiveSize=0,
    AdaptiveCount=boolean_toggle_4,
    HardEdges=boolean_toggle_4,
    SeamEdges=Slider(1, range=0..1),
    Symmetry=0,
    GuideCurves=0)
reduce_mesh = ReduceMesh(Mesh=mesh_brep_2, FaceCount=20, Accuracy=Slider(10, range=0..10), FaceType=0, Distort=Toggle(False), Normalize=False)  # -> Reduced, CountDifference
quad_remesh = QuadRemesh(Mesh=geometry, Settings=quad_remesh_settings)
quad_remesh_2 = QuadRemesh(Mesh=merge, Settings=quad_remesh_settings_3)
triangulate = Triangulate(Mesh=quad_remesh)  # -> Mesh, Count
face_boundaries_2 = FaceBoundaries(Mesh=quad_remesh)
quad_remesh_3 = QuadRemesh(Mesh=closed_brep_with_curved_roof, Settings=quad_remesh_settings_2)
triangulate_2 = Triangulate(Mesh=quad_remesh_2)  # -> Mesh, Count
face_boundaries_3 = FaceBoundaries(Mesh=quad_remesh_2)
# unequal division of roof
face_boundaries_4 = FaceBoundaries(Mesh=triangulate.Mesh)  # -> simplify(Boundaries)
face_boundaries_5 = FaceBoundaries(Mesh=reduce_mesh.Reduced)  # -> simplify(Boundaries)
volume_2 = Volume(Geometry=geometry_3)  # -> Volume, Centroid
volume_3 = Volume(Geometry=reduce_mesh.Reduced)  # -> Volume, Centroid
is_mesh_closed_2 = IsMeshClosed(Mesh=reduce_mesh.Reduced)
face_boundaries_6 = FaceBoundaries(Mesh=triangulate_2.Mesh)  # -> simplify(Boundaries)
triangulate_3 = Triangulate(Mesh=quad_remesh_3)  # -> Mesh, Count
# unequal division of roof
face_boundaries_7 = FaceBoundaries(Mesh=quad_remesh_3)
# Geometry is broken, by the meshing process
# (does not represent the original geometry)
brep_join = BrepJoin(Breps=face_boundaries_4)  # -> flatten(Breps), Closed
brep_join_2 = BrepJoin(Breps=face_boundaries_5)  # -> flatten(Breps), Closed
# Volume difference
panel_5 = Panel(volume_2.Volume)
panel_6 = Panel(volume_3.Volume)
panel_7 = Panel(is_mesh_closed_2)
brep_join_3 = BrepJoin(Breps=face_boundaries_6)  # -> flatten(Breps), Closed
face_boundaries_8 = FaceBoundaries(Mesh=triangulate_3.Mesh)  # -> simplify(Boundaries)
merge_faces = MergeFaces(Brep=brep_join.Breps)  # -> Breps, Before, After
merge_faces_2 = MergeFaces(Brep=brep_join_2.Breps)  # -> Breps, Before, After
merge_faces_3 = MergeFaces(Brep=brep_join_3.Breps)  # -> Breps, Before, After

volume_4 = Volume(Geometry=geometry)  # -> Volume, Centroid
volume_5 = Volume(Geometry=brep_join.Breps)  # -> Volume, Centroid
panel_8 = Panel(volume_4.Volume)
subtraction = Subtraction(A=volume_5.Volume, B=panel_8)
# Volume difference
panel_9 = Panel(volume_5.Volume)
division_2 = Division(A=subtraction, B=panel_8)
multiplication = Multiplication(A=division_2, B=Slider(100, range=0..100))
panel_10 = Panel(multiplication)

# ----
# Geometry is broken, by the meshing process
# (does not represent the original geometry)
brep_join_4 = BrepJoin(Breps=face_boundaries_8)  # -> flatten(Breps), Closed

# ----
# Check for "correct" meshing
topology_bygeometry = TopologyByGeometry(Geometry=brep_join_2.Breps, Tolerance=0.0001)
cellcomplex_bycells = CellComplexByCells(Cells=topology_bygeometry)
cellcomplex_cells = CellComplexCells(CellComplex=cellcomplex_bycells)
topology_geometry = TopologyGeometry(Topology=cellcomplex_cells, Tolerance=0.0001)

brep = Brep(merge_faces_2.Breps)
panel_11 = Panel(merge_faces.Breps)
panel_12 = Panel(merge_faces_3.Breps)
subtraction_2 = Subtraction(A=panel_6, B=panel_5)
brep_2 = Brep(merge_faces.Breps)
brep_3 = Brep(merge_faces_3.Breps)
merge_faces_4 = MergeFaces(Brep=brep_join_4.Breps)  # -> Breps, Before, After
volume_6 = Volume(Geometry=brep)  # -> Volume, Centroid
panel_13 = Panel(merge_faces_4.Breps)
division_3 = Division(A=subtraction_2, B=panel_5)
brep_4 = Brep(merge_faces_4.Breps)

volume_7 = Volume(Geometry=merge)  # -> Volume, Centroid
# Volume difference
# Target is <2.5%
volume_8 = Volume(Geometry=brep_3)  # -> Volume, Centroid
panel_14 = Panel(volume_7.Volume)
subtraction_3 = Subtraction(A=volume_8.Volume, B=panel_14)
panel_15 = Panel(volume_8.Volume)
division_4 = Division(A=subtraction_3, B=panel_14)
multiplication_2 = Multiplication(A=division_4, B=Slider(100, range=0..100))
panel_16 = Panel(multiplication_2)

topology_bygeometry_2 = TopologyByGeometry(Geometry=brep_3, Tolerance=0.0001)
# External plug-ins
samanalytical_createadjacencyclusterbybr = SAMAnalyticalCreateAdjacencyClusterByBreps(_breps=flatten(brep_3), Tolerance_=1e-06, SAM_ComponentVersion="1.0.1")
samanalytical_createpanelby3dgeometry = SAMAnalyticalCreatePanelBy3DGeometry(_3Dgeometry=flatten(brep_3), Simplify_=True, MinArea_=0.001, Tolerance_=1e-06, SAM_ComponentVersion="1.0.1")
cellcomplex_bycells_2 = CellComplexByCells(Cells=topology_bygeometry_2)
samadjacencycluster_updatepaneltypes = SAMAdjacencyClusterUpdatePanelTypes(_adjacencyCluster=samanalytical_createadjacencyclusterbybr, SAM_ComponentVersion="1.0.1")
create_samadjacencycluster = CreateSAMAdjacencyCluster(
    _panels=flatten(samanalytical_createpanelby3dgeometry),
    Tolerance_=0.0001,
    TryCellComplexByCells_=False,
    MinArea_=0.001,
    SilverSpacing_=0.001,
    _run=invert(False),
    SAM_ComponentVersion="1.0.0")  # -> AdjacencyCluster, Topologies, Panels, Spaces, InternalPanels, ExternalPanels, ShadingPanels, RedundantPanels, Log, Sucessfull
samadjacencycluster_updatepaneltypes_2 = SAMAdjacencyClusterUpdatePanelTypes(_adjacencyCluster=create_samadjacencycluster.AdjacencyCluster, SAM_ComponentVersion="1.0.1")

multiplication_3 = Multiplication(A=division_3, B=Slider(100, range=0..100))

topology_bygeometry_3 = TopologyByGeometry(Geometry=brep_2, Tolerance=0.0001)
# External plug-ins
samanalytical_createpanelby3dgeometry_2 = SAMAnalyticalCreatePanelBy3DGeometry(_3Dgeometry=flatten(brep_2), Simplify_=True, MinArea_=0.001, Tolerance_=1e-06, SAM_ComponentVersion="1.0.1")
cellcomplex_bycells_3 = CellComplexByCells(Cells=topology_bygeometry_3)
create_samadjacencycluster_2 = CreateSAMAdjacencyCluster(
    _panels=flatten(samanalytical_createpanelby3dgeometry_2),
    Tolerance_=0.0001,
    TryCellComplexByCells_=False,
    MinArea_=0.001,
    SilverSpacing_=0.001,
    _run=invert(False),
    SAM_ComponentVersion="1.0.0")  # -> AdjacencyCluster, Topologies, Panels, Spaces, InternalPanels, ExternalPanels, ShadingPanels, RedundantPanels, Log, Sucessfull
samadjacencycluster_updatepaneltypes_3 = SAMAdjacencyClusterUpdatePanelTypes(_adjacencyCluster=create_samadjacencycluster_2.AdjacencyCluster, SAM_ComponentVersion="1.0.1")

subtraction_4 = Subtraction(A=volume_6.Volume, B=panel_5)

# ---- group: Volume difference
volume_9 = Volume(Geometry=closed_brep_with_curved_roof)  # -> Volume, Centroid
volume_10 = Volume(Geometry=brep_4)  # -> Volume, Centroid
panel_17 = Panel(volume_9.Volume)
subtraction_5 = Subtraction(A=volume_10.Volume, B=panel_17)
# Target is <2.5%
# Volume difference
panel_18 = Panel(volume_10.Volume)
division_5 = Division(A=subtraction_5, B=panel_17)
multiplication_4 = Multiplication(A=division_5, B=Slider(100, range=0..100))
panel_19 = Panel(multiplication_4)

# ----
topology_bygeometry_4 = TopologyByGeometry(Geometry=brep_4, Tolerance=0.0001)
samanalytical_createpanelby3dgeometry_3 = SAMAnalyticalCreatePanelBy3DGeometry(_3Dgeometry=flatten(brep_4), Simplify_=True, MinArea_=0.001, Tolerance_=1e-06, SAM_ComponentVersion="1.0.1")
# External plug-ins
samanalytical_createadjacencyclusterbybr_2 = SAMAnalyticalCreateAdjacencyClusterByBreps(_breps=flatten(brep_4), Tolerance_=1e-06, SAM_ComponentVersion="1.0.1")
cellcomplex_bycells_4 = CellComplexByCells(Cells=topology_bygeometry_4)
create_samadjacencycluster_3 = CreateSAMAdjacencyCluster(
    _panels=flatten(samanalytical_createpanelby3dgeometry_3),
    Tolerance_=0.0001,
    TryCellComplexByCells_=False,
    MinArea_=0.001,
    SilverSpacing_=0.001,
    _run=invert(False),
    SAM_ComponentVersion="1.0.0")  # -> AdjacencyCluster, Topologies, Panels, Spaces, InternalPanels, ExternalPanels, ShadingPanels, RedundantPanels, Log, Sucessfull
samadjacencycluster_updatepaneltypes_4 = SAMAdjacencyClusterUpdatePanelTypes(_adjacencyCluster=samanalytical_createadjacencyclusterbybr_2, SAM_ComponentVersion="1.0.1")
samadjacencycluster_updatepaneltypes_5 = SAMAdjacencyClusterUpdatePanelTypes(_adjacencyCluster=create_samadjacencycluster_3.AdjacencyCluster, SAM_ComponentVersion="1.0.1")

panel_20 = Panel(multiplication_3)
division_6 = Division(A=subtraction_4, B=panel_5)
multiplication_5 = Multiplication(A=division_6, B=Slider(100, range=0..100))
panel_21 = Panel(topology_geometry)
panel_22 = Panel(multiplication_5)
