# Grasshopper definition Koch_Curve.gh (Grasshopper 1.0.7)

geometry = Geometry(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)
ghpython_script = GhPythonScript(input_crv=geometry, divisions=Slider(7, range=0..10))  # -> out, a; inputs input_crv: Curve, divisions: Int32
# ---------- ghpython_script: Python ----------
__author__ = "micha"
__version__ = "2023.05.01"

import rhinoscriptsyntax as rs
from math import sqrt

def Kochcurve(input_crv):
    
    length = rs.CurveLength(input_crv)
    distance = length/3
    midpoint = rs.CurveMidPoint(input_crv)
    pts = rs.DivideCurve(input_crv, 3)
    endpoint = rs.CurveEndPoint(input_crv)
    
    vector1 = rs.VectorCreate(endpoint, midpoint)
    
    product = rs.VectorCrossProduct(vector1, (0,0,1))
    product = distance * rs.VectorUnitize(product)
    
    top_point = midpoint + product
    
    pts.insert(2, top_point)
    
    return(rs.AddPolyline(pts))
    

pts = []
output = []
if divisions > 1:
    input_crv = Kochcurve(input_crv)
    for i in range (2, divisions+1):
        print(i)
        segment_pts = rs.CurvePoints(input_crv)
        for j in range(0, len(segment_pts) - 1):
            crv_pts= [segment_pts[j], segment_pts[j+1]]
            pts.append(crv_pts)
            segment = rs.AddCurve(crv_pts)
            KochSegment = Kochcurve(segment)
            output.append(KochSegment)
        input_crv = rs.JoinCurves(output)
        output = []
    a = input_crv
elif divisions == 1:
    a = Kochcurve(input_crv)
else:
    a = input_crv
# ---------- end ghpython_script ----------
geometry_2 = Geometry(ghpython_script.a)
panel = Panel(ghpython_script.out)
