# Grasshopper definition Sierpinski_Triangle.gh (Grasshopper 1.0.7)

number_slider = Slider(100, range=0..100)
ghpython_script = GhPythonScript(length=Slider(10, range=0..10))  # -> out, triangle; inputs length: Int32
# ---------- ghpython_script: Python ----------
__author__ = "micha"
__version__ = "2023.05.09"

import rhinoscriptsyntax as rs
from math import sqrt

#base = rs.AddCurve((0,0), (0, length/2))


triangle = rs.AddPolyline(((0,0), (length/2, sqrt(3/4* length**2)), (length, 0), (0,0)))
# ---------- end ghpython_script ----------
ghpython_script_2 = GhPythonScript(input_tri=ghpython_script.triangle, divisions=Slider(5, range=1..10))  # -> out, a; inputs input_tri: Curve, divisions: Int32
# ---------- ghpython_script_2: Python ----------
__author__ = "micha"
__version__ = "2023.05.09"

import rhinoscriptsyntax as rs

def SierpinskiSplit(input_tri):
    pts = rs.DivideCurve(input_tri,3)
    midpoint0 = (pts[0] + pts[1])/2
    midpoint1 = (pts[1] + pts[2])/2
    midpoint2 = (pts[2] + pts[0])/2
    triangle = rs.AddPolyline((midpoint0, midpoint1, midpoint2, midpoint0))
    return triangle


input_tri_pts = rs.CurvePoints(input_tri)
sierpinskiTriangle = [input_tri, SierpinskiSplit(input_tri)]
input_tri = [input_tri]

for i in range(0, divisions - 1):
    curr_tri = []
    for elem in input_tri:
        input_tri_pts = rs.CurvePoints(elem)
        tri1 = rs.AddPolyline((input_tri_pts[0],(input_tri_pts[0]+input_tri_pts[1])/2, (input_tri_pts[2]+input_tri_pts[0])/2, input_tri_pts[0]))
        tri2 = rs.AddPolyline(((input_tri_pts[0]+input_tri_pts[1])/2,input_tri_pts[1], (input_tri_pts[1]+input_tri_pts[2])/2, (input_tri_pts[0]+input_tri_pts[1])/2))
        tri3 = rs.AddPolyline(((input_tri_pts[1]+input_tri_pts[2])/2, input_tri_pts[2],(input_tri_pts[2]+input_tri_pts[0])/2, (input_tri_pts[1]+input_tri_pts[2])/2))
        curr_tri.append(tri1)
        curr_tri.append(tri2)
        curr_tri.append(tri3)
    for tri in curr_tri:
        sierpinskiTriangle.append(SierpinskiSplit(tri))
    input_tri = curr_tri
    
a = sierpinskiTriangle
# ---------- end ghpython_script_2 ----------
panel = Panel(ghpython_script_2.a)
