# Grasshopper definition Random.gh (Grasshopper 1.0.7)

construct_domain = ConstructDomain(DomainStart=Slider(3, range=1..5), DomainEnd=Slider(8, range=-6..12))
random = Random(Range=construct_domain, Number=Slider(10, range=0..10), Seed=Slider(7.38, range=0..10))
round = Round(Number=random)  # -> Nearest, Floor, Ceiling
integer = Integer(random)
panel = Panel(round.Nearest)
panel_2 = Panel(round.Ceiling)
panel_3 = Panel(integer)
panel_4 = Panel(round.Floor)
