# Grasshopper definition Range_-1.gh (Grasshopper 1.0.7)

range = Range(Domain=Slider(10, range=0..10), Steps=expr("X - 1", Slider(10, range=0..10)))
panel = Panel(range)
list_length = ListLength(List=panel)
