# Grasshopper definition Rhino_Post_Changing_Materials.gh (Grasshopper 1.0.7)

geometry = Geometry([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])
colour = Colour(RGB(0, 7, 255))
circle = Circle(Plane=PlaneXY(0, 0, 0), Radius=Slider(10, range=0..10))
create_material = CreateMaterial(
    Diffuse=colour,
    Specular=RGB(255, 255, 255),
    Emission=RGB(0, 0, 0),
    Transparency=Slider(0.4, range=0.1..1),
    Shine=Slider(100, range=1..100))
surface = Surface(circle)
custom_preview = CustomPreview(Geometry=surface, Material=create_material)
