# Grasshopper definition Ring_Pipe.gh (Grasshopper 1.0.7)

# ---- group: Origin
max_radius = Slider(0.4, range=0.05..1)
min_radius = Slider(0.1, range=0.05..1)
select_the_magnet = Point(Point(0, 0, -4))

# ---- group: Origin / Select Center Curve
curve = Curve(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)

# ---- group: Origin / Right Curve
curve_2 = Curve(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)

# ---- group: Origin / Left Curve
curve_3 = Curve(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)

# ----
number_slider = Slider(42, range=8..50)
divide_curve = DivideCurve(Curve=curve_3, Count=number_slider, Kinks=False)  # -> Points, Tangents, Parameters
divide_curve_2 = DivideCurve(Curve=curve, Count=number_slider, Kinks=False)  # -> Points, Tangents, Parameters
divide_curve_3 = DivideCurve(Curve=curve_2, Count=number_slider, Kinks=False)  # -> Points, Tangents, Parameters
number_slider_2 = Slider(0.35, range=0.05..1)
arc_3pt = Arc3Pt(PointA=divide_curve.Points, PointB=divide_curve_2.Points, PointC=divide_curve_3.Points)  # -> Arc, Plane, Radius
distance = Distance(PointA=divide_curve_2.Points, PointB=select_the_magnet)
panel = Panel(distance)
construct_domain = ConstructDomain(DomainStart=min_radius, DomainEnd=max_radius)
bounds = Bounds(Numbers=panel)
remap_numbers = RemapNumbers(Value=panel, Source=bounds, Target=construct_domain)  # -> Mapped, Clipped
pipe = Pipe(Curve=arc_3pt.Arc, Radius=remap_numbers.Mapped, Caps=Slider(2, range=1..2))
yz_plane = YZPlane(Origin=Point(0, 0, 0))
mirror = Mirror(Geometry=pipe, Plane=PlaneYZ(0, 0, 0))  # -> Geometry, Transform
custom_preview = CustomPreview(Geometry=pipe, Material=ColourSwatch(SwatchColor=RGB(213, 160, 166)))
custom_preview_2 = CustomPreview(Geometry=mirror.Geometry, Material=ColourSwatch(SwatchColor=RGB(255, 255, 255)))
