# Grasshopper definition SAM_Introduction.gh (Grasshopper 1.0.7)
# plug-ins: SAM, SAM.Analytical.Grasshopper.LadybugTools, Bifocals

panel = Panel("""Wall
Floor""")
geometry = Geometry(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)
geometry_2 = Geometry([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])
# We are taking the Rhino Geometry and translating it into SAM.
samanalytical_createpanel = SAMAnalyticalCreatePanel(_geometry=flatten(geometry), Simplify_=True, MinArea_=0.001)
geometry_3 = Geometry(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)
# We are making an aperature in the model.
samanalytical_addaperture = SAMAnalyticalAddAperture(_geometry=geometry_3, _panel=flatten(samanalytical_createpanel), MaxDistance_=0.1, _trimGeometry_=True, MinArea_=0.001)  # -> Panels, Apertures
panel_2 = Panel(samanalytical_addaperture.Panels)
# Here we are making a space, cells.
panel_3 = Panel(samanalytical_addaperture.Panels)
samanalytical_createadjacencycluster = SAMAnalyticalCreateAdjacencyCluster(
    _panels=flatten(samanalytical_addaperture.Panels),
    _tolerance_=0.001,
    _tryCellComplexByCells_=False,
    MinArea_=0.001,
    _run_=Toggle(True))  # -> AdjacencyCluster, Topology, Panels, Spaces, InternalPanels, ExternalPanels, ShadingPanels, Sucessfull
panel_4 = Panel(samanalytical_createadjacencycluster.Panels)
getvalue = GetValue(_object=samanalytical_createadjacencycluster.Spaces, _name="Name")
samadjacencycluster_adjacencyinformation = SAMAdjacencyClusterAdjacencyInformation(_adjacencyCluster=samanalytical_createadjacencycluster.AdjacencyCluster)  # -> Panels, PanelTypes, Geometries, SpaceAdjNames
topology_adjacencies = TopologyAdjacencies(
    _adjacencyCluster=samanalytical_createadjacencycluster.AdjacencyCluster,
    _SAMAnalytical=samanalytical_createadjacencycluster.Spaces)
panel_5 = Panel(samadjacencycluster_adjacencyinformation.Panels)
samanalytical_hbface = SAMAnalyticalHBFace(_panel=topology_adjacencies)  # -> simplify(HBFace)
panel_6 = Panel(topology_adjacencies)
ghpython_script = GhPythonScript(face_str=samanalytical_hbface)  # -> face
# ---------- ghpython_script: Python ----------
__author__ = "micha"
__version__ = "2020.03.21"

import rhinoscriptsyntax as rs
import json
from honeybee.face import Face

if face_str:
    face_dict = json.loads(face_str)
    face = Face.from_dict(face_dict)
# ---------- end ghpython_script ----------
room = HBRoom(faces=ghpython_script, name=graft(getvalue), conditioned=True)  # -> out, simplify(room); plug-in component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
model = HBModel(rooms=flatten(room.room), name="MichalinaTower")  # -> out, model; plug-in component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
boolean_toggle = BooleanToggle(True)
file_path = FilePath("C:\EnergyPlusV9-2-0\WeatherData\USA_IL_Chicago-OHare.Intl.AP.725300_TMY3.epw")

# ---- group: Visulise
labelrooms = HBLabelRooms(rooms=flatten(room.room))  # -> label_text, base_pts, labels, wire_frame; plug-in component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
lablefaces = HBLabelFaces(hb_objs=flatten(room.room))  # -> label_text, base_pts, labels, wire_frame; plug-in component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
vizall = HBVizualizeAll(hb_objs=flatten(room.room))  # -> geo; plug-in component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
vizwiref = HBVizualizeWireframe(hb_objs=flatten(room.room))  # -> geo; plug-in component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

# ----
modeltoidf = HBModelToIDF(
    model=model.model,
    epw_file=file_path,
    folder="C:\Users\micha\OneDrive\Documents\SAM\2020-03-22_example",
    write=boolean_toggle,
    run=boolean_toggle)  # -> out, idf, sql, zsz, rdd, html; plug-in component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

# ---- group: Deconstruct
deconstructmodel = HBDeconstructModel(model=model.model)  # -> rooms, faces, apertures, doors, shades; plug-in component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
decnstrobj = HBDeconstructObject(hb_obj=deconstructmodel.rooms)  # -> faces, apertures, doors, shades; plug-in component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
panel_7 = Panel(decnstrobj.faces)
