# Grasshopper definition SAM_createPanel_bug.gh (Grasshopper 1.0.7)
# plug-ins: SAM

polygon = Polygon(Plane=PlaneXY(0, 0, 0), Radius=Slider(3, range=0..10), Segments=Slider(10, range=0..10), FilletRadius=0)  # -> Polygon, Length
geometryconvert = GeometryConvert(_geometry=polygon.Polygon)
panel = Panel(geometryconvert)
geometryconvert_2 = GeometryConvert(_geometry=geometryconvert)
samanalytical_createconstruction = SAMAnalyticalCreateConstruction(_name="Basic Roof: SIM_EXT_SLD_Roof DA01")
samanalytical_paneltype = SAMAnalyticalPanelType(PanelType=11)
samanalytical_createpanel = SAMAnalyticalCreatePanel(
    _geometry=geometryconvert_2,
    _panelType=samanalytical_paneltype,
    _construction=samanalytical_createconstruction,
    Simplify_=True)
samanalytical_geometry = SAMAnalyticalGeometry(_SAMAnalytical=samanalytical_createpanel)
