# Grasshopper definition 3_methods.gh (Grasshopper 1.0.7)
# plug-ins: SAM

unit_z = UnitZ(Factor=Slider(4, range=0..10))
panel = Panel(
    [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],
    SAM_Analytical_Grasshopper_GooPanelParam=True)
move = Move(Motion=unit_z)  # -> Geometry, Transform
samanalytical_transform = SAMAnalyticalTransform(_analytical=panel, _transform=move.Transform, SAM_ComponentVersion="1.0.0")
panel_2 = Panel(
    [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],
    SAM_Analytical_Grasshopper_GooPanelParam=True)
panel_3 = Panel(samanalytical_transform, SAM_Analytical_Grasshopper_GooPanelParam=True)
merge = Merge(Data1=panel, Data2=panel_3)
geometry = Geometry([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])
geometry_2 = Geometry([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])
samanalytical_createshells = SAMAnalyticalCreateShells(_panels=flatten(merge), SAM_ComponentVersion="1.0.1")
samanalytical_createadjacencycluster = SAMAnalyticalCreateAdjacencyCluster(_geometry=flatten(geometry), Elevation_Ground_=0, Tolerance_=1e-06, SAM_ComponentVersion="1.0.0")
samanalytical_createpanelsbyshell = SAMAnalyticalCreatePanelsByShell(_shell=samanalytical_createshells, SAM_ComponentVersion="1.0.0")  # -> Walls, Floors, Roofs, Others
samanalytical_createadjacencyclusterbybr = SAMAnalyticalCreateAdjacencyClusterByBreps(_breps=flatten(geometry_2), Tolerance_=1e-06, SAM_ComponentVersion="1.0.1")
boolean_toggle = BooleanToggle(True)
boolean_toggle_2 = BooleanToggle(False)
merge_2 = Merge(Data1=merge, Data2=samanalytical_createpanelsbyshell.Floors, Data3=samanalytical_createpanelsbyshell.Roofs)
samanalytical_createanalyticalmodelbyadj = SAMAnalyticalCreateAnalyticalModelByAdjacencyCluster(
    _name_="000000_SAM_AnalyticalModel",
    _description_="Delivered by SAM https://github.com/HoareLea/SAM [2022/06/28]",
    _adjacencyCluster=samanalytical_createadjacencyclusterbybr,
    SAM_ComponentVersion="1.0.4")
samanalytical_createanalyticalmodelbyadj_2 = SAMAnalyticalCreateAnalyticalModelByAdjacencyCluster(
    _name_="000000_SAM_AnalyticalModel",
    _description_="Delivered by SAM https://github.com/HoareLea/SAM [2022/06/28]",
    _adjacencyCluster=samanalytical_createadjacencycluster,
    SAM_ComponentVersion="1.0.4")
panel_4 = Panel(
    [samanalytical_createpanelsbyshell.Roofs, samanalytical_createpanelsbyshell.Floors],
    SAM_Analytical_Grasshopper_GooPanelParam=True)
samanalytical_createadjacencyclusterbysh = SAMAnalyticalCreateAdjacencyClusterByShells(_shells=flatten(samanalytical_createshells), _panels=flatten(merge_2), Tolerance_=1e-06, SAM_ComponentVersion="1.0.4")
samanalytical_mergeoverlappanels = SAMAnalyticalMergeOverlapPanels(
    _analyticalObject=flatten(panel_4),
    _offset_=1e-06,
    _defaultConstruction_=boolean_toggle,
    _tolerance_=1e-06,
    _run=boolean_toggle,
    SAM_ComponentVersion="1.0.0")  # -> AnalyticalObject, RedundantPanels
inspect = Inspect(_object=samanalytical_createanalyticalmodelbyadj_2, SAM_ComponentVersion="1.0.0")
samadjacencycluster_updatepaneltypes = SAMAdjacencyClusterUpdatePanelTypes(_adjacencyCluster=samanalytical_createadjacencyclusterbysh, SAM_ComponentVersion="1.0.1")
merge_3 = Merge()
panel_5 = Panel(samanalytical_mergeoverlappanels.AnalyticalObject, SAM_Analytical_Grasshopper_GooPanelParam=True)
panel_6 = Panel(inspect, SAM_Analytical_Grasshopper_GooPanelParam=True)
samanalytical_createanalyticalmodelbyadj_3 = SAMAnalyticalCreateAnalyticalModelByAdjacencyCluster(
    _name_="000000_SAM_AnalyticalModel",
    _description_="Delivered by SAM https://github.com/HoareLea/SAM [2022/06/28]",
    _adjacencyCluster=samadjacencycluster_updatepaneltypes,
    SAM_ComponentVersion="1.0.4")
samanalytical_createadjacencyclusterbysh_2 = SAMAnalyticalCreateAdjacencyClusterByShells(
    _shells=flatten(samanalytical_createshells),
    _panels=flatten([panel_5, merge]),
    Tolerance_=1e-06,
    SAM_ComponentVersion="1.0.4")
getvaluefilter = GetValueFilter(_objects=panel_6, _name="PanelGroup", _value="Wall", SAM_ComponentVersion="1.0.0")  # -> In, Out
inspect_2 = Inspect(_object=panel_6, SAM_ComponentVersion="1.0.0")  # -> Apertures, Area, AreaNet, Azimuth, BoundingBox, Construction, Face3D, Guid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
samadjacencycluster_updatepaneltypes_2 = SAMAdjacencyClusterUpdatePanelTypes(_adjacencyCluster=samanalytical_createadjacencyclusterbysh_2, SAM_ComponentVersion="1.0.1")
samanalytical_createanalyticalmodelbyadj_4 = SAMAnalyticalCreateAnalyticalModelByAdjacencyCluster(
    _name_="000000_SAM_AnalyticalModel",
    _description_="Delivered by SAM https://github.com/HoareLea/SAM [2022/06/28]",
    _adjacencyCluster=samadjacencycluster_updatepaneltypes_2,
    SAM_ComponentVersion="1.0.4")
