# Grasshopper definition Bug_MergeOverlap.gh (Grasshopper 1.0.7)
# plug-ins: SAM

number_slider = Slider(1e-05, range=0..1e-05)
panel = Panel(
    [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],
    SAM_Analytical_Grasshopper_GooPanelParam=True)
samanalytical_mergeoverlappanels = SAMAnalyticalMergeOverlapPanels(
    _analyticalObject=flatten(panel),
    _offset_=1e-06,
    _defaultConstruction_=False,
    _tolerance_=Slider(0.0001, range=0..0.0001),
    _run=False,
    SAM_ComponentVersion="1.0.0")  # -> AnalyticalObject, RedundantPanels
inspect = Inspect(_object=panel, SAM_ComponentVersion="1.0.0")  # -> Apertures, Area, AreaNet, Azimuth, BoundingBox, Construction, Face3D, Guid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
panel_2 = Panel(samanalytical_mergeoverlappanels.AnalyticalObject, SAM_Analytical_Grasshopper_GooPanelParam=True)
panel_3 = Panel(inspect.Area)
