# Grasshopper definition Bounding_Box_Snapping.gh (Grasshopper 1.0.7)
# plug-ins: Bifocals

geo = Geometry([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])
bbox = BoundingBox(Content=flatten(geo), Plane=PlaneXY(0, 0, 0), UnionBox=True)  # -> Box, Box_2
# We are taking the bounding box and scaling it to
# the appropriate bigness.
number_slider = Slider(1.02, range=0..2)
area = Area(Geometry=bbox.Box)  # -> Area, Centroid
scale = Scale(Geometry=bbox.Box, Center=area.Centroid, Factor=number_slider)  # -> Geometry, Transform
debrep = DeconstructBrep(Brep=scale.Geometry)  # -> Faces, Edges, Vertices
number_slider_2 = Slider(0, range=0..6)
number_slider_3 = Slider(0, range=0..6)
number_slider_4 = Slider(3, range=0..6)
merge = Merge(Data1=Slider(0, range=0..6))
item = ListItem(List=debrep.Edges, Index=0, Wrap=True)
item_2 = ListItem(List=debrep.Faces, Index=merge, Wrap=True)
item_3 = ListItem(List=debrep.Edges, Index=Slider(1, range=0..5), Wrap=True)
divlength = DivideLength(Curve=item, Length=Slider(4, range=0..10))  # -> Points, Tangents, Parameters
divlength_2 = DivideLength(Curve=item_3, Length=Slider(4, range=0..10))  # -> Points, Tangents, Parameters
edges = BrepEdges(Brep=item_2)  # -> Naked, Interior, NonManifold
pl = PlaneNormal(Origin=divlength_2.Points, ZAxis=item_3)
pl_2 = PlaneNormal(Origin=divlength.Points, ZAxis=item)
number_slider_5 = Slider(4, range=0..10)
item_4 = ListItem(List=edges.Naked, Index=Slider(2, range=0..3), Wrap=True)
item_5 = ListItem(List=edges.Naked, Index=Slider(0, range=0..3), Wrap=True)
sec = BrepPlane(Brep=scale.Geometry, Plane=pl)  # -> Curves, Points
sec_2 = BrepPlane(Brep=scale.Geometry, Plane=pl_2)  # -> Curves, Points

number_slider_6 = Slider(8, range=0..8)  # disabled
number_slider_7 = Slider(4, range=0..10)  # disabled
item_6 = ListItem(List=debrep.Edges, Index=number_slider_6, Wrap=True)  # disabled
divlength_3 = DivideLength(Curve=item_6, Length=number_slider_7)  # -> Points, Tangents, Parameters; disabled
pl_3 = PlaneNormal(Origin=divlength_3.Points, ZAxis=item_6)  # disabled
sec_3 = BrepPlane(Brep=scale.Geometry, Plane=pl_3)  # -> Curves, Points; disabled
ccx = CurveCurve(CurveA=flatten(sec_2.Curves), CurveB=sec_3.Curves)  # -> Points, ParamsA, ParamsB; disabled

len = Length(Curve=item_4)
divlength_4 = DivideLength(Curve=item_5, Length=number_slider_5)  # -> Points, Tangents, Parameters
division = Division(A=len, B=number_slider_5)
ccx_2 = CurveCurve(CurveA=flatten(sec.Curves), CurveB=sec_3.Curves)  # -> Points, ParamsA, ParamsB
ccx_3 = CurveCurve(CurveA=flatten(sec_2.Curves), CurveB=sec.Curves)  # -> Points, ParamsA, ParamsB
series = Series(Start=0, Step=number_slider_5, Count=expr("x+1", division))
merge_2 = Merge(Data1=flatten(ccx_3.Points), Data2=flatten(ccx_2.Points), Data3=flatten(ccx.Points))
amp = Amplitude(Vector=item_4, Amplitude=series)
panel = Panel(merge_2)
move = Move(Geometry=divlength_4.Points, Motion=graft(amp))  # -> Geometry, Transform
orto_geometry = Geometry([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])
copy_of_geo = Data(geo)
list_of_points = Data(merge_2)
xy = XYPlane(Origin=Point(0, 0, 0))
data = Data(orto_geometry)
python = GhPythonScript(
    geo1=data,
    ptCloud=list_of_points,
    XYplane=xy,
    x=Slider(7, range=0..10),
    y=Slider(7, range=0..10),
    z=Slider(3, range=0..10))  # -> out, a, b, c; inputs geo1: Polyline, ptCloud: list of Point3d, XYplane: Plane
# ---------- python: Python ----------
import Rhino #rhinocommon
import ghpythonlib.components as ghc

#########
""" this is how you comment lots of lines in py
firstPoint = Rhino.Geometry.Point3d(10,10,10)
print firstPoint

a = firstPoint

#make an empty list
anyList = [] 

#make a grid of points
for i in range(20):
    
    for j in range(20):
        
        for k in range (4):
        
            #make a provisional point
            tempPt = Rhino.Geometry.Point3d(i*x, j*y, k*z) 
            
            #store point in a list
            anyList.append( tempPt )
    
a = anyList
"""
#############

#TO DO
#1. make bounding bbox

bbox = ghc.BoundingBox(geo1, XYplane) 
print bbox[0]

#2. scale bounding bbox

#3. decosntruct bbox


anyList = ptCloud

newPoint3dlist = Rhino.Collections.Point3dList(anyList)

#now we have a polyline


#CHEATING bringing GH components to python
#points = ghc.Discontinuity(geo1, 1)

closestPtList = []
#proper python way
for p in geo1:
    print p
    closestPt = Rhino.Collections.Point3dList.ClosestPointInList(newPoint3dlist, p)
    closestPtList.append(closestPt)
    
    b = closestPtList

newPoly = Rhino.Geometry.Polyline(closestPtList)

#pass a polyline outside
c = [newPoly]
# ---------- end python ----------
panel_2 = Panel(data)
data_2 = Data(python.c)
boundary = BoundarySurfaces(Edges=data_2)
preview = CustomPreview(
    Geometry=boundary,
    Material={diffuse=RGB(221, 160, 221), emission=RGB(66, 48, 66), shine=0.5, specular=RGB(255, 255, 255), transparency=0})
