# Grasshopper definition Grid.gh (Grasshopper 1.0.7)
# plug-ins: Bifocals

number_slider = Slider(26, range=0..100)
number_slider_2 = Slider(1, range=0..5)
number_slider_3 = Slider(1, range=0..5)
number_slider_4 = Slider(29, range=0..100)
number_slider_5 = Slider(18, range=0..100)
# we want the user to pick how big the square/rectangle cells and choose choose the measurments for x and y. Then how big the whole figure should be. the program divides the hugness of the square by the individual measurements of a cells. To create you "perfect" grid.
square = Square(Plane=PlaneXY(0, 0, 0), Size=Slider(0.9, range=0..1), ExtentX=number_slider, ExtentY=number_slider)  # -> Cells, Points

# ---- group: Individual Geometry Cell
rectangle = Rectangle(Plane=PlaneXY(0, 0, 0), XSize=number_slider_2, YSize=number_slider_3, Radius=0)  # -> Rectangle, Length

# ---- group: Whole Geometry in which we want to pack the cells in
rectangle_2 = Rectangle(Plane=PlaneXY(0, 0, 0), XSize=number_slider_4, YSize=number_slider_5, Radius=0)  # -> Rectangle, Length

# ----
division = Division(A=number_slider_4, B=number_slider_2)
division_2 = Division(A=number_slider_5, B=number_slider_3)
# **Extension**
# 1.Rectangle/Square
# 2.Polylines or wierd squiggles
round = Round(Number=division_2)  # -> Nearest, Floor, Ceiling
round_2 = Round(Number=division)  # -> Nearest, Floor, Ceiling
rectangular_array = RectangularArray(Geometry=rectangle.Rectangle, Cell=rectangle.Rectangle, XCount=round_2.Floor, YCount=round.Floor)  # -> Geometry, Transform
