# Grasshopper definition Official_Snap_To_Grids.gh (Grasshopper 1.0.7)

# ---- group: Input: Individual Geometry Cell
number_slider = Slider(0.1, range=0..5)
number_slider_2 = Slider(0.1, range=0..5)

# ---- group: Input: Whole grid
number_slider_3 = Slider(29, range=0..100)
# In the meantime I am building a grid and rotating if nescessary to the object.
#  Then I am finding the closest point from the object to the grid.
number_slider_4 = Slider(18, range=0..100)

# ---- group: Individual Geometry Cell
# This script snaps the geometry to a grid, and tries to be very much user friendly !
rectangle = Rectangle(Plane=PlaneXY(0, 0, 0), XSize=number_slider, YSize=number_slider_2, Radius=0)  # -> Rectangle, Length

# ---- group: Whole Geometry in which we want to pack the cells in
rectangle_2 = Rectangle(Plane=PlaneXY(0, 0, 0), XSize=number_slider_3, YSize=number_slider_4, Radius=0)  # -> Rectangle, Length

# ---- group: Input: Geometry
geometry = Geometry(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)

# ----
# I am taking out the points from the geometry, then finding its closest point on the grid.
# Afterwards, I am shifting the list by one, then making lines out of these points, and connecting them together and...Voila!
# We have the snapped shape (at this point for 2D objects)
# We are taking the x values dividing them by each other and then finding the x- count
# and the same with the y values
division = Division(A=number_slider_3, B=number_slider)
division_2 = Division(A=number_slider_4, B=number_slider_2)
round = Round(Number=division_2)  # -> Nearest, Floor, Ceiling
round_2 = Round(Number=division)  # -> Nearest, Floor, Ceiling
rectangular_array = RectangularArray(Geometry=rectangle.Rectangle, Cell=rectangle.Rectangle, XCount=round_2.Floor, YCount=round.Floor)  # -> Geometry, Transform
discontinuity = Discontinuity(Curve=geometry, Level=1)  # -> Points, Parameters
discontinuity_2 = Discontinuity(Curve=rectangular_array.Geometry, Level=1)  # -> Points, Parameters
closest_point = ClosestPoint(Point=discontinuity.Points, Cloud=flatten(discontinuity_2.Points))  # -> ClosestPoint, CPIndex, Distance
point_list = PointList(Points=discontinuity.Points, Size=Slider(2, range=0..10))
dispatch = Dispatch(List=closest_point.ClosestPoint, DispatchPattern=[True, False])  # -> ListA, ListB
shift_list = ShiftList(List=closest_point.ClosestPoint, Shift=1, Wrap=True)
dispatch_2 = Dispatch(List=shift_list, DispatchPattern=[True, False])  # -> ListA, ListB
line = Line(StartPoint=dispatch.ListA, EndPoint=dispatch.ListB)
line_2 = Line(StartPoint=dispatch_2.ListA, EndPoint=dispatch_2.ListB)
merge = Merge(Data1=line_2, Data2=line)
