# Grasshopper definition Snap_To_Grids_3D.gh (Grasshopper 1.0.7)

# 3D Snapping to Grids:
# 
# First, checking if the 3D model is a brep or not.
# 
# Yes: Then deconstruct it, take the plane out of each face, then snap, same a s below.
# 
# No: then you need to find out each faces plane, then the grid automatically comes in the plane it is and snps it.
# After all faces have been snapped, the whole figure needs to be closed so the point overlap in order to close the model.
# Ask user true/ false if they want to close it.
# And Voila!
geometry = Geometry([<curve referenced from the Rhino model> x4])
brep = Brep(<brep referenced from the Rhino model>)
ghpython_script = GhPythonScript(Geometry=geometry)  # -> isBrep
# ---------- ghpython_script: Python ----------
__author__ = "micha"
__version__ = "2020.03.24"

import rhinoscriptsyntax as rs

if rs.IsBrep (Geometry) and not rs.IsSurface(Geometry):
    isBrep = Geometry
# ---------- end ghpython_script ----------
deconstruct_brep = DeconstructBrep(Brep=brep)  # -> Faces, Edges, Vertices
surface = Surface(deconstruct_brep.Faces)
divide_surface = DivideSurface(Surface=surface, UCount=10, VCount=10)  # -> Points, Normals, Parameters
deconstruct_plane = DeconstructPlane(Plane=divide_surface.Points)  # -> Origin, flatten(XAxis), flatten(YAxis), ZAxis
# Orient the grid on the vertices from the surfaces.
number_slider = Slider(1, range=0..5)
number_slider_2 = Slider(1, range=0..5)
# how many times we want to duplicate it
number_slider_3 = Slider(18, range=0..100)
number_slider_4 = Slider(29, range=0..100)

# ---- group: Individual Geometry Cell
rectangle = Rectangle(Plane=PlaneXY(0, 0, 0), XSize=number_slider, YSize=number_slider_2, Radius=0)  # -> Rectangle, Length

# ---- group: Whole Geometry in which we want to pack the cells in
rectangle_2 = Rectangle(Plane=PlaneXY(0, 0, 0), XSize=deconstruct_plane.XAxis, YSize=deconstruct_plane.YAxis, Radius=0)  # -> Rectangle, Length

# ----
division = Division(A=deconstruct_plane.XAxis, B=number_slider)
division_2 = Division(A=deconstruct_plane.YAxis, B=number_slider_2)
round = Round(Number=division_2)  # -> Nearest, Floor, Ceiling
round_2 = Round(Number=division)  # -> Nearest, Floor, Ceiling
rectangular_array = RectangularArray(Geometry=rectangle.Rectangle, Cell=rectangle.Rectangle, XCount=round_2.Floor, YCount=round.Floor)  # -> Geometry, Transform
