# Grasshopper definition SnappingToGrids_C#_Michalina.gh (Grasshopper 1.0.7)
# plug-ins: ScriptSync, Bifocals

geometry = Geometry(<curve referenced from the Rhino model>)
geometry_2 = Geometry(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)
geometry_3 = Geometry(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)
c_script = CSharpScript(iGeometry=geometry_2, iCellWidth=Slider(1, range=0..1))  # -> out, oGrid; inputs iGeometry: Curve, iCellWidth: Double
# ---------- c_script: C# ----------
    // This project generates a grid that covers any provided XY planar geometry (using a bounding box)
    //where the user can specify the square grid cell width or a default value will be used.

    //If the value(cell width) is not provided or the value is less than or equal to 0, it assigns a default value of 1.
    //This protects the script from crashing.
    if (double.IsNaN(iCellWidth) || iCellWidth <= 0)
      iCellWidth = 1;

    //We are creating a bounding box(a square/rectangle created by two points) around the inputted geometry.
    BoundingBox bBox = iGeometry.GetBoundingBox(true);

    //We are defining new variables for creating the grid size by taking the x and y value from the maximum and minimum point
    //and subtracting them by the inputted cell width then rounding them up(i.e. 4.3 becomes 5).
    double xDistance = (Math.Ceiling(bBox.Max.X - bBox.Min.X)) / iCellWidth;
    double yDistance = (Math.Ceiling(bBox.Max.Y - bBox.Min.Y)) / iCellWidth;

    //We are defining an empty list of points, and 2 temporary Point3d variable for the for loop.
    List<Point3d> ptsGrid = new List<Point3d>();
    Point3d tempIPt = bBox.Min;
    Point3d ptGrid = tempIPt;

    //We are starting with the value of the minimum point of the bounding box then adding the vector to it, and storing this as a temporary point.
    //In the first "for loop" we are creating a vector of each cell width size then substituting the temporary tempJPt variable to the grid point and
    //repeating this process the number of the distance between the two x's.
    for (int i = 0; i <= xDistance; i++)
    {
      Vector3d xVector = new Vector3d(iCellWidth, 0, 0);
      Point3d tempJPt = ptGrid;

      //In the second "for loop" we are creating a vector of each cell height size then adding the temporary J varaiable to the list of points.
      for (int j = 0; j <= yDistance; j++)
      {
        Vector3d yVector = new Vector3d(0, iCellWidth, 0);
        ptsGrid.Add(tempJPt);
        tempJPt = tempJPt + yVector;
      }

      ptGrid = ptGrid + xVector;
      tempIPt = ptGrid;
    }

    //Here we are outputting grid, the list of points.
    oGrid = ptsGrid;
# ---------- end c_script ----------
c_script_2 = CSharpScript(iGeometry=geometry_3, iCellWidth=Slider(1, range=0..1))  # -> out, oGrid; inputs iGeometry: Curve, iCellWidth: Double
# ---------- c_script_2: C# ----------
        /*
        1. Create grid
        2. Take the control-points out of the geometry
        3. Find the closest points of the control points on the grid
        4.Move the control-points to the grid.
        5. Output the geometry.
        */

    if (double.IsNaN(iCellWidth) || iCellWidth <= 0)
      iCellWidth = 1;

    BoundingBox bBox = iGeometry.GetBoundingBox(true);

    double xDistance = (Math.Ceiling(bBox.Max.X - bBox.Min.X)) / iCellWidth;
    double yDistance = (Math.Ceiling(bBox.Max.Y - bBox.Min.Y)) / iCellWidth;

    List<Point3d> ptsGrid = new List<Point3d>();
    Point3d tempIPt = bBox.Min;
    Point3d ptGrid = tempIPt;

    for (int i = 0; i <= xDistance; i++)
    {
      Vector3d xVector = new Vector3d(iCellWidth, 0, 0);
      Point3d tempJPt = ptGrid;

      for (int j = 0; j <= yDistance; j++)
      {
        Vector3d yVector = new Vector3d(0, iCellWidth, 0);
        ptsGrid.Add(tempJPt);
        tempJPt = tempJPt + yVector;
      }

      ptGrid = ptGrid + xVector;
      tempIPt = ptGrid;
    }

    PolylineCurve PLine = iGeometry.ToPolyline(0.01, 0.0349066, 0.1, 10000);

    List<Point3d> ptsCurve = new List<Point3d>();
    int countPt = PLine.PointCount;
    for(int i = 0; i < countPt; i = i + 2)
      ptsCurve.Add(PLine.Point(i));
    ptsCurve.C


      oGrid = ptsCurve;
# ---------- end c_script_2 ----------
scriptsync = ScriptSync(
    externalCodeFileName="C:\Users\micha\Documents\ScriptSyncExternalScripts_VS\ScriptSyncExternalScripts\Grid\Grid1.cs",
    targetScriptComponentGuid=c_script_2)
geometry_4 = Geometry(c_script_2.oGrid)
point = Point(c_script.oGrid)
panel = Panel(c_script_2.out)
panel_2 = Panel(c_script.oGrid)
