# Grasshopper definition Snapping_Grids.gh (Grasshopper 1.0.7)
# plug-ins: Bifocals

geometry = Geometry([<curve referenced from the Rhino model> x2])
square = Square(Plane=PlaneXY(0, 0, 0), Size=1, ExtentX=Slider(23, range=0..100), ExtentY=Slider(22, range=0..100))  # -> Cells, Points
discontinuity = Discontinuity(Curve=geometry, Level=1)  # -> Points, Parameters
end_points = EndPoints(Curve=geometry)  # -> Start, End
closest_point = ClosestPoint(Point=discontinuity.Points, Cloud=flatten(square.Points))  # -> ClosestPoint, CPIndex, Distance
ghpython_script = GhPythonScript()  # -> out, a; unedited script template
point_list = PointList(Points=discontinuity.Points, Size=Slider(2, range=0..10))
point = Point(end_points.Start)
point_2 = Point(end_points.End)
shift_list = ShiftList(List=closest_point.ClosestPoint, Shift=1, Wrap=True)
dispatch = Dispatch(List=closest_point.ClosestPoint, DispatchPattern=[True, False])  # -> ListA, ListB
panel = Panel(shift_list)
dispatch_2 = Dispatch(List=shift_list, DispatchPattern=[True, False])  # -> ListA, ListB
stream_gate = StreamGate(Stream=shift_list, Gate=0)  # -> Target0, Target1, Target2, Target3
line = Line(StartPoint=dispatch.ListA, EndPoint=dispatch.ListB)
point_3 = Point(dispatch_2.ListB)
point_4 = Point(stream_gate.Target0)
line_2 = Line(StartPoint=dispatch_2.ListA, EndPoint=dispatch_2.ListB)
merge = Merge(Data1=line_2, Data2=line)
