# Grasshopper definition Snapping_Grids_Python_Bounding_Box.gh (Grasshopper 1.0.7)

geo = Geometry([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])
orto_geometry = Geometry([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])
bbox = BoundingBox(Content=flatten(orto_geometry), Plane=PlaneXY(0, 0, 0), UnionBox=True)  # -> Box, Box_2
area = Area(Geometry=bbox.Box)  # -> Area, Centroid
scale = Scale(Geometry=bbox.Box, Center=area.Centroid, Factor=Slider(1.02, range=0..2))  # -> Geometry, Transform
debrep = DeconstructBrep(Brep=scale.Geometry)  # -> Faces, Edges, Vertices
item = ListItem(List=debrep.Faces, Index=Slider(0, range=0..6), Wrap=True)
edges = BrepEdges(Brep=item)  # -> Naked, Interior, NonManifold
item_2 = ListItem(List=debrep.Edges, Index=0, Wrap=True)
divlength = DivideLength(Curve=item_2, Length=Slider(4, range=0..10))  # -> Points, Tangents, Parameters
item_3 = ListItem(List=edges.Naked, Index=Slider(2, range=0..3), Wrap=True)
item_4 = ListItem(List=debrep.Edges, Index=Slider(1, range=0..5), Wrap=True)
len = Length(Curve=item_3)
pl = PlaneNormal(Origin=divlength.Points, ZAxis=item_2)
divlength_2 = DivideLength(Curve=item_4, Length=Slider(4, range=0..10))  # -> Points, Tangents, Parameters
division = Division(A=len, B=Slider(1, range=0..10))
item_5 = ListItem(List=edges.Naked, Index=Slider(0, range=0..3), Wrap=True)
pl_2 = PlaneNormal(Origin=divlength_2.Points, ZAxis=item_4)
sec = BrepPlane(Brep=scale.Geometry, Plane=pl)  # -> Curves, Points

number_slider = Slider(8, range=0..8)  # disabled
number_slider_2 = Slider(4, range=0..10)  # disabled
item_6 = ListItem(List=debrep.Edges, Index=number_slider, Wrap=True)  # disabled
divlength_3 = DivideLength(Curve=item_6, Length=number_slider_2)  # -> Points, Tangents, Parameters; disabled
pl_3 = PlaneNormal(Origin=divlength_3.Points, ZAxis=item_6)  # disabled
sec_2 = BrepPlane(Brep=scale.Geometry, Plane=pl_3)  # -> Curves, Points; disabled
ccx = CurveCurve(CurveA=flatten(sec.Curves), CurveB=sec_2.Curves)  # -> Points, ParamsA, ParamsB; disabled

sec_3 = BrepPlane(Brep=scale.Geometry, Plane=pl_2)  # -> Curves, Points
series = Series(Start=0, Step=Slider(1, range=0..10), Count=expr("x+1", division))
ccx_2 = CurveCurve(CurveA=flatten(sec.Curves), CurveB=sec_3.Curves)  # -> Points, ParamsA, ParamsB
amp = Amplitude(Vector=item_3, Amplitude=series)
divlength_4 = DivideLength(Curve=item_5, Length=Slider(1, range=0..10))  # -> Points, Tangents, Parameters
ccx_3 = CurveCurve(CurveA=flatten(sec_3.Curves), CurveB=sec_2.Curves)  # -> Points, ParamsA, ParamsB
move = Move(Geometry=divlength_4.Points, Motion=graft(amp))  # -> Geometry, Transform
merge = Merge(Data1=flatten(ccx_2.Points), Data2=flatten(ccx_3.Points), Data3=flatten(ccx.Points))
copy_of_geo = Data(orto_geometry)
list_of_points = Data(merge)
data = Data(copy_of_geo)
xy = XYPlane(Origin=Point(0, 0, 0))
panel = Panel(merge)
python = GhPythonScript(
    geo1=data,
    ptCloud=list_of_points,
    XYplane=xy,
    x=Slider(7, range=0..10),
    y=Slider(7, range=0..10),
    z=Slider(3, range=0..10))  # -> out, a, b, c; inputs geo1: Polyline, ptCloud: list of Point3d, XYplane: Plane
# ---------- python: Python ----------
import Rhino #rhinocommon
import ghpythonlib.components as ghc

#########
""" this is how you comment lots of lines in py
firstPoint = Rhino.Geometry.Point3d(10,10,10)
print firstPoint

a = firstPoint

#make an empty list
anyList = [] 

#make a grid of points
for i in range(20):
    
    for j in range(20):
        
        for k in range (4):
        
            #make a provisional point
            tempPt = Rhino.Geometry.Point3d(i*x, j*y, k*z) 
            
            #store point in a list
            anyList.append( tempPt )
    
a = anyList
"""
#############

#TO DO
#1. make bounding bbox

bbox = ghc.BoundingBox(geo1, XYplane) 
print bbox[0]

#2. scale bounding bbox

#3. decosntruct bbox


anyList = ptCloud

newPoint3dlist = Rhino.Collections.Point3dList(anyList)

#now we have a polyline


#CHEATING bringing GH components to python
#points = ghc.Discontinuity(geo1, 1)

closestPtList = []
#proper python way
for p in geo1:
    print p
    closestPt = Rhino.Collections.Point3dList.ClosestPointInList(newPoint3dlist, p)
    closestPtList.append(closestPt)
    
    b = closestPtList

newPoly = Rhino.Geometry.Polyline(closestPtList)

#pass a polyline outside
c = [newPoly]
# ---------- end python ----------
panel_2 = Panel(data)
data_2 = Data(python.c)
geometry = Geometry(python.c)
boundary = BoundarySurfaces(Edges=data_2)
preview = CustomPreview(
    Geometry=boundary,
    Material={diffuse=RGB(221, 160, 221), emission=RGB(66, 48, 66), shine=0.5, specular=RGB(255, 255, 255), transparency=0})  # disabled
