# Grasshopper definition Snapping_to_grids.gh (Grasshopper 1.0.7)
# plug-ins: Bifocals, Kangaroo2 Components

number_slider = Slider(60, range=0..100)
geometry = Geometry([<curve referenced from the Rhino model> x6])
geometry_2 = Geometry([<curve referenced from the Rhino model> x3])

# ---- group: 2D snapping to grids
number_slider_2 = Slider(0.5, range=0.001..100)
number_slider_3 = Slider(39, range=0..100)
number_slider_4 = Slider(49, range=0..100)
geometry_3 = Geometry([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])

# ----
square = Square(Plane=PlaneXY(0, 0, 0), Size=Slider(0.2, range=0..1), ExtentX=number_slider, ExtentY=number_slider)  # -> Cells, Points
discontinuity = Discontinuity(Curve=geometry_2, Level=1)  # -> Points, Parameters

# ---- group: 2D EX. for not exact curves
number_slider_5 = Slider(56, range=0..100)  # disabled
number_slider_6 = Slider(33, range=0..100)  # disabled
geometry_4 = Geometry([<brep referenced from the Rhino model> x3])  # disabled
square_2 = Square(Plane=PlaneXY(0, 0, 0), Size=1, ExtentX=number_slider_5, ExtentY=number_slider_6)  # -> Cells, Points; disabled
number_slider_7 = Slider(2, range=0..10)  # disabled
discontinuity_2 = Discontinuity(Curve=geometry_4, Level=1)  # -> Points, Parameters; disabled
end_points = EndPoints(Curve=geometry_4)  # -> Start, End; disabled
closest_point = ClosestPoint(Point=discontinuity_2.Points, Cloud=flatten(square_2.Points))  # -> ClosestPoint, CPIndex, Distance; disabled
ghpython_script = GhPythonScript()  # -> out, a; disabled; unedited script template
point_list = PointList(Points=discontinuity_2.Points, Size=number_slider_7)  # disabled
point = Point(end_points.Start)  # disabled
point_2 = Point(end_points.End)  # disabled
shift_list = ShiftList(List=closest_point.ClosestPoint, Shift=1, Wrap=True)  # disabled
dispatch = Dispatch(List=closest_point.ClosestPoint, DispatchPattern=[True, False])  # -> ListA, ListB; disabled
panel = Panel(shift_list)  # disabled
dispatch_2 = Dispatch(List=shift_list, DispatchPattern=[True, False])  # -> ListA, ListB; disabled
stream_gate = StreamGate(Stream=shift_list, Gate=0)  # -> Target0, Target1, Target2, Target3; disabled
line = Line(StartPoint=dispatch.ListA, EndPoint=dispatch.ListB)  # disabled
point_3 = Point(dispatch_2.ListB)  # disabled
point_4 = Point(stream_gate.Target0)  # disabled
line_2 = Line(StartPoint=dispatch_2.ListA, EndPoint=dispatch_2.ListB)  # disabled
merge = Merge(Data1=line_2, Data2=line)  # disabled

# ----
end_points_2 = EndPoints(Curve=geometry)  # -> Start, End
closest_point_2 = ClosestPoint(Point=discontinuity.Points, Cloud=flatten(square.Points))  # -> ClosestPoint, CPIndex, Distance

# ---- group: 3D Figures / Broken Boxes
brep = Brep(flatten([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]))

# ---- group: 3D Figures
number_slider_8 = Slider(0.5, range=0.001..100)  # disabled
number_slider_9 = Slider(67, range=0..100)  # disabled
number_slider_10 = Slider(29, range=0..100)  # disabled
number_slider_11 = Slider(90, range=0..100)  # disabled
number_slider_12 = Slider(-4, range=-10..10)  # disabled
square_3 = Square(Plane=PlaneXY(0, 0, 0), Size=number_slider_8, ExtentX=number_slider_9, ExtentY=number_slider_10)  # -> Cells, Points; disabled
yz_plane = YZPlane(Origin=Point(0, 0, 0))  # disabled
brep_2 = Brep(flatten([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]))
number_slider_13 = Slider(0.5, range=0.001..100)  # disabled
number_slider_14 = Slider(77, range=0..100)  # disabled
number_slider_15 = Slider(29, range=0..100)  # disabled
rotate = Rotate(Geometry=square_3.Points, Angle=degrees(number_slider_11), Plane=yz_plane)  # -> Geometry, Transform; disabled
surface = Surface(brep)
curve = Curve(brep)
unit_x = UnitX(Factor=1)  # disabled
number_slider_16 = Slider(9, range=0..10)  # disabled
number_slider_17 = Slider(25, range=0..100)  # disabled
number_slider_18 = Slider(-4, range=-10..10)  # disabled
explode = Explode(Curve=curve, Recursive=True)  # -> Segments, Vertices
number_slider_19 = Slider(1, range=0..1)  # disabled
square_4 = Square(Plane=PlaneXY(0, 0, 0), Size=number_slider_13, ExtentX=number_slider_14, ExtentY=number_slider_15)  # -> Cells, Points; disabled
brep_3 = Brep(flatten([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]))  # disabled
brep_4 = Brep(flatten([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]))  # disabled
brep_5 = Brep(flatten([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]))  # disabled
brep_6 = Brep(flatten([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]))  # disabled
move = Move(Geometry=rotate.Geometry, Motion=unit_x)  # -> Geometry, Transform; disabled
curve_2 = Curve(brep_4)  # disabled
surface_2 = Surface(brep_4)  # disabled
rotate_2 = Rotate(Geometry=square_4.Points, Angle=degrees(number_slider_17), Plane=PlaneXY(0, 0, 0))  # -> Geometry, Transform; disabled
curve_3 = Curve(brep_6)  # disabled
surface_3 = Surface(brep_6)  # disabled
unit_z = UnitZ(Factor=number_slider_16)  # disabled
unit_y = UnitY(Factor=number_slider_18)  # disabled
geometry_5 = Geometry([<brep referenced from the Rhino model> x7])  # disabled
explode_2 = Explode(Curve=curve_2, Recursive=True)  # -> Segments, Vertices; disabled
geometry_6 = Geometry([<brep referenced from the Rhino model> x7])  # disabled
explode_3 = Explode(Curve=curve_3, Recursive=True)  # -> Segments, Vertices; disabled
move_2 = Move(Geometry=move.Geometry, Motion=unit_z)  # -> Geometry, Transform; disabled
discontinuity_3 = Discontinuity(Curve=geometry_5, Level=1)  # -> Points, Parameters; disabled
discontinuity_4 = Discontinuity(Curve=geometry_6, Level=1)  # -> Points, Parameters; disabled
end_points_3 = EndPoints(Curve=geometry_5)  # -> Start, End; disabled
end_points_4 = EndPoints(Curve=geometry_6)  # -> Start, End; disabled
move_3 = Move(Geometry=rotate_2.Geometry, Motion=unit_y)  # -> Geometry, Transform; disabled
point_5 = Point(end_points_3.Start)  # disabled
point_6 = Point(end_points_3.End)  # disabled
point_7 = Point(end_points_4.Start)  # disabled
point_8 = Point(end_points_4.End)  # disabled
number_slider_20 = Slider(2, range=0..10)  # disabled
number_slider_21 = Slider(2, range=0..10)  # disabled
closest_point_3 = ClosestPoint(Point=discontinuity_3.Points, Cloud=flatten(square_4.Points))  # -> ClosestPoint, CPIndex, Distance; disabled
closest_point_4 = ClosestPoint(Point=discontinuity_4.Points, Cloud=flatten(move.Geometry))  # -> ClosestPoint, CPIndex, Distance; disabled
point_list_2 = PointList(Points=discontinuity_3.Points, Size=number_slider_20)  # disabled
point_list_3 = PointList(Points=discontinuity_4.Points, Size=number_slider_21)  # disabled
dispatch_3 = Dispatch(List=closest_point_3.ClosestPoint, DispatchPattern=[True, False])  # -> ListA, ListB; disabled
dispatch_4 = Dispatch(List=closest_point_4.ClosestPoint, DispatchPattern=[True, False])  # -> ListA, ListB; disabled
shift_list_2 = ShiftList(List=closest_point_3.ClosestPoint, Shift=1, Wrap=True)  # disabled
shift_list_3 = ShiftList(List=closest_point_4.ClosestPoint, Shift=1, Wrap=True)  # disabled
line_3 = Line(StartPoint=dispatch_3.ListA, EndPoint=dispatch_3.ListB)  # disabled
line_4 = Line(StartPoint=dispatch_4.ListA, EndPoint=dispatch_4.ListB)  # disabled
panel_2 = Panel(shift_list_2)  # disabled
panel_3 = Panel(shift_list_3)  # disabled
dispatch_5 = Dispatch(List=shift_list_2, DispatchPattern=[True, False])  # -> ListA, ListB; disabled
dispatch_6 = Dispatch(List=shift_list_3, DispatchPattern=[True, False])  # -> ListA, ListB; disabled
ghpython_script_2 = GhPythonScript()  # -> out, a; disabled; unedited script template
line_5 = Line(StartPoint=dispatch_5.ListA, EndPoint=dispatch_5.ListB)  # disabled
line_6 = Line(StartPoint=dispatch_6.ListA, EndPoint=dispatch_6.ListB)  # disabled
point_9 = Point(dispatch_5.ListB)  # disabled
point_10 = Point(dispatch_6.ListB)  # disabled
merge_2 = Merge(Data1=line_5, Data2=line_3)  # disabled
merge_3 = Merge(Data1=line_6, Data2=line_4)  # disabled
number_slider_22 = Slider(25, range=0..100)  # disabled
number_slider_23 = Slider(25, range=0..100)  # disabled
colour = Colour(RGB(28, 55, 255))  # disabled
colour_2 = Colour(RGB(28, 55, 255))  # disabled
xy_plane = XYPlane(Origin=Point(0, 0, 0))  # disabled
xy_plane_2 = XYPlane(Origin=Point(0, 0, 0))  # disabled
custom_preview = CustomPreview(Geometry=merge_2, Material=colour)  # disabled
custom_preview_2 = CustomPreview(Geometry=merge_3, Material=colour_2)  # disabled
rotate_3 = Rotate(Geometry=xy_plane, Angle=degrees(number_slider_22), Plane=PlaneXY(0, 0, 0))  # -> Geometry, Transform; disabled
# TO DO:
# 
# 
# 1. First check if figure is closed if not then trim and extend to the closest point on the figure with in a range.
# 
# 2.improve grid with a bounding box or better option.
# 
# 3. Check if every model is working and make exceptions.
# 
# 4.Turn it into a Python or C# component
panel_4 = Panel(merge_2)  # disabled
rotate_4 = Rotate(Geometry=xy_plane_2, Angle=degrees(number_slider_23), Plane=PlaneXY(0, 0, 0))  # -> Geometry, Transform; disabled
panel_5 = Panel(merge_3)  # disabled
end_points_5 = EndPoints(Curve=flatten(merge_2))  # -> Start, End; disabled
end_points_6 = EndPoints(Curve=flatten(merge_3))  # -> Start, End; disabled
line_7 = Line(flatten(merge_2))  # disabled
line_8 = Line(flatten(merge_3))  # disabled
vector_2pt = Vector2Pt(PointA=end_points_5.Start, PointB=end_points_5.End, Unitize=False)  # -> Vector, Length; disabled
vector_2pt_2 = Vector2Pt(PointA=end_points_6.Start, PointB=end_points_6.End, Unitize=False)  # -> Vector, Length; disabled
deconstruct_plane = DeconstructPlane(Plane=rotate_3.Geometry)  # -> Origin, XAxis, YAxis, ZAxis; disabled
deconstruct_plane_2 = DeconstructPlane(Plane=rotate_4.Geometry)  # -> Origin, XAxis, YAxis, ZAxis; disabled
panel_6 = Panel(line_7)  # disabled
panel_7 = Panel(line_8)  # disabled
angle = Angle(VectorA=deconstruct_plane.XAxis, VectorB=vector_2pt.Vector)  # -> Angle, Reflex; disabled
angle_2 = Angle(VectorA=deconstruct_plane_2.XAxis, VectorB=vector_2pt_2.Vector)  # -> Angle, Reflex; disabled
panel_8 = Panel(angle.Angle)  # disabled
panel_9 = Panel(angle_2.Angle)  # disabled
sort_list = SortList(Keys=angle.Angle)  # -> Keys, ValuesValuesA; disabled
sort_list_2 = SortList(Keys=angle_2.Angle)  # -> Keys, ValuesValuesA; disabled
explode_4 = Explode(Curve=merge_2, Recursive=True)  # -> Segments, Vertices; disabled
closed = Closed(Curve=flatten(merge_2))  # -> Closed, Periodic; disabled
discontinuity_5 = Discontinuity(Curve=merge_2, Level=1)  # -> Points, Parameters; disabled
divide_curve = DivideCurve(Curve=merge_2, Count=10, Kinks=False)  # -> Points, Tangents, Parameters; disabled
equality = Equality(FirstNumber=angle.Angle, SecondNumber=0)  # -> Equality, Inequality; disabled
equality_2 = Equality(FirstNumber=panel_8, SecondNumber=1.570796327)  # -> Equality, Inequality; disabled
equality_3 = Equality(FirstNumber=angle.Angle, SecondNumber=3.141592654)  # -> Equality, Inequality; disabled
explode_5 = Explode(Curve=merge_3, Recursive=True)  # -> Segments, Vertices; disabled
closed_2 = Closed(Curve=flatten(merge_3))  # -> Closed, Periodic; disabled
discontinuity_6 = Discontinuity(Curve=merge_3, Level=1)  # -> Points, Parameters; disabled
divide_curve_2 = DivideCurve(Curve=merge_3, Count=10, Kinks=False)  # -> Points, Tangents, Parameters; disabled
equality_4 = Equality(FirstNumber=angle_2.Angle, SecondNumber=0)  # -> Equality, Inequality; disabled
equality_5 = Equality(FirstNumber=panel_9, SecondNumber=1.570796327)  # -> Equality, Inequality; disabled
equality_6 = Equality(FirstNumber=angle_2.Angle, SecondNumber=3.141592654)  # -> Equality, Inequality; disabled
panel_10 = Panel(angle.Angle)  # disabled
panel_11 = Panel(angle_2.Angle)  # disabled
dispatch_7 = Dispatch(List=discontinuity_5.Points, DispatchPattern=[True, False])  # -> ListA, ListB; disabled
dispatch_8 = Dispatch(List=discontinuity_6.Points, DispatchPattern=[True, False])  # -> ListA, ListB; disabled
closest_point_5 = ClosestPoint(Point=discontinuity_5.Points, Cloud=flatten(divide_curve.Points))  # -> ClosestPoint, CPIndex, Distance; disabled
point_11 = Point(explode_4.Vertices)  # disabled
closest_point_6 = ClosestPoint(Point=discontinuity_6.Points, Cloud=flatten(divide_curve_2.Points))  # -> ClosestPoint, CPIndex, Distance; disabled
point_12 = Point(explode_5.Vertices)  # disabled
cull_pattern = CullPattern(List=line_7, CullPattern=equality.Equality)  # disabled
cull_pattern_2 = CullPattern(List=line_7, CullPattern=equality_2.Equality)  # disabled
cull_pattern_3 = CullPattern(List=line_8, CullPattern=equality_4.Equality)  # disabled
cull_pattern_4 = CullPattern(List=line_7, CullPattern=equality_3.Equality)  # disabled
cull_pattern_5 = CullPattern(List=line_8, CullPattern=equality_5.Equality)  # disabled
cull_pattern_6 = CullPattern(List=line_8, CullPattern=equality_6.Equality)  # disabled
colinear = CoLinear(Points=point_11, Strength=0)  # disabled
colinear_2 = CoLinear(Points=point_12, Strength=0)  # disabled
data = Data(colinear)  # disabled
data_2 = Data(colinear_2)  # disabled
merge_4 = Merge(Data1=cull_pattern, Data2=cull_pattern_2, Data3=cull_pattern_4)  # disabled
merge_5 = Merge(Data1=cull_pattern_3, Data2=cull_pattern_5, Data3=cull_pattern_6)  # disabled
number_slider_24 = Slider(0.2, range=0.001..100)  # disabled
number_slider_25 = Slider(67, range=0..100)  # disabled
number_slider_26 = Slider(29, range=0..100)  # disabled
merge_6 = Merge(Data1=merge_4, Data2=merge_5)  # disabled
number_slider_27 = Slider(25, range=0..100)  # disabled
number_slider_28 = Slider(-4, range=-10..10)  # disabled
square_5 = Square(Plane=PlaneXY(0, 0, 0), Size=number_slider_24, ExtentX=number_slider_25, ExtentY=number_slider_26)  # -> Cells, Points; disabled
rotate_5 = Rotate(Geometry=square_5.Points, Angle=degrees(number_slider_27), Plane=PlaneXY(0, 0, 0))  # -> Geometry, Transform; disabled
unit_y_2 = UnitY(Factor=number_slider_28)  # disabled
brep_7 = Brep(flatten([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]))  # disabled
brep_8 = Brep(flatten([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]))  # disabled
number_slider_29 = Slider(339.7, range=0..1000)  # disabled
number_slider_30 = Slider(1, range=0..1)  # disabled
move_4 = Move(Geometry=rotate_5.Geometry, Motion=unit_y_2)  # -> Geometry, Transform; disabled
curve_4 = Curve(brep_8)  # disabled
surface_4 = Surface(brep_8)  # disabled
explode_6 = Explode(Curve=curve_4, Recursive=True)  # -> Segments, Vertices; disabled
geometry_7 = Geometry(curve_4)  # disabled
rotate_6 = Rotate(Geometry=geometry_7, Angle=degrees(number_slider_29), Plane=PlaneXY(0, 0, 0))  # -> Geometry, Transform; disabled
unit_z_2 = UnitZ(Factor=number_slider_30)  # disabled
move_5 = Move(Geometry=move_4.Geometry, Motion=unit_z_2)  # -> Geometry, Transform; disabled
discontinuity_7 = Discontinuity(Curve=rotate_6.Geometry, Level=1)  # -> Points, Parameters; disabled
end_points_7 = EndPoints(Curve=rotate_6.Geometry)  # -> Start, End; disabled
point_13 = Point(end_points_7.Start)  # disabled
point_14 = Point(end_points_7.End)  # disabled
number_slider_31 = Slider(2, range=0..10)  # disabled
closest_point_7 = ClosestPoint(Point=discontinuity_7.Points, Cloud=flatten(move_5.Geometry))  # -> ClosestPoint, CPIndex, Distance; disabled
point_list_4 = PointList(Points=discontinuity_7.Points, Size=number_slider_31)  # disabled
dispatch_9 = Dispatch(List=closest_point_7.ClosestPoint, DispatchPattern=[True, False])  # -> ListA, ListB; disabled
shift_list_4 = ShiftList(List=closest_point_7.ClosestPoint, Shift=1, Wrap=True)  # disabled
line_9 = Line(StartPoint=dispatch_9.ListA, EndPoint=dispatch_9.ListB)  # disabled
panel_12 = Panel(shift_list_4)  # disabled
dispatch_10 = Dispatch(List=shift_list_4, DispatchPattern=[True, False])  # -> ListA, ListB; disabled
ghpython_script_3 = GhPythonScript()  # -> out, a; disabled; unedited script template
line_10 = Line(StartPoint=dispatch_10.ListA, EndPoint=dispatch_10.ListB)  # disabled
point_15 = Point(dispatch_10.ListB)  # disabled
merge_7 = Merge(Data1=line_10, Data2=line_9)  # disabled
number_slider_32 = Slider(25, range=0..100)  # disabled
colour_3 = Colour(RGB(28, 55, 255))  # disabled
xy_plane_3 = XYPlane(Origin=Point(0, 0, 0))  # disabled
custom_preview_3 = CustomPreview(Geometry=merge_7, Material=colour_3)  # disabled
rotate_7 = Rotate(Geometry=xy_plane_3, Angle=degrees(number_slider_32), Plane=PlaneXY(0, 0, 0))  # -> Geometry, Transform; disabled
panel_13 = Panel(merge_7)  # disabled
end_points_8 = EndPoints(Curve=flatten(merge_7))  # -> Start, End; disabled
line_11 = Line(flatten(merge_7))  # disabled
vector_2pt_3 = Vector2Pt(PointA=end_points_8.Start, PointB=end_points_8.End, Unitize=False)  # -> Vector, Length; disabled
deconstruct_plane_3 = DeconstructPlane(Plane=rotate_7.Geometry)  # -> Origin, XAxis, YAxis, ZAxis; disabled
panel_14 = Panel(line_11)  # disabled
angle_3 = Angle(VectorA=deconstruct_plane_3.XAxis, VectorB=vector_2pt_3.Vector)  # -> Angle, Reflex; disabled
panel_15 = Panel(angle_3.Angle)  # disabled
sort_list_3 = SortList(Keys=angle_3.Angle)  # -> Keys, ValuesValuesA; disabled
explode_7 = Explode(Curve=merge_7, Recursive=True)  # -> Segments, Vertices; disabled
closed_3 = Closed(Curve=flatten(merge_7))  # -> Closed, Periodic; disabled
discontinuity_8 = Discontinuity(Curve=merge_7, Level=1)  # -> Points, Parameters; disabled
divide_curve_3 = DivideCurve(Curve=merge_7, Count=10, Kinks=False)  # -> Points, Tangents, Parameters; disabled
equality_7 = Equality(FirstNumber=angle_3.Angle, SecondNumber=0)  # -> Equality, Inequality; disabled
equality_8 = Equality(FirstNumber=panel_15, SecondNumber=1.570796327)  # -> Equality, Inequality; disabled
equality_9 = Equality(FirstNumber=angle_3.Angle, SecondNumber=3.141592654)  # -> Equality, Inequality; disabled
panel_16 = Panel(angle_3.Angle)  # disabled
dispatch_11 = Dispatch(List=discontinuity_8.Points, DispatchPattern=[True, False])  # -> ListA, ListB; disabled
closest_point_8 = ClosestPoint(Point=discontinuity_8.Points, Cloud=flatten(divide_curve_3.Points))  # -> ClosestPoint, CPIndex, Distance; disabled
point_16 = Point(explode_7.Vertices)  # disabled
cull_pattern_7 = CullPattern(List=line_11, CullPattern=equality_7.Equality)  # disabled
cull_pattern_8 = CullPattern(List=line_11, CullPattern=equality_8.Equality)  # disabled
cull_pattern_9 = CullPattern(List=line_11, CullPattern=equality_9.Equality)  # disabled
colinear_3 = CoLinear(Points=point_16, Strength=0)  # disabled
data_3 = Data(colinear_3)  # disabled
merge_8 = Merge(Data1=cull_pattern_7, Data2=cull_pattern_8, Data3=cull_pattern_9)  # disabled

# ----
square_6 = Square(
    Plane=PlaneXY(0, 0, 0),
    Size=Slider(0.5, range=0.001..100),
    ExtentX=Slider(31, range=0..100),
    ExtentY=Slider(27, range=0..100))  # -> Cells, Points
# In the meantime I am building a grid and rotating if nescessary to the object.
#  Then I am finding the closest point from the object to the grid.
number_slider_33 = Slider(-4, range=-10..10)
# I am taking out the points from the geometry given.
point_17 = Point(end_points_2.Start)
point_18 = Point(end_points_2.End)
discontinuity_9 = Discontinuity(Curve=geometry, Level=1)  # -> Points, Parameters
rotate_8 = Rotate(Geometry=square_6.Points, Angle=degrees(Slider(25, range=0..100)), Plane=PlaneXY(0, 0, 0))  # -> Geometry, Transform
unit_y_3 = UnitY(Factor=number_slider_33)
move_6 = Move(Geometry=rotate_8.Geometry, Motion=unit_y_3)  # -> Geometry, Transform
closest_point_9 = ClosestPoint(Point=discontinuity_9.Points, Cloud=flatten(square_6.Points))  # -> ClosestPoint, CPIndex, Distance
point_list_5 = PointList(Points=discontinuity_9.Points, Size=Slider(2, range=0..10))
# Afterwards, I am sorting the closest points and conncecting them with a line.
dispatch_12 = Dispatch(List=closest_point_9.ClosestPoint, DispatchPattern=[True, False])  # -> ListA, ListB
panel_17 = Panel(closest_point_9.ClosestPoint)
shift_list_5 = ShiftList(List=closest_point_9.ClosestPoint, Shift=1, Wrap=True)
line_12 = Line(StartPoint=dispatch_12.ListA, EndPoint=dispatch_12.ListB)
dispatch_13 = Dispatch(List=shift_list_5, DispatchPattern=[True, False])  # -> ListA, ListB
# I am shifting the list of closest points by one and connecting them also, thus making them lines.
panel_18 = Panel(shift_list_5)
point_19 = Point(dispatch_13.ListB)
line_13 = Line(StartPoint=dispatch_13.ListA, EndPoint=dispatch_13.ListB)
merge_9 = Merge(Data1=line_13, Data2=line_12)
# That is the whole process yet here we have an exception.
# It is about when the snapping to grids isn't perfect and then we are culling the pattern that we don't want to have.
xy_plane_4 = XYPlane(Origin=Point(0, 0, 0))
panel_19 = Panel(merge_9)
rotate_9 = Rotate(Geometry=xy_plane_4, Angle=degrees(Slider(25, range=0..100)), Plane=PlaneXY(0, 0, 0))  # -> Geometry, Transform
end_points_9 = EndPoints(Curve=flatten(merge_9))  # -> Start, End
line_14 = Line(flatten(merge_9))
vector_2pt_4 = Vector2Pt(PointA=end_points_9.End, PointB=end_points_9.Start, Unitize=False)  # -> Vector, Length
deconstruct_plane_4 = DeconstructPlane(Plane=rotate_9.Geometry)  # -> Origin, XAxis, YAxis, ZAxis
panel_20 = Panel(line_14)
angle_4 = Angle(VectorA=deconstruct_plane_4.XAxis, VectorB=vector_2pt_4.Vector)  # -> Angle, Reflex
panel_21 = Panel(angle_4.Angle)
sort_list_4 = SortList(Keys=angle_4.Angle)  # -> Keys, ValuesValuesA
equality_10 = Equality(FirstNumber=angle_4.Angle, SecondNumber=0)  # -> Equality, Inequality
equality_11 = Equality(FirstNumber=panel_21, SecondNumber=1.570796327)  # -> Equality, Inequality
equality_12 = Equality(FirstNumber=angle_4.Angle, SecondNumber=3.141592654)  # -> Equality, Inequality
panel_22 = Panel(angle_4.Angle)
cull_pattern_10 = CullPattern(List=line_14, CullPattern=equality_10.Equality)
cull_pattern_11 = CullPattern(List=line_14, CullPattern=equality_11.Equality)
cull_pattern_12 = CullPattern(List=line_14, CullPattern=equality_12.Equality)
merge_10 = Merge(Data1=cull_pattern_10, Data2=cull_pattern_11, Data3=cull_pattern_12)  # disabled

# ---- group: Experimenting with Python
# improve grid with bounding box
number_slider_34 = Slider(5, range=0..10)
ghpython_script_4 = GhPythonScript()  # -> out, a; unedited script template
ghpython_script_5 = GhPythonScript(value1=Toggle(False), value2=number_slider_34)  # -> history, pYout, Course; inputs value1: Boolean, value2: Int32
# ---------- ghpython_script_5: Python ----------
import rhinoscriptsyntax as rs
import ghpythonlib.components as ghc

if value1:
    pYout  =  "Hello User, it is nice meeting you, please contact the web: boooring.hated.usersOnEarth.org, it has the informaton you are looking for..."
    Course = "value1 is true, if you are getting this message, unfortunatley I must inform you that you are a smart person..."
else:
    pYout=  "What do you expect me to do?! Talk to you, why should I !!I have  better things to do!! I really do not have anything to say to YOU !!!Kind Regards, your loved Computer that actually hates you, Rupert"
    Course = "value 1 is, haha I tricked you this is a false message!"
# ---------- end ghpython_script_5 ----------
panel_23 = Panel(ghpython_script_5.pYout)
panel_24 = Panel(ghpython_script_5.Course)

# ---- group: 2D snapping to grids
# I am shifting the list of closest points by one and connecting them also, thus making them lines.
# I am taking out the points from the geometry given.
# Afterwards, I am sorting the closest points and conncecting them with a line.
# In the meantime I am building a grid and rotating if nescessary to the object.
#  Then I am finding the closest point from the object to the grid.
# That is the whole process yet here we have an exception.
# It is about when the snapping to grids isn't perfect or we want to change something like the figure should be closed.
# Then we are culling the pattern that we don't want to have.
# That is the whole process yet here we have an exception.
# It is about when the snapping to grids isn't perfect and then we are culling the pattern that we don't want to have.
end_points_10 = EndPoints(Curve=geometry_3)  # -> Start, End
point_20 = Point(end_points_10.Start)
point_21 = Point(end_points_10.End)
square_7 = Square(Plane=PlaneXY(0, 0, 0), Size=number_slider_2, ExtentX=number_slider_3, ExtentY=number_slider_4)  # -> Cells, Points
discontinuity_10 = Discontinuity(Curve=geometry_3, Level=1)  # -> Points, Parameters
rotate_10 = Rotate(Geometry=square_7.Points, Angle=degrees(Slider(25, range=0..100)), Plane=PlaneXY(0, 0, 0))  # -> Geometry, Transform
unit_y_4 = UnitY(Factor=Slider(-4, range=-10..10))
move_7 = Move(Geometry=rotate_10.Geometry, Motion=unit_y_4)  # -> Geometry, Transform
closest_point_10 = ClosestPoint(Point=discontinuity_10.Points, Cloud=flatten(square_7.Points))  # -> ClosestPoint, CPIndex, Distance
point_list_6 = PointList(Points=discontinuity_10.Points, Size=Slider(2, range=0..10))
dispatch_14 = Dispatch(List=closest_point_10.ClosestPoint, DispatchPattern=[True, False])  # -> ListA, ListB
panel_25 = Panel(closest_point_10.ClosestPoint)
shift_list_6 = ShiftList(List=closest_point_10.ClosestPoint, Shift=1, Wrap=True)
line_15 = Line(StartPoint=dispatch_14.ListA, EndPoint=dispatch_14.ListB)
dispatch_15 = Dispatch(List=shift_list_6, DispatchPattern=[True, False])  # -> ListA, ListB
panel_26 = Panel(shift_list_6)
point_22 = Point(dispatch_15.ListB)
line_16 = Line(StartPoint=dispatch_15.ListA, EndPoint=dispatch_15.ListB)
merge_11 = Merge(Data1=line_16, Data2=line_15)
number_slider_35 = Slider(25, range=0..100)  # disabled
colour_4 = Colour(RGB(255, 255, 0))  # disabled
xy_plane_5 = XYPlane(Origin=Point(0, 0, 0))  # disabled
custom_preview_4 = CustomPreview(Geometry=merge_11, Material=colour_4)  # disabled
panel_27 = Panel(merge_11)  # disabled
rotate_11 = Rotate(Geometry=xy_plane_5, Angle=degrees(number_slider_35), Plane=PlaneXY(0, 0, 0))  # -> Geometry, Transform; disabled
end_points_11 = EndPoints(Curve=flatten(merge_11))  # -> Start, End; disabled
line_17 = Line(flatten(merge_11))  # disabled
vector_2pt_5 = Vector2Pt(PointA=end_points_11.Start, PointB=end_points_11.End, Unitize=False)  # -> Vector, Length; disabled
deconstruct_plane_5 = DeconstructPlane(Plane=rotate_11.Geometry)  # -> Origin, XAxis, YAxis, ZAxis; disabled
number_slider_36 = Slider(2, range=0..2)
number_slider_37 = Slider(1, range=0..2)
number_slider_38 = Slider(0, range=0..2)
panel_28 = Panel(line_17)  # disabled
angle_5 = Angle(VectorA=deconstruct_plane_5.XAxis, VectorB=vector_2pt_5.Vector)  # -> Angle, Reflex; disabled
xy_plane_6 = XYPlane(Origin=Point(0, 0, 0))
colour_5 = Colour(RGB(255, 255, 0))
rotate_12 = Rotate(Geometry=xy_plane_6, Angle=degrees(Slider(25, range=0..100)), Plane=PlaneXY(0, 0, 0))  # -> Geometry, Transform
deconstruct_plane_6 = DeconstructPlane(Plane=rotate_12.Geometry)  # -> Origin, XAxis, YAxis, ZAxis

list_item = ListItem(List=merge_11, Index=number_slider_38, Wrap=True)
geometry_8 = Geometry(<curve referenced from the Rhino model>)

list_item_2 = ListItem(List=merge_11, Index=number_slider_37, Wrap=True)
geometry_9 = Geometry(<curve referenced from the Rhino model>)

list_item_3 = ListItem(List=merge_11, Index=number_slider_36, Wrap=True)
geometry_10 = Geometry(<curve referenced from the Rhino model>)

# ---- group: 2D snapping to grids / NEEDS TO BE CODED
panel_29 = Panel(angle_5.Angle)  # disabled
sort_list_5 = SortList(Keys=angle_5.Angle)  # -> Keys, ValuesValuesA; disabled
equality_13 = Equality(FirstNumber=angle_5.Angle, SecondNumber=0)  # -> Equality, Inequality; disabled
equality_14 = Equality(FirstNumber=panel_29, SecondNumber=1.570796327)  # -> Equality, Inequality; disabled
equality_15 = Equality(FirstNumber=angle_5.Angle, SecondNumber=3.141592654)  # -> Equality, Inequality; disabled
panel_30 = Panel(angle_5.Angle)  # disabled
cull_pattern_13 = CullPattern(List=line_17, CullPattern=equality_13.Equality)  # disabled
cull_pattern_14 = CullPattern(List=line_17, CullPattern=equality_14.Equality)  # disabled
cull_pattern_15 = CullPattern(List=line_17, CullPattern=equality_15.Equality)  # disabled

# ---- group: 2D snapping to grids (continued)
end_points_12 = EndPoints(Curve=list_item_2)  # -> Start, End
end_points_13 = EndPoints(Curve=list_item)  # -> Start, End
discontinuity_11 = Discontinuity(Curve=list_item_3, Level=1)  # -> Points, Parameters
discontinuity_12 = Discontinuity(Curve=list_item_2, Level=1)  # -> Points, Parameters
closest_point_11 = ClosestPoint(Point=end_points_12.End, Cloud=flatten(discontinuity_11.Points))  # -> ClosestPoint, CPIndex, Distance
closest_point_12 = ClosestPoint(Point=[end_points_13.Start, end_points_13.End], Cloud=flatten(discontinuity_12.Points))  # -> ClosestPoint, CPIndex, Distance
line_18 = Line(StartPoint=[end_points_13.Start, end_points_13.End], EndPoint=closest_point_12.ClosestPoint)
line_19 = Line(StartPoint=end_points_12.End, EndPoint=closest_point_11.ClosestPoint)
merge_12 = Merge(Data1=line_18, Data2=line_19, Data3=list_item, Data4=list_item_2, Data5=list_item_3)
merge_13 = Merge(Data1=cull_pattern_13, Data2=cull_pattern_14, Data3=cull_pattern_15)  # disabled
custom_preview_5 = CustomPreview(Geometry=merge_12, Material=colour_5)
line_20 = Line(flatten(merge_12))
panel_31 = Panel(merge_12)
end_points_14 = EndPoints(Curve=flatten(merge_12))  # -> Start, End
panel_32 = Panel(line_20)
vector_2pt_6 = Vector2Pt(PointA=end_points_14.End, PointB=end_points_14.Start, Unitize=False)  # -> Vector, Length
angle_6 = Angle(VectorA=deconstruct_plane_6.XAxis, VectorB=vector_2pt_6.Vector)  # -> Angle, Reflex
panel_33 = Panel(angle_6.Angle)
panel_34 = Panel(angle_6.Angle)
sort_list_6 = SortList(Keys=angle_6.Angle)  # -> Keys, ValuesValuesA

equality_16 = Equality(FirstNumber=panel_33, SecondNumber=2.007129)  # -> Equality, Inequality
equality_17 = Equality(FirstNumber=panel_33, SecondNumber=2.870409)  # -> Equality, Inequality
equality_18 = Equality(FirstNumber=panel_33, SecondNumber=2.70526)  # -> Equality, Inequality
equality_19 = Equality(FirstNumber=panel_33, SecondNumber=0.436332)  # -> Equality, Inequality
equality_20 = Equality(FirstNumber=panel_33, SecondNumber=1.134464)  # -> Equality, Inequality
equality_21 = Equality(FirstNumber=panel_33, SecondNumber=0.238937)  # -> Equality, Inequality
equality_22 = Equality(FirstNumber=panel_33, SecondNumber=1.65361)  # -> Equality, Inequality
panel_35 = Panel(equality_16.Equality)
cull_pattern_16 = CullPattern(List=line_20, CullPattern=equality_16.Equality)
cull_pattern_17 = CullPattern(List=line_20, CullPattern=equality_17.Equality)
cull_pattern_18 = CullPattern(List=line_20, CullPattern=equality_18.Equality)
cull_pattern_19 = CullPattern(List=line_20, CullPattern=equality_19.Equality)
cull_pattern_20 = CullPattern(List=line_20, CullPattern=equality_20.Equality)
cull_pattern_21 = CullPattern(List=line_20, CullPattern=equality_21.Equality)
cull_pattern_22 = CullPattern(List=line_20, CullPattern=equality_22.Equality)
merge_14 = Merge(
    Data1=cull_pattern_16,
    Data2=cull_pattern_17,
    Data3=cull_pattern_18,
    Data4=cull_pattern_19,
    Data5=cull_pattern_20,
    Data6=cull_pattern_21,
    Data7=cull_pattern_22)
