# Grasshopper definition Working_Snapping_2_Grids_4_Presentation.gh (Grasshopper 1.0.7)

# ---- group: Snapping to Grids with 2D Models
number_slider = Slider(0.5, range=0.001..100)
number_slider_2 = Slider(91, range=0..100)
number_slider_3 = Slider(49, range=0..100)
geometry = Geometry([<curve referenced from the Rhino model> x3])

# ----
colour = Colour(RGB(222, 22, 136))

# ---- group: Snapping to Grids with 2D Models
# I am shifting the list of closest points by one and connecting them also, thus making them lines.
# Afterwards, I am sorting the closest points and conncecting them with a line.
# That is the whole process yet here we have an exception.
# It is about when the snapping to grids isn't perfect or we want to change something like the figure should be closed.
# Then we are culling the pattern that we don't want to have.
end_points = EndPoints(Curve=geometry)  # -> Start, End
# In the meantime I am building a grid and rotating if nescessary to the object.
#  Then I am finding the closest point from the object to the grid.
number_slider_4 = Slider(-4, range=-10..10)
point = Point(end_points.End)
point_2 = Point(end_points.Start)
square = Square(Plane=PlaneXY(0, 0, 0), Size=number_slider, ExtentX=number_slider_2, ExtentY=number_slider_3)  # -> Cells, Points
# I am taking out the points from the geometry given.
discontinuity = Discontinuity(Curve=geometry, Level=1)  # -> Points, Parameters
rotate = Rotate(Geometry=square.Points, Angle=degrees(Slider(25, range=0..100)), Plane=PlaneXY(0, 0, 0))  # -> Geometry, Transform
unit_y = UnitY(Factor=number_slider_4)
move = Move(Geometry=rotate.Geometry, Motion=unit_y)  # -> Geometry, Transform
closest_point = ClosestPoint(Point=discontinuity.Points, Cloud=flatten(square.Points))  # -> ClosestPoint, CPIndex, Distance
point_list = PointList(Points=discontinuity.Points, Size=Slider(2, range=0..10))
dispatch = Dispatch(List=closest_point.ClosestPoint, DispatchPattern=[True, False])  # -> ListA, ListB
panel = Panel(closest_point.ClosestPoint)
shift_list = ShiftList(List=closest_point.ClosestPoint, Shift=1, Wrap=True)
line = Line(StartPoint=dispatch.ListA, EndPoint=dispatch.ListB)
dispatch_2 = Dispatch(List=shift_list, DispatchPattern=[True, False])  # -> ListA, ListB
panel_2 = Panel(shift_list)
point_3 = Point(dispatch_2.ListB)
line_2 = Line(StartPoint=dispatch_2.ListA, EndPoint=dispatch_2.ListB)
merge = Merge(Data1=line_2, Data2=line)
panel_3 = Panel(merge)  # disabled
number_slider_5 = Slider(2, range=0..2)
number_slider_6 = Slider(1, range=0..2)
number_slider_7 = Slider(0, range=0..2)
xy_plane = XYPlane(Origin=Point(0, 0, 0))
colour_2 = Colour(RGB(255, 255, 0))
rotate_2 = Rotate(Geometry=xy_plane, Angle=degrees(Slider(25, range=0..100)), Plane=PlaneXY(0, 0, 0))  # -> Geometry, Transform
deconstruct_plane = DeconstructPlane(Plane=rotate_2.Geometry)  # -> Origin, XAxis, YAxis, ZAxis

list_item = ListItem(List=merge, Index=number_slider_7, Wrap=True)
geometry_2 = Geometry(<curve referenced from the Rhino model>)

list_item_2 = ListItem(List=merge, Index=number_slider_6, Wrap=True)
geometry_3 = Geometry(<curve referenced from the Rhino model>)

list_item_3 = ListItem(List=merge, Index=number_slider_5, Wrap=True)
geometry_4 = Geometry(<curve referenced from the Rhino model>)

end_points_2 = EndPoints(Curve=list_item_2)  # -> Start, End
end_points_3 = EndPoints(Curve=list_item)  # -> Start, End
discontinuity_2 = Discontinuity(Curve=list_item_3, Level=1)  # -> Points, Parameters
discontinuity_3 = Discontinuity(Curve=list_item_2, Level=1)  # -> Points, Parameters
closest_point_2 = ClosestPoint(Point=end_points_2.End, Cloud=flatten(discontinuity_2.Points))  # -> ClosestPoint, CPIndex, Distance
closest_point_3 = ClosestPoint(Point=[end_points_3.Start, end_points_3.End], Cloud=flatten(discontinuity_3.Points))  # -> ClosestPoint, CPIndex, Distance
line_3 = Line(StartPoint=[end_points_3.Start, end_points_3.End], EndPoint=closest_point_3.ClosestPoint)
line_4 = Line(StartPoint=end_points_2.End, EndPoint=closest_point_2.ClosestPoint)
merge_2 = Merge(Data1=line_3, Data2=line_4, Data3=list_item, Data4=list_item_2, Data5=list_item_3)
custom_preview = CustomPreview(Geometry=merge_2, Material=colour_2)
line_5 = Line(flatten(merge_2))
panel_4 = Panel(merge_2)
end_points_4 = EndPoints(Curve=flatten(merge_2))  # -> Start, End
panel_5 = Panel(line_5)
vector_2pt = Vector2Pt(PointA=end_points_4.End, PointB=end_points_4.Start, Unitize=False)  # -> Vector, Length
angle = Angle(VectorA=deconstruct_plane.XAxis, VectorB=vector_2pt.Vector)  # -> Angle, Reflex
panel_6 = Panel(angle.Angle)
panel_7 = Panel(angle.Angle)
sort_list = SortList(Keys=angle.Angle)  # -> Keys, ValuesValuesA

equality = Equality(FirstNumber=panel_6, SecondNumber=2.007129)  # -> Equality, Inequality
equality_2 = Equality(FirstNumber=panel_6, SecondNumber=2.870409)  # -> Equality, Inequality
equality_3 = Equality(FirstNumber=panel_6, SecondNumber=2.70526)  # -> Equality, Inequality
equality_4 = Equality(FirstNumber=panel_6, SecondNumber=0.436332)  # -> Equality, Inequality
equality_5 = Equality(FirstNumber=panel_6, SecondNumber=1.134464)  # -> Equality, Inequality
equality_6 = Equality(FirstNumber=panel_6, SecondNumber=0.238937)  # -> Equality, Inequality
equality_7 = Equality(FirstNumber=panel_6, SecondNumber=1.65361)  # -> Equality, Inequality
panel_8 = Panel(equality.Equality)
cull_pattern = CullPattern(List=line_5, CullPattern=equality.Equality)
cull_pattern_2 = CullPattern(List=line_5, CullPattern=equality_2.Equality)
cull_pattern_3 = CullPattern(List=line_5, CullPattern=equality_3.Equality)
cull_pattern_4 = CullPattern(List=line_5, CullPattern=equality_4.Equality)
cull_pattern_5 = CullPattern(List=line_5, CullPattern=equality_5.Equality)
cull_pattern_6 = CullPattern(List=line_5, CullPattern=equality_6.Equality)
cull_pattern_7 = CullPattern(List=line_5, CullPattern=equality_7.Equality)
merge_3 = Merge(
    Data1=cull_pattern,
    Data2=cull_pattern_2,
    Data3=cull_pattern_3,
    Data4=cull_pattern_4,
    Data5=cull_pattern_5,
    Data6=cull_pattern_6,
    Data7=cull_pattern_7)

# ----
custom_preview_2 = CustomPreview(Geometry=merge_3, Material=colour)
