# Grasshopper definition t.gh (Grasshopper 1.0.7)

geometry = Geometry()
geo = Geometry(<curve referenced from the Rhino model>)
geo_2 = Geometry(<curve referenced from the Rhino model>)
disc = Discontinuity(Curve=geo_2, Level=1)  # -> Points, Parameters
python = GhPythonScript(geo1=geo_2, x=Slider(1, range=0..10), y=Slider(1, range=0..10), z=Slider(0, range=0..10))  # -> out, a, b, c; inputs geo1: Polyline
# ---------- python: Python ----------
import Rhino #rhinocommon
import ghpythonlib.components as ghc


firstPoint = Rhino.Geometry.Point3d(10,10,10)
print firstPoint

a = firstPoint

#make an empty list
anyList = [] 

#make a grid of points
for i in range(20):
    
    for j in range(20):
        
        for k in range (4):
        
            #make a provisional point
            tempPt = Rhino.Geometry.Point3d(i*x, j*y, k*z) 
            
            #store point in a list
            anyList.append( tempPt )
    
a = anyList

newPoint3dlist = Rhino.Collections.Point3dList(anyList)

#now we have a polyline
print geo1

#CHEATING bringing GH components to python
#points = ghc.Discontinuity(geo1, 1)

closestPtList = []
#proper python way
for p in geo1:
    print p
    closestPt = Rhino.Collections.Point3dList.ClosestPointInList(newPoint3dlist, p)
    closestPtList.append(closestPt)
    
    b = closestPtList

newPoly = Rhino.Geometry.Polyline(closestPtList)

#pass a polyline outside
c = [newPoly]
# ---------- end python ----------
python_2 = GhPythonScript(x=Slider(31, range=0..50), y=Slider(15, range=0..50), z=geo, u=geometry)  # -> out, a; inputs x: Int32, z: Point3d, u: Point3d
# ---------- python_2: Python ----------
a = z

print (type(z))
print (z)

print z.X
print z.Y
print z.Y

print z.DistanceTo(u)
# ---------- end python_2 ----------
points = PointList(Points=disc.Points, Size=Slider(2.27, range=0..10))
data = Data(python.c)
panel = Panel(python.a)
panel_2 = Panel(python_2.a)
