# Grasshopper definition Snapping_to_grids.gh (Grasshopper 1.0.7)
# plug-ins: Bifocals, Kangaroo2 Components

# ---- group: 3D Figures
geometry = Geometry([<brep referenced from the Rhino model> x7])
bounding_box = BoundingBox(Content=geometry, Plane=PlaneXY(0, 0, 0), UnionBox=True)  # -> Box, Box_2
number_slider = Slider(29, range=0..100)  # disabled
# improve grid with bounding box
number_slider_2 = Slider(0.5, range=0.001..100)  # disabled
number_slider_3 = Slider(67, range=0..100)  # disabled
number_slider_4 = Slider(90, range=0..100)  # disabled
number_slider_5 = Slider(-4, range=-10..10)  # disabled
square = Square(Plane=PlaneXY(0, 0, 0), Size=number_slider_2, ExtentX=number_slider_3, ExtentY=number_slider)  # -> Cells, Points; disabled
yz_plane = YZPlane(Origin=Point(0, 0, 0))  # disabled
number_slider_6 = Slider(0.5, range=0.001..100)  # disabled
number_slider_7 = Slider(77, range=0..100)  # disabled
number_slider_8 = Slider(29, range=0..100)  # disabled
rotate = Rotate(Geometry=square.Points, Angle=degrees(number_slider_4), Plane=yz_plane)  # -> Geometry, Transform; disabled
unit_x = UnitX(Factor=1)  # disabled
number_slider_9 = Slider(9, range=0..10)  # disabled
number_slider_10 = Slider(25, range=0..100)  # disabled
number_slider_11 = Slider(-4, range=-10..10)  # disabled
number_slider_12 = Slider(1, range=0..1)  # disabled
square_2 = Square(Plane=PlaneXY(0, 0, 0), Size=number_slider_6, ExtentX=number_slider_7, ExtentY=number_slider_8)  # -> Cells, Points; disabled
brep = Brep(flatten([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]))  # disabled
brep_2 = Brep(flatten([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]))  # disabled
brep_3 = Brep(flatten([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]))  # disabled
brep_4 = Brep(flatten([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]))  # disabled
move = Move(Geometry=rotate.Geometry, Motion=unit_x)  # -> Geometry, Transform; disabled
curve = Curve(brep_2)  # disabled
surface = Surface(brep_2)  # disabled
curve_2 = Curve(brep_4)  # disabled
rotate_2 = Rotate(Geometry=square_2.Points, Angle=degrees(number_slider_10), Plane=PlaneXY(0, 0, 0))  # -> Geometry, Transform; disabled
surface_2 = Surface(brep_4)  # disabled
unit_z = UnitZ(Factor=number_slider_9)  # disabled
unit_y = UnitY(Factor=number_slider_11)  # disabled
geometry_2 = Geometry([<brep referenced from the Rhino model> x7])  # disabled
explode = Explode(Curve=curve, Recursive=True)  # -> Segments, Vertices; disabled
geometry_3 = Geometry([<brep referenced from the Rhino model> x7])  # disabled
explode_2 = Explode(Curve=curve_2, Recursive=True)  # -> Segments, Vertices; disabled
move_2 = Move(Geometry=move.Geometry, Motion=unit_z)  # -> Geometry, Transform; disabled
discontinuity = Discontinuity(Curve=geometry_2, Level=1)  # -> Points, Parameters; disabled
discontinuity_2 = Discontinuity(Curve=geometry_3, Level=1)  # -> Points, Parameters; disabled
end_points = EndPoints(Curve=geometry_2)  # -> Start, End; disabled
end_points_2 = EndPoints(Curve=geometry_3)  # -> Start, End; disabled
move_3 = Move(Geometry=rotate_2.Geometry, Motion=unit_y)  # -> Geometry, Transform; disabled
point = Point(end_points.Start)  # disabled
point_2 = Point(end_points.End)  # disabled
point_3 = Point(end_points_2.Start)  # disabled
point_4 = Point(end_points_2.End)  # disabled
number_slider_13 = Slider(2, range=0..10)  # disabled
number_slider_14 = Slider(2, range=0..10)  # disabled
closest_point = ClosestPoint(Point=discontinuity.Points, Cloud=flatten(square_2.Points))  # -> ClosestPoint, CPIndex, Distance; disabled
closest_point_2 = ClosestPoint(Point=discontinuity_2.Points, Cloud=flatten(move.Geometry))  # -> ClosestPoint, CPIndex, Distance; disabled
point_list = PointList(Points=discontinuity.Points, Size=number_slider_13)  # disabled
point_list_2 = PointList(Points=discontinuity_2.Points, Size=number_slider_14)  # disabled
dispatch = Dispatch(List=closest_point.ClosestPoint, DispatchPattern=[True, False])  # -> ListA, ListB; disabled
dispatch_2 = Dispatch(List=closest_point_2.ClosestPoint, DispatchPattern=[True, False])  # -> ListA, ListB; disabled
shift_list = ShiftList(List=closest_point.ClosestPoint, Shift=1, Wrap=True)  # disabled
shift_list_2 = ShiftList(List=closest_point_2.ClosestPoint, Shift=1, Wrap=True)  # disabled
line = Line(StartPoint=dispatch.ListA, EndPoint=dispatch.ListB)  # disabled
line_2 = Line(StartPoint=dispatch_2.ListA, EndPoint=dispatch_2.ListB)  # disabled
panel = Panel(shift_list)  # disabled
panel_2 = Panel(shift_list_2)  # disabled
dispatch_3 = Dispatch(List=shift_list, DispatchPattern=[True, False])  # -> ListA, ListB; disabled
dispatch_4 = Dispatch(List=shift_list_2, DispatchPattern=[True, False])  # -> ListA, ListB; disabled
ghpython_script = GhPythonScript()  # -> out, a; disabled; unedited script template
line_3 = Line(StartPoint=dispatch_3.ListA, EndPoint=dispatch_3.ListB)  # disabled
line_4 = Line(StartPoint=dispatch_4.ListA, EndPoint=dispatch_4.ListB)  # disabled
point_5 = Point(dispatch_3.ListB)  # disabled
point_6 = Point(dispatch_4.ListB)  # disabled
merge = Merge(Data1=line_3, Data2=line)  # disabled
merge_2 = Merge(Data1=line_4, Data2=line_2)  # disabled
number_slider_15 = Slider(25, range=0..100)  # disabled
number_slider_16 = Slider(25, range=0..100)  # disabled
colour = Colour(RGB(28, 55, 255))  # disabled
colour_2 = Colour(RGB(28, 55, 255))  # disabled
xy_plane = XYPlane(Origin=Point(0, 0, 0))  # disabled
xy_plane_2 = XYPlane(Origin=Point(0, 0, 0))  # disabled
custom_preview = CustomPreview(Geometry=merge, Material=colour)  # disabled
custom_preview_2 = CustomPreview(Geometry=merge_2, Material=colour_2)  # disabled
rotate_3 = Rotate(Geometry=xy_plane, Angle=degrees(number_slider_15), Plane=PlaneXY(0, 0, 0))  # -> Geometry, Transform; disabled
panel_3 = Panel(merge)  # disabled
rotate_4 = Rotate(Geometry=xy_plane_2, Angle=degrees(number_slider_16), Plane=PlaneXY(0, 0, 0))  # -> Geometry, Transform; disabled
panel_4 = Panel(merge_2)  # disabled
end_points_3 = EndPoints(Curve=flatten(merge))  # -> Start, End; disabled
end_points_4 = EndPoints(Curve=flatten(merge_2))  # -> Start, End; disabled
line_5 = Line(flatten(merge))  # disabled
line_6 = Line(flatten(merge_2))  # disabled
vector_2pt = Vector2Pt(PointA=end_points_3.Start, PointB=end_points_3.End, Unitize=False)  # -> Vector, Length; disabled
vector_2pt_2 = Vector2Pt(PointA=end_points_4.Start, PointB=end_points_4.End, Unitize=False)  # -> Vector, Length; disabled
deconstruct_plane = DeconstructPlane(Plane=rotate_3.Geometry)  # -> Origin, XAxis, YAxis, ZAxis; disabled
deconstruct_plane_2 = DeconstructPlane(Plane=rotate_4.Geometry)  # -> Origin, XAxis, YAxis, ZAxis; disabled
panel_5 = Panel(line_5)  # disabled
panel_6 = Panel(line_6)  # disabled
angle = Angle(VectorA=deconstruct_plane.XAxis, VectorB=vector_2pt.Vector)  # -> Angle, Reflex; disabled
angle_2 = Angle(VectorA=deconstruct_plane_2.XAxis, VectorB=vector_2pt_2.Vector)  # -> Angle, Reflex; disabled
panel_7 = Panel(angle.Angle)  # disabled
panel_8 = Panel(angle_2.Angle)  # disabled
sort_list = SortList(Keys=angle.Angle)  # -> Keys, ValuesValuesA; disabled
sort_list_2 = SortList(Keys=angle_2.Angle)  # -> Keys, ValuesValuesA; disabled
explode_3 = Explode(Curve=merge, Recursive=True)  # -> Segments, Vertices; disabled
closed = Closed(Curve=flatten(merge))  # -> Closed, Periodic; disabled
discontinuity_3 = Discontinuity(Curve=merge, Level=1)  # -> Points, Parameters; disabled
divide_curve = DivideCurve(Curve=merge, Count=10, Kinks=False)  # -> Points, Tangents, Parameters; disabled
equality = Equality(FirstNumber=angle.Angle, SecondNumber=0)  # -> Equality, Inequality; disabled
equality_2 = Equality(FirstNumber=panel_7, SecondNumber=1.570796327)  # -> Equality, Inequality; disabled
equality_3 = Equality(FirstNumber=angle.Angle, SecondNumber=3.141592654)  # -> Equality, Inequality; disabled
explode_4 = Explode(Curve=merge_2, Recursive=True)  # -> Segments, Vertices; disabled
closed_2 = Closed(Curve=flatten(merge_2))  # -> Closed, Periodic; disabled
discontinuity_4 = Discontinuity(Curve=merge_2, Level=1)  # -> Points, Parameters; disabled
divide_curve_2 = DivideCurve(Curve=merge_2, Count=10, Kinks=False)  # -> Points, Tangents, Parameters; disabled
equality_4 = Equality(FirstNumber=angle_2.Angle, SecondNumber=0)  # -> Equality, Inequality; disabled
equality_5 = Equality(FirstNumber=panel_8, SecondNumber=1.570796327)  # -> Equality, Inequality; disabled
equality_6 = Equality(FirstNumber=angle_2.Angle, SecondNumber=3.141592654)  # -> Equality, Inequality; disabled
panel_9 = Panel(angle.Angle)  # disabled
panel_10 = Panel(angle_2.Angle)  # disabled
dispatch_5 = Dispatch(List=discontinuity_3.Points, DispatchPattern=[True, False])  # -> ListA, ListB; disabled
dispatch_6 = Dispatch(List=discontinuity_4.Points, DispatchPattern=[True, False])  # -> ListA, ListB; disabled
closest_point_3 = ClosestPoint(Point=discontinuity_3.Points, Cloud=flatten(divide_curve.Points))  # -> ClosestPoint, CPIndex, Distance; disabled
closest_point_4 = ClosestPoint(Point=discontinuity_4.Points, Cloud=flatten(divide_curve_2.Points))  # -> ClosestPoint, CPIndex, Distance; disabled
point_7 = Point(explode_3.Vertices)  # disabled
point_8 = Point(explode_4.Vertices)  # disabled
cull_pattern = CullPattern(List=line_5, CullPattern=equality.Equality)  # disabled
cull_pattern_2 = CullPattern(List=line_5, CullPattern=equality_2.Equality)  # disabled
cull_pattern_3 = CullPattern(List=line_6, CullPattern=equality_4.Equality)  # disabled
cull_pattern_4 = CullPattern(List=line_5, CullPattern=equality_3.Equality)  # disabled
cull_pattern_5 = CullPattern(List=line_6, CullPattern=equality_5.Equality)  # disabled
cull_pattern_6 = CullPattern(List=line_6, CullPattern=equality_6.Equality)  # disabled
colinear = CoLinear(Points=point_7, Strength=0)  # disabled
colinear_2 = CoLinear(Points=point_8, Strength=0)  # disabled
data = Data(colinear)  # disabled
data_2 = Data(colinear_2)  # disabled
merge_3 = Merge(Data1=cull_pattern, Data2=cull_pattern_2, Data3=cull_pattern_4)  # disabled
merge_4 = Merge(Data1=cull_pattern_3, Data2=cull_pattern_5, Data3=cull_pattern_6)  # disabled
number_slider_17 = Slider(0.2, range=0.001..100)  # disabled
number_slider_18 = Slider(67, range=0..100)  # disabled
number_slider_19 = Slider(29, range=0..100)  # disabled
merge_5 = Merge(Data1=merge_3, Data2=merge_4)  # disabled
number_slider_20 = Slider(25, range=0..100)  # disabled
number_slider_21 = Slider(-4, range=-10..10)  # disabled
square_3 = Square(Plane=PlaneXY(0, 0, 0), Size=number_slider_17, ExtentX=number_slider_18, ExtentY=number_slider_19)  # -> Cells, Points; disabled
rotate_5 = Rotate(Geometry=square_3.Points, Angle=degrees(number_slider_20), Plane=PlaneXY(0, 0, 0))  # -> Geometry, Transform; disabled
unit_y_2 = UnitY(Factor=number_slider_21)  # disabled
brep_5 = Brep(flatten([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]))  # disabled
brep_6 = Brep(flatten([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]))  # disabled
number_slider_22 = Slider(339.7, range=0..1000)  # disabled
number_slider_23 = Slider(1, range=0..1)  # disabled
move_4 = Move(Geometry=rotate_5.Geometry, Motion=unit_y_2)  # -> Geometry, Transform; disabled
curve_3 = Curve(brep_6)  # disabled
surface_3 = Surface(brep_6)  # disabled
explode_5 = Explode(Curve=curve_3, Recursive=True)  # -> Segments, Vertices; disabled
geometry_4 = Geometry(curve_3)  # disabled
rotate_6 = Rotate(Geometry=geometry_4, Angle=degrees(number_slider_22), Plane=PlaneXY(0, 0, 0))  # -> Geometry, Transform; disabled
unit_z_2 = UnitZ(Factor=number_slider_23)  # disabled
move_5 = Move(Geometry=move_4.Geometry, Motion=unit_z_2)  # -> Geometry, Transform; disabled
discontinuity_5 = Discontinuity(Curve=rotate_6.Geometry, Level=1)  # -> Points, Parameters; disabled
end_points_5 = EndPoints(Curve=rotate_6.Geometry)  # -> Start, End; disabled
point_9 = Point(end_points_5.Start)  # disabled
point_10 = Point(end_points_5.End)  # disabled
number_slider_24 = Slider(2, range=0..10)  # disabled
closest_point_5 = ClosestPoint(Point=discontinuity_5.Points, Cloud=flatten(move_5.Geometry))  # -> ClosestPoint, CPIndex, Distance; disabled
point_list_3 = PointList(Points=discontinuity_5.Points, Size=number_slider_24)  # disabled
dispatch_7 = Dispatch(List=closest_point_5.ClosestPoint, DispatchPattern=[True, False])  # -> ListA, ListB; disabled
shift_list_3 = ShiftList(List=closest_point_5.ClosestPoint, Shift=1, Wrap=True)  # disabled
line_7 = Line(StartPoint=dispatch_7.ListA, EndPoint=dispatch_7.ListB)  # disabled
panel_11 = Panel(shift_list_3)  # disabled
dispatch_8 = Dispatch(List=shift_list_3, DispatchPattern=[True, False])  # -> ListA, ListB; disabled
ghpython_script_2 = GhPythonScript()  # -> out, a; disabled; unedited script template
line_8 = Line(StartPoint=dispatch_8.ListA, EndPoint=dispatch_8.ListB)  # disabled
point_11 = Point(dispatch_8.ListB)  # disabled
merge_6 = Merge(Data1=line_8, Data2=line_7)  # disabled
number_slider_25 = Slider(25, range=0..100)  # disabled
colour_3 = Colour(RGB(28, 55, 255))  # disabled
xy_plane_3 = XYPlane(Origin=Point(0, 0, 0))  # disabled
custom_preview_3 = CustomPreview(Geometry=merge_6, Material=colour_3)  # disabled
rotate_7 = Rotate(Geometry=xy_plane_3, Angle=degrees(number_slider_25), Plane=PlaneXY(0, 0, 0))  # -> Geometry, Transform; disabled
panel_12 = Panel(merge_6)  # disabled
end_points_6 = EndPoints(Curve=flatten(merge_6))  # -> Start, End; disabled
line_9 = Line(flatten(merge_6))  # disabled
vector_2pt_3 = Vector2Pt(PointA=end_points_6.Start, PointB=end_points_6.End, Unitize=False)  # -> Vector, Length; disabled
deconstruct_plane_3 = DeconstructPlane(Plane=rotate_7.Geometry)  # -> Origin, XAxis, YAxis, ZAxis; disabled
panel_13 = Panel(line_9)  # disabled
angle_3 = Angle(VectorA=deconstruct_plane_3.XAxis, VectorB=vector_2pt_3.Vector)  # -> Angle, Reflex; disabled
panel_14 = Panel(angle_3.Angle)  # disabled
sort_list_3 = SortList(Keys=angle_3.Angle)  # -> Keys, ValuesValuesA; disabled
explode_6 = Explode(Curve=merge_6, Recursive=True)  # -> Segments, Vertices; disabled
closed_3 = Closed(Curve=flatten(merge_6))  # -> Closed, Periodic; disabled
discontinuity_6 = Discontinuity(Curve=merge_6, Level=1)  # -> Points, Parameters; disabled
divide_curve_3 = DivideCurve(Curve=merge_6, Count=10, Kinks=False)  # -> Points, Tangents, Parameters; disabled
equality_7 = Equality(FirstNumber=angle_3.Angle, SecondNumber=0)  # -> Equality, Inequality; disabled
equality_8 = Equality(FirstNumber=panel_14, SecondNumber=1.570796327)  # -> Equality, Inequality; disabled
equality_9 = Equality(FirstNumber=angle_3.Angle, SecondNumber=3.141592654)  # -> Equality, Inequality; disabled
panel_15 = Panel(angle_3.Angle)  # disabled
dispatch_9 = Dispatch(List=discontinuity_6.Points, DispatchPattern=[True, False])  # -> ListA, ListB; disabled
closest_point_6 = ClosestPoint(Point=discontinuity_6.Points, Cloud=flatten(divide_curve_3.Points))  # -> ClosestPoint, CPIndex, Distance; disabled
point_12 = Point(explode_6.Vertices)  # disabled
cull_pattern_7 = CullPattern(List=line_9, CullPattern=equality_7.Equality)  # disabled
cull_pattern_8 = CullPattern(List=line_9, CullPattern=equality_8.Equality)  # disabled
cull_pattern_9 = CullPattern(List=line_9, CullPattern=equality_9.Equality)  # disabled
colinear_3 = CoLinear(Points=point_12, Strength=0)  # disabled
data_3 = Data(colinear_3)  # disabled
merge_7 = Merge(Data1=cull_pattern_7, Data2=cull_pattern_8, Data3=cull_pattern_9)  # disabled

# ---- group: 2D EX. for not exact curves
number_slider_26 = Slider(56, range=0..100)  # disabled
number_slider_27 = Slider(33, range=0..100)  # disabled
geometry_5 = Geometry([<brep referenced from the Rhino model> x3])  # disabled
square_4 = Square(Plane=PlaneXY(0, 0, 0), Size=1, ExtentX=number_slider_26, ExtentY=number_slider_27)  # -> Cells, Points; disabled
number_slider_28 = Slider(2, range=0..10)  # disabled
discontinuity_7 = Discontinuity(Curve=geometry_5, Level=1)  # -> Points, Parameters; disabled
end_points_7 = EndPoints(Curve=geometry_5)  # -> Start, End; disabled
closest_point_7 = ClosestPoint(Point=discontinuity_7.Points, Cloud=flatten(square_4.Points))  # -> ClosestPoint, CPIndex, Distance; disabled
ghpython_script_3 = GhPythonScript()  # -> out, a; disabled; unedited script template
point_list_4 = PointList(Points=discontinuity_7.Points, Size=number_slider_28)  # disabled
point_13 = Point(end_points_7.Start)  # disabled
point_14 = Point(end_points_7.End)  # disabled
shift_list_4 = ShiftList(List=closest_point_7.ClosestPoint, Shift=1, Wrap=True)  # disabled
dispatch_10 = Dispatch(List=closest_point_7.ClosestPoint, DispatchPattern=[True, False])  # -> ListA, ListB; disabled
panel_16 = Panel(shift_list_4)  # disabled
dispatch_11 = Dispatch(List=shift_list_4, DispatchPattern=[True, False])  # -> ListA, ListB; disabled
stream_gate = StreamGate(Stream=shift_list_4, Gate=0)  # -> Target0, Target1, Target2, Target3; disabled
line_10 = Line(StartPoint=dispatch_10.ListA, EndPoint=dispatch_10.ListB)  # disabled
point_15 = Point(dispatch_11.ListB)  # disabled
point_16 = Point(stream_gate.Target0)  # disabled
line_11 = Line(StartPoint=dispatch_11.ListA, EndPoint=dispatch_11.ListB)  # disabled
merge_8 = Merge(Data1=line_11, Data2=line_10)  # disabled

# ----
deconstruct_brep = DeconstructBrep(Brep=bounding_box.Box)  # -> Faces, Edges, Vertices

# ---- group: Compliling 2D into 3D / Broken Boxes
brep_7 = Brep(flatten([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]))

# ----
point_17 = Point(<point referenced from the Rhino model>)
ghpython_script_4 = GhPythonScript(value1=Toggle(False), value2=Slider(5, range=0..10))  # -> history, pYout, Course; inputs value1: Boolean, value2: Int32
# ---------- ghpython_script_4: Python ----------
import rhinoscriptsyntax as rs
import ghpythonlib.components as ghc

if value1:
    pYout  =  "Hello User, it is nice meeting you, please contact the web: boooring.hated.usersOnEarth.org, it has the informaton you are looking for..."
    Course = "value1 is true, if you are getting this message, unfortunatley I must inform you that you are a smart person..."
else:
    pYout=  "What do you expect me to do?! Talk to you, why should I !!I have  better things to do!! I really do not have anything to say to YOU !!!Kind Regards, your loved Computer that actually hates you, Rupert"
    Course = "value 1 is, haha I tricked you this is a false message!"
# ---------- end ghpython_script_4 ----------
ghpython_script_5 = GhPythonScript()  # -> Out, A
panel_17 = Panel(ghpython_script_4.pYout)
panel_18 = Panel(ghpython_script_4.Course)

# ---- group: Compliling 2D into 3D
square_5 = Square(
    Plane=PlaneXY(0, 0, 0),
    Size=Slider(0.88, range=0.001..100),
    ExtentX=Slider(67, range=0..100),
    ExtentY=Slider(49, range=0..100))  # -> Cells, Points
brep_8 = Brep(flatten([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]))
curve_4 = Curve(brep_7)
surface_4 = Surface(brep_7)
rotate_8 = Rotate(Geometry=square_5.Points, Angle=degrees(Slider(25, range=0..100)), Plane=PlaneXY(0, 0, 0))  # -> Geometry, Transform
unit_y_3 = UnitY(Factor=Slider(-4, range=-10..10))
geometry_6 = Geometry([<brep referenced from the Rhino model> x7])
explode_7 = Explode(Curve=curve_4, Recursive=True)  # -> Segments, Vertices
discontinuity_8 = Discontinuity(Curve=geometry_6, Level=1)  # -> Points, Parameters
end_points_8 = EndPoints(Curve=geometry_6)  # -> Start, End
move_6 = Move(Geometry=rotate_8.Geometry, Motion=unit_y_3)  # -> Geometry, Transform
point_18 = Point(end_points_8.Start)
point_19 = Point(end_points_8.End)
closest_point_8 = ClosestPoint(Point=discontinuity_8.Points, Cloud=flatten(square_5.Points))  # -> ClosestPoint, CPIndex, Distance
point_list_5 = PointList(Points=discontinuity_8.Points, Size=Slider(2, range=0..10))
dispatch_12 = Dispatch(List=closest_point_8.ClosestPoint, DispatchPattern=[True, False])  # -> ListA, ListB
shift_list_5 = ShiftList(List=closest_point_8.ClosestPoint, Shift=1, Wrap=True)
line_12 = Line(StartPoint=dispatch_12.ListA, EndPoint=dispatch_12.ListB)
panel_19 = Panel(shift_list_5)
dispatch_13 = Dispatch(List=shift_list_5, DispatchPattern=[True, False])  # -> ListA, ListB
ghpython_script_6 = GhPythonScript()  # -> out, a; unedited script template
line_13 = Line(StartPoint=dispatch_13.ListA, EndPoint=dispatch_13.ListB)
point_20 = Point(dispatch_13.ListB)
merge_9 = Merge(Data1=line_13, Data2=line_12)
colour_4 = Colour(RGB(255, 255, 0))
xy_plane_4 = XYPlane(Origin=Point(0, 0, 0))
custom_preview_4 = CustomPreview(Geometry=merge_9, Material=colour_4)
rotate_9 = Rotate(Geometry=xy_plane_4, Angle=degrees(Slider(25, range=0..100)), Plane=PlaneXY(0, 0, 0))  # -> Geometry, Transform
end_points_9 = EndPoints(Curve=flatten(merge_9))  # -> Start, End
panel_20 = Panel(merge_9)
line_14 = Line(flatten(merge_9))
vector_2pt_4 = Vector2Pt(PointA=end_points_9.Start, PointB=end_points_9.End, Unitize=False)  # -> Vector, Length
deconstruct_plane_4 = DeconstructPlane(Plane=rotate_9.Geometry)  # -> Origin, XAxis, YAxis, ZAxis
panel_21 = Panel(line_14)
angle_4 = Angle(VectorA=deconstruct_plane_4.XAxis, VectorB=vector_2pt_4.Vector)  # -> Angle, Reflex
explode_8 = Explode(Curve=merge_9, Recursive=True)  # -> Segments, Vertices
closed_4 = Closed(Curve=flatten(merge_9))  # -> Closed, Periodic
discontinuity_9 = Discontinuity(Curve=merge_9, Level=1)  # -> Points, Parameters
divide_curve_4 = DivideCurve(Curve=merge_9, Count=10, Kinks=False)  # -> Points, Tangents, Parameters
dispatch_14 = Dispatch(List=discontinuity_9.Points, DispatchPattern=[True, False])  # -> ListA, ListB
closest_point_9 = ClosestPoint(Point=discontinuity_9.Points, Cloud=flatten(divide_curve_4.Points))  # -> ClosestPoint, CPIndex, Distance
point_21 = Point(explode_8.Vertices)
colinear_4 = CoLinear(Points=point_21, Strength=0)
data_4 = Data(colinear_4)

# ---- group: Compliling 2D into 3D / NEEDS TO BE CODED
panel_22 = Panel(angle_4.Angle)
sort_list_4 = SortList(Keys=angle_4.Angle)  # -> Keys, ValuesValuesA
equality_10 = Equality(FirstNumber=angle_4.Angle, SecondNumber=0)  # -> Equality, Inequality
equality_11 = Equality(FirstNumber=panel_22, SecondNumber=1.570796327)  # -> Equality, Inequality
equality_12 = Equality(FirstNumber=angle_4.Angle, SecondNumber=3.141592654)  # -> Equality, Inequality
panel_23 = Panel(angle_4.Angle)
cull_pattern_10 = CullPattern(List=line_14, CullPattern=equality_10.Equality)
cull_pattern_11 = CullPattern(List=line_14, CullPattern=equality_11.Equality)
cull_pattern_12 = CullPattern(List=line_14, CullPattern=equality_12.Equality)

# ---- group: Compliling 2D into 3D (continued)
merge_10 = Merge(Data1=cull_pattern_10, Data2=cull_pattern_11, Data3=cull_pattern_12)
