# Grasshopper definition Split_List.gh (Grasshopper 1.0.7)
# plug-ins: Bifocals

series = Series(Start=Slider(1, range=0..1), Step=1, Count=10)
panel = Panel(series)
split_list = SplitList(List=series, Index=Slider(5, range=0..9))  # -> ListA, ListB
panel_2 = Panel(split_list.ListA)
panel_3 = Panel(split_list.ListB)
