# Grasshopper definition Chair.gh (Grasshopper 1.0.7)
# plug-ins: Bifocals

curve = Curve(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)

# ---- group: Select the Magnet
curve_2 = Curve(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)

# ----
divide_distance = DivideDistance(Curve=curve, Distance=Slider(3, range=1..10))  # -> Points, Tangents, Parameters
list_length = ListLength(List=divide_distance.Points)
divide_curve = DivideCurve(Curve=curve, Count=expr("X - 1", list_length), Kinks=False)  # -> Points, Tangents, Parameters
divide_curve_2 = DivideCurve(Curve=curve_2, Count=expr("X - 1", list_length), Kinks=False)  # -> Points, Tangents, Parameters
distance = Distance(PointA=divide_curve.Points, PointB=divide_curve_2.Points)
number_slider = Slider(22, range=15..30)
perp_frame = PerpFrame(Curve=curve, Parameter=divide_curve.Parameters)
division = Division(A=distance, B=Slider(2, range=0..10))
division_2 = Division(A=Slider(0.5, range=0.5..2), B=Slider(2, range=0..10))
negative = Negative(Value=division)
negative_2 = Negative(Value=division_2)
construct_domain = ConstructDomain(DomainStart=division, DomainEnd=negative)
value_list = ValueList({"A) Render": 0, "B) Shop Fab": 1}, selected="A) Render")
construct_domain_2 = ConstructDomain(DomainStart=division_2, DomainEnd=negative_2)
rotate_plane = RotatePlane(Plane=perp_frame, Angle=degrees(Slider(90, range=0..90)))
stream_gate = StreamGate(Stream=rotate_plane, Gate=value_list)  # -> Target0, Target1

# ---- group: Rendering
rectangle = Rectangle(Plane=stream_gate.Target0, XSize=construct_domain, YSize=construct_domain_2, Radius=0)  # -> Rectangle, Length
amplitude = Amplitude(Vector=divide_curve.Tangents, Amplitude=Slider(2.5, range=0.5..2.5))
boundary_surfaces = BoundarySurfaces(Edges=rectangle.Rectangle)
extrude = Extrude(Base=boundary_surfaces, Direction=amplitude)
create_material = CreateMaterial(
    Diffuse=RGB(255, 105, 180),
    Specular=RGB(255, 255, 255),
    Emission=RGB(0, 0, 0),
    Transparency=0,
    Shine=Slider(100, range=0..100))
custom_preview = CustomPreview(Geometry=extrude, Material=create_material)

# ---- group: Shop fabrication
rectangle_2 = Rectangle(Plane=stream_gate.Target1, XSize=construct_domain, YSize=construct_domain_2, Radius=0)  # -> Rectangle, Length
list_length_2 = ListLength(List=rectangle_2.Rectangle)
series = Series(Start=0, Step=Slider(4, range=1..20), Count=list_length_2)
construct_point = ConstructPoint(XCoordinate=series, YCoordinate=Slider(-6, range=-20..2), ZCoordinate=0)
series_2 = Series(Start=Slider(1, range=0..1), Step=1, Count=list_length_2)
construct_point_2 = ConstructPoint(XCoordinate=series, YCoordinate=Slider(-17, range=-20..2), ZCoordinate=0)
xy_plane = XYPlane(Origin=construct_point_2)
rotate_plane_2 = RotatePlane(Plane=xy_plane, Angle=degrees(Slider(90, range=0..90)))
text_tag_3d = TextTag3D(Location=construct_point, Text=series_2, Size=Slider(0.26, range=0..1), Justification=Slider(2, range=0..8))
orient = Orient(Geometry=rectangle_2.Rectangle, Source=stream_gate.Target1, Target=rotate_plane_2)  # -> Geometry, Transform
