# Grasshopper definition Closest_Point_Magnet.gh (Grasshopper 1.0.7)

curve = Curve(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)
rectangle = Rectangle({Plane=PlaneXY(-25, 0, 0), Size=Domain2(u=-5..5, v=-5..5)})
rectangular_array = RectangularArray(Geometry=curve, Cell=rectangle, XCount=Slider(10, range=5..25), YCount=Slider(15, range=5..25))  # -> Geometry, Transform
area = Area(Geometry=rectangular_array.Geometry)  # -> Area, Centroid

# ---- group: Magnet Curve
curve_2 = Curve(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)

# ----
curve_closest_point = CurveClosestPoint(Point=area.Centroid, Curve=curve_2)  # -> Point, Parameter, Distance
construct_domain = ConstructDomain(DomainStart=Slider(1, range=0.2..1), DomainEnd=Slider(0.2, range=0.2..1))
bounds = Bounds(Numbers=curve_closest_point.Distance)
remap_numbers = RemapNumbers(Value=curve_closest_point.Distance, Source=bounds, Target=construct_domain)  # -> Mapped, Clipped
scale = Scale(Geometry=rectangular_array.Geometry, Center=area.Centroid, Factor=remap_numbers.Mapped)  # -> Geometry, Transform
