# Grasshopper definition Cross_Reference_Remap.gh (Grasshopper 1.0.7)
# plug-ins: Bifocals

series = Series(Start=0, Step=1, Count=Slider(10, range=3..20))
series_2 = Series(Start=0, Step=1, Count=Slider(10, range=3..20))
cross_reference = CrossReference(ListA=series, ListB=series_2, CrossMode=1)  # -> ListA, ListB
construct_point = ConstructPoint(XCoordinate=cross_reference.ListA, YCoordinate=cross_reference.ListB, ZCoordinate=0)
point = Point(<point referenced from the Rhino model>)
distance = Distance(PointA=point, PointB=construct_point)
sort_list = SortList(Keys=distance, ValuesA=construct_point)  # -> Keys, ValuesA
point_list = PointList(Points=sort_list.ValuesA, Size=Slider(0.3, range=0.1..1))
panel = Panel(sort_list.Keys)
bounds = Bounds(Numbers=panel)
construct_domain = ConstructDomain(DomainStart=Slider(0.2, range=0..1), DomainEnd=Slider(0.5, range=0..1))
remap_numbers = RemapNumbers(Value=panel, Source=bounds, Target=construct_domain)  # -> Mapped, Clipped
circle = Circle(Plane=sort_list.ValuesA, Radius=remap_numbers.Mapped)
