# Grasshopper definition Door_Handle_Design_Rail_Sweep1.gh (Grasshopper 1.0.7)

curve = Curve(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)
perp_frame = PerpFrame(Curve=reparameterize(curve), Parameter=Slider(1, range=0..1))
number_slider = Slider(2, range=0.2..2)
number_slider_2 = Slider(8, range=3..8)
number_slider_3 = Slider(0, range=0..1)
perp_frame_2 = PerpFrame(Curve=reparameterize(curve), Parameter=Slider(0.7, range=0..1))
number_slider_4 = Slider(2, range=0.2..2)
perp_frame_3 = PerpFrame(Curve=reparameterize(curve), Parameter=Slider(0.3, range=0..1))
perp_frame_4 = PerpFrame(Curve=reparameterize(curve), Parameter=Slider(0, range=0..1))
circle = Circle(Plane=perp_frame_4, Radius=number_slider_4)
polygon = Polygon(Plane=perp_frame_3, Radius=number_slider, Segments=number_slider_2, FilletRadius=number_slider_3)  # -> Polygon, Length
polygon_2 = Polygon(Plane=perp_frame_2, Radius=number_slider, Segments=number_slider_2, FilletRadius=number_slider_3)  # -> Polygon, Length
circle_2 = Circle(Plane=perp_frame, Radius=number_slider_4)
arc_rail = Data(curve)
merge = Merge(Data1=circle, Data2=polygon.Polygon, Data3=polygon_2.Polygon, Data4=circle_2)
sweep1 = Sweep1(Rail=arc_rail, Sections=merge, Miter=1)
stream_gate = StreamGate(Stream=sweep1, Gate=Toggle(True))  # -> Target0, Target1
custom_preview = CustomPreview(Geometry=stream_gate.Target0, Material=ColourSwatch(SwatchColor=RGB(89, 84, 178)))
custom_preview_2 = CustomPreview(Geometry=stream_gate.Target1, Material=ColourSwatch(SwatchColor=RGBA(89, 84, 178, 100)))
