# Grasshopper definition Explode_and_deconstruct_Brep.gh (Grasshopper 1.0.7)

curve = Curve(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)
curve_2 = Curve(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)
explode = Explode(Curve=curve, Recursive=True)  # -> Segments, Vertices
deconstruct_brep = DeconstructBrep(Brep=curve_2)  # -> Faces, Edges, Vertices
list_length = ListLength(List=explode.Segments)
list_length_2 = ListLength(List=explode.Vertices)
panel = Panel(list_length)
