# Grasshopper definition Grasshopper_basics_course.gh (Grasshopper 1.0.7)
# plug-ins: Bifocals

# ---- group: 3-D Polygon
number_slider = Slider(5, range=5..10)
series = Series(Start=Slider(1, range=1..5), Step=Slider(1, range=1..5), Count=number_slider)
multiplication = Multiplication(A=number_slider, B=Slider(2, range=1..20))
reverse_list = ReverseList(List=series)
series_2 = Series(Start=0, Step=Slider(2.1, range=1..5), Count=multiplication)
merge = Merge(Data1=series, Data2=reverse_list)
construct_point = ConstructPoint(XCoordinate=0, YCoordinate=0, ZCoordinate=series_2)
panel = Panel(merge)
number_slider_2 = Slider(1, range=1..10)
xy_plane = XYPlane(Origin=construct_point)
polygon = Polygon(Plane=xy_plane, Radius=panel, Segments=Slider(8, range=3..8), FilletRadius=0)  # -> Polygon, Length
loft = Loft(Curves=polygon.Polygon, Options={Adjust=False, Closed=False, LoftEnds=0, LoftSimp=0, LoftType=0, Rebuild=10, Refit=0.01})

# ---- group: Michalina copy
series_3 = Series(Start=Slider(1, range=0..1), Step=Slider(1, range=1..5), Count=Slider(5, range=1..10))
panel_2 = Panel(series_3)
reverse_list_2 = ReverseList(List=panel_2)
panel_3 = Panel(reverse_list_2)
merge_2 = Merge(Data1=panel_2, Data2=panel_3)
panel_4 = Panel(merge_2)

# ---- group: Lesson 1 session 2
series_4 = Series(Start=Slider(1, range=0..1), Step=Slider(1, range=1..5), Count=Slider(5, range=1..10))
panel_5 = Panel(series_4)
reverse_list_3 = ReverseList(List=panel_5)
panel_6 = Panel(reverse_list_3)
merge_3 = Merge(Data1=panel_5, Data2=panel_6)
panel_7 = Panel(merge_3)
