# Grasshopper definition Hor_Ver_C-planes.gh (Grasshopper 1.0.7)

curve = Curve(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)
horizontal_frame = HorizontalFrame(Curve=reparameterize(curve), Parameter=Slider(0.66, range=0..1))
perp_frame = PerpFrame(Curve=reparameterize(curve), Parameter=Slider(1, range=0..1))
