# Grasshopper definition Image_Sampler.gh (Grasshopper 1.0.7)

series = Series(Start=0, Step=1, Count=Slider(50, range=0..100))
series_2 = Series(Start=0, Step=1, Count=Slider(50, range=0..100))
cross_reference = CrossReference(ListA=series, ListB=series_2, CrossMode=1)  # -> ListA, ListB
construct_point = ConstructPoint(XCoordinate=cross_reference.ListA, YCoordinate=cross_reference.ListB, ZCoordinate=0)
image_sampler = ImageSampler(
    construct_point,
    FilePath="C:\Users\micha\Dropbox\GH101-Nov2018\Day 4\rhino2.JPG",
    Filter="Value",
    Interpolate=True,
    Umax=49,
    Umin=0,
    Vmax=49,
    Vmin=0,
    Wrap=1)
expression = Expression(x=image_sampler, y=Slider(0.2, range=0..1), Expression="IF ( x > y, 1, 0)")
panel = Panel(image_sampler)
dispatch = Dispatch(List=construct_point, DispatchPattern=expression)  # -> ListA, ListB
dispatch_2 = Dispatch(List=panel, DispatchPattern=expression)  # -> ListA, ListB
bounds = Bounds(Numbers=dispatch_2.ListA)
construct_domain = ConstructDomain(DomainStart=Slider(0.2, range=0.2..2), DomainEnd=Slider(0.47, range=0.2..2))
circle = Circle(Plane=dispatch.ListA, Radius=dispatch_2.ListA)
remap_numbers = RemapNumbers(Value=dispatch_2.ListA, Source=bounds, Target=construct_domain)  # -> Mapped, Clipped
