# Grasshopper definition Image_Sampler_Surface_From_Points.gh (Grasshopper 1.0.7)

number_slider = Slider(50, range=0..100)
series = Series(Start=0, Step=1, Count=Slider(50, range=0..100))
series_2 = Series(Start=0, Step=1, Count=number_slider)
cross_reference = CrossReference(ListA=series, ListB=series_2, CrossMode=1)  # -> ListA, ListB
construct_point = ConstructPoint(XCoordinate=cross_reference.ListA, YCoordinate=cross_reference.ListB, ZCoordinate=0)
image_sampler = ImageSampler(
    construct_point,
    FilePath="C:\Users\micha\Dropbox\GH101-Nov2018\Day 4\rhino2.JPG",
    Filter="Value",
    Interpolate=True,
    Umax=49,
    Umin=0,
    Vmax=49,
    Vmin=0,
    Wrap=1)
multiplication = Multiplication(A=image_sampler, B=Slider(5, range=1..5))
deconstruct = Deconstruct(Point=construct_point)  # -> XComponent, YComponent, ZComponent
construct_point_2 = ConstructPoint(XCoordinate=deconstruct.XComponent, YCoordinate=deconstruct.YComponent, ZCoordinate=multiplication)
expression = Expression(x=image_sampler, y=Slider(0.2, range=0..1), Expression="IF ( x > y, 1, 0)")
surface_from_points = SurfaceFromPoints(Points=construct_point_2, UCount=number_slider, Interpolate=False)
panel = Panel(image_sampler)
curve = Curve(<curve referenced from the Rhino model>)
dispatch = Dispatch(List=construct_point, DispatchPattern=expression)  # -> ListA, ListB
project = Project(Curve=curve, Brep=surface_from_points, Direction=Vector(0, 0, 1))
custom_preview = CustomPreview(Geometry=surface_from_points, Material=ColourSwatch(SwatchColor=RGB(125, 83, 109)))
dispatch_2 = Dispatch(List=panel, DispatchPattern=expression)  # -> ListA, ListB
bounds = Bounds(Numbers=dispatch_2.ListA)
construct_domain = ConstructDomain(DomainStart=Slider(0.2, range=0.2..2), DomainEnd=Slider(0.47, range=0.2..2))
circle = Circle(Plane=dispatch.ListA, Radius=dispatch_2.ListA)
remap_numbers = RemapNumbers(Value=dispatch_2.ListA, Source=bounds, Target=construct_domain)  # -> Mapped, Clipped
