# Grasshopper definition Jitters.gh (Grasshopper 1.0.7)

series = Series(Start=Slider(1, range=-1..1), Step=1, Count=10)
panel = Panel(series)
jitter = Jitter(List=panel, Jitter=1, Seed=Slider(5, range=0..10))  # -> Values, Indices
panel_2 = Panel(jitter.Values)
