# Grasshopper definition Offset_Curve.gh (Grasshopper 1.0.7)

curve = Curve(<curve referenced from the Rhino model>)
offset_curve = OffsetCurve(Curve=curve, Distance=Slider(2.5, range=-2.5..2.5), Plane=PlaneXY(0, 0, 0), Corners=Slider(0, range=0..4))
number_slider = Slider(0, range=0..1)
deconstruct_brep = DeconstructBrep(Brep=curve)  # -> Faces, Edges, Vertices
negative = Negative(Value=number_slider)
extend_curve = ExtendCurve(Curve=offset_curve, Type=number_slider, Start=negative, End=negative)
end_points = EndPoints(Curve=extend_curve)  # -> Start, End
