# Grasshopper definition Random_circle_or_polygon_plane.gh (Grasshopper 1.0.7)

square = Square(Plane=PlaneXY(0, 0, 0), Size=Slider(3, range=1..5), ExtentX=Slider(8, range=5..20), ExtentY=Slider(14, range=5..20))  # -> Cells, Points
flatten_tree = FlattenTree(Tree=square.Points, Path="{0}")
please_select_one = ValueList({"A) Circles": 0, "B) Polygons": 1}, selected="B) Polygons")
construct_domain = ConstructDomain(DomainStart=Slider(0.2, range=0..1), DomainEnd=Slider(0.49, range=0..1))
list_length = ListLength(List=flatten_tree)
random = Random(Range=construct_domain, Number=list_length, Seed=Slider(5, range=0..10))
stream_gate = StreamGate(Stream=flatten_tree, Gate=please_select_one)  # -> Target0, Target1
polygon = Polygon(
    Plane=stream_gate.Target1,
    Radius=[0.2981272539, 0.2824813498, 0.2762591661, 0.3813589949, 0.3344039373, 0.4692284101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],
    Segments=Slider(3, range=0..10),
    FilletRadius=0)  # -> Polygon, Length
circle = Circle(Plane=stream_gate.Target0, Radius=random)
random_reduce = RandomReduce(List=[circle, polygon.Polygon], Reduction=Slider(24, range=0..100), Seed=Slider(5, range=0..10))
