# Grasshopper definition Random_polygon_and_circle_grid.gh (Grasshopper 1.0.7)

square = Square(Plane=PlaneXY(0, 0, 0), Size=Slider(1.67, range=0..10), ExtentX=Slider(8, range=5..20), ExtentY=Slider(14, range=5..20))  # -> Cells, Points
flatten_tree = FlattenTree(Tree=square.Points, Path="{0}")
please_select_one = ValueList({"A) Circles": 0, "B) Polygons": 1}, selected="B) Polygons")
construct_domain = ConstructDomain(DomainStart=Slider(3, range=3..8), DomainEnd=Slider(8, range=3..8))
construct_domain_2 = ConstructDomain(DomainStart=Slider(0.2, range=0..1), DomainEnd=Slider(1, range=0..1))
list_length = ListLength(List=flatten_tree)
list_length_2 = ListLength(List=flatten_tree)
number_slider = Slider(4, range=0..10)
random = Random(Range=construct_domain, Number=list_length, Seed=Slider(5, range=0..10))
random_2 = Random(Range=construct_domain_2, Number=list_length_2, Seed=Slider(5, range=0..10))
stream_gate = StreamGate(Stream=flatten_tree, Gate=please_select_one)  # -> Target0, Target1
integer = Integer(random)
polygon = Polygon(Plane=stream_gate.Target1, Radius=random_2, Segments=integer, FilletRadius=0)  # -> Polygon, Length
circle = Circle(Plane=stream_gate.Target0, Radius=random_2)
random_reduce = RandomReduce(List=[circle, polygon.Polygon], Reduction=Slider(24, range=0..100), Seed=Slider(5, range=0..10))
