# Grasshopper definition Rectangle_Surface.gh (Grasshopper 1.0.7)

curve = Curve(<curve referenced from the Rhino model>)
deconstruct_brep = DeconstructBrep(Brep=curve)  # -> Faces, Edges, Vertices
list_length = ListLength(List=deconstruct_brep.Vertices)
list_item = ListItem(List=deconstruct_brep.Vertices, Index=Slider(3, range=0..3), Wrap=True)
list_item_2 = ListItem(List=deconstruct_brep.Vertices, Index=0, Wrap=True)  # -> Item, Item1, Item2, Item3
sphere = Sphere(Base=list_item, Radius=1)
panel = Panel(list_length)
_4point_surface = _4PointSurface(CornerA=list_item_2.Item, CornerB=list_item_2.Item1, CornerC=list_item_2.Item2)
_4point_surface_2 = _4PointSurface(CornerA=list_item_2.Item, CornerB=list_item_2.Item2, CornerC=list_item_2.Item3)
custom_preview = CustomPreview(
    Geometry=_4point_surface,
    Material={diffuse=RGB(221, 160, 221), emission=RGB(66, 48, 66), shine=0.5, specular=RGB(255, 255, 255), transparency=0})
custom_preview_2 = CustomPreview(Geometry=_4point_surface_2, Material=ColourSwatch(SwatchColor=RGB(204, 124, 255)))
