# Grasshopper definition Rectangular_Array.gh (Grasshopper 1.0.7)
# plug-ins: Bifocals

rectangle = Rectangle(Plane=PlaneXY(0, 0, 0), XSize=Slider(2, range=1..10), YSize=Slider(2, range=1..10), Radius=0)  # -> Rectangle, Length

# ---- group: Select the 2D Tile
curve = Curve(<curve referenced from the Rhino model>)

# ----
rectangular_array = RectangularArray(Geometry=curve, Cell=rectangle.Rectangle, XCount=Slider(10, range=8..20), YCount=Slider(15, range=8..20))  # -> Geometry, Transform
area = Area(Geometry=rectangular_array.Geometry)  # -> Area, Centroid

# ---- group: Select the Magnet
curve_2 = Curve(<curve referenced from the Rhino model>)

# ----
curve_closest_point = CurveClosestPoint(Point=area.Centroid, Curve=curve_2)  # -> Point, Parameter, Distance
bounds = Bounds(Numbers=curve_closest_point.Distance)
construct_domain = ConstructDomain(DomainStart=Slider(0.16, range=0..1), DomainEnd=Slider(0.92, range=0.25..2.5))
line = Line(StartPoint=area.Centroid, EndPoint=curve_closest_point.Point)
remap_numbers = RemapNumbers(Value=curve_closest_point.Distance, Source=bounds, Target=construct_domain)  # -> Mapped, Clipped
scale = Scale(Geometry=rectangular_array.Geometry, Center=area.Centroid, Factor=remap_numbers.Mapped)  # -> Geometry, Transform
