# Grasshopper definition Remap_Domain.gh (Grasshopper 1.0.7)

series = Series(Start=Slider(1, range=0..1), Step=1, Count=10)
panel = Panel(series)

construct_domain = ConstructDomain(DomainStart=Slider(1, range=1..2), DomainEnd=Slider(2, range=1..2))
bounds = Bounds(Numbers=panel)
remap_numbers = RemapNumbers(Value=panel, Source=bounds, Target=construct_domain)  # -> Mapped, Clipped

panel_2 = Panel(remap_numbers.Mapped)
