# Grasshopper definition Reversing Lists.gh (Grasshopper 1.0.7)

series = Series(Start=Slider(1, range=0..1), Step=Slider(1, range=1..5), Count=Slider(5, range=1..10))
panel = Panel(series)
reverse_list = ReverseList(List=panel)
panel_2 = Panel(reverse_list)
merge = Merge(Data1=panel, Data2=panel_2)
panel_3 = Panel(merge)
