# Grasshopper definition Rhino_Image_3D.gh (Grasshopper 1.0.7)

construct_domain² = ConstructDomain²(UMin=Slider(0.1, range=0..1), UMax=Slider(0.9, range=0..1), VMin=Slider(0.1, range=0..1), VMax=Slider(0.9, range=0..1))
geometry = Geometry(<brep referenced from the Rhino model>)
isotrim = Isotrim(Surface=reparameterize(geometry), Domain=construct_domain²)
divide_domain² = DivideDomain²(Domain=isotrim, UCount=Slider(3, range=3..12), VCount=Slider(3, range=3..12))
isotrim_2 = Isotrim(Surface=isotrim, Domain=divide_domain²)
deconstruct_brep = DeconstructBrep(Brep=isotrim_2)  # -> Faces, Edges, Vertices
list_item = ListItem(List=deconstruct_brep.Vertices, Index=0, Wrap=True)  # -> Item, Item1, Item2, Item3
point_list = PointList(Points=deconstruct_brep.Vertices, Size=Slider(0.55, range=0..2))
_4point_surface = _4PointSurface(CornerA=list_item.Item, CornerB=list_item.Item1, CornerC=list_item.Item2)
_4point_surface_2 = _4PointSurface(CornerA=list_item.Item, CornerB=list_item.Item2, CornerC=list_item.Item3)
colour_swatch = ColourSwatch(SwatchColor=RGB(255, 255, 255))
custom_preview = CustomPreview(Geometry=_4point_surface_2, Material=ColourSwatch(SwatchColor=RGB(255, 255, 255)))
custom_preview_2 = CustomPreview(Geometry=_4point_surface, Material=ColourSwatch(SwatchColor=RGB(154, 169, 255)))
