# Grasshopper definition Rotate_CPlane.gh (Grasshopper 1.0.7)

number_slider = Slider(20, range=10..25)
series = Series(Start=0, Step=Slider(1, range=1..5), Count=number_slider)
construct_point = ConstructPoint(XCoordinate=0, YCoordinate=0, ZCoordinate=series)
range = Range(Domain=Slider(90, range=0..360), Steps=expr("X - 1", number_slider))
series_2 = Series(Start=0, Step=Slider(0, range=0..25), Count=number_slider)
xy_plane = XYPlane(Origin=construct_point)
stream_filter = StreamFilter(Gate=Toggle(True), Stream0=series_2, Stream1=range)
curve = Curve(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)
rotate_plane = RotatePlane(Plane=xy_plane, Angle=degrees(stream_filter))
area = Area(Geometry=curve)  # -> Area, Centroid
xy_plane_2 = XYPlane(Origin=area.Centroid)
orient = Orient(Geometry=curve, Source=xy_plane_2, Target=rotate_plane)  # -> Geometry, Transform
