# Grasshopper definition Seam_Fillet.gh (Grasshopper 1.0.7)

curve = Curve(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)
fillet = Fillet(Curve=curve, Radius=Slider(2.3, range=0..2.5))
seam = Seam(Curve=reparameterize(fillet), Seam=Slider(0, range=0..1))
point_on_curve = PointOnCurve(seam, parameter=0.5)
