# Grasshopper definition Series_Exercise.gh (Grasshopper 1.0.7)

series = Series(Start=0, Step=1, Count=10)
reverse_list = ReverseList(List=series)
series_2 = Series(Start=Slider(9, range=0..10), Step=Slider(-1, range=-1..0), Count=Slider(10, range=0..10))
series_3 = Series(Start=Slider(0, range=0..10), Step=Slider(0, range=0..100), Count=Slider(5, range=0..10))
panel = Panel(reverse_list)
panel_2 = Panel(series_2)
panel_3 = Panel(series_3)
