# Grasshopper definition Sort_Numbers.gh (Grasshopper 1.0.7)

series = Series(Start=0, Step=1, Count=10)
jitter = Jitter(List=series, Jitter=1, Seed=2)  # -> Values, Indices
panel = Panel(jitter.Values)
sort_list = SortList(Keys=panel)  # -> Keys, ValuesValuesA
panel_2 = Panel(sort_list.Keys)
