# Grasshopper definition Stream_Gate.gh (Grasshopper 1.0.7)

curve = Curve(<curve referenced from the Rhino model>)
stream_gate = StreamGate(Stream=curve, Gate=Toggle(False))  # -> Target0, Target1
stream_filter = StreamFilter(Gate=0)
boundary_surfaces = BoundarySurfaces(Edges=stream_gate.Target0)
area = Area(Geometry=stream_gate.Target1)  # -> Area, Centroid
