# Grasshopper definition Sub_List.gh (Grasshopper 1.0.7)
# plug-ins: Bifocals

series = Series(Start=Slider(1, range=0..1), Step=1, Count=10)
panel = Panel(series)
construct_domain = ConstructDomain(DomainStart=Slider(0, range=0..100), DomainEnd=Slider(5, range=0..100))
sub_list = SubList(List=series, Domain=construct_domain, Wrap=True)  # -> List, Index
panel_2 = Panel(sub_list.List)
