# Grasshopper definition Tween_Curves.gh (Grasshopper 1.0.7)
# plug-ins: Bifocals

# ---- group: Right Curve
curve = Curve(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)

# ---- group: Please,Select the centercurve
curve_2 = Curve(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)

# ---- group: Left curve
curve_3 = Curve(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)

# ----
range = Range(Domain=Domain(0, 1), Steps=Slider(12, range=5..20))

end_points = EndPoints(Curve=curve_2)  # -> Start, End
cloud_display = CloudDisplay(
    Points=[end_points.End, end_points.Start],
    Colours=ColourSwatch(SwatchColor=RGB(255, 255, 255)),
    Size=Slider(0.5, range=0..1),
    SpriteType=0)

range_2 = Range(Domain=Domain(0, 1), Steps=Slider(12, range=5..20))
tween_curve = TweenCurve(CurveA=curve_2, CurveB=curve, Factor=range, BlendType=0)
tween_curve_2 = TweenCurve(CurveA=curve_3, CurveB=curve_2, Factor=range_2, BlendType=0)
cull_index = CullIndex(List=tween_curve, Indices=Slider(0, range=0..1), Wrap=True)
merge = Merge(Data1=tween_curve_2, Data2=cull_index)
flatten_tree = FlattenTree(Tree=merge, Path="{0}")
xz_plane = XZPlane(Origin=Point(0, 0, 0))
project = Project(Geometry=flatten_tree, Plane=xz_plane)  # -> Geometry, Transform
colour_swatch = ColourSwatch(SwatchColor=RGB(255, 134, 0))
colour_swatch_2 = ColourSwatch(SwatchColor=RGB(160, 186, 255))
edge_surface = EdgeSurface(CurveA=flatten_tree, CurveB=project.Geometry)
list_length = ListLength(List=edge_surface)
colour_wheel = ColourWheel(
    edge_surface,
    ColourGrips_Style=31,
    ColourGrips_Grip=[0.8431988157, 2.937593918, 5.031989021, 3.141592654],
    ColourGrips_Lum=[0.1, 0.5],
    ColourGrips_Range=[1.516688781, 1.516688781, 1.516688781, 1.516688781],
    ColourGrips_Sat=[0.2, 0.6])
series = Series(Start=0, Step=1, Count=list_length)
bounds = Bounds(Numbers=series)
remap_numbers = RemapNumbers(Value=series, Source=bounds, Target=Slider(255, range=0..1000))  # -> Mapped, Clipped
sort_list = SortList(Keys=remap_numbers.Mapped)  # -> Keys, ValuesA
gradient = Gradient(
    LowerLimit=Slider(0, range=0..1),
    UpperLimit=sort_list.Keys,
    Parameter=edge_surface,
    stops=[0: RGB(243, 57, 0), 0.1: RGB(236, 27, 60), 0.2: RGB(210, 0, 118), 0.3: RGB(103, 0, 120), 0.4: RGB(39, 72, 161), 0.5: RGB(1, 192, 229), 0.6: RGB(18, 178, 90), 0.7: RGB(79, 186, 8), 0.8: RGB(220, 237, 32), 0.9: RGB(247, 159, 20), 1: RGB(243, 57, 0)])
custom_preview = CustomPreview(Geometry=edge_surface, Material=gradient)
