# Grasshopper definition Vase.gh (Grasshopper 1.0.7)

range = Range(Domain=Slider(360, range=0..360), Steps=Slider(33, range=10..50))
curve = Curve(<curve referenced from the Rhino model>)
xy_plane = XYPlane(Origin=Point(0, 0, 0))
rotate = Rotate(Geometry=curve, Angle=degrees(range), Plane=xy_plane)  # -> Geometry, Transform
cull_index = CullIndex(List=rotate.Geometry, Indices=Slider(-1, range=-1..0), Wrap=True)
list_length = ListLength(List=cull_index)
random = Random(Range=Slider(5, range=0..10), Number=list_length, Seed=Slider(0.84, range=0..10))
extend_curve = ExtendCurve(Curve=cull_index, Type=Slider(0, range=0..2), Start=Slider(0, range=0..100), End=random)
merge = Merge(Data1=Slider(0, range=0..1), Data2=Slider(0.25, range=0..1), Data3=Slider(0.8, range=0..1), Data4=Slider(1, range=0..1))
merge_2 = Merge(
    Data1=Slider(0.5, range=0.1..2),
    Data2=Slider(0.2, range=0.1..2),
    Data3=Slider(0.2, range=0.1..2),
    Data4=Slider(0.33, range=0.1..2))
pipe_variable = PipeVariable(Curve=reparameterize(extend_curve), Parameters=merge, Radii=merge_2, Caps=Slider(2, range=1..2))
custom_preview = CustomPreview(Geometry=pipe_variable, Material=ColourSwatch(SwatchColor=RGB(94, 103, 143)))
