# Grasshopper definition Array_Along_Curve.gh (Grasshopper 1.0.7)
# plug-ins: Bifocals

curve = Curve(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)
number_slider = Slider(-5, range=-10..20)
curve_2 = Curve([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])
group = Group(Objects=curve_2)
number_slider_2 = Slider(8.3, range=0..20)
negative = Negative(Value=number_slider)
data = Data(curve)
bounding_box = BoundingBox(Content=group, Plane=PlaneXY(0, 0, 0))  # -> Box, Box_2
extend_curve = ExtendCurve(Curve=data, Type=Slider(0, range=0..2), Start=number_slider, End=negative)
area = Area(Geometry=bounding_box.Box)  # -> Area, Centroid
divide_distance = DivideDistance(Curve=curve, Distance=number_slider_2)  # -> Points, Tangents, Parameters
unit_z = UnitZ(Factor=1)
divide_distance_2 = DivideDistance(Curve=extend_curve, Distance=number_slider_2)  # -> Points, Tangents, Parameters
rotate = Rotate(Vector=divide_distance.Tangents, Axis=unit_z, Angle=Slider(-90, range=-90..90))
amplitude = Amplitude(Vector=rotate, Amplitude=1)
move = Move(Geometry=divide_distance.Points, Motion=amplitude)  # -> Geometry, Transform
xy_plane = XYPlane(Origin=move.Geometry)
align_plane = AlignPlane(Plane=xy_plane, Direction=divide_distance.Tangents)  # -> Plane, Angle
rotate_plane = RotatePlane(Plane=align_plane.Plane, Angle=degrees(Slider(-45, range=-45..45)))
orient = Orient(Geometry=group, Source=area.Centroid, Target=rotate_plane)  # -> Geometry, Transform
bounding_box_2 = BoundingBox(Content=orient.Geometry, Plane=PlaneXY(0, 0, 0))  # -> Box, Box_2
construct_domain = ConstructDomain(DomainStart=Slider(1, range=0..1), DomainEnd=Slider(0.5, range=0..1))
list_length = ListLength(List=bounding_box_2.Box)
area_2 = Area(Geometry=bounding_box_2.Box)  # -> Area, Centroid
range = Range(Domain=construct_domain, Steps=expr("X -1", list_length))
scale = Scale(Geometry=orient.Geometry, Center=area_2.Centroid, Factor=range)  # -> Geometry, Transform
