# Grasshopper definition Dispatch_&_Flatten.gh (Grasshopper 1.0.7)
# plug-ins: Bifocals

curve = Curve([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])
closed = Closed(Curve=curve)  # -> Closed, Periodic
panel = Panel(closed.Closed)
dispatch = Dispatch(List=curve, DispatchPattern=closed.Closed)  # -> ListA, ListB
select_one_type = ValueList({"Line": 0, "Tan": 1, "Curv": 2}, selected="Tan")
end_points = EndPoints(Curve=dispatch.ListB)  # -> Start, End
blend_curve = BlendCurve(
    CurveA=dispatch.ListB,
    CurveB=dispatch.ListB,
    BulgeA=Slider(0.1, range=0..1),
    BulgeB=Slider(0.9, range=0..1),
    Continuity=select_one_type)
line = Line(StartPoint=end_points.Start, EndPoint=end_points.End)
join_curves = JoinCurves(Curves=[blend_curve, dispatch.ListB], Preserve=False)
merge = Merge(Data1=dispatch.ListA, Data2=join_curves)
data = Data(merge)
flatten_tree = FlattenTree(Tree=merge, Path="{0}")
data_2 = Data(flatten_tree)
