# Grasshopper definition Dispatch_Area.gh (Grasshopper 1.0.7)
# plug-ins: Bifocals

curve = Curve([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])
area = Area(Geometry=curve)  # -> Area, Centroid
expression = Expression(X=area.Area, Y=Slider(5, range=5..30), Expression="IF ( X > Y , 1 ,0 )")
panel = Panel(expression)
dispatch = Dispatch(List=curve, DispatchPattern=expression)  # -> ListA, ListB
dispatch_2 = Dispatch(List=area.Area, DispatchPattern=[True, False])  # -> ListA, ListB
boundary_surfaces = BoundarySurfaces(Edges=dispatch.ListA)
