# Grasshopper definition File_Path_&_Read_File.gh (Grasshopper 1.0.7)
# plug-ins: Bifocals

file_path = FilePath("C:\Users\micha\Dropbox\Grasshopper Intermediate - June 2019\Andres_Files\105_DOF_XYZ.txt")
text = Text(",")  # "( , )"
read_file = ReadFile(File=file_path, PerLineParse=True)
panel = Panel(read_file)
text_split = TextSplit(Text=read_file, Separators=text)
flip_matrix = FlipMatrix(Data=text_split)
panel_2 = Panel(text_split)
panel_3 = Panel(flip_matrix)
list_item = ListItem(List=flip_matrix, Index=Slider(3, range=0..3), Wrap=True)
flatten_tree = FlattenTree(Tree=list_item, Path="{0}")
panel_4 = Panel(flatten_tree)
