# Grasshopper definition Graph_Mapper.gh (Grasshopper 1.0.7)
# plug-ins: Bifocals

panel = Panel("Definition 2 :)")
number_slider = Slider(20, range=0..100)
number_slider_2 = Slider(10, range=0..10)
range = Range(Domain=Domain(0, 1), Steps=Slider(10, range=0..10))
series = Series(Start=0, Step=1, Count=number_slider)
range_2 = Range(Domain=Domain(0, 1), Steps=expr("X-1", number_slider))
list_length = ListLength(List=range)
graph_mapper = GraphMapper(
    range_2,
    x0=0,
    x1=1,
    y0=0,
    y1=1,
    container_name="Bezier",
    cpx=[0, 0.3782610595, 0.639130652, 1],
    cpy=[0.1869564056, 0.5927535295, 0.05942040682, 0.289855063])
construct_point = ConstructPoint(XCoordinate=0, YCoordinate=0, ZCoordinate=series)
panel_2 = Panel(range)
graph_mapper_2 = GraphMapper(
    panel_2,
    x0=0,
    x1=1,
    y0=0,
    y1=1,
    container_name="Bezier",
    cpx=[0, 0.2815662622, 0.6996763349, 1],
    cpy=[0, 0.6379795074, 0.6602805257, 0])
construct_domain = ConstructDomain(DomainStart=Slider(3, range=1..12), DomainEnd=Slider(8, range=1..12))
bounds = Bounds(Numbers=graph_mapper)
panel_3 = Panel(graph_mapper_2)
remap_numbers = RemapNumbers(Value=graph_mapper, Source=bounds, Target=construct_domain)  # -> Mapped, Clipped
circle = Circle(Plane=construct_point, Radius=remap_numbers.Mapped)
