# Grasshopper definition Ordering_Squares.gh (Grasshopper 1.0.7)
# plug-ins: Bifocals

number_slider = Slider(5, range=5..10)
construct_domain = ConstructDomain(DomainStart=Slider(2, range=2..8), DomainEnd=Slider(8, range=2..8))
random = Random(Range=construct_domain, Number=number_slider, Seed=Slider(3.08, range=0..10))
series = Series(Start=0, Step=Slider(10, range=2..10), Count=number_slider)
construct_point = ConstructPoint(XCoordinate=series, YCoordinate=Slider(26.11, range=0..100), ZCoordinate=0)
panel = Panel(random)
construct_point_2 = ConstructPoint(XCoordinate=series, YCoordinate=Slider(26.11, range=0..100), ZCoordinate=0)
rectangle = Rectangle(Plane=construct_point, XSize=random, YSize=random, Radius=0)  # -> Rectangle, Length
xy_plane = XYPlane(Origin=construct_point_2)
area = Area(Geometry=rectangle.Rectangle)  # -> Area, Centroid
panel_2 = Panel(rectangle.Length)
sort_list = SortList(Keys=panel_2, ValuesValuesA=rectangle.Rectangle)  # -> Keys, ValuesValuesA
area_2 = Area(Geometry=sort_list.ValuesValuesA)  # -> Area, Centroid
panel_3 = Panel(sort_list.Keys)
orient = Orient(Geometry=sort_list.ValuesValuesA, Source=area_2.Centroid, Target=xy_plane)  # -> Geometry, Transform
brep_wireframe = BrepWireframe(Brep=orient.Geometry, Density=-1)
list_item = ListItem(List=brep_wireframe, Index=0, Wrap=True)  # -> Item1, Item, Item1_2, Item2, Item3
data = Data(list_item.Item1)
flatten_tree = FlattenTree(Tree=data, Path="{0}")
length = Length(Curve=flatten_tree)
end_points = EndPoints(Curve=flatten_tree)  # -> Start, End
addition = Addition(A=length, B=Slider(-0.8, range=-2..2))
mass_addition = MassAddition(Input=addition)  # -> Result, PartialResults
construct_point_3 = ConstructPoint(XCoordinate=mass_addition.PartialResults, YCoordinate=0, ZCoordinate=0)
orient_2 = Orient(Geometry=orient.Geometry, Source=end_points.End, Target=construct_point_3)  # -> Geometry, Transform
