# Grasshopper definition Sort.gh (Grasshopper 1.0.7)
# plug-ins: Bifocals

curve = Curve([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])
end_points = EndPoints(Curve=curve)  # -> Start, End
deconstruct = Deconstruct(Point=end_points.Start)  # -> XComponent, YComponent, ZComponent
stream_filter = StreamFilter(
    Gate=Slider(0, range=0..2),
    Stream0=deconstruct.XComponent,
    Stream1=deconstruct.YComponent,
    Stream2=deconstruct.ZComponent)
panel = Panel(stream_filter)
sort_list = SortList(Keys=stream_filter, ValuesA=curve)  # -> Keys, ValuesA
loft = Loft(
    Curves=sort_list.ValuesA,
    Options={Adjust=False, Closed=False, LoftEnds=0, LoftSimp=0, LoftType=0, Rebuild=10, Refit=0.01})
panel_2 = Panel(sort_list.Keys)
