# Grasshopper definition Weave_Single_Line.gh (Grasshopper 1.0.7)
# plug-ins: Bifocals

construct_point = ConstructPoint(XCoordinate=0, YCoordinate=0, ZCoordinate=0)
unit_y = UnitY(Factor=1)
line_sdl = LineSDL(Start=construct_point, Direction=unit_y, Length=Slider(10, range=1..10))

# ---- group: List Zero
list_zero = DivideCurve(Curve=line_sdl, Count=Slider(11, range=5..21), Kinks=False)  # -> Points, Tangents, Parameters

# ----
unit_x = UnitX(Factor=Slider(0, range=0..10))

# ---- group: List One
move = Move(Geometry=list_zero.Points, Motion=unit_x)  # -> Geometry, Transform

# ----
panel = Panel("""0
1
1
0""")
weave = Weave(Pattern=panel, Stream0=list_zero.Points, Stream1=move.Geometry, NullGaps=False)
polyline = PolyLine(Vertices=weave, Closed=False)
point_list = PointList(Points=weave, Size=Slider(1.2, range=0..10))
