# Grasshopper definition Weave_Splines_Rotate.gh (Grasshopper 1.0.7)
# plug-ins: Bifocals

number_slider = Slider(1.6, range=-5..5)
curve = Curve(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)
extend_curve = ExtendCurve(Curve=curve, Type=Slider(0, range=0..2), Start=number_slider, End=number_slider)
unit_z = UnitZ(Factor=1)

# ---- group: List 0
divide_curve = DivideCurve(Curve=extend_curve, Count=Slider(21, range=5..21), Kinks=False)  # -> Points, Tangents, Parameters

# ----
rotate = Rotate(Vector=divide_curve.Tangents, Axis=unit_z, Angle=degrees(Slider(-90, range=-90..90)))
amplitude = Amplitude(Vector=rotate, Amplitude=Slider(2.6, range=1..5))
list_1 = Move(Geometry=divide_curve.Points, Motion=amplitude)  # -> Geometry, Transform
stream_gate = StreamGate(Stream=rotate, Gate=Button())  # -> Target0, Target1
panel = Panel("""0
1
1
0""")
weave = Weave(Pattern=panel, Stream0=divide_curve.Points, Stream1=list_1.Geometry, NullGaps=False)
vector_display_ex = VectorDisplayEx(Point=divide_curve.Points, Vector=stream_gate.Target1, Colour=RGB(0, 0, 0), Width=2)
stream_gate_2 = StreamGate(Stream=weave, Gate=Slider(1, range=0..2))  # -> Target0, Target1, Target2
polyline = PolyLine(Vertices=stream_gate_2.Target0, Closed=False)
nurbs_curve = NurbsCurve(Vertices=stream_gate_2.Target2, Degree=3, Periodic=False)  # -> Curve, Length, Domain
interpolate = Interpolate(Vertices=stream_gate_2.Target1, Degree=3, Periodic=False, KnotStyle=1)  # -> Curve, Length, Domain
