# Grasshopper definition AddApertures_Bug.gh (Grasshopper 1.0.7)
# plug-ins: TopologicGH, SAM

geometry = Geometry(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)
geometry_2 = Geometry([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])
topology_bygeometry = TopologyByGeometry(Geometry=geometry, Tolerance=0.0001)
topology_bygeometry_2 = TopologyByGeometry(Geometry=geometry_2, Tolerance=0.0001)
panel = Panel(topology_bygeometry)
panel_2 = Panel(topology_bygeometry_2)
face_bywire = FaceByWire(Wire=topology_bygeometry_2)
cluster_bytopologies = ClusterByTopologies(Topologies=face_bywire)
topology_slice = TopologySlice(Topology=topology_bygeometry, Tool=cluster_bytopologies, TransferDictionary=False)
geometry_3 = Geometry(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)
topology_bygeometry_3 = TopologyByGeometry(Geometry=geometry_3, Tolerance=0.0001)
geometry_4 = Geometry([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])
topology_bygeometry_4 = TopologyByGeometry(Geometry=geometry_4, Tolerance=0.0001)
topology_impose = TopologyImpose(Topology=topology_slice, Tool=topology_bygeometry_3, TransferDictionary=False)
cluster_bytopologies_2 = ClusterByTopologies(Topologies=topology_bygeometry_4)
topology_slice_2 = TopologySlice(Topology=topology_impose, Tool=cluster_bytopologies_2, TransferDictionary=False)
topology_cells = TopologyCells(Topology=topology_slice_2)
topology_faces = TopologyFaces(Topology=topology_slice_2)
cellcomplex_byfaces = CellComplexByFaces(Faces=topology_faces, Tolerance=0.001)
topology_geometry = TopologyGeometry(Topology=topology_faces, Tolerance=0.0001)

topology_faces_2 = TopologyFaces(Topology=topology_slice_2)
list_item = ListItem(List=topology_faces_2, Index=Slider(31, range=1..150), Wrap=True)
geometry_5 = Geometry(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)
topology_bygeometry_5 = TopologyByGeometry(Geometry=geometry_5, Tolerance=0.0001)
topology_addapertures = TopologyAddApertures(Topology=list_item, ApertureTopologies=topology_bygeometry_5)
topology_typeasstring = TopologyTypeAsString(Topology=topology_bygeometry_5)
panel_3 = Panel(topology_typeasstring)
topology_apertures = TopologyApertures(Topology=topology_addapertures)
topology_geometry_2 = TopologyGeometry(Topology=topology_addapertures, Tolerance=0.0001)
geometry_6 = Geometry(topology_geometry_2)

faceutility_adjacentcells = FaceUtilityAdjacentCells(Face=topology_faces, ParentTopology=topology_slice_2)  # -> simplify(Cells)
list_length = ListLength(List=faceutility_adjacentcells)
equality = Equality(FirstNumber=list_length, SecondNumber=Slider(1, range=0..1))  # -> Equality, Inequality
dispatch = Dispatch(List=topology_faces, DispatchPattern=flatten(equality.Equality))  # -> ListA, ListB
topology_geometry_3 = TopologyGeometry(Topology=dispatch.ListB, Tolerance=0.0001)
topology_centroid = TopologyCentroid(Topology=dispatch.ListA)
faceutility_parametersatvertex = FaceUtilityParametersAtVertex(Face=dispatch.ListA, Vertex=topology_centroid)  # -> U, V
faceutility_normalatparameters = FaceUtilityNormalAtParameters(Face=dispatch.ListA, U=faceutility_parametersatvertex.U, V=faceutility_parametersatvertex.V)  # -> X, Y, Z
absolute = Absolute(Value=faceutility_normalatparameters.Z)

topology_geometry_4 = TopologyGeometry(Topology=dispatch.ListA, Tolerance=0.0001)  # -> flatten(Geometry)
area = Area(Geometry=topology_geometry_4)  # -> Area, Centroid
evaluate_surface = EvaluateSurface(Surface=topology_geometry_4, Point=area.Centroid)  # -> Point, Normal, UDirection, VDirection, Frame
dispatch_2 = Dispatch(List=dispatch.ListA, DispatchPattern=flatten(absolute))  # -> ListA, ListB
deconstruct = Deconstruct(Point=evaluate_surface.Normal)  # -> XComponent, YComponent, ZComponent
panel_4 = Panel(evaluate_surface.Normal)

construct_point = ConstructPoint(XCoordinate=deconstruct.XComponent, YCoordinate=deconstruct.YComponent, ZCoordinate=deconstruct.ZComponent)
panel_5 = Panel(construct_point)
construct_point_2 = ConstructPoint(XCoordinate=faceutility_normalatparameters.X, YCoordinate=faceutility_normalatparameters.Y, ZCoordinate=absolute)
panel_6 = Panel(construct_point_2)
geometry_7 = Geometry([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])
topology_bygeometry_6 = TopologyByGeometry(Geometry=geometry_7, Tolerance=0.0001)
topology_addapertures_2 = TopologyAddApertures(Topology=dispatch_2.ListB, ApertureTopologies=topology_bygeometry_6)
topology_apertures_2 = TopologyApertures(Topology=topology_addapertures_2)
merge = Merge(Data2=dispatch_2.ListA, Data3=topology_addapertures_2, Data4=dispatch.ListB)  # -> flatten(Result); disabled
topology_samgeometry = TopologySAMGeometry(_topology=merge, SAM_ComponentVersion="1.0.0")
geometry_8 = Geometry()
topology_geometry_5 = TopologyGeometry(Topology=merge, Tolerance=0.0001)  # -> flatten(Geometry)
cellcomplex_byfaces_2 = CellComplexByFaces(Faces=merge, Tolerance=0.001)  # disabled
topology_geometry_6 = TopologyGeometry(Topology=merge, Tolerance=0.0001)
cell_byfaces = CellByFaces(Faces=merge, Tolerance=0.001)
samanalytical_createpanelby3dgeometry = SAMAnalyticalCreatePanelBy3DGeometry(
    _3Dgeometry=flatten(topology_samgeometry),
    Simplify_=True,
    MinArea_=0.001,
    Tolerance_=1e-06,
    SAM_ComponentVersion="1.0.1")
topology_bygeometry_7 = TopologyByGeometry(Geometry=topology_geometry_5, Tolerance=0.0001)

cellcomplex_externalboundary = CellComplexExternalBoundary(CellComplex=topology_slice_2)  # disabled
cellcomplex_internalboundaries = CellComplexInternalBoundaries(CellComplex=topology_slice_2)  # disabled
number_slider = Slider(4, range=0..10)  # disabled
number_slider_2 = Slider(0, range=0..100)  # disabled
number_slider_3 = Slider(33, range=0..100)  # disabled
number_slider_4 = Slider(5, range=0..10)  # disabled
number_slider_5 = Slider(28, range=0..100)  # disabled
number_slider_6 = Slider(29, range=0..100)  # disabled
cell_faces = CellFaces(Cell=cellcomplex_externalboundary)  # disabled
construct_domain = ConstructDomain(DomainStart=number_slider_4, DomainEnd=number_slider_5)  # disabled
construct_domain_2 = ConstructDomain(DomainStart=number_slider_2, DomainEnd=number_slider)  # disabled
construct_domain_3 = ConstructDomain(DomainStart=number_slider_6, DomainEnd=number_slider_3)  # disabled
sub_list = SubList(List=cell_faces, Domain=construct_domain, Wrap=True)  # -> List, Index; disabled
sub_list_2 = SubList(List=cell_faces, Domain=construct_domain_2, Wrap=True)  # -> List, Index; disabled
sub_list_3 = SubList(List=cell_faces, Domain=construct_domain_3, Wrap=True)  # -> List, Index; disabled
geometry_9 = Geometry([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])  # disabled
topology_bygeometry_8 = TopologyByGeometry(Geometry=geometry_9, Tolerance=0.0001)  # disabled
topology_addapertures_3 = TopologyAddApertures(Topology=sub_list.List, ApertureTopologies=topology_bygeometry_8)  # disabled
replace_items = ReplaceItems(Wrap=False)  # disabled
topology_apertures_3 = TopologyApertures(Topology=topology_addapertures_3)  # disabled
merge_2 = Merge(Data1=cellcomplex_internalboundaries, Data2=topology_addapertures_3, Data3=sub_list_2.List, Data4=sub_list_3.List)  # -> flatten(Result); disabled
topology_geometry_7 = TopologyGeometry(Topology=merge_2, Tolerance=0.0001)  # disabled
topology_samgeometry_2 = TopologySAMGeometry(_topology=merge_2, SAM_ComponentVersion="1.0.0")  # disabled
topology_analyze = TopologyAnalyze(Topology=merge_2)  # disabled
topology_analyze_2 = TopologyAnalyze(_topology=merge_2, SAM_ComponentVersion="1.0.0")  # disabled
samanalytical_createpanelby3dgeometry_2 = SAMAnalyticalCreatePanelBy3DGeometry(
    _3Dgeometry=flatten(topology_samgeometry_2),
    Simplify_=True,
    MinArea_=0.001,
    Tolerance_=1e-06,
    SAM_ComponentVersion="1.0.1")  # disabled
topology_selfmerge = TopologySelfMerge(Topology=merge_2)  # disabled
number_slider_7 = Slider(0.01, range=0..0.01)  # disabled
cluster_cellcomplexes = ClusterCellComplexes(Cluster=topology_selfmerge)  # disabled
samanalytical_mergeoverlappanels = SAMAnalyticalMergeOverlapPanels(
    _analyticalObject=flatten(samanalytical_createpanelby3dgeometry_2),
    _offset_=1e-06,
    _defaultConstruction_=False,
    _tolerance_=1e-06,
    _run=True,
    SAM_ComponentVersion="1.0.0")  # -> AnalyticalObject, RedundantPanels; disabled
topology_apertures_4 = TopologyApertures(Topology=merge_2)  # -> flatten(Apertures); disabled
cellcomplex_byfaces_3 = CellComplexByFaces(Faces=topology_selfmerge, Tolerance=number_slider_7)  # disabled
topology_geometry_8 = TopologyGeometry(Topology=cluster_cellcomplexes, Tolerance=0.0001)  # disabled
cell_byfaces_2 = CellByFaces(Faces=topology_selfmerge, Tolerance=0.001)  # disabled
number_slider_8 = Slider(28, range=1..49)  # disabled
create_samadjacencycluster = CreateSAMAdjacencyCluster(
    _panels=flatten(samanalytical_mergeoverlappanels.AnalyticalObject),
    Tolerance_=0.0001,
    TryCellComplexByCells_=False,
    MinArea_=0.001,
    SilverSpacing_=0.001,
    _run=True,
    SAM_ComponentVersion="1.0.0")  # -> AdjacencyCluster, Topologies, Panels, Spaces, InternalPanels, ExternalPanels, ShadingPanels, RedundantPanels, Log, Sucessfull; disabled
geometry_10 = Geometry(topology_geometry_8)  # disabled
list_item_2 = ListItem(List=flatten(topology_apertures_4), Index=number_slider_8, Wrap=True)  # disabled
topology_geometry_9 = TopologyGeometry(Topology=list_item_2, Tolerance=0.0001)  # disabled
panel_7 = Panel(create_samadjacencycluster.ExternalPanels, SAM_Analytical_Grasshopper_GooPanelParam=True)  # disabled

samanalytical_mergeoverlappanels_2 = SAMAnalyticalMergeOverlapPanels(
    _analyticalObject=flatten(samanalytical_createpanelby3dgeometry),
    _offset_=1e-06,
    _defaultConstruction_=False,
    _tolerance_=1e-06,
    _run=True,
    SAM_ComponentVersion="1.0.0")  # -> AnalyticalObject, RedundantPanels
create_samadjacencycluster_2 = CreateSAMAdjacencyCluster(
    _panels=flatten(samanalytical_mergeoverlappanels_2.AnalyticalObject),
    Tolerance_=0.0001,
    TryCellComplexByCells_=False,
    MinArea_=0.001,
    SilverSpacing_=0.001,
    _run=True,
    SAM_ComponentVersion="1.0.0")  # -> AdjacencyCluster, Topologies, Panels, Spaces, InternalPanels, ExternalPanels, ShadingPanels, RedundantPanels, Log, Sucessfull
samadjacencycluster_updatepaneltypes = SAMAdjacencyClusterUpdatePanelTypes(_adjacencyCluster=create_samadjacencycluster_2.AdjacencyCluster, SAM_ComponentVersion="1.0.1")
topology_inspect = TopologyInspect(_topology=create_samadjacencycluster_2.Topologies, SAM_ComponentVersion="1.0.3")  # -> CellComplexes, Cells
panel_8 = Panel(create_samadjacencycluster.ExternalPanels, SAM_Analytical_Grasshopper_GooPanelParam=True)  # disabled
