# Grasshopper definition Bug_CellComplex.gh (Grasshopper 1.0.7)
# plug-ins: TopologicGH

geometry = Geometry(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)
geometry_2 = Geometry([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])
topology_bygeometry = TopologyByGeometry(Geometry=geometry, Tolerance=0.0001)
topology_bygeometry_2 = TopologyByGeometry(Geometry=geometry_2, Tolerance=0.0001)
panel = Panel(topology_bygeometry)
panel_2 = Panel(topology_bygeometry_2)
face_bywire = FaceByWire(Wire=topology_bygeometry_2)
cluster_bytopologies = ClusterByTopologies(Topologies=face_bywire)
topology_slice = TopologySlice(Topology=topology_bygeometry, Tool=cluster_bytopologies, TransferDictionary=False)
geometry_3 = Geometry(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)
topology_bygeometry_3 = TopologyByGeometry(Geometry=geometry_3, Tolerance=0.0001)
geometry_4 = Geometry([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])
topology_bygeometry_4 = TopologyByGeometry(Geometry=geometry_4, Tolerance=0.0001)
topology_impose = TopologyImpose(Topology=topology_slice, Tool=topology_bygeometry_3, TransferDictionary=False)
cluster_bytopologies_2 = ClusterByTopologies(Topologies=topology_bygeometry_4)
topology_slice_2 = TopologySlice(Topology=topology_impose, Tool=cluster_bytopologies_2, TransferDictionary=False)
number_slider = Slider(0.0001, range=0..0.0001)
number_slider_2 = Slider(0.1, range=0..0.1)
topology_faces = TopologyFaces(Topology=topology_slice_2)
cellcomplex_byfaces = CellComplexByFaces(Faces=topology_faces, Tolerance=Slider(0.01, range=0..0.01))
