# Grasshopper definition Building_Boxes_Then_Bug#2.gh (Grasshopper 1.0.7)
# plug-ins: TopologicGH

geometry = Geometry([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])
geometry_2 = Geometry([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])
geometry_3 = Geometry([<brep referenced from the Rhino model> x5])
# Here is the cluster!
deconstruct_brep = DeconstructBrep(Brep=geometry)  # -> Faces, Edges, Vertices
# This is the geometry involving the faces in Topologic, like you see it doesn't work...
topology_bygeometry = TopologyByGeometry(Geometry=geometry_3, Tolerance=0.0001)
geometry_4 = Geometry([<brep referenced from the Rhino model> x6])
list_item = ListItem(List=geometry_2, Index=0, Wrap=True)
list_item_2 = ListItem(List=geometry_2, Index=1, Wrap=True)
topology_bygeometry_2 = TopologyByGeometry(Geometry=geometry_4, Tolerance=0.0001)
geometry_5 = Geometry(deconstruct_brep.Edges)
topology_bygeometry_3 = TopologyByGeometry(Geometry=flatten(deconstruct_brep.Faces), Tolerance=0.0001)
geometry_6 = Geometry(list_item_2)
# 1 closed BREP from each cube.
geometry_7 = Geometry(list_item)
topology_bygeometry_4 = TopologyByGeometry(Geometry=geometry_7, Tolerance=0.0001)
topology_bygeometry_5 = TopologyByGeometry(Geometry=geometry_6, Tolerance=0.0001)
topology_merge = TopologyMerge(Topology=topology_bygeometry, Topology_2=topology_bygeometry_2, TransferDictionary=False)
cluster_bytopologies = ClusterByTopologies(Topologies=topology_bygeometry_3)
topology_merge_2 = TopologyMerge(Topology=topology_bygeometry_4, Topology_2=topology_bygeometry_5, TransferDictionary=False)
topology_faces = TopologyFaces(Topology=topology_merge)
cluster_bytopologies_2 = ClusterByTopologies(Topologies=topology_merge)
cluster_faces = ClusterFaces(Cluster=cluster_bytopologies)
list_item_3 = ListItem(List=cluster_bytopologies, Index=Slider(10, range=0..10), Wrap=True)
file_path = FilePath("C:\Users\micha\OneDrive\Documents\GitHub\Grasshopper_Rhino\Projects\Topologic\Topologic_BREP_Bug_2.brep")
cellcomplex_byfaces = CellComplexByFaces(Faces=topology_faces, Tolerance=0.001)
topology_faces_2 = TopologyFaces(Topology=topology_merge_2)
topology_geometry = TopologyGeometry(Topology=list_item_3, Tolerance=0.0001)
topology_exporttobrep = TopologyExportToBRep(Topology=cluster_bytopologies_2, Path=file_path)
cellcomplex_byfaces_2 = CellComplexByFaces(Faces=cluster_faces, Tolerance=0.001)
cellcomplex_byfaces_3 = CellComplexByFaces(Faces=topology_faces_2, Tolerance=0.001)
geometry_8 = Geometry(topology_geometry)
