# Grasshopper definition Building_Boxes_Then_Bug.gh (Grasshopper 1.0.7)
# plug-ins: TopologicGH, Bifocals

xz_plane = XZPlane(Origin=Point(0, 0, 0))
xy_plane = XYPlane(Origin=Point(0, 0, 0))
construct_point = ConstructPoint(XCoordinate=Slider(5, range=-100..100), YCoordinate=Slider(-2, range=-100..100), ZCoordinate=0)
rotate = Rotate(Geometry=xy_plane, Angle=Slider(45, range=0..100), Plane=xz_plane)  # -> Geometry, Transform
construct_point_2 = ConstructPoint(XCoordinate=Slider(0, range=-100..100), YCoordinate=Slider(0, range=-100..100), ZCoordinate=0)
construct_point_3 = ConstructPoint(XCoordinate=Slider(10, range=0..100), YCoordinate=Slider(3, range=0..100), ZCoordinate=0)
construct_point_4 = ConstructPoint(XCoordinate=Slider(15, range=0..100), YCoordinate=Slider(9, range=0..100), ZCoordinate=0)
construct_point_5 = ConstructPoint(XCoordinate=Slider(5, range=-100..100), YCoordinate=Slider(-2, range=-100..100), ZCoordinate=0)
construct_point_6 = ConstructPoint(XCoordinate=Slider(0, range=-100..100), YCoordinate=Slider(0, range=-100..100), ZCoordinate=0)
construct_point_7 = ConstructPoint(XCoordinate=Slider(10, range=0..100), YCoordinate=Slider(3, range=0..100), ZCoordinate=0)
construct_point_8 = ConstructPoint(XCoordinate=Slider(15, range=0..100), YCoordinate=Slider(9, range=0..100), ZCoordinate=0)
box_2pt = Box2Pt(PointA=construct_point, PointB=construct_point_3, Plane=PlaneXY(0, 0, 0))
box_2pt_2 = Box2Pt(PointA=construct_point_5, PointB=construct_point_7, Plane=PlaneXY(0, 0, 0))
box_2pt_3 = Box2Pt(PointA=construct_point_2, PointB=construct_point_4, Plane=PlaneXY(0, 0, 0))
unit_x = UnitX(Factor=Slider(7, range=0..100))
plane_surface = PlaneSurface(Plane=rotate.Geometry, XSize=Domain(-10, 10), YSize=Domain(-10, 10))
box_2pt_4 = Box2Pt(PointA=construct_point_6, PointB=construct_point_8, Plane=PlaneXY(0, 0, 0))
unit_y = UnitY(Factor=Slider(-27, range=-100..100))
unit_y_2 = UnitY(Factor=Slider(-27, range=-100..100))
move = Move(Geometry=plane_surface, Motion=unit_x)  # -> Geometry, Transform
move_2 = Move(Geometry=box_2pt, Motion=unit_y)  # -> Geometry, Transform
move_3 = Move(Geometry=box_2pt_2, Motion=unit_y_2)  # -> Geometry, Transform
box_rectangle = BoxRectangle(Rectangle=box_2pt_3, Height=Slider(3, range=0..10))
box_rectangle_2 = BoxRectangle(Rectangle=box_2pt_4, Height=Slider(3, range=0..10))
unit_y_3 = UnitY(Factor=Slider(-9, range=-100..100))
unit_y_4 = UnitY(Factor=Slider(-5, range=-10..10))
unit_y_5 = UnitY(Factor=Slider(-9, range=-100..100))
box_rectangle_3 = BoxRectangle(Rectangle=move_2.Geometry, Height=Slider(7, range=0..10))
move_4 = Move(Geometry=move.Geometry, Motion=unit_y_4)  # -> Geometry, Transform
unit_y_6 = UnitY(Factor=Slider(18, range=0..100))
box_rectangle_4 = BoxRectangle(Rectangle=move_3.Geometry, Height=Slider(7, range=0..10))
unit_y_7 = UnitY(Factor=Slider(18, range=0..100))
move_5 = Move(Geometry=box_rectangle, Motion=unit_y_3)  # -> Geometry, Transform
move_6 = Move(Geometry=box_rectangle_2, Motion=unit_y_5)  # -> Geometry, Transform
move_7 = Move(Geometry=box_rectangle_3, Motion=unit_y_6)  # -> Geometry, Transform
move_8 = Move(Geometry=box_rectangle_4, Motion=unit_y_7)  # -> Geometry, Transform
brep_join = BrepJoin(Breps=[move_7.Geometry, move_5.Geometry])  # -> Breps, Closed
brep_join_2 = BrepJoin(Breps=[move_8.Geometry, move_6.Geometry])  # -> Breps, Closed
deconstruct_brep = DeconstructBrep(Brep=brep_join.Breps)  # -> Faces, Edges, Vertices
deconstruct_brep_2 = DeconstructBrep(Brep=brep_join_2.Breps)  # -> Faces, Edges, Vertices
split_brep = SplitBrep(Brep=brep_join.Breps, Cutter=move_4.Geometry)
topology_bygeometry = TopologyByGeometry(Geometry=deconstruct_brep_2.Faces, Tolerance=0.0001)  # -> flatten(Topology)
panel = Panel(split_brep)
panel_2 = Panel(topology_bygeometry)
cellcomplex_byfaces = CellComplexByFaces(Faces=topology_bygeometry, Tolerance=0.001)
cluster_bytopologies = ClusterByTopologies(Topologies=topology_bygeometry)
topology_geometry = TopologyGeometry(Topology=topology_bygeometry, Tolerance=0.0001)
topology_selfmerge = TopologySelfMerge(Topology=cluster_bytopologies)
topology_analyze = TopologyAnalyze(Topology=topology_selfmerge)
panel_3 = Panel(topology_selfmerge)
dispatch = Dispatch(List=split_brep, DispatchPattern=[True, False])  # -> ListA, ListB
panel_4 = Panel(topology_analyze)
data = Data(dispatch.ListB)
data_2 = Data(dispatch.ListA)
topology_bygeometry_2 = TopologyByGeometry(Geometry=data_2, Tolerance=0.0001)
panel_5 = Panel(topology_bygeometry_2)
topology_faces = TopologyFaces(Topology=topology_bygeometry_2)
panel_6 = Panel(topology_faces)
cellcomplex_byfaces_2 = CellComplexByFaces(Faces=topology_faces, Tolerance=0.001)
