# Grasshopper definition Experimenting_With_Capholesgh.gh (Grasshopper 1.0.7)
# plug-ins: TopologicGH, Bifocals

xz_plane = XZPlane(Origin=Point(0, 0, 0))
xy_plane = XYPlane(Origin=Point(0, 0, 0))
rotate = Rotate(Geometry=xy_plane, Angle=degrees(Slider(45, range=0..100)), Plane=xz_plane)  # -> Geometry, Transform
construct_point = ConstructPoint(XCoordinate=Slider(10, range=0..100), YCoordinate=Slider(15, range=0..100), ZCoordinate=0)
construct_point_2 = ConstructPoint(XCoordinate=Slider(15, range=0..100), YCoordinate=Slider(10, range=0..100), ZCoordinate=0)
construct_point_3 = ConstructPoint(XCoordinate=Slider(20, range=0..100), YCoordinate=Slider(10, range=0..100), ZCoordinate=0)
construct_point_4 = ConstructPoint(XCoordinate=Slider(10, range=0..100), YCoordinate=Slider(20, range=0..100), ZCoordinate=0)
plane_surface = PlaneSurface(Plane=rotate.Geometry, XSize=Domain(-10, 10), YSize=Domain(-10, 10))
unit_y = UnitY(Factor=Slider(11, range=0..100))
box_2pt = Box2Pt(PointA=construct_point, PointB=construct_point_2, Plane=PlaneXY(0, 0, 0))
box_2pt_2 = Box2Pt(PointA=construct_point_3, PointB=construct_point_4, Plane=PlaneXY(0, 0, 0))
unit_y_2 = UnitY(Factor=Slider(-7, range=-10..10))
move = Move(Geometry=plane_surface, Motion=unit_y)  # -> Geometry, Transform
box_rectangle = BoxRectangle(Rectangle=box_2pt, Height=Slider(5, range=0..10))
box_rectangle_2 = BoxRectangle(Rectangle=box_2pt_2, Height=Slider(2, range=0..10))
unit_x = UnitX(Factor=Slider(12, range=0..100))
move_2 = Move(Geometry=box_rectangle_2, Motion=unit_y_2)  # -> Geometry, Transform
move_3 = Move(Geometry=move.Geometry, Motion=unit_x)  # -> Geometry, Transform
topology_bygeometry = TopologyByGeometry(Geometry=box_rectangle, Tolerance=0.0001)
topology_bygeometry_2 = TopologyByGeometry(Geometry=move_2.Geometry, Tolerance=0.0001)
topology_bygeometry_3 = TopologyByGeometry(Geometry=move_3.Geometry, Tolerance=0.0001)
topology_impose = TopologyImpose(Topology=[topology_bygeometry, topology_bygeometry_2], Tool=topology_bygeometry_3, TransferDictionary=False)
topology_divide = TopologyDivide(Topology=[topology_bygeometry, topology_bygeometry_2], Tool=topology_bygeometry_3, TransferDictionary=False)
topology_geometry = TopologyGeometry(Topology=topology_impose, Tolerance=0.0001)
topology_geometry_2 = TopologyGeometry(Topology=topology_divide, Tolerance=0.0001)
topology_merge = TopologyMerge(Topology=topology_bygeometry, Topology_2=topology_bygeometry_2, TransferDictionary=False)
topology_difference = TopologyDifference(Topology=topology_bygeometry, Topology_2=topology_bygeometry_2, TransferDictionary=False)
topology_imprint = TopologyImprint(Topology=[topology_bygeometry, topology_bygeometry_2], Tool=topology_bygeometry_3, TransferDictionary=False)
topology_intersect = TopologyIntersect(Topology=topology_bygeometry, Topology_2=topology_bygeometry_2, TransferDictionary=False)
topology_union = TopologyUnion(Topology=topology_bygeometry, Topology_2=topology_bygeometry_2, TransferDictionary=False)
topology_geometry_3 = TopologyGeometry(Topology=topology_imprint, Tolerance=0.0001)
topology_geometry_4 = TopologyGeometry(Topology=topology_difference, Tolerance=0.0001)
topology_geometry_5 = TopologyGeometry(Topology=topology_union, Tolerance=0.0001)
topology_geometry_6 = TopologyGeometry(Topology=topology_merge, Tolerance=0.0001)
topology_geometry_7 = TopologyGeometry(Topology=topology_intersect, Tolerance=0.0001)
