# Grasshopper definition External_Internal_Wall_Filtering#2_with_Pyramid.gh (Grasshopper 1.0.7)
# plug-ins: TopologicGH

geometry = Geometry([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])
topology_bygeometry = TopologyByGeometry(Geometry=geometry, Tolerance=0.0001)
topology_faces = TopologyFaces(Topology=topology_bygeometry)
cellcomplex_byfaces = CellComplexByFaces(Faces=flatten(topology_faces), Tolerance=0.001)
topology_faces_2 = TopologyFaces(Topology=cellcomplex_byfaces)
face_cells = FaceCells(Face=topology_faces_2)
list_length = ListLength(List=face_cells)
equality = Equality(FirstNumber=list_length, SecondNumber=Slider(2, range=0..10))  # -> simplify(flatten(Equality)), Inequality
dispatch = Dispatch(List=topology_faces_2, DispatchPattern=equality.Equality)  # -> ListA, ListB
topology_geometry = TopologyGeometry(Topology=dispatch.ListB, Tolerance=0.0001)
panel = Panel(dispatch.ListA)
