# Grasshopper definition External_Internal_Wall_Filtering.gh (Grasshopper 1.0.7)
# plug-ins: TopologicGH

geometry = Geometry([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])
topology_bygeometry = TopologyByGeometry(Geometry=geometry, Tolerance=0.0001)
panel = Panel(geometry)
topology_faces = TopologyFaces(Topology=topology_bygeometry)  # -> flatten(Faces)
cellcomplex_byfaces = CellComplexByFaces(Faces=topology_faces, Tolerance=0.001)
topology_faces_2 = TopologyFaces(Topology=cellcomplex_byfaces)
topology_cells = TopologyCells(Topology=cellcomplex_byfaces)
list_length = ListLength(List=flatten(topology_faces_2))
face_cells = FaceCells(Face=topology_faces_2)  # -> simplify(Cells)
list_item = ListItem(List=topology_cells, Index=Slider(0, range=0..2), Wrap=True)
list_length_2 = ListLength(List=face_cells)
panel_2 = Panel(list_length)
topology_geometry = TopologyGeometry(Topology=list_item, Tolerance=0.0001)
equality = Equality(FirstNumber=list_length_2, SecondNumber=Slider(2, range=0..10))  # -> simplify(flatten(Equality)), simplify(flatten(Inequality))
topology_geometry_2 = TopologyGeometry(Topology=topology_cells, Tolerance=0.0001)
dispatch = Dispatch(List=topology_faces_2, DispatchPattern=equality.Equality)  # -> ListA, ListB
brep_wireframe = BrepWireframe(Brep=topology_geometry_2, Density=-1)
topology_geometry_3 = TopologyGeometry(Topology=dispatch.ListB, Tolerance=0.0001)
panel_3 = Panel(dispatch.ListA)
