# Grasshopper definition FinalTopologicVideo.gh (Grasshopper 1.0.7)
# plug-ins: TopologicGH, SAM, SAM.Analytical.Grasshopper.LadybugTools

geometry = Geometry(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)
geometry_2 = Geometry(<brep referenced from the Rhino model>)
geometry_3 = Geometry(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)
geometry_4 = Geometry(<brep referenced from the Rhino model>)
topology_bygeometry = TopologyByGeometry(Geometry=geometry, Tolerance=0.0001)
topology_bygeometry_2 = TopologyByGeometry(Geometry=geometry_3, Tolerance=0.0001)
topology_bygeometry_3 = TopologyByGeometry(Geometry=geometry_2, Tolerance=0.0001)
topology_bygeometry_4 = TopologyByGeometry(Geometry=geometry_4, Tolerance=0.0001)
geometry_5 = Geometry(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)
geometry_6 = Geometry(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)
topology_difference = TopologyDifference(Topology=topology_bygeometry, Topology_2=topology_bygeometry_2, TransferDictionary=False)
topology_union = TopologyUnion(Topology=topology_bygeometry_3, Topology_2=topology_bygeometry_4, TransferDictionary=False)
xz_plane = XZPlane(Origin=Point(0, 0, 0))
rotate = Rotate(Geometry=geometry_5, Angle=degrees(Slider(45, range=0..100)), Plane=PlaneXY(0, 0, 0))  # -> Geometry, Transform
topology_intersect = TopologyIntersect(Topology=topology_bygeometry_3, Topology_2=topology_bygeometry_4, TransferDictionary=False)
topology_bygeometry_5 = TopologyByGeometry(Geometry=geometry_5, Tolerance=0.0001)
topology_bygeometry_6 = TopologyByGeometry(Geometry=geometry_6, Tolerance=0.0001)
rotate_2 = Rotate(Geometry=geometry_6, Angle=degrees(Slider(25, range=0..100)), Plane=xz_plane)  # -> Geometry, Transform
topology_geometry = TopologyGeometry(Topology=topology_union, Tolerance=0.0001)
topology_union_2 = TopologyUnion(Topology=topology_bygeometry_6, Topology_2=topology_bygeometry_5, TransferDictionary=False)
topology_bygeometry_7 = TopologyByGeometry(Geometry=rotate_2.Geometry, Tolerance=0.0001)
geometry_7 = Geometry(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)
geometry_8 = Geometry(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)
unit_z = UnitZ(Factor=Slider(8, range=0..100))
topology_bygeometry_8 = TopologyByGeometry(Geometry=geometry_7, Tolerance=0.0001)
topology_bygeometry_9 = TopologyByGeometry(Geometry=geometry_8, Tolerance=0.0001)
geometry_9 = Geometry(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)
cellcomplex_bycells = CellComplexByCells(Cells=[topology_difference, topology_union])
rectangle = Rectangle(Plane=PlaneXY(0, 0, 0), XSize=Slider(30, range=0..1000), YSize=Slider(40, range=0..1000), Radius=0)  # -> Rectangle, Length
move = Move(Geometry=geometry_9, Motion=unit_z)  # -> Geometry, Transform
topology_slice = TopologySlice(Topology=topology_bygeometry_8, Tool=topology_bygeometry_9, TransferDictionary=False)
unit_x = UnitX(Factor=Slider(70, range=0..100))
box_rectangle = BoxRectangle(Rectangle=rectangle.Rectangle, Height=Slider(15, range=0..10000))
topology_geometry_2 = TopologyGeometry(Topology=cellcomplex_bycells, Tolerance=0.0001)
topology_bygeometry_10 = TopologyByGeometry(Geometry=move.Geometry, Tolerance=0.0001)
topology_bygeometry_11 = TopologyByGeometry(Geometry=rotate.Geometry, Tolerance=0.0001)
move_2 = Move(Geometry=box_rectangle, Motion=unit_x)  # -> Geometry, Transform
topology_cells = TopologyCells(Topology=topology_slice)
rectangle_2 = Rectangle(Plane=PlaneXY(0, 0, 0), XSize=Slider(100, range=0..1000), YSize=Slider(50, range=0..1000), Radius=0)  # -> Rectangle, Length
topology_slice_2 = TopologySlice(Topology=topology_union_2, Tool=topology_bygeometry_10, TransferDictionary=False)
topology_bygeometry_12 = TopologyByGeometry(Geometry=move_2.Geometry, Tolerance=0.0001)
geometry_10 = Geometry(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)
list_item = ListItem(List=topology_cells, Index=Slider(1, range=0..100), Wrap=True)
box_rectangle_2 = BoxRectangle(Rectangle=rectangle_2.Rectangle, Height=Slider(25, range=0..10000))
topology_bygeometry_13 = TopologyByGeometry(Geometry=geometry_10, Tolerance=0.0001)
cellcomplex_cells = CellComplexCells(CellComplex=topology_slice_2)
topology_merge = TopologyMerge(Topology=list_item, Topology_2=topology_bygeometry_12, TransferDictionary=False)
unit_z_2 = UnitZ(Factor=Slider(30, range=0..100))
list_item_2 = ListItem(List=topology_cells, Index=Slider(0, range=0..100), Wrap=True)
list_item_3 = ListItem(List=cellcomplex_cells, Index=0, Wrap=True)
topology_merge_2 = TopologyMerge(Topology=list_item, Topology_2=topology_bygeometry_13, TransferDictionary=False)
list_item_4 = ListItem(List=cellcomplex_cells, Index=Slider(1, range=0..1), Wrap=True)
move_3 = Move(Geometry=box_rectangle_2, Motion=unit_z_2)  # -> Geometry, Transform
topology_impose = TopologyImpose(Topology=list_item_3, Tool=topology_bygeometry_11, TransferDictionary=False)
topology_cells_2 = TopologyCells(Topology=topology_merge)
topology_cells_3 = TopologyCells(Topology=topology_merge_2)
topology_bygeometry_14 = TopologyByGeometry(Geometry=move_3.Geometry, Tolerance=0.0001)
topology_difference_2 = TopologyDifference(Topology=topology_bygeometry_7, Topology_2=list_item_4, TransferDictionary=False)
up = Geometry(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)
topology_bygeometry_15 = TopologyByGeometry(Geometry=up, Tolerance=0.0001)
topology_difference_3 = TopologyDifference(Topology=list_item_2, Topology_2=topology_bygeometry_14, TransferDictionary=False)
topology_merge_3 = TopologyMerge(Topology=topology_impose, Topology_2=topology_difference_2, TransferDictionary=False)
topology_geometry_3 = TopologyGeometry(Topology=topology_difference_2, Tolerance=0.0001)
cellcomplex_bycells_2 = CellComplexByCells(Cells=[topology_cells_2, topology_difference_3])
topology_difference_4 = TopologyDifference(Topology=list_item_2, Topology_2=topology_bygeometry_15, TransferDictionary=False)
topology_geometry_4 = TopologyGeometry(Topology=topology_merge_3, Tolerance=0.0001)
topology_geometry_5 = TopologyGeometry(Topology=cellcomplex_bycells_2, Tolerance=0.0001)
cellcomplex_bycells_3 = CellComplexByCells(Cells=[topology_difference_4, topology_cells_3])
topology_geometry_6 = TopologyGeometry(Topology=cellcomplex_bycells_3, Tolerance=0.0001)
geometry_11 = Geometry(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)
geometry_12 = Geometry(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)
geometry_13 = Geometry(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)
geometry_14 = Geometry(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)
topology_bygeometry_16 = TopologyByGeometry(Geometry=geometry_11, Tolerance=0.0001)
geometry_15 = Geometry(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)
geometry_16 = Geometry(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)
geometry_17 = Geometry(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)
geometry_18 = Geometry(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)
cell_faces = CellFaces(Cell=topology_bygeometry_16)
topology_bygeometry_17 = TopologyByGeometry(Geometry=geometry_15, Tolerance=0.0001)
list_item_5 = ListItem(List=cell_faces, Index=Slider(5, range=0..5), Wrap=True)
topology_geometry_7 = TopologyGeometry(Topology=list_item_5, Tolerance=0.0001)
cell_faces_2 = CellFaces(Cell=topology_bygeometry_17)
list_item_6 = ListItem(List=cell_faces_2, Index=Slider(5, range=0..5), Wrap=True)
deconstruct_plane = DeconstructPlane(Plane=topology_geometry_7)  # -> Origin, XAxis, YAxis, ZAxis
topology_geometry_8 = TopologyGeometry(Topology=list_item_6, Tolerance=0.0001)
deconstruct = Deconstruct(Point=deconstruct_plane.Origin)  # -> XComponent, YComponent, ZComponent
deconstruct_plane_2 = DeconstructPlane(Plane=topology_geometry_8)  # -> Origin, XAxis, YAxis, ZAxis
unit_z_3 = UnitZ(Factor=deconstruct.ZComponent)
geometry_19 = Geometry(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)
deconstruct_2 = Deconstruct(Point=deconstruct_plane_2.Origin)  # -> XComponent, YComponent, ZComponent
xy_plane = XYPlane(Origin=Point(0, 0, 0))
move_4 = Move(Geometry=geometry_19, Motion=unit_z_3)  # -> Geometry, Transform
unit_z_4 = UnitZ(Factor=deconstruct_2.ZComponent)
geometry_20 = Geometry(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)
topology_bygeometry_18 = TopologyByGeometry(Geometry=move_4.Geometry, Tolerance=0.0001)
topology_bygeometry_19 = TopologyByGeometry(Geometry=geometry_13, Tolerance=0.0001)
xy_plane_2 = XYPlane(Origin=Point(0, 0, 0))
move_5 = Move(Geometry=geometry_20, Motion=unit_z_4)  # -> Geometry, Transform
topology_slice_3 = TopologySlice(Topology=topology_bygeometry_19, Tool=topology_bygeometry_18, TransferDictionary=False)
topology_bygeometry_20 = TopologyByGeometry(Geometry=move_5.Geometry, Tolerance=0.0001)
topology_bygeometry_21 = TopologyByGeometry(Geometry=geometry_17, Tolerance=0.0001)
cellcomplex_cells_2 = CellComplexCells(CellComplex=topology_slice_3)
topology_slice_4 = TopologySlice(Topology=topology_bygeometry_21, Tool=topology_bygeometry_20, TransferDictionary=False)
list_item_7 = ListItem(List=cellcomplex_cells_2, Index=Slider(1, range=0..1), Wrap=True)
list_item_8 = ListItem(List=cellcomplex_cells_2, Index=0, Wrap=True)
topology_bygeometry_22 = TopologyByGeometry(Geometry=geometry_14, Tolerance=0.0001)
topology_bygeometry_23 = TopologyByGeometry(Geometry=geometry_12, Tolerance=0.0001)
cellcomplex_cells_3 = CellComplexCells(CellComplex=topology_slice_4)
geometry_21 = Geometry(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)
list_item_9 = ListItem(List=cellcomplex_cells_3, Index=Slider(1, range=0..1), Wrap=True)
topology_merge_4 = TopologyMerge(Topology=topology_bygeometry_16, Topology_2=list_item_7, TransferDictionary=False)
list_item_10 = ListItem(List=cellcomplex_cells_3, Index=0, Wrap=True)
topology_bygeometry_24 = TopologyByGeometry(Geometry=geometry_18, Tolerance=0.0001)
topology_bygeometry_25 = TopologyByGeometry(Geometry=geometry_16, Tolerance=0.0001)
topology_bygeometry_26 = TopologyByGeometry(Geometry=geometry_21, Tolerance=0.0001)
topology_union_3 = TopologyUnion(Topology=list_item_8, Topology_2=topology_bygeometry_23, TransferDictionary=False)
geometry_22 = Geometry(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)
topology_merge_5 = TopologyMerge(Topology=topology_bygeometry_17, Topology_2=list_item_9, TransferDictionary=False)
topology_difference_5 = TopologyDifference(Topology=topology_merge_4, Topology_2=topology_bygeometry_26, TransferDictionary=False)
topology_bygeometry_27 = TopologyByGeometry(Geometry=geometry_22, Tolerance=0.0001)
topology_union_4 = TopologyUnion(Topology=list_item_10, Topology_2=topology_bygeometry_25, TransferDictionary=False)
topology_union_5 = TopologyUnion(Topology=topology_union_3, Topology_2=topology_bygeometry_22, TransferDictionary=False)
topology_difference_6 = TopologyDifference(Topology=topology_merge_5, Topology_2=topology_bygeometry_27, TransferDictionary=False)
topology_merge_6 = TopologyMerge(Topology=topology_difference_5, Topology_2=topology_union_5, TransferDictionary=False)
topology_union_6 = TopologyUnion(Topology=topology_union_4, Topology_2=topology_bygeometry_24, TransferDictionary=False)
topology_geometry_9 = TopologyGeometry(Topology=topology_merge_6, Tolerance=0.0001)
topology_merge_7 = TopologyMerge(Topology=topology_difference_6, Topology_2=topology_union_6, TransferDictionary=False)
topology_geometry_10 = TopologyGeometry(Topology=topology_merge_7, Tolerance=0.0001)
topology_geometry_11 = TopologyGeometry(Topology=topology_merge_7, Tolerance=0.0001)
geometry_23 = Geometry(simplify(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))
samanalytical_createadjacencyclusterbybr = SAMAnalyticalCreateAdjacencyClusterByBreps(_breps=flatten(geometry_23), Tolerance_=1e-06, SAM_ComponentVersion="1.0.2")
create_samadjacencyclusterbycellcomplex = CreateSAMAdjacencyClusterByCellComplex(_cellComplex=topology_merge_7, _run=Toggle(True), SAM_ComponentVersion="1.0.0")
geometry_24 = Geometry(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)
samanalytical_mapinternalconditions = SAMAnalyticalMapInternalConditions(_analytical=create_samadjacencyclusterbycellcomplex, SAM_ComponentVersion="1.0.4")
samanalytical_addaperturesbygeometryanda = SAMAnalyticalAddAperturesByGeometryAndApertureType(
    _geometries_=flatten(geometry_24),
    _analyticalObject=samanalytical_createadjacencyclusterbybr,
    MaxDistance_=0.1,
    TrimGeometry_=True,
    MinArea_=0.001,
    SAM_ComponentVersion="1.0.3")  # -> AnalyticalObject, Apertures
samanalytical_createanalyticalmodelbyadj = SAMAnalyticalCreateAnalyticalModelByAdjacencyCluster(
    _name_="000000_SAM_AnalyticalModel",
    _description_="Delivered by SAM https://github.com/HoareLea/SAM [2023/06/04]",
    _adjacencyCluster=samanalytical_mapinternalconditions,
    SAM_ComponentVersion="1.0.5")
samanalytical_mapinternalconditions_2 = SAMAnalyticalMapInternalConditions(_analytical=samanalytical_addaperturesbygeometryanda.AnalyticalObject, SAM_ComponentVersion="1.0.4")
samanalytical_paths = SAMAnalyticalPaths(
    _directory_="C:\Users\micha\SAMSimulation",
    _projectName_="000000",
    _modelName_="000000_SAM_AnalyticalModel",
    SAM_ComponentVersion="1.0.4")  # -> ModelName, Directory, Sam, Json, Tbd, GbXML, Gem
samanalytical_hbmodel = SAMAnalyticalHBModel(_analyticalModel=samanalytical_createanalyticalmodelbyadj, SAM_ComponentVersion="1.0.0")
samanalytical_createanalyticalmodelbyadj_2 = SAMAnalyticalCreateAnalyticalModelByAdjacencyCluster(
    _name_="000000_SAM_AnalyticalModel",
    _description_="Delivered by SAM https://github.com/HoareLea/SAM [2023/06/04]",
    _adjacencyCluster=samanalytical_mapinternalconditions_2,
    SAM_ComponentVersion="1.0.5")
weatherdata = WeatherData("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")
file_path = FilePath("C:\Users\micha\Downloads\JPN_Shimonoseki.477620_IWEC\JPN_Shimonoseki.477620_IWEC.epw")
togbxml = TogbXML(
    _analyticalModel=samanalytical_createanalyticalmodelbyadj,
    _path=samanalytical_paths.GbXML,
    _tolerance_=1e-05,
    _run_=False,
    SAM_ComponentVersion="1.0.1")  # -> String, Successful
samanalytical_loadweatherdata = SAMAnalyticalLoadWeatherData(_epwPath=file_path, SAM_ComponentVersion="1.0.1")  # -> WeatherData, CoolingDesignDay, HeatingDesignDay
samanalytical_designdays = SAMAnalyticalDesignDays(_weatherData=weatherdata, SAM_ComponentVersion="1.0.0")  # -> WeatherData, CoolingDesignDay, HeatingDesignDay
strtoobj = HBStringToObject(hb_str=samanalytical_hbmodel)  # -> hb_obj; plug-in component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
vizbytype = HBVisualizeByType(hb_objs=strtoobj)  # -> walls, interior_walls, roofs, ceilings, exterior_floors, interior_floors, air_walls, apertures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; plug-in component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
tas_workflowgbxml = TasWorkflowgbXML(
    _analyticalModel=samanalytical_createanalyticalmodelbyadj,
    _pathgbXML=samanalytical_paths.GbXML,
    _pathTasTBD=samanalytical_paths.Tbd,
    WeatherData_=samanalytical_loadweatherdata.WeatherData,
    CoolingDesignDays_=samanalytical_loadweatherdata.CoolingDesignDay,
    HeatingDesignDays_=samanalytical_loadweatherdata.HeatingDesignDay,
    _run=togbxml.Successful,
    SAM_ComponentVersion="1.0.2")  # -> AnalyticalModel, Successful
mesh = Mesh(vizbytype.wire_frame)

shadowcalc = HBShadowCalculation(calc_method="PixelCounting")  # -> shadow_calc; plug-in component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

boolean_toggle = BooleanToggle(True)
simpar = HBSimulationParameter(timestep=6, shadow_calc=shadowcalc)  # -> sim_par; plug-in component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
syncghfile = LBSyncGrasshopperFile(sync=Toggle(False))  # -> report; plug-in component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
modeltoosm = HBModelToOSM(model=strtoobj, epw_file=file_path, sim_par=simpar, write=boolean_toggle, run=boolean_toggle)  # -> out, jsons, osw, osm, idf, sql, zsz, rdd, html; plug-in component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
eui = HBEndUseIntensity(sql=modeltoosm.sql)  # -> eui, eui_end_use, end_uses, gross_floor; plug-in component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
panel = Panel(eui.end_uses)
panel_2 = Panel(eui.eui_end_use)
