# Grasshopper definition SlicingBoxes.gh (Grasshopper 1.0.7)
# plug-ins: TopologicGH, Bifocals

xz_plane = XZPlane(Origin=Point(0, 0, 0))
xy_plane = XYPlane(Origin=Point(0, 0, 0))
rotate = Rotate(Geometry=xy_plane, Angle=degrees(Slider(45, range=0..100)), Plane=xz_plane)  # -> Geometry, Transform
construct_point = ConstructPoint(XCoordinate=Slider(10, range=0..100), YCoordinate=Slider(15, range=0..100), ZCoordinate=0)
construct_point_2 = ConstructPoint(XCoordinate=Slider(15, range=0..100), YCoordinate=Slider(10, range=0..100), ZCoordinate=0)
construct_point_3 = ConstructPoint(XCoordinate=Slider(20, range=0..100), YCoordinate=Slider(10, range=0..100), ZCoordinate=0)
construct_point_4 = ConstructPoint(XCoordinate=Slider(10, range=0..100), YCoordinate=Slider(20, range=0..100), ZCoordinate=0)
plane_surface = PlaneSurface(Plane=rotate.Geometry, XSize=Domain(-10, 10), YSize=Domain(-10, 10))
unit_y = UnitY(Factor=Slider(11, range=0..100))
box_2pt = Box2Pt(PointA=construct_point, PointB=construct_point_2, Plane=PlaneXY(0, 0, 0))
box_2pt_2 = Box2Pt(PointA=construct_point_3, PointB=construct_point_4, Plane=PlaneXY(0, 0, 0))
unit_y_2 = UnitY(Factor=Slider(-7, range=-10..10))
move = Move(Geometry=plane_surface, Motion=unit_y)  # -> Geometry, Transform
box_rectangle = BoxRectangle(Rectangle=box_2pt, Height=Slider(5, range=0..10))
box_rectangle_2 = BoxRectangle(Rectangle=box_2pt_2, Height=Slider(2, range=0..10))
unit_x = UnitX(Factor=Slider(12, range=0..100))
move_2 = Move(Geometry=box_rectangle_2, Motion=unit_y_2)  # -> Geometry, Transform
move_3 = Move(Geometry=move.Geometry, Motion=unit_x)  # -> Geometry, Transform
topology_bygeometry = TopologyByGeometry(Geometry=box_rectangle, Tolerance=0.0001)
topology_bygeometry_2 = TopologyByGeometry(Geometry=move_2.Geometry, Tolerance=0.0001)
topology_bygeometry_3 = TopologyByGeometry(Geometry=move_3.Geometry, Tolerance=0.0001)
topology_faces = TopologyFaces(Topology=topology_bygeometry)
topology_faces_2 = TopologyFaces(Topology=topology_bygeometry_2)
cellcomplex_byfaces = CellComplexByFaces(Faces=[topology_faces, topology_faces_2], Tolerance=0.001)
topology_slice = TopologySlice(Topology=cellcomplex_byfaces, Tool=topology_bygeometry_3, TransferDictionary=False)
panel = Panel(topology_slice)
topology_geometry = TopologyGeometry(Topology=topology_slice, Tolerance=0.0001)
list_item = ListItem(List=topology_geometry, Index=Slider(5, range=0..5), Wrap=True)
dispatch = Dispatch(List=topology_geometry, DispatchPattern=[True, False])  # -> ListA, ListB
geometry = Geometry(dispatch.ListA)
geometry_2 = Geometry(dispatch.ListB)
