# Grasshopper definition Micha_Tutorial.gh (Grasshopper 1.0.7)
# plug-ins: TopologicGH, SAM

panel = Panel("Tutorial 3")
panel_2 = Panel("Topologic Tutorial 1")
panel_3 = Panel("Tutorial 2")
geometry = Geometry(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)  # disabled
geometry_2 = Geometry([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])  # disabled
geometry_3 = Geometry(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)  # disabled
geometry_4 = Geometry([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])  # disabled
number_slider = Slider(1, range=0..1)  # disabled
number_slider_2 = Slider(10, range=0..10)  # disabled
number_slider_3 = Slider(25, range=0..100)  # disabled
geometry_5 = Geometry(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)  # disabled
geometry_6 = Geometry(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)  # disabled
geometry_7 = Geometry(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)
geometry_8 = Geometry([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])
topology_bygeometry = TopologyByGeometry(Geometry=geometry, Tolerance=0.0001)  # disabled
topology_bygeometry_2 = TopologyByGeometry(Geometry=geometry_3, Tolerance=0.0001)  # disabled
topology_bygeometry_3 = TopologyByGeometry(Geometry=geometry_2, Tolerance=0.0001)  # disabled
topology_bygeometry_4 = TopologyByGeometry(Geometry=geometry_4, Tolerance=0.0001)  # disabled
topology_bygeometry_5 = TopologyByGeometry(Geometry=geometry_5, Tolerance=0.0001)  # disabled
topology_bygeometry_6 = TopologyByGeometry(Geometry=geometry_6, Tolerance=0.0001)  # disabled
topology_bygeometry_7 = TopologyByGeometry(Geometry=geometry_7, Tolerance=0.0001)
topology_bygeometry_8 = TopologyByGeometry(Geometry=geometry_8, Tolerance=0.0001)
geometry_9 = Geometry(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)  # disabled
panel_4 = Panel(topology_bygeometry)
panel_5 = Panel(topology_bygeometry_2)  # disabled
construct_point = ConstructPoint(XCoordinate=number_slider_3, YCoordinate=number_slider_2, ZCoordinate=number_slider)  # disabled
panel_6 = Panel(topology_bygeometry_3)  # disabled
panel_7 = Panel(topology_bygeometry_4)  # disabled
face_bywire = FaceByWire(Wire=topology_bygeometry_3)  # disabled
face_bywire_2 = FaceByWire(Wire=topology_bygeometry_4)  # disabled
panel_8 = Panel(topology_bygeometry_7)
topology_merge = TopologyMerge(Topology=topology_bygeometry_5, Topology_2=topology_bygeometry_6, TransferDictionary=False)  # disabled
panel_9 = Panel(topology_bygeometry_8)
topology_bygeometry_9 = TopologyByGeometry(Geometry=geometry_9, Tolerance=0.0001)  # disabled
topology_impose = TopologyImpose(Topology=topology_bygeometry_5, Tool=topology_bygeometry_6, TransferDictionary=False)  # disabled
face_bywire_3 = FaceByWire(Wire=topology_bygeometry_8)
cluster_bytopologies = ClusterByTopologies(Topologies=face_bywire)  # disabled
cluster_bytopologies_2 = ClusterByTopologies(Topologies=face_bywire_2)  # disabled
topology_bygeometry_10 = TopologyByGeometry(Geometry=construct_point, Tolerance=0.0001)  # disabled
cluster_bytopologies_3 = ClusterByTopologies(Topologies=face_bywire_3)
topology_analyze = TopologyAnalyze(Topology=topology_merge)  # disabled
topology_type = TopologyType(Topology=topology_bygeometry_9)  # disabled
topology_typeasstring = TopologyTypeAsString(Topology=topology_bygeometry_9)  # disabled
topology_analyze_2 = TopologyAnalyze(Topology=topology_impose)  # disabled
edge_vertices = EdgeVertices(Edge=topology_bygeometry_9)  # disabled
topology_geometry = TopologyGeometry(Topology=topology_bygeometry_10, Tolerance=0.0001)  # disabled
geometry_10 = Geometry(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)  # disabled
topology_slice = TopologySlice(Topology=topology_bygeometry, Tool=cluster_bytopologies, TransferDictionary=False)  # disabled
topology_slice_2 = TopologySlice(Topology=topology_bygeometry_2, Tool=cluster_bytopologies_2, TransferDictionary=False)  # disabled
geometry_11 = Geometry(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)

# ---- group: Display settings
number_slider_4 = Slider(255, range=0..1000)  # disabled
number_slider_5 = Slider(0, range=0..100)  # disabled
cellcomplex_edges = CellComplexEdges(CellComplex=topology_slice)  # disabled
number_slider_6 = Slider(100, range=0..100)  # disabled
number_slider_7 = Slider(0, range=0..100)  # disabled
topology_geometry_2 = TopologyGeometry(Topology=cellcomplex_edges, Tolerance=0.0001)  # disabled
colour_rgb = ColourRGB(Alpha=number_slider_6, Red=number_slider_4, Green=number_slider_7, Blue=number_slider_5)  # disabled
geometry_12 = Geometry(topology_geometry_2)  # disabled
custom_preview = CustomPreview(Geometry=geometry_12, Material=colour_rgb)  # disabled

# ----
panel_10 = Panel(topology_type)  # disabled
topology_slice_3 = TopologySlice(Topology=topology_bygeometry_7, Tool=cluster_bytopologies_3, TransferDictionary=False)
panel_11 = Panel(topology_typeasstring)  # disabled
topology_bygeometry_11 = TopologyByGeometry(Geometry=geometry_10, Tolerance=0.0001)  # disabled
panel_12 = Panel(topology_analyze)  # disabled
geometry_13 = Geometry([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])  # disabled
panel_13 = Panel(topology_analyze_2)  # disabled
topology_geometry_3 = TopologyGeometry(Topology=edge_vertices, Tolerance=0.0001)  # disabled
topology_bygeometry_12 = TopologyByGeometry(Geometry=geometry_11, Tolerance=0.0001)
geometry_14 = Geometry([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])
panel_14 = Panel(topology_geometry)  # disabled
topology_bygeometry_13 = TopologyByGeometry(Geometry=geometry_13, Tolerance=0.0001)  # disabled
topology_bygeometry_14 = TopologyByGeometry(Geometry=geometry_14, Tolerance=0.0001)
topology_impose_2 = TopologyImpose(Topology=topology_slice_2, Tool=topology_bygeometry_11, TransferDictionary=False)  # disabled
geometry_15 = Geometry(topology_geometry_3)  # disabled
# they said nested lists, but there are trees?
# A tree is non-linear and a hierarchical data structure consisting of a collection of nodes such that each node of the tree stores a value and a list of references to other nodes. Topologic shows how each element is connected to each other.
panel_15 = Panel(topology_geometry_3)  # disabled
cluster_bytopologies_4 = ClusterByTopologies(Topologies=topology_bygeometry_13)  # disabled
topology_impose_3 = TopologyImpose(Topology=topology_slice_3, Tool=topology_bygeometry_12, TransferDictionary=False)
cluster_bytopologies_5 = ClusterByTopologies(Topologies=topology_bygeometry_14)
geometry_16 = Geometry([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])
topology_geometry_4 = TopologyGeometry(Topology=topology_slice, Tolerance=0.0001)  # disabled
topology_slice_4 = TopologySlice(Topology=topology_impose_2, Tool=cluster_bytopologies_4, TransferDictionary=False)  # disabled
geometry_17 = Geometry(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)  # disabled
topology_bygeometry_15 = TopologyByGeometry(Geometry=geometry_16, Tolerance=0.0001)
topology_slice_5 = TopologySlice(Topology=topology_impose_3, Tool=cluster_bytopologies_5, TransferDictionary=False)
aperture = Aperture()  # disabled
geometry_18 = Geometry(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)  # disabled
topology_geometry_5 = TopologyGeometry(Topology=topology_slice_5, Tolerance=0.0001)
geometry_19 = Geometry(topology_geometry_4)  # disabled
topology_bygeometry_16 = TopologyByGeometry(Geometry=geometry_17, Tolerance=0.0001)  # disabled
topology_bygeometry_17 = TopologyByGeometry(Geometry=geometry_18, Tolerance=0.0001)  # disabled
topology_addapertures = TopologyAddApertures(Topology=topology_bygeometry_15)
cellcomplex_cells = CellComplexCells(CellComplex=topology_slice_5)
topology_geometry_6 = TopologyGeometry(Topology=topology_slice_4, Tolerance=0.0001)  # disabled
cell_cellcomplexes = CellCellComplexes()
topology_contexts = TopologyContexts(Topology=[topology_bygeometry_16, topology_bygeometry_17, topology_slice_4])  # disabled
topology_addapertures_2 = TopologyAddApertures(Topology=topology_slice_4, ApertureTopologies=topology_bygeometry_16)  # disabled
list_item = ListItem(List=cellcomplex_cells, Index=Slider(18, range=0..100), Wrap=True)
list_item_2 = ListItem(List=cellcomplex_cells, Index=Slider(96, range=0..100), Wrap=True)
topology_geometry_7 = TopologyGeometry(Topology=list_item, Tolerance=0.0001)
topology_geometry_8 = TopologyGeometry(Topology=list_item_2, Tolerance=0.0001)
topology_geometry_9 = TopologyGeometry(Topology=topology_contexts, Tolerance=0.0001)  # disabled
panel_16 = Panel(list_item)
cell_adjacentcells = CellAdjacentCells(Cell=list_item)
cell_sharededges = CellSharedEdges(Cell=list_item_2, Cell_2=list_item)
aperture_bytopologycontext = ApertureByTopologyContext(Topology=topology_bygeometry_16, Context=topology_contexts)  # disabled
topology_geometry_10 = TopologyGeometry(Topology=cell_adjacentcells, Tolerance=0.0001)
geometry_20 = Geometry(topology_geometry_7)
geometry_21 = Geometry(topology_geometry_8)
topology_geometry_11 = TopologyGeometry(Topology=cell_sharededges, Tolerance=0.0001)
topology_geometry_12 = TopologyGeometry(Topology=topology_addapertures_2, Tolerance=0.0001)  # disabled
topology_analyze_3 = TopologyAnalyze(Topology=topology_slice_4)  # disabled
aperture_topology = ApertureTopology(Aperture=aperture_bytopologycontext)  # disabled
geometry_22 = Geometry(topology_geometry_10)
geometry_23 = Geometry(topology_geometry_11)
geometry_24 = Geometry(<brep referenced from the Rhino model>)  # disabled
aperture_topology_2 = ApertureTopology()  # disabled
topology_geometry_13 = TopologyGeometry(Topology=topology_slice_4, Tolerance=0.0001)  # disabled
context_topology = ContextTopology(Context=geometry_24)  # disabled
topology_apertures = TopologyApertures(Topology=topology_addapertures_2)  # disabled
geometry_25 = Geometry(topology_geometry_12)  # disabled
