# Grasshopper definition Topologic-01-Tutorial01.gh (Grasshopper 1.0.7)
# plug-ins: TopologicGH, Bifocals

panel = Panel("Geometry vs. Topology")
panel_2 = Panel("Boolean Operations")

# ----
# Converting between Grasshopper and Topologic
panel_3 = Panel("10")
pt = ConstructPoint(XCoordinate=panel_3, YCoordinate="20", ZCoordinate="30")
topology_bygeometry = TopologyByGeometry(Geometry=pt, Tolerance=0.0001)
panel_4 = Panel(topology_bygeometry)
topology_geometry = TopologyGeometry(Topology=topology_bygeometry, Tolerance=0.0001)
panel_5 = Panel(topology_geometry)

pt_2 = ConstructPoint(XCoordinate="10", YCoordinate="10", ZCoordinate="10")
box = DomainBox(Base=PlaneXY(0, 0, 0), X="20", Y="20", Z="20")
move = Move(Geometry=box, Motion=pt_2)  # -> Geometry, Transform
topology_bygeometry_2 = TopologyByGeometry(Geometry=move.Geometry, Tolerance=0.0001)
topology_bygeometry_3 = TopologyByGeometry(Geometry=box, Tolerance=0.0001)
topology_merge = TopologyMerge(Topology=topology_bygeometry_3, Topology_2=topology_bygeometry_2, TransferDictionary=False)
topology_edges = TopologyEdges(Topology=topology_merge)
topology_geometry_2 = TopologyGeometry(Topology=topology_merge, Tolerance=0.0001)
topology_analyze = TopologyAnalyze(Topology=topology_merge)
topology_geometry_3 = TopologyGeometry(Topology=topology_edges, Tolerance=0.0001)
preview = CustomPreview(Geometry=topology_geometry_2, Material=ColourSwatch(SwatchColor=RGBA(255, 0, 0, 100)))

series = Series(Start=0, Step=1, Count=10)
sin = Sine(Value=series)
cos = Cosine(Value=series)
pt_3 = ConstructPoint(XCoordinate=cos, YCoordinate=sin, ZCoordinate=series)
intcrv = Interpolate(Vertices=pt_3, Degree=3, Periodic=False, KnotStyle=1)  # -> Curve, Length, Domain
topology_bygeometry_4 = TopologyByGeometry(Geometry=intcrv.Curve, Tolerance=0.0001)
edge_vertices = EdgeVertices(Edge=topology_bygeometry_4)
panel_6 = Panel(edge_vertices)
