# Grasshopper definition Topologic-02-Tutorial02.gh (Grasshopper 1.0.7)
# plug-ins: TopologicGH, Bifocals

panel = Panel("OUTER PRISM")
panel_2 = Panel("CLUSTER OF FACES")

pt = ConstructPoint(XCoordinate="-10", YCoordinate="-10", ZCoordinate="0")
pt_2 = ConstructPoint(XCoordinate="10", YCoordinate="10", ZCoordinate="60")
box = Box2Pt(PointA=pt, PointB=pt_2, Plane=PlaneXY(0, 0, 0))
topology_bygeometry = TopologyByGeometry(Geometry=box, Tolerance=0.0001)

pt_3 = ConstructPoint(XCoordinate="15", YCoordinate="-15", ZCoordinate=0)
pt_4 = ConstructPoint(XCoordinate="-15", YCoordinate="15", ZCoordinate=0)
pt_5 = ConstructPoint(XCoordinate="-15", YCoordinate="-15", ZCoordinate=0)
pt_6 = ConstructPoint(XCoordinate="15", YCoordinate="15", ZCoordinate=0)
pline = PolyLine(Vertices=[pt_5, pt_4, pt_6, pt_3], Closed=True)
series = Series(Start="0", Step="10", Count="6")
Z = UnitZ(Factor=series)
move = Move(Geometry=pline, Motion=Z)  # -> Geometry, Transform
topology_bygeometry_2 = TopologyByGeometry(Geometry=move.Geometry, Tolerance=0.0001)
face_bywire = FaceByWire(Wire=topology_bygeometry_2)
cluster_bytopologies = ClusterByTopologies(Topologies=face_bywire)

panel_3 = Panel("INNER ATRIUM")

pt_7 = ConstructPoint(XCoordinate="-5", YCoordinate="-5", ZCoordinate="0")
pt_8 = ConstructPoint(XCoordinate="5", YCoordinate="5", ZCoordinate="60")
box_2 = Box2Pt(PointA=pt_7, PointB=pt_8, Plane=PlaneXY(0, 0, 0))
topology_bygeometry_3 = TopologyByGeometry(Geometry=box_2, Tolerance=0.0001)

panel_4 = Panel("SLICE PRISM")

topology_slice = TopologySlice(Topology=topology_bygeometry, Tool=cluster_bytopologies, TransferDictionary=False)
topology_geometry = TopologyGeometry(Topology=topology_slice, Tolerance=0.0001)
cellcomplex_edges = CellComplexEdges(CellComplex=topology_slice)
topology_geometry_2 = TopologyGeometry(Topology=cellcomplex_edges, Tolerance=0.0001)
preview = CustomPreview(Geometry=topology_geometry, Material=ColourSwatch(SwatchColor=RGBA(255, 0, 0, 100)))

panel_5 = Panel("IMPOSE INNER ATRIUM")

topology_impose = TopologyImpose(Topology=topology_slice, Tool=topology_bygeometry_3, TransferDictionary=False)
topology_geometry_3 = TopologyGeometry(Topology=topology_impose, Tolerance=0.0001)
cellcomplex_edges_2 = CellComplexEdges(CellComplex=topology_impose)
topology_geometry_4 = TopologyGeometry(Topology=cellcomplex_edges_2, Tolerance=0.0001)
preview_2 = CustomPreview(Geometry=topology_geometry_3, Material=ColourSwatch(SwatchColor=RGBA(255, 0, 0, 50)))

pt_9 = ConstructPoint(XCoordinate="-10", YCoordinate="-10", ZCoordinate="0")
pt_10 = ConstructPoint(XCoordinate="-5", YCoordinate="-5", ZCoordinate="0")
pt_11 = ConstructPoint(XCoordinate="-5", YCoordinate="-5", ZCoordinate="60")
pt_12 = ConstructPoint(XCoordinate="-10", YCoordinate="-10", ZCoordinate="60")
srf4pt = _4PointSurface(CornerA=pt_9, CornerB=pt_10, CornerC=pt_11, CornerD=pt_12)
topology_bygeometry_4 = TopologyByGeometry(Geometry=srf4pt, Tolerance=0.0001)

pt_13 = ConstructPoint(XCoordinate="-10", YCoordinate="10", ZCoordinate="0")
pt_14 = ConstructPoint(XCoordinate="-5", YCoordinate="5", ZCoordinate="0")
pt_15 = ConstructPoint(XCoordinate="-5", YCoordinate="5", ZCoordinate="60")
pt_16 = ConstructPoint(XCoordinate="-10", YCoordinate="10", ZCoordinate="60")
srf4pt_2 = _4PointSurface(CornerA=pt_13, CornerB=pt_14, CornerC=pt_15, CornerD=pt_16)
topology_bygeometry_5 = TopologyByGeometry(Geometry=srf4pt_2, Tolerance=0.0001)

pt_17 = ConstructPoint(XCoordinate="10", YCoordinate="-10", ZCoordinate="0")
pt_18 = ConstructPoint(XCoordinate="5", YCoordinate="-5", ZCoordinate="0")
pt_19 = ConstructPoint(XCoordinate="5", YCoordinate="-5", ZCoordinate="60")
pt_20 = ConstructPoint(XCoordinate="10", YCoordinate="-10", ZCoordinate="60")
srf4pt_3 = _4PointSurface(CornerA=pt_17, CornerB=pt_18, CornerC=pt_19, CornerD=pt_20)
topology_bygeometry_6 = TopologyByGeometry(Geometry=srf4pt_3, Tolerance=0.0001)

pt_21 = ConstructPoint(XCoordinate="10", YCoordinate="10", ZCoordinate="0")
pt_22 = ConstructPoint(XCoordinate="5", YCoordinate="5", ZCoordinate="0")
pt_23 = ConstructPoint(XCoordinate="5", YCoordinate="5", ZCoordinate="60")
pt_24 = ConstructPoint(XCoordinate="10", YCoordinate="10", ZCoordinate="60")
srf4pt_4 = _4PointSurface(CornerA=pt_21, CornerB=pt_22, CornerC=pt_23, CornerD=pt_24)
topology_bygeometry_7 = TopologyByGeometry(Geometry=srf4pt_4, Tolerance=0.0001)

merge = Merge(Data1=topology_bygeometry_7, Data2=topology_bygeometry_4, Data3=topology_bygeometry_5, Data4=topology_bygeometry_6)
cluster_bytopologies_2 = ClusterByTopologies(Topologies=merge)
topology_slice_2 = TopologySlice(Topology=topology_impose, Tool=cluster_bytopologies_2, TransferDictionary=False)
topology_geometry_5 = TopologyGeometry(Topology=topology_slice_2, Tolerance=0.0001)
cellcomplex_edges_3 = CellComplexEdges(CellComplex=topology_slice_2)
topology_geometry_6 = TopologyGeometry(Topology=cellcomplex_edges_3, Tolerance=0.0001)
preview_3 = CustomPreview(Geometry=topology_geometry_5, Material=ColourSwatch(SwatchColor=RGBA(255, 0, 0, 50)))
