# Grasshopper definition Topologic-03-Tutorial03.gh (Grasshopper 1.0.7)
# plug-ins: TopologicGH, Bifocals

pt = ConstructPoint(XCoordinate="-15", YCoordinate="-15", ZCoordinate="0")
pt_2 = ConstructPoint(XCoordinate="15", YCoordinate="-15", ZCoordinate="0")
pt_3 = ConstructPoint(XCoordinate="15", YCoordinate="15", ZCoordinate="0")
pt_4 = ConstructPoint(XCoordinate="-15", YCoordinate="15", ZCoordinate="0")
series = Series(Start="0", Step="10", Count="6")
merge = Merge(Data1=pt, Data2=pt_2, Data3=pt_3, Data4=pt_4)
Z = UnitZ(Factor=series)
pline = PolyLine(Vertices=merge, Closed=Toggle(True))
move = Move(Geometry=pline, Motion=Z)  # -> Geometry, Transform
topology_bygeometry = TopologyByGeometry(Geometry=move.Geometry, Tolerance=0.0001)
face_bywire = FaceByWire(Wire=topology_bygeometry)
cluster_bytopologies = ClusterByTopologies(Topologies=face_bywire)

pt_5 = ConstructPoint(XCoordinate="-10", YCoordinate="-10", ZCoordinate="0")
pt_6 = ConstructPoint(XCoordinate="-5", YCoordinate="-5", ZCoordinate="0")
pt_7 = ConstructPoint(XCoordinate="-5", YCoordinate="-5", ZCoordinate="60")
pt_8 = ConstructPoint(XCoordinate="-10", YCoordinate="-10", ZCoordinate="60")
srf4pt = _4PointSurface(CornerA=pt_5, CornerB=pt_6, CornerC=pt_7, CornerD=pt_8)
topology_bygeometry_2 = TopologyByGeometry(Geometry=srf4pt, Tolerance=0.0001)

pt_9 = ConstructPoint(XCoordinate="-10", YCoordinate="10", ZCoordinate="0")
pt_10 = ConstructPoint(XCoordinate="-5", YCoordinate="5", ZCoordinate="0")
pt_11 = ConstructPoint(XCoordinate="-5", YCoordinate="5", ZCoordinate="60")
pt_12 = ConstructPoint(XCoordinate="-10", YCoordinate="10", ZCoordinate="60")
srf4pt_2 = _4PointSurface(CornerA=pt_9, CornerB=pt_10, CornerC=pt_11, CornerD=pt_12)
topology_bygeometry_3 = TopologyByGeometry(Geometry=srf4pt_2, Tolerance=0.0001)

pt_13 = ConstructPoint(XCoordinate="10", YCoordinate="-10", ZCoordinate="0")
pt_14 = ConstructPoint(XCoordinate="5", YCoordinate="-5", ZCoordinate="0")
pt_15 = ConstructPoint(XCoordinate="5", YCoordinate="-5", ZCoordinate="60")
pt_16 = ConstructPoint(XCoordinate="10", YCoordinate="-10", ZCoordinate="60")
srf4pt_3 = _4PointSurface(CornerA=pt_13, CornerB=pt_14, CornerC=pt_15, CornerD=pt_16)
topology_bygeometry_4 = TopologyByGeometry(Geometry=srf4pt_3, Tolerance=0.0001)

pt_17 = ConstructPoint(XCoordinate="10", YCoordinate="10", ZCoordinate="0")
pt_18 = ConstructPoint(XCoordinate="5", YCoordinate="5", ZCoordinate="0")
pt_19 = ConstructPoint(XCoordinate="5", YCoordinate="5", ZCoordinate="60")
pt_20 = ConstructPoint(XCoordinate="10", YCoordinate="10", ZCoordinate="60")
srf4pt_4 = _4PointSurface(CornerA=pt_17, CornerB=pt_18, CornerC=pt_19, CornerD=pt_20)
topology_bygeometry_5 = TopologyByGeometry(Geometry=srf4pt_4, Tolerance=0.0001)

pt_21 = ConstructPoint(XCoordinate="-10", YCoordinate="-10", ZCoordinate="0")
pt_22 = ConstructPoint(XCoordinate="10", YCoordinate="10", ZCoordinate="60")
pt_23 = ConstructPoint(XCoordinate="-5", YCoordinate="-5", ZCoordinate="0")
pt_24 = ConstructPoint(XCoordinate="5", YCoordinate="5", ZCoordinate="60")
box = Box2Pt(PointA=pt_23, PointB=pt_24, Plane=PlaneXY(0, 0, 0))
box_2 = Box2Pt(PointA=pt_21, PointB=pt_22, Plane=PlaneXY(0, 0, 0))
topology_bygeometry_6 = TopologyByGeometry(Geometry=box, Tolerance=0.0001)
topology_bygeometry_7 = TopologyByGeometry(Geometry=box_2, Tolerance=0.0001)
topology_slice = TopologySlice(Topology=topology_bygeometry_7, Tool=cluster_bytopologies, TransferDictionary=False)
topology_impose = TopologyImpose(Topology=topology_slice, Tool=topology_bygeometry_6, TransferDictionary=False)

merge_2 = Merge(Data1=topology_bygeometry_5, Data2=topology_bygeometry_2, Data3=topology_bygeometry_3, Data4=topology_bygeometry_4)
cluster_bytopologies_2 = ClusterByTopologies(Topologies=merge_2)
topology_slice_2 = TopologySlice(Topology=topology_impose, Tool=cluster_bytopologies_2, TransferDictionary=False)
topology_cells = TopologyCells(Topology=topology_slice_2)
cellcomplex_edges = CellComplexEdges(CellComplex=topology_slice_2)
topology_geometry = TopologyGeometry(Topology=topology_slice_2, Tolerance=0.0001)
item = ListItem(List=topology_cells, Index=Slider(1, range=1..24), Wrap=True)
topology_geometry_2 = TopologyGeometry(Topology=cellcomplex_edges, Tolerance=0.0001)
cell_adjacentcells = CellAdjacentCells(Cell=item)
preview = CustomPreview(Geometry=topology_geometry, Material=ColourSwatch(SwatchColor=RGBA(255, 0, 0, 100)))
topology_geometry_3 = TopologyGeometry(Topology=item, Tolerance=0.0001)
topology_geometry_4 = TopologyGeometry(Topology=cell_adjacentcells, Tolerance=0.0001)
preview_2 = CustomPreview(Geometry=topology_geometry_3, Material=ColourSwatch(SwatchColor=RGB(0, 0, 255)))
preview_3 = CustomPreview(Geometry=topology_geometry_4, Material=ColourSwatch(SwatchColor=RGB(255, 255, 0)))
