# Grasshopper definition Topologic-04b-Tutorial04.gh (Grasshopper 1.0.7)
# plug-ins: TopologicGH, Bifocals

pt = ConstructPoint(XCoordinate="-15", YCoordinate="-15", ZCoordinate="0")
pt_2 = ConstructPoint(XCoordinate="15", YCoordinate="-15", ZCoordinate="0")
pt_3 = ConstructPoint(XCoordinate="15", YCoordinate="15", ZCoordinate="0")
pt_4 = ConstructPoint(XCoordinate="-15", YCoordinate="15", ZCoordinate="0")
div = DivideDomain(Domain="60", Count="6")
dedomain = DeconstructDomain(Domain=div)  # -> Start, End
merge = Merge(Data1=pt, Data2=pt_2, Data3=pt_3, Data4=pt_4)
Z = UnitZ(Factor=dedomain.Start)
pline = PolyLine(Vertices=merge, Closed=Toggle(True))
move = Move(Geometry=pline, Motion=Z)  # -> Geometry, Transform

panel = Panel("Topologic Faces")

topology_bygeometry = TopologyByGeometry(Geometry=move.Geometry, Tolerance=0.0001)
face_bywire = FaceByWire(Wire=topology_bygeometry)
cluster_bytopologies = ClusterByTopologies(Topologies=face_bywire)

panel_2 = Panel("Outer Prism")
panel_3 = Panel("Inner Prism (Core)")

pt_5 = ConstructPoint(XCoordinate="-10", YCoordinate="-10", ZCoordinate="0")
pt_6 = ConstructPoint(XCoordinate="10", YCoordinate="10", ZCoordinate="60")
box = Box2Pt(PointA=pt_5, PointB=pt_6, Plane=PlaneXY(0, 0, 0))

pt_7 = ConstructPoint(XCoordinate="-5", YCoordinate="-5", ZCoordinate="0")
pt_8 = ConstructPoint(XCoordinate="5", YCoordinate="5", ZCoordinate="60")
box_2 = Box2Pt(PointA=pt_7, PointB=pt_8, Plane=PlaneXY(0, 0, 0))

topology_bygeometry_2 = TopologyByGeometry(Geometry=box, Tolerance=0.0001)
panel_4 = Panel("Topologic Cell")
topology_slice = TopologySlice(Topology=topology_bygeometry_2, Tool=cluster_bytopologies, TransferDictionary=False)
panel_5 = Panel("Diagonal 2")
panel_6 = Panel("Diagonal 4")
panel_7 = Panel("Diagonal 1")
panel_8 = Panel("Diagonal 3")
topology_bygeometry_3 = TopologyByGeometry(Geometry=box_2, Tolerance=0.0001)

pt_9 = ConstructPoint(XCoordinate="10", YCoordinate="10", ZCoordinate="0")
pt_10 = ConstructPoint(XCoordinate="5", YCoordinate="5", ZCoordinate="0")
pt_11 = ConstructPoint(XCoordinate="5", YCoordinate="5", ZCoordinate="60")
pt_12 = ConstructPoint(XCoordinate="10", YCoordinate="10", ZCoordinate="60")
srf4pt = _4PointSurface(CornerA=pt_9, CornerB=pt_10, CornerC=pt_11, CornerD=pt_12)

pt_13 = ConstructPoint(XCoordinate="-10", YCoordinate="-10", ZCoordinate="0")
pt_14 = ConstructPoint(XCoordinate="-5", YCoordinate="-5", ZCoordinate="0")
pt_15 = ConstructPoint(XCoordinate="-5", YCoordinate="-5", ZCoordinate="60")
pt_16 = ConstructPoint(XCoordinate="-10", YCoordinate="-10", ZCoordinate="60")
srf4pt_2 = _4PointSurface(CornerA=pt_13, CornerB=pt_14, CornerC=pt_15, CornerD=pt_16)

pt_17 = ConstructPoint(XCoordinate="-10", YCoordinate="10", ZCoordinate="0")
pt_18 = ConstructPoint(XCoordinate="-5", YCoordinate="5", ZCoordinate="0")
pt_19 = ConstructPoint(XCoordinate="-5", YCoordinate="5", ZCoordinate="60")
pt_20 = ConstructPoint(XCoordinate="-10", YCoordinate="10", ZCoordinate="60")
srf4pt_3 = _4PointSurface(CornerA=pt_17, CornerB=pt_18, CornerC=pt_19, CornerD=pt_20)

pt_21 = ConstructPoint(XCoordinate="10", YCoordinate="-10", ZCoordinate="0")
pt_22 = ConstructPoint(XCoordinate="5", YCoordinate="-5", ZCoordinate="0")
pt_23 = ConstructPoint(XCoordinate="5", YCoordinate="-5", ZCoordinate="60")
pt_24 = ConstructPoint(XCoordinate="10", YCoordinate="-10", ZCoordinate="60")
srf4pt_4 = _4PointSurface(CornerA=pt_21, CornerB=pt_22, CornerC=pt_23, CornerD=pt_24)

panel_10 = Panel("Create Window Surfaces")

pt_25 = ConstructPoint(XCoordinate="-10", YCoordinate="5", ZCoordinate="3")
pt_26 = ConstructPoint(XCoordinate="-10", YCoordinate="5", ZCoordinate="7")
pt_27 = ConstructPoint(XCoordinate="-10", YCoordinate="-5", ZCoordinate="7")
pt_28 = ConstructPoint(XCoordinate="-10", YCoordinate="-5", ZCoordinate="3")
merge_2 = Merge(Data1=pt_25, Data2=pt_26, Data3=pt_27, Data4=pt_28)
pline_2 = PolyLine(Vertices=merge_2, Closed=True)
div_2 = DivideDomain(Domain="0,60", Count="6")
dedomain_2 = DeconstructDomain(Domain=div_2)  # -> Start, End
Z_2 = UnitZ(Factor=dedomain_2.Start)
move_2 = Move(Geometry=pline_2, Motion=Z_2)  # -> Geometry, Transform

pt_29 = ConstructPoint(XCoordinate="10", YCoordinate="5", ZCoordinate="3")
pt_30 = ConstructPoint(XCoordinate="10", YCoordinate="5", ZCoordinate="7")
pt_31 = ConstructPoint(XCoordinate="10", YCoordinate="-5", ZCoordinate="7")
pt_32 = ConstructPoint(XCoordinate="10", YCoordinate="-5", ZCoordinate="3")
merge_3 = Merge(Data1=pt_29, Data2=pt_30, Data3=pt_31, Data4=pt_32)
pline_3 = PolyLine(Vertices=merge_3, Closed=True)
div_3 = DivideDomain(Domain="0,60", Count="6")
dedomain_3 = DeconstructDomain(Domain=div_3)  # -> Start, End
Z_3 = UnitZ(Factor=dedomain_3.Start)
move_3 = Move(Geometry=pline_3, Motion=Z_3)  # -> Geometry, Transform

pt_33 = ConstructPoint(XCoordinate="5", YCoordinate="-10", ZCoordinate="3")
pt_34 = ConstructPoint(XCoordinate="5", YCoordinate="-10", ZCoordinate="7")
pt_35 = ConstructPoint(XCoordinate="-5", YCoordinate="-10", ZCoordinate="7")
pt_36 = ConstructPoint(XCoordinate="-5", YCoordinate="-10", ZCoordinate="3")
merge_4 = Merge(Data1=pt_33, Data2=pt_34, Data3=pt_35, Data4=pt_36)
pline_4 = PolyLine(Vertices=merge_4, Closed=True)
div_4 = DivideDomain(Domain="0,60", Count="6")
dedomain_4 = DeconstructDomain(Domain=div_4)  # -> Start, End
Z_4 = UnitZ(Factor=dedomain_4.Start)
move_4 = Move(Geometry=pline_4, Motion=Z_4)  # -> Geometry, Transform

pt_37 = ConstructPoint(XCoordinate="5", YCoordinate="10", ZCoordinate="3")
pt_38 = ConstructPoint(XCoordinate="5", YCoordinate="10", ZCoordinate="7")
pt_39 = ConstructPoint(XCoordinate="-5", YCoordinate="10", ZCoordinate="7")
pt_40 = ConstructPoint(XCoordinate="-5", YCoordinate="10", ZCoordinate="3")
merge_5 = Merge(Data1=pt_37, Data2=pt_38, Data3=pt_39, Data4=pt_40)
pline_5 = PolyLine(Vertices=merge_5, Closed=True)
div_5 = DivideDomain(Domain="0,60", Count="6")
dedomain_5 = DeconstructDomain(Domain=div_5)  # -> Start, End
Z_5 = UnitZ(Factor=dedomain_5.Start)
move_5 = Move(Geometry=pline_5, Motion=Z_5)  # -> Geometry, Transform

topology_impose = TopologyImpose(Topology=topology_slice, Tool=topology_bygeometry_3, TransferDictionary=False)

topology_bygeometry_4 = TopologyByGeometry(Geometry=srf4pt, Tolerance=0.0001)
topology_bygeometry_5 = TopologyByGeometry(Geometry=srf4pt_3, Tolerance=0.0001)
topology_bygeometry_6 = TopologyByGeometry(Geometry=srf4pt_2, Tolerance=0.0001)
topology_bygeometry_7 = TopologyByGeometry(Geometry=srf4pt_4, Tolerance=0.0001)
merge_6 = Merge(Data1=topology_bygeometry_4, Data2=topology_bygeometry_6, Data3=topology_bygeometry_5, Data4=topology_bygeometry_7)
cluster_bytopologies_2 = ClusterByTopologies(Topologies=merge_6)

panel_12 = Panel("Topologic Apertures")
topology_slice_2 = TopologySlice(Topology=topology_impose, Tool=cluster_bytopologies_2, TransferDictionary=False)

topology_bygeometry_8 = TopologyByGeometry(Geometry=move_3.Geometry, Tolerance=0.0001)
topology_bygeometry_9 = TopologyByGeometry(Geometry=move_2.Geometry, Tolerance=0.0001)
topology_bygeometry_10 = TopologyByGeometry(Geometry=move_4.Geometry, Tolerance=0.0001)
topology_bygeometry_11 = TopologyByGeometry(Geometry=move_5.Geometry, Tolerance=0.0001)
merge_7 = Merge(Data1=topology_bygeometry_8, Data2=topology_bygeometry_9, Data3=topology_bygeometry_10, Data4=topology_bygeometry_11)

# ----
# Add apertures. This creates the final CellComplex
topology_addapertures = TopologyAddApertures(Topology=topology_slice_2, ApertureTopologies=merge_7)
ladybug = Ladybug_Ladybug()  # -> Vviiiiiiiiiizzz; plug-in component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
honeybee = Honeybee_Honeybee()  # -> Vviiiiiiiiiizzz; plug-in component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
panel_13 = Panel(honeybee)
panel_14 = Panel("Display Cell Complex")

topology_geometry = TopologyGeometry(Topology=topology_addapertures, Tolerance=0.0001)
topology_edges = TopologyEdges(Topology=topology_addapertures)
topology_geometry_2 = TopologyGeometry(Topology=topology_edges, Tolerance=0.0001)
flatten = FlattenTree(Tree=topology_geometry, Path="{0}")
rgb = ColourRGB(Alpha="12", Red="255", Green="0", Blue="0")
preview = CustomPreview(Geometry=flatten, Material=rgb)

# ----
# Display Apertures (get the wires of the contents of faces)
topology_faces = TopologyFaces(Topology=topology_addapertures)
topology_contents = TopologyContents(Topology=topology_faces)
topology_wires = TopologyWires(Topology=topology_contents)
flatten_2 = FlattenTree(Tree=topology_wires, Path="{0}")
topology_geometry_3 = TopologyGeometry(Topology=flatten_2, Tolerance=0.0001)

bldgprograms = Honeybee_bldgPrograms({"Office": 0, "Retail": 1, "MidriseApartment": 2, "PrimarySchool": 3, "SecondarySchool": 4, "SmallHotel": 5, "LargeHotel": 6, "Hospital": 7, "Outpatient": 8, "Warehouse": 9, "SuperMarket": 10, "FullServiceRestaurant": 11, "QuickServiceRestaurant": 12}, selected="Office")
listzoneprograms = Honeybee_ListZonePrograms(bldgProgram=bldgprograms)  # -> OfficeZonePrograms; plug-in component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
item = ListItem(List=listzoneprograms, Index=Slider(5, range=0..12), Wrap=True)
mass2zone = Honeybee_Masses2Zones(zoneMasses=flatten(topology_geometry), zonePrograms=item, maxRoofAngle=30, createHBZones=Toggle(True))  # -> readMe, HBZones; plug-in component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
solveadjc = Honeybee_SolveAdjacencies(HBZones=flatten(mass2zone.HBZones), removeCurrentAdjc=False, findAdjc=Toggle(True))  # -> readMe, HBZonesWADJ; plug-in component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
# Change to True to start the simulation
toggle = BooleanToggle(False)
glazingcreator = Honeybee_GlazingBasedOnRatio(HBObjects=solveadjc.HBZonesWADJ, glzRatio="0.25", breakUpWindow=Toggle(False), runIt=Toggle(True))  # -> readMe, HBObjWGLZ; plug-in component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
decomposebytype = Honeybee_DecomposeBasedOnType(HBZone=glazingcreator.HBObjWGLZ)  # -> walls, interiorWalls, airWalls, windows, interiorWindows, skylights, roofs, ceilings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; plug-in component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
preview_2 = CustomPreview(Geometry=[decomposebytype.walls, decomposebytype.interiorWalls], Material=ColourSwatch(SwatchColor=RGB(255, 255, 175)))
preview_3 = CustomPreview(Geometry=decomposebytype.windows, Material=ColourSwatch(SwatchColor=RGBA(180, 235, 255, 164)))
preview_4 = CustomPreview(Geometry=decomposebytype.roofs, Material=ColourSwatch(SwatchColor=RGB(157, 157, 163)))
preview_5 = CustomPreview(Geometry=[decomposebytype.floors, decomposebytype.groundFloors], Material=ColourSwatch(SwatchColor=RGB(210, 172, 121)))

toggle_2 = BooleanToggle(True)
panel_15 = Panel("https://www.energyplus.net/weather-download/europe_wmo_region_6/GBR//GBR_London.Gatwick.037760_IWEC/all")
epoutput = Honeybee_GenerateEPOutput(zoneEnergyUse=toggle_2, zoneGainsAndLosses="False", zoneComfortMetrics=toggle_2, surfaceTempAnalysis=toggle_2)  # -> report, flatten(simulationOutputs); plug-in component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
analysisperiod = Ladybug_AnalysisPeriod()  # -> readMe, analysisPeriod; plug-in component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
epw_stat = Ladybug_OpenEPWAndSTATWeatherFiles(weatherFileURL=panel_15)  # -> epwFile, statFile; plug-in component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
runenergysimulation = Honeybee_RunEnergySimulation(
    epwFile=epw_stat.epwFile,
    analysisPeriod=analysisperiod.analysisPeriod,
    HBZones=flatten(glazingcreator.HBObjWGLZ),
    simulationOutputs=flatten(epoutput.simulationOutputs),
    writeIdf=toggle,
    runEnergyPlus=toggle)  # -> readMe, idfFileAddress, resultFileAddress, eioFileAddress, rddFileAddress, htmlReport, studyFolder; plug-in component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
readepresult = Honeybee_ReadEPResult(resultFileAddress=runenergysimulation.resultFileAddress)  # -> totalThermalLoad, thermalLoadBalance, cooling, heating, electricLight, electricEquip, fanElectric, pumpElectric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; plug-in component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
colorzones = Honeybee_ColorZonesByEPResult(zoneData=readepresult.operativeTemperature, HBZones=flatten(glazingcreator.HBObjWGLZ), runIt=Toggle(True))  # -> readMe, zoneColoredMesh, zoneWireFrame, legend, legendBasePt, analysisTitle, zoneBreps, zoneColors, zoneValues, relevantZoneData; plug-in component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
preview_6 = CustomPreview(Geometry=[colorzones.legend, colorzones.zoneWireFrame], Material=ColourSwatch(SwatchColor=RGB(0, 0, 0)))
preview_7 = CustomPreview(Geometry=colorzones.zoneBreps, Material=colorzones.zoneColors)
