# Grasshopper definition Topologic-05-DiversionWorkflow.gh (Grasshopper 1.0.7)
# plug-ins: TopologicGH, Bifocals

pt = ConstructPoint(XCoordinate=Slider(-60, range=-100..100), YCoordinate=Slider(10, range=-100..100), ZCoordinate=0)
pt_2 = ConstructPoint(XCoordinate=Slider(-80, range=-100..100), YCoordinate=Slider(60, range=-100..100), ZCoordinate=0)
pt_3 = ConstructPoint(XCoordinate=Slider(0, range=-100..100), YCoordinate=Slider(90, range=-100..100), ZCoordinate=0)
pt_4 = ConstructPoint(XCoordinate=Slider(-20, range=-100..100), YCoordinate=Slider(30, range=-100..100), ZCoordinate=0)
pt_5 = ConstructPoint(XCoordinate=Slider(-20, range=-100..100), YCoordinate=Slider(20, range=-100..100), ZCoordinate=0)
pt_6 = ConstructPoint(XCoordinate=Slider(-30, range=-100..100), YCoordinate=Slider(-30, range=-100..100), ZCoordinate=0)
merge = Merge(Data1=pt, Data2=pt_2, Data3=pt_3, Data4=pt_4, Data5=pt_5, Data6=pt_6)
pline = PolyLine(Vertices=merge, Closed=Toggle(True))
pt_7 = ConstructPoint(XCoordinate=Slider(-90, range=-100..200), YCoordinate=Slider(-80, range=-100..200), ZCoordinate=0)
pt_8 = ConstructPoint(XCoordinate=Slider(-10, range=-100..200), YCoordinate=Slider(120, range=-100..200), ZCoordinate=0)
ln = Line(StartPoint=pt_8, EndPoint=pt_7)
Z = UnitZ(Factor="10")
extr = Extrude(Base=pline, Direction=Z)
crv_cp = CurveClosestPoint(Point=merge, Curve=ln)  # -> Point, Parameter, Distance
topology_bygeometry = TopologyByGeometry(Geometry=extr, Tolerance=0.0001)
sort = SortList(Keys=crv_cp.Parameter, ValuesA=crv_cp.Point)  # -> Keys, ValuesA
sort_2 = SortList(Keys=crv_cp.Parameter, ValuesA=merge)  # -> Keys, ValuesA
preview = CustomPreview(Geometry=extr, Material=ColourSwatch(SwatchColor=RGBA(255, 0, 0, 100)))
topology_edges = TopologyEdges(Topology=topology_bygeometry)
ln_2 = Line(StartPoint=sort.ValuesA, EndPoint=sort_2.ValuesA)
topology_geometry = TopologyGeometry(Topology=topology_edges, Tolerance=0.0001)
item = ListItem(List=ln_2, Index=0, Wrap=True)
len = Length(Curve=ln_2)
end = EndPoints(Curve=item)  # -> Start, End
sort_3 = SortList(Keys=len, ValuesA=len)  # -> Keys, ValuesA
vec2pt = Vector2Pt(PointA=end.Start, PointB=end.End, Unitize=False)  # -> Vector, Length
lng = ListLength(List=sort_3.ValuesA)
item_2 = ListItem(List=sort_3.ValuesA, Index=expr("x-1", lng), Wrap=True)
expression = Expression(x=item_2, Expression="-x*1.2")
expression_2 = Expression(x=item_2, Expression="-x*1.2")
expression_3 = Expression(x=item_2, Expression="x*1.2")
expression_4 = Expression(x=item_2, Expression="x*1.2")
amp = Amplitude(Vector=vec2pt.Vector, Amplitude=expression_3)
amp_2 = Amplitude(Vector=vec2pt.Vector, Amplitude=expression)
amp_3 = Amplitude(Vector=vec2pt.Vector, Amplitude=expression_4)
amp_4 = Amplitude(Vector=vec2pt.Vector, Amplitude=expression_2)
sort_4 = SortList(Keys=crv_cp.Parameter, ValuesA=crv_cp.Point)  # -> Keys, ValuesA
lng_2 = ListLength(List=sort_4.ValuesA)
item_3 = ListItem(List=sort_4.ValuesA, Index=expr("x-1", lng_2), Wrap=True)
item_4 = ListItem(List=sort_4.ValuesA, Index=0, Wrap=True)
move = Move(Geometry=item_4, Motion=amp)  # -> Geometry, Transform
move_2 = Move(Geometry=item_4, Motion=amp_2)  # -> Geometry, Transform
move_3 = Move(Geometry=item_3, Motion=amp_3)  # -> Geometry, Transform
move_4 = Move(Geometry=item_3, Motion=amp_4)  # -> Geometry, Transform
ln_3 = Line(StartPoint=move.Geometry, EndPoint=move_2.Geometry)
ln_4 = Line(StartPoint=move_3.Geometry, EndPoint=move_4.Geometry)
crv_cp_2 = CurveClosestPoint(Point=merge, Curve=ln_3)  # -> Point, Parameter, Distance
crv_cp_3 = CurveClosestPoint(Point=merge, Curve=ln_4)  # -> Point, Parameter, Distance
sort_5 = SortList(Keys=crv_cp_2.Parameter, ValuesA=crv_cp_2.Point)  # -> Keys, ValuesA
sort_6 = SortList(Keys=crv_cp_3.Parameter, ValuesA=crv_cp_3.Point)  # -> Keys, ValuesA
lng_3 = ListLength(List=sort_5.ValuesA)
lng_4 = ListLength(List=sort_6.ValuesA)
item_5 = ListItem(List=sort_5.ValuesA, Index=expr("x-1", lng_3), Wrap=True)
item_6 = ListItem(List=sort_6.ValuesA, Index=expr("x-1", lng_4), Wrap=True)
item_7 = ListItem(List=sort_5.ValuesA, Index=0, Wrap=True)
item_8 = ListItem(List=sort_6.ValuesA, Index=0, Wrap=True)
merge_2 = Merge(Data1=item_7, Data2=item_5, Data3=item_6, Data4=item_8)
pline_2 = PolyLine(Vertices=merge_2, Closed=Toggle(True))
topology_bygeometry_2 = TopologyByGeometry(Geometry=pline_2, Tolerance=0.0001)
topology_bygeometry_3 = TopologyByGeometry(Geometry=ln, Tolerance=0.0001)
face_bywire = FaceByWire(Wire=topology_bygeometry_2)
topology_difference = TopologyDifference(Topology=topology_bygeometry_3, Topology_2=face_bywire, TransferDictionary=False)
topology_edges_2 = TopologyEdges(Topology=topology_bygeometry_2)
cluster_edges = ClusterEdges(Cluster=topology_difference)
merge_3 = Merge(Data1=cluster_edges, Data2=topology_edges_2)
flatten = FlattenTree(Tree=merge_3, Path="{0}")
cluster_bytopologies = ClusterByTopologies(Topologies=flatten)
topology_selfmerge = TopologySelfMerge(Topology=cluster_bytopologies)
topology_wires = TopologyWires(Topology=topology_selfmerge)
item_9 = ListItem(List=topology_wires, Index=0, Wrap=True)
graph_bytopology = GraphByTopology(
    Topology=item_9,
    Direct=True,
    ViaSharedTopologies=False,
    ViaSharedApertures=False,
    ToExteriorTopologies=False,
    ToExteriorApertures=False,
    UseFaceInternalVertex=False,
    Tolerance=0.0001)
pdecon = Deconstruct(Point=pt_8)  # -> XComponent, YComponent, ZComponent
pdecon_2 = Deconstruct(Point=pt_7)  # -> XComponent, YComponent, ZComponent
graph_verticesatcoordinates = GraphVerticesAtCoordinates(Graph=graph_bytopology, X=pdecon.XComponent, Y=pdecon.YComponent, Z=pdecon.ZComponent, Tolerance=0.0001)
graph_verticesatcoordinates_2 = GraphVerticesAtCoordinates(Graph=graph_bytopology, X=pdecon_2.XComponent, Y=pdecon_2.YComponent, Z=pdecon_2.ZComponent, Tolerance=0.0001)
item_10 = ListItem(List=graph_verticesatcoordinates, Index=0, Wrap=True)
item_11 = ListItem(List=graph_verticesatcoordinates_2, Index=0, Wrap=True)
graph_shortestpath = GraphShortestPath(Graph=graph_bytopology, StartVertex=item_10, EndVertex=item_11)
topology_geometry_2 = TopologyGeometry(Topology=topology_wires, Tolerance=0.0001)
topology_geometry_3 = TopologyGeometry(Topology=graph_shortestpath, Tolerance=0.0001)
null = NullItem(Item=topology_geometry_3)  # -> NullFlags, InvalidFlags, Description
if = GhPythonScript(test=null.NullFlags, true=topology_geometry_3, false=ln)  # -> result
# ---------- if: Python ----------
__author__ = "katie"
__version__ = "2020.06.17"

# If statement that allows a wire output

import rhinoscriptsyntax as rs

result= []

if test == 0:
    result.append(true)
else:
    result.append(false)
# ---------- end if ----------
