# Grasshopper definition Topologic-06-ShortestPaths.gh (Grasshopper 1.0.7)
# plug-ins: TopologicGH, Bifocals

panel = Panel("Create Cuboids")

box = DomainBox(Base=PlaneXY(0, 0, 0), X="10", Y="10", Z="10")
box_2 = DomainBox(Base=PlaneXY(0, 0, 0), X="10", Y="15", Z="10")
box_3 = DomainBox(Base=PlaneXY(0, 0, 0), X="10", Y="10", Z="10")
box_4 = DomainBox(Base=PlaneXY(0, 0, 0), X="20", Y="10", Z="10")
box_5 = DomainBox(Base=PlaneXY(0, 0, 0), X="10", Y="20", Z="20")
box_6 = DomainBox(Base=PlaneXY(0, 0, 0), X="10", Y="20", Z="10")
box_7 = DomainBox(Base=PlaneXY(0, 0, 0), X="20", Y="10", Z="10")
box_8 = DomainBox(Base=PlaneXY(0, 0, 0), X="10", Y="10", Z="10")
pt = ConstructPoint(XCoordinate=0, YCoordinate=0, ZCoordinate=0)
pt_2 = ConstructPoint(XCoordinate="10", YCoordinate=0, ZCoordinate=0)
pt_3 = ConstructPoint(XCoordinate="15", YCoordinate="-15", ZCoordinate=0)
pt_4 = ConstructPoint(XCoordinate="30", YCoordinate=0, ZCoordinate=0)
pt_5 = ConstructPoint(XCoordinate=0, YCoordinate="10", ZCoordinate="0")
pt_6 = ConstructPoint(XCoordinate=0, YCoordinate="30", ZCoordinate=0)
pt_7 = ConstructPoint(XCoordinate="30", YCoordinate="30", ZCoordinate=0)
pt_8 = ConstructPoint(XCoordinate="30", YCoordinate="10", ZCoordinate=0)
pt_9 = ConstructPoint(XCoordinate="10", YCoordinate="30", ZCoordinate=0)
move = Move(Geometry=box, Motion=pt_6)  # -> Geometry, Transform
move_2 = Move(Geometry=box_2, Motion=pt_3)  # -> Geometry, Transform
move_3 = Move(Geometry=box_3, Motion=pt)  # -> Geometry, Transform
move_4 = Move(Geometry=box_3, Motion=pt_4)  # -> Geometry, Transform
move_5 = Move(Geometry=box_4, Motion=pt_2)  # -> Geometry, Transform
move_6 = Move(Geometry=box_5, Motion=pt_5)  # -> Geometry, Transform
move_7 = Move(Geometry=box_6, Motion=pt_8)  # -> Geometry, Transform
move_8 = Move(Geometry=box_7, Motion=pt_9)  # -> Geometry, Transform
move_9 = Move(Geometry=box_8, Motion=pt_7)  # -> Geometry, Transform

merge = Merge(
    Data1=move_3.Geometry,
    Data2=move_4.Geometry,
    Data3=move_5.Geometry,
    Data4=move_6.Geometry,
    Data5=move_7.Geometry,
    Data6=move_8.Geometry,
    Data7=move.Geometry,
    Data8=move_9.Geometry,
    Data9=move_2.Geometry)
topology_bygeometry = TopologyByGeometry(Geometry=merge, Tolerance=0.0001)
cellcomplex_bycells = CellComplexByCells(Cells=topology_bygeometry)
# Create Dual Graph of the CellComplex
graph_bytopology = GraphByTopology(
    Topology=cellcomplex_bycells,
    Direct=True,
    ViaSharedTopologies=False,
    ViaSharedApertures=False,
    ToExteriorTopologies=False,
    ToExteriorApertures=False,
    UseFaceInternalVertex=False,
    Tolerance=0.0001)
graph_vertices = GraphVertices(Graph=graph_bytopology)
# Get the Edges from the Graph
graph_edges = GraphEdges(Graph=graph_bytopology, Vertices=graph_vertices, Tolerance=0.0001)

# ----
# Compute the slope of an edge using a simple Z delta surrogate
edge_endvertex = EdgeEndVertex(Edge=graph_edges)
edge_startvertex = EdgeStartVertex(Edge=graph_edges)
vertex_z = VertexZ(Vertex=edge_endvertex)
vertex_z_2 = VertexZ(Vertex=edge_startvertex)
subtraction = Subtraction(A=vertex_z, B=vertex_z_2)
abs = Absolute(Value=subtraction)
round = Round(Number=abs)  # -> Nearest, Floor, Ceiling

# ----
# Add the delta as a custom attribute to the edge's dictionary
dictionary_bykeysvalues = DictionaryByKeysValues(Keys="\"delta\"", Values=graft(round.Nearest))
flatten = FlattenTree(Tree=dictionary_bykeysvalues, Path="{0}")
topology_setdictionary = TopologySetDictionary(Topology=graph_edges, Dictionary=flatten)

# ----
# Make a wire out of the edges. The dictionaries carry through
wire_byedges = WireByEdges(Edges=topology_setdictionary)
# Create a Graph from the Wire
graph_bytopology_2 = GraphByTopology(
    Topology=wire_byedges,
    Direct=True,
    ViaSharedTopologies=False,
    ViaSharedApertures=False,
    ToExteriorTopologies=False,
    ToExteriorApertures=False,
    UseFaceInternalVertex=False,
    Tolerance=0.0001)

# ----
# Specify the Start and End Vertices in the Graph
panel_2 = Panel("20")
graph_verticesatcoordinates = GraphVerticesAtCoordinates(Graph=graph_bytopology_2, X=panel_2, Y="-7.5", Z="5", Tolerance="0.1")
graph_verticesatcoordinates_2 = GraphVerticesAtCoordinates(Graph=graph_bytopology_2, X="5", Y="35", Z="5", Tolerance="0.1")

# ----
# Find the Shortest Path with the lowest total 'delta'
graph_shortestpath = GraphShortestPath(
    Graph=graph_bytopology_2,
    StartVertex=graph_verticesatcoordinates,
    EndVertex=graph_verticesatcoordinates_2,
    EdgeKey="\"delta\"")

# ----
# Find the Shortest Path ignoring the dictionary keys (Fewest Edges)
graph_shortestpath_2 = GraphShortestPath(Graph=graph_bytopology_2, StartVertex=graph_verticesatcoordinates, EndVertex=graph_verticesatcoordinates_2)

topology_edges = TopologyEdges(Topology=graph_shortestpath)
edge_endvertex_2 = EdgeEndVertex(Edge=topology_edges)
edge_startvertex_2 = EdgeStartVertex(Edge=topology_edges)
topology_geometry = TopologyGeometry(Topology=edge_endvertex_2, Tolerance=0.0001)
topology_geometry_2 = TopologyGeometry(Topology=edge_startvertex_2, Tolerance=0.0001)

topology_edges_2 = TopologyEdges(Topology=graph_shortestpath_2)
edge_endvertex_3 = EdgeEndVertex(Edge=topology_edges_2)
edge_startvertex_3 = EdgeStartVertex(Edge=topology_edges_2)
topology_geometry_3 = TopologyGeometry(Topology=edge_endvertex_3, Tolerance=0.0001)
topology_geometry_4 = TopologyGeometry(Topology=edge_startvertex_3, Tolerance=0.0001)

graph_vertices_2 = GraphVertices(Graph=graph_bytopology_2)
topology_geometry_5 = TopologyGeometry(Topology=graph_vertices_2, Tolerance=0.0001)
flatten_2 = FlattenTree(Tree=topology_geometry_5, Path="{0}")
sph = Sphere(Base=flatten_2, Radius="0.6")

graph_topology = GraphTopology(Graph=graph_bytopology_2)
topology_geometry_6 = TopologyGeometry(Topology=graph_topology, Tolerance=0.0001)

topology_edges_3 = TopologyEdges(Topology=cellcomplex_bycells)
topology_geometry_7 = TopologyGeometry(Topology=topology_edges_3, Tolerance=0.0001)
preview = CustomPreview(Geometry=topology_geometry_7, Material=ColourSwatch(SwatchColor=RGB(0, 0, 0)))

topology_geometry_8 = TopologyGeometry(Topology=graph_verticesatcoordinates_2, Tolerance=0.0001)
sph_2 = Sphere(Base=topology_geometry_8, Radius="1")
preview_2 = CustomPreview(Geometry=sph_2, Material=ColourSwatch(SwatchColor=RGB(255, 0, 0)))

topology_geometry_9 = TopologyGeometry(Topology=graph_verticesatcoordinates, Tolerance=0.0001)
sph_3 = Sphere(Base=topology_geometry_9, Radius="1")
preview_3 = CustomPreview(Geometry=sph_3, Material=ColourSwatch(SwatchColor=RGB(0, 255, 0)))

ln = Line(StartPoint=topology_geometry_4, EndPoint=topology_geometry_3)
pipe = Pipe(Curve=ln, Radius="0.2", Caps=1)

ln_2 = Line(StartPoint=topology_geometry_2, EndPoint=topology_geometry)
pipe_2 = Pipe(Curve=ln_2, Radius="0.2", Caps=1)

topology_geometry_10 = TopologyGeometry(Topology=cellcomplex_bycells, Tolerance=0.0001)
preview_4 = CustomPreview(Geometry=topology_geometry_10, Material=ColourSwatch(SwatchColor=RGBA(255, 255, 255, 5)))

# ---- group: Custom Preview
preview_5 = CustomPreview(Geometry=[topology_geometry_6, sph], Material=ColourSwatch(SwatchColor=RGB(255, 255, 255)))

# ----
# Show the Red Path (Stairs)
preview_6 = CustomPreview(Geometry=pipe, Material=ColourSwatch(SwatchColor=RGB(255, 0, 0)))
# Show the Green Path (Flat)
preview_7 = CustomPreview(Geometry=pipe_2, Material=ColourSwatch(SwatchColor=RGB(0, 255, 0)))
