# Grasshopper definition WireDualGraphExampleWorkflow.gh (Grasshopper 1.0.7)
# plug-ins: TopologicGH, Bifocals

rectangle = Rectangle(Plane=PlaneXY(0, 0, 0), XSize="10", YSize="10", Radius=0)  # -> Rectangle, Length
arrrec = RectangularArray(Geometry=rectangle.Rectangle, Cell=rectangle.Rectangle, XCount="6", YCount="5")  # -> Geometry, Transform
explode = Explode(Curve=arrrec.Geometry, Recursive=True)  # -> Segments, Vertices
topology_bygeometry = TopologyByGeometry(Geometry=explode.Segments, Tolerance=0.0001)
topology_edges = TopologyEdges(Topology=topology_bygeometry)
flatten = FlattenTree(Tree=topology_edges, Path="{0}")
cluster_bytopologies = ClusterByTopologies(Topologies=flatten)
topology_selfmerge = TopologySelfMerge(Topology=cluster_bytopologies)
cluster = Cluster(wire=topology_selfmerge)
topology_geometry = TopologyGeometry(Topology=cluster, Tolerance=0.0001)

# ==== cluster Cluster

# ---- group: Cluster Input
tolerance = ClusterInput()

wire = ClusterInput()

# ----
python = GhPythonScript(wire=wire, tolerance=tolerance)  # -> w
# ---------- python: Python ----------
__author__ = "katie"
__version__ = "2020.07.19"

import rhinoscriptsyntax as rs
import clr
clr.AddReference('TopologicNET')
import Topologic

def createMatrix(rows, columns):
	mat = []
	for i in range(rows):
		row = []
		for j in range(columns):
			row.append(0)
		mat.append(row)
	return mat

edges = wire.Edges
n = len(edges)

mat = createMatrix(len(edges), len(edges))

def indexOf(edges, edge):
	for i in range(len(edges)):
		if Topologic.Topology.IsSame(edge, edges[i]):
			return i
	return -1
		
outputEdges = []
for i in range(n):
	v1 = Topologic.Utilities.EdgeUtility.VertexAtParameter(edges[i],0.5)
	adjacentEdges = edges[i].AdjacentEdges
	for anAdjacentEdge in adjacentEdges:
		j = indexOf(edges, anAdjacentEdge)
		if mat[i][j] != 1:
			v2 = Topologic.Utilities.EdgeUtility.VertexAtParameter(anAdjacentEdge,0.5)
			if Topologic.Utilities.VertexUtility.Distance(v1, v2) >= tolerance:
				outputEdges.append(Topologic.Edge.ByStartVertexEndVertex(v1, v2))
			mat[i][j] = 1
			mat[j][i] = 1
			
try:
	w = Topologic.Wire.ByEdges(outputEdges)
except:
	w = outputEdges
# ---------- end python ----------

# ---- group: Cluster Output
w = ClusterOutput(python)
