# Grasshopper definition CellComplexTower.gh (Grasshopper 1.0.7)
# plug-ins: TopologicGH, Bifocals

panel = Panel("CellComplexExternalFaces Cluster")
cellcomplexexternalfaces = CellComplexExternalFaces(upvector=0, tolerance=0)
panel_2 = Panel("CellComplexInternalFaces Cluster")
cellcomplexinternalfaces = CellComplexInternalFaces(upvector=0, angle=0, tolerance=0.001)

div = DivideDomain(Domain="5,20", Count="10")
dedomain = DeconstructDomain(Domain=div)  # -> Start, End
sin = Sine(Value=degrees(dedomain.Start))
division = Division(A=1, B=sin)
addition = Addition(A=division, B=1)
flatten = FlattenTree(Tree=addition, Path="{0}")
div_2 = DivideDomain(Domain="50", Count="10")
sort = SortList(Keys=flatten, ValuesA=flatten)  # -> Keys, ValuesA
dedomain_2 = DeconstructDomain(Domain=div_2)  # -> Start, End
rev = ReverseList(List=sort.Keys)
pt = ConstructPoint(XCoordinate=0, YCoordinate=0, ZCoordinate=dedomain_2.Start)
polygon = Polygon(Plane=PlaneXY(0, 0, 0), Radius=rev, Segments="8", FilletRadius=0)  # -> Polygon, Length
move = Move(Geometry=polygon.Polygon, Motion=pt)  # -> Geometry, Transform

div_3 = DivideDomain(Domain="5,15", Count="10")
dedomain_3 = DeconstructDomain(Domain=div_3)  # -> Start, End
sin_2 = Sine(Value=degrees(dedomain_3.Start))
division_2 = Division(A=1, B=sin_2)
addition_2 = Addition(A=division_2, B=1)
flatten_2 = FlattenTree(Tree=addition_2, Path="{0}")
sort_2 = SortList(Keys=flatten_2, ValuesA=flatten_2)  # -> Keys, ValuesA
div_4 = DivideDomain(Domain="50", Count="10")
rev_2 = ReverseList(List=sort_2.Keys)
dedomain_4 = DeconstructDomain(Domain=div_4)  # -> Start, End
division_3 = Division(A=rev_2, B=2)
pt_2 = ConstructPoint(XCoordinate=0, YCoordinate=0, ZCoordinate=dedomain_4.Start)
polygon_2 = Polygon(Plane=PlaneXY(0, 0, 0), Radius=division_3, Segments="8", FilletRadius=0)  # -> Polygon, Length
move_2 = Move(Geometry=polygon_2.Polygon, Motion=pt_2)  # -> Geometry, Transform

topology_bygeometry = TopologyByGeometry(Geometry=move.Geometry, Tolerance=0.0001)
topology_bygeometry_2 = TopologyByGeometry(Geometry=move_2.Geometry, Tolerance=0.0001)
cellutility_byloft = CellUtilityByLoft(Wires=topology_bygeometry_2)
cellutility_byloft_2 = CellUtilityByLoft(Wires=topology_bygeometry)
face_bywire = FaceByWire(Wire=topology_bygeometry)
cluster_bytopologies = ClusterByTopologies(Topologies=face_bywire)
topology_slice = TopologySlice(Topology=cellutility_byloft_2, Tool=cluster_bytopologies, TransferDictionary=False)
topology_impose = TopologyImpose(Topology=topology_slice, Tool=cellutility_byloft, TransferDictionary=False)
cellcomplexexternalfaces_2 = CellComplexExternalFaces(cellcomplex=topology_impose, upvector=0, angle="80", tolerance="5")
cellcomplexinternalfaces_2 = CellComplexInternalFaces(cellcomplex=topology_impose, upvector=0, angle="80", tolerance="5")
cellcomplexinternalfaces_3 = CellComplexInternalFaces(cellcomplex=topology_impose, upvector=0, angle=0, tolerance=0.001)

topology_geometry = TopologyGeometry(Topology=cellcomplexinternalfaces_2, Tolerance=0.0001)
vec = VectorXYZ(XComponent="80", YComponent=0, ZComponent=0)  # -> Vector, Length
move_3 = Move(Geometry=topology_geometry, Motion=vec.Vector)  # -> Geometry, Transform
rgb = ColourRGB(Alpha="255", Red="255", Green="255", Blue="0")
preview = CustomPreview(Geometry=move_3.Geometry, Material=rgb)

topology_geometry_2 = TopologyGeometry(Topology=cellcomplexinternalfaces_3, Tolerance=0.0001)
vec_2 = VectorXYZ(XComponent="120", YComponent=0, ZComponent=0)  # -> Vector, Length
move_4 = Move(Geometry=topology_geometry_2, Motion=vec_2.Vector)  # -> Geometry, Transform
rgb_2 = ColourRGB(Alpha="255", Red="255", Green="255", Blue="0")
preview_2 = CustomPreview(Geometry=move_4.Geometry, Material=rgb_2)

topology_geometry_3 = TopologyGeometry(Topology=cellcomplexexternalfaces_2, Tolerance=0.0001)
vec_3 = VectorXYZ(XComponent="40", YComponent=0, ZComponent=0)  # -> Vector, Length
move_5 = Move(Geometry=topology_geometry_3, Motion=vec_3.Vector)  # -> Geometry, Transform
rgb_3 = ColourRGB(Alpha="255", Red="255", Green="255", Blue="0")
preview_3 = CustomPreview(Geometry=move_5.Geometry, Material=rgb_3)

topology_edges = TopologyEdges(Topology=topology_impose)
panel_3 = Panel("""40
80""")
topology_geometry_4 = TopologyGeometry(Topology=topology_edges, Tolerance=0.0001)
vec_4 = VectorXYZ(XComponent=panel_3, YComponent=0, ZComponent=0)  # -> Vector, Length
move_6 = Move(Geometry=topology_geometry_4, Motion=vec_4.Vector)  # -> Geometry, Transform

# ==== cluster CellComplexExternalFaces

# ---- group: Cluster Input
cellcomplex = ClusterInput()

# ----
cellcomplex_externalboundary = CellComplexExternalBoundary(CellComplex=cellcomplex)
topology_faces = TopologyFaces(Topology=cellcomplex_externalboundary)

# ---- group: Cluster Input
angle = ClusterInput()

# ----
faceutility_normalatparameters = FaceUtilityNormalAtParameters(Face=topology_faces, U="0.5", V="0.5")  # -> X, Y, Z
min = Minimum(A=angle, B="180")

# ---- group: Cluster Input
upvector = ClusterInput()

tolerance = ClusterInput()

# ----
vec = VectorXYZ(
    XComponent=faceutility_normalatparameters.X,
    YComponent=faceutility_normalatparameters.Y,
    ZComponent=faceutility_normalatparameters.Z)  # -> Vector, Length
max = Maximum(A=min, B="0")
equals = Equality(FirstNumber=upvector, SecondNumber="0")  # -> Equality, Inequality
Z = UnitZ(Factor=1)
if = GhPythonScript(x=equals.Equality, y=Z, z=upvector)  # -> a
# ---------- if: Python ----------
__author__ = "katie"
__version__ = "2020.07.20"

import rhinoscriptsyntax as rs

if x==True:
    a=y
else:
    a=z
# ---------- end if ----------
angle_2 = Angle(VectorA=if, VectorB=vec.Vector)  # -> Angle, Reflex
deg = Degrees(Radians=angle_2.Angle)
subtraction = Subtraction(A=deg, B=max)
abs = Absolute(Value=subtraction)
smaller = SmallerThan(FirstNumber=abs, SecondNumber=tolerance)  # -> SmallerThan, OrEqualTo
mindex = MemberIndex(Set=smaller.SmallerThan, Member=Toggle(True))  # -> Index, Count
item = ListItem(List=topology_faces, Index=mindex.Index, Wrap=True)
cluster_bytopologies = ClusterByTopologies(Topologies=item)
cluster = ClusterOutput(cluster_bytopologies)

# ==== cluster CellComplexInternalFaces

# ---- group: Cluster Input
cellcomplex = ClusterInput()

# ----
cellcomplex_internalboundaries = CellComplexInternalBoundaries(CellComplex=cellcomplex)
topology_faces = TopologyFaces(Topology=cellcomplex_internalboundaries)

# ---- group: Cluster Input
angle = ClusterInput()

# ----
flatten = FlattenTree(Tree=topology_faces, Path="{0}")

# ---- group: Cluster Input
upvector = ClusterInput()

# ----
min = Minimum(A=angle, B="180")
faceutility_normalatparameters = FaceUtilityNormalAtParameters(Face=flatten, U="0.5", V="0.5")  # -> X, Y, Z

# ---- group: Cluster Input
tolerance = ClusterInput()

# ----
max = Maximum(A=min, B="0")
vec = VectorXYZ(
    XComponent=faceutility_normalatparameters.X,
    YComponent=faceutility_normalatparameters.Y,
    ZComponent=faceutility_normalatparameters.Z)  # -> Vector, Length
equals = Equality(FirstNumber=upvector, SecondNumber=0)  # -> Equality, Inequality
Z = UnitZ(Factor=1)
if = GhPythonScript(x=equals.Equality, y=Z, z=upvector)  # -> a; same code as if
angle_2 = Angle(VectorA=if, VectorB=vec.Vector)  # -> Angle, Reflex
deg = Degrees(Radians=angle_2.Angle)
subtraction = Subtraction(A=deg, B=max)
abs = Absolute(Value=subtraction)
smaller = SmallerThan(FirstNumber=abs, SecondNumber=tolerance)  # -> SmallerThan, OrEqualTo
mindex = MemberIndex(Set=smaller.SmallerThan, Member=Toggle(True))  # -> Index, Count
item = ListItem(List=flatten, Index=mindex.Index, Wrap=True)
cluster_bytopologies = ClusterByTopologies(Topologies=item)
cluster = ClusterOutput(cluster_bytopologies)
