# Grasshopper definition Topologic-MinimumSpanningTree.gh (Grasshopper 1.0.7)
# plug-ins: TopologicGH, Bifocals

vertex_bycoordinates = VertexByCoordinates(X="5.9", Y="6.2", Z=0)
vertex_bycoordinates_2 = VertexByCoordinates(X="3.6", Y="0.6", Z=0)
vertex_bycoordinates_3 = VertexByCoordinates(X="4.7", Y="3.4", Z=0)
vertex_bycoordinates_4 = VertexByCoordinates(X="1.7", Y="4.6", Z=0)
vertex_bycoordinates_5 = VertexByCoordinates(X="0.6", Y="2.7", Z=0)
vertex_bycoordinates_6 = VertexByCoordinates(X="6.7", Y="6.1", Z=0)
vertex_bycoordinates_7 = VertexByCoordinates(X="4.5", Y="6", Z=0)
vertex_bycoordinates_8 = VertexByCoordinates(X="5.7", Y="6.5", Z=0)
vertex_bycoordinates_9 = VertexByCoordinates(X="2", Y="4", Z=0)
vertex_bycoordinates_10 = VertexByCoordinates(X="1.7", Y="3.4", Z=0)

merge = Merge(
    Data1=vertex_bycoordinates_5,
    Data2=vertex_bycoordinates_10,
    Data3=vertex_bycoordinates_4,
    Data4=vertex_bycoordinates_9,
    Data5=vertex_bycoordinates_2,
    Data6=vertex_bycoordinates_7,
    Data7=vertex_bycoordinates_3,
    Data8=vertex_bycoordinates_8,
    Data9=vertex_bycoordinates,
    Data10=vertex_bycoordinates_6)

edge_bystartvertexendvertex = EdgeByStartVertexEndVertex(StartVertex=vertex_bycoordinates_5, EndVertex=vertex_bycoordinates_2)
edge_bystartvertexendvertex_2 = EdgeByStartVertexEndVertex(StartVertex=vertex_bycoordinates_10, EndVertex=vertex_bycoordinates_2)
edge_bystartvertexendvertex_3 = EdgeByStartVertexEndVertex(StartVertex=vertex_bycoordinates_10, EndVertex=vertex_bycoordinates_9)
edge_bystartvertexendvertex_4 = EdgeByStartVertexEndVertex(StartVertex=vertex_bycoordinates_9, EndVertex=vertex_bycoordinates_3)
edge_bystartvertexendvertex_5 = EdgeByStartVertexEndVertex(StartVertex=vertex_bycoordinates_2, EndVertex=vertex_bycoordinates_3)
edge_bystartvertexendvertex_6 = EdgeByStartVertexEndVertex(StartVertex=vertex_bycoordinates_4, EndVertex=vertex_bycoordinates_7)
edge_bystartvertexendvertex_7 = EdgeByStartVertexEndVertex(StartVertex=vertex_bycoordinates_7, EndVertex=vertex_bycoordinates_8)
edge_bystartvertexendvertex_8 = EdgeByStartVertexEndVertex(StartVertex=vertex_bycoordinates_3, EndVertex=vertex_bycoordinates)
edge_bystartvertexendvertex_9 = EdgeByStartVertexEndVertex(StartVertex=vertex_bycoordinates_2, EndVertex=vertex_bycoordinates_6)
edge_bystartvertexendvertex_10 = EdgeByStartVertexEndVertex(StartVertex=vertex_bycoordinates, EndVertex=vertex_bycoordinates_6)
edge_bystartvertexendvertex_11 = EdgeByStartVertexEndVertex(StartVertex=vertex_bycoordinates_5, EndVertex=vertex_bycoordinates_4)
edge_bystartvertexendvertex_12 = EdgeByStartVertexEndVertex(StartVertex=vertex_bycoordinates_10, EndVertex=vertex_bycoordinates_4)
edge_bystartvertexendvertex_13 = EdgeByStartVertexEndVertex(StartVertex=vertex_bycoordinates_9, EndVertex=vertex_bycoordinates_4)
edge_bystartvertexendvertex_14 = EdgeByStartVertexEndVertex(StartVertex=vertex_bycoordinates_10, EndVertex=vertex_bycoordinates_3)
edge_bystartvertexendvertex_15 = EdgeByStartVertexEndVertex(StartVertex=vertex_bycoordinates_9, EndVertex=vertex_bycoordinates_7)
edge_bystartvertexendvertex_16 = EdgeByStartVertexEndVertex(StartVertex=vertex_bycoordinates_7, EndVertex=vertex_bycoordinates_3)
edge_bystartvertexendvertex_17 = EdgeByStartVertexEndVertex(StartVertex=vertex_bycoordinates_7, EndVertex=vertex_bycoordinates)
edge_bystartvertexendvertex_18 = EdgeByStartVertexEndVertex(StartVertex=vertex_bycoordinates_3, EndVertex=vertex_bycoordinates_6)
edge_bystartvertexendvertex_19 = EdgeByStartVertexEndVertex(StartVertex=vertex_bycoordinates_8, EndVertex=vertex_bycoordinates)
edge_bystartvertexendvertex_20 = EdgeByStartVertexEndVertex(StartVertex=vertex_bycoordinates_5, EndVertex=vertex_bycoordinates_10)

merge_2 = Merge(
    Data1=edge_bystartvertexendvertex,
    Data2=edge_bystartvertexendvertex_11,
    Data3=edge_bystartvertexendvertex_2,
    Data4=edge_bystartvertexendvertex_12,
    Data5=edge_bystartvertexendvertex_3,
    Data6=edge_bystartvertexendvertex_13,
    Data7=edge_bystartvertexendvertex_4,
    Data8=edge_bystartvertexendvertex_14,
    Data9=edge_bystartvertexendvertex_5,
    Data10=edge_bystartvertexendvertex_15,
    Data11=edge_bystartvertexendvertex_6,
    Data12=edge_bystartvertexendvertex_16,
    Data13=edge_bystartvertexendvertex_7,
    Data14=edge_bystartvertexendvertex_17,
    Data15=edge_bystartvertexendvertex_8,
    Data16=edge_bystartvertexendvertex_18,
    Data17=edge_bystartvertexendvertex_9,
    Data18=edge_bystartvertexendvertex_19,
    Data19=edge_bystartvertexendvertex_10,
    Data20=edge_bystartvertexendvertex_20)
cluster_bytopologies = ClusterByTopologies(Topologies=merge_2)
topology_selfmerge = TopologySelfMerge(Topology=cluster_bytopologies)
topology_wires = TopologyWires(Topology=topology_selfmerge)
item = ListItem(List=topology_wires, Index=0, Wrap=True)
topology_edges = TopologyEdges(Topology=item)
topology_geometry = TopologyGeometry(Topology=topology_edges, Tolerance=0.0001)
topology_centroid = TopologyCentroid(Topology=topology_edges)
len = Length(Curve=topology_geometry)
dictionary_bykeysvalues = DictionaryByKeysValues(Keys="\"weight\"", Values=len)
flatten = FlattenTree(Tree=dictionary_bykeysvalues, Path="{0}")
topology_setdictionaries = TopologySetDictionaries(Topology=item, Selectors=topology_centroid, Dictionaries=flatten, TypeFilter="2")
graph_bytopology = GraphByTopology(
    Topology=topology_setdictionaries,
    Direct=True,
    ViaSharedTopologies=False,
    ViaSharedApertures=False,
    ToExteriorTopologies=False,
    ToExteriorApertures=False,
    UseFaceInternalVertex=False,
    Tolerance=0.0001)
panel = Panel("GraphMinimumSpanningTree Cluster")
graphminimumspanningtree = GraphMinimumSpanningTree(graph=graph_bytopology, edgekey="\"weight\"", tolerance="0.001")
topologyutility_translate = TopologyUtilityTranslate(Topology=graphminimumspanningtree, X="0", Y="0", Z="0.1")
topology_vertices = TopologyVertices(Topology=topologyutility_translate)
topology_geometry_2 = TopologyGeometry(Topology=topology_vertices, Tolerance=0.0001)
sph = Sphere(Base=topology_geometry_2, Radius="0.05")
topology_geometry_3 = TopologyGeometry(Topology=merge, Tolerance=0.0001)
topology_geometry_4 = TopologyGeometry(Topology=topologyutility_translate, Tolerance=0.0001)
preview = CustomPreview(Geometry=topology_geometry, Material=ColourSwatch(SwatchColor=RGB(200, 200, 200)))
preview_2 = CustomPreview(Geometry=sph, Material=ColourSwatch(SwatchColor=RGB(0, 0, 0)))

# ==== cluster GraphMinimumSpanningTree

# ---- group: Cluster Input
edgekey = ClusterInput()

tolerance = ClusterInput()

graph = ClusterInput()

# ----
python = GhPythonScript(graph=graph, edgeKey=edgekey, tolerance=tolerance)  # -> edges, dictValues
# ---------- python: Python ----------
__author__ = "katie"
__version__ = "2020.07.14"

import rhinoscriptsyntax as rs
import sys
import clr
clr.AddReference('TopologicNET')
import Topologic

# Python program for Kruskal's algorithm to find 
# Minimum Spanning Tree of a given connected, 
# undirected and weighted graph 

from collections import defaultdict 

tolerance = float(tolerance)

#Class to represent a graph 
class Graph: 

	def __init__(self,vertices): 
		self.V= vertices #No. of vertices 
		self.graph = [] # default dictionary 
								# to store graph 
		

	# function to add an edge to graph 
	def addEdge(self,u,v,w): 
		self.graph.append([u,v,w]) 

	# A utility function to find set of an element i 
	# (uses path compression technique) 
	def find(self, parent, i): 
		if parent[i] == i: 
			return i 
		return self.find(parent, parent[i]) 

	# A function that does union of two sets of x and y 
	# (uses union by rank) 
	def union(self, parent, rank, x, y): 
		xroot = self.find(parent, x) 
		yroot = self.find(parent, y) 

		# Attach smaller rank tree under root of 
		# high rank tree (Union by Rank) 
		if rank[xroot] < rank[yroot]: 
			parent[xroot] = yroot 
		elif rank[xroot] > rank[yroot]: 
			parent[yroot] = xroot 

		# If ranks are same, then make one as root 
		# and increment its rank by one 
		else : 
			parent[yroot] = xroot 
			rank[xroot] += 1

	# The main function to construct MST using Kruskal's 
		# algorithm 
	def KruskalMST(self): 

		result =[] #This will store the resultant MST 

		i = 0 # An index variable, used for sorted edges 
		e = 0 # An index variable, used for result[] 

			# Step 1: Sort all the edges in non-decreasing 
				# order of their 
				# weight. If we are not allowed to change the 
				# given graph, we can create a copy of graph 
		self.graph = sorted(self.graph,key=lambda item: item[2]) 

		parent = [] ; rank = [] 

		# Create V subsets with single elements 
		for node in range(self.V): 
			parent.append(node) 
			rank.append(0) 
	
		# Number of edges to be taken is equal to V-1 
		while e < self.V -1 : 

			# Step 2: Pick the smallest edge and increment 
					# the index for next iteration 
			u,v,w = self.graph[i] 
			i = i + 1
			x = self.find(parent, u) 
			y = self.find(parent ,v) 

			# If including this edge does't cause cycle, 
						# include it in result and increment the index 
						# of result for next edge 
			if x != y: 
				e = e + 1	
				result.append([u,v,w]) 
				self.union(parent, rank, x, y)			 
			# Else discard the edge 

		# print the contents of result[] to display the built MST 
		return result

# Driver code

def vertexIndex(v, vertices, tolerance):
	for i in range(len(vertices)):
		if Topologic.Utilities.VertexUtility.Distance(v, vertices[i]) < tolerance:
			return i
	return None

vertices = graph.Vertices
g = Graph(len(vertices))

edges = graph.Edges(None, tolerance)

for anEdge in edges:
	sv = anEdge.StartVertex
	svi = vertexIndex(sv, vertices, tolerance)
	ev = anEdge.EndVertex
	evi = vertexIndex(ev, vertices, tolerance)
	if edgeKey.lower() == "length":
		weight = Topologic.Utilities.VertexUtility.Distance(anEdge.StartVertex, anEdge.EndVertex)
	else:
		dict = anEdge.Dictionary
		weight = dict[edgeKey]
	g.addEdge(svi, evi, weight) 


graphEdges = g.KruskalMST()

edges = []
dictValues = []
for anEdge in graphEdges:
	sv = vertices[anEdge[0]]
	ev = vertices[anEdge[1]]
	tEdge = Topologic.Edge.ByStartVertexEndVertex(sv, ev)
	edges.append(tEdge)
	dictValues.append(anEdge[2])
# ---------- end python ----------
lng = ListLength(List=python.dictValues)
repeat = RepeatData(Data=edgekey, Length=lng)
dictionary_bykeysvalues = DictionaryByKeysValues(Keys=graft(repeat), Values=graft(python.dictValues))
flatten = FlattenTree(Tree=dictionary_bykeysvalues, Path="{0}")
topology_setdictionary = TopologySetDictionary(Topology=python.edges, Dictionary=flatten)
wire_byedges = WireByEdges(Edges=topology_setdictionary)

# ---- group: Cluster Output
wire = ClusterOutput(wire_byedges)
