# Grasshopper definition Topologic-13-BooleanBasedOnDictionary.gh (Grasshopper 1.0.7)
# plug-ins: TopologicGH, Bifocals

panel = Panel("1. Build Block -> Cell")

box = DomainBox(Base=PlaneXY(0, 0, 0), X="60", Y="30", Z="20")
topology_bygeometry = TopologyByGeometry(Geometry=box, Tolerance=0.0001)

panel_2 = Panel("2. Build Towers -> Cell")

dom = ConstructDomain(DomainStart="37.5", DomainEnd="7.5")
box_2 = DomainBox(Base=PlaneXY(0, 0, 0), X="15", Y="15", Z="24")
dedomain = DeconstructDomain(Domain=dom)  # -> Start, End
pt = ConstructPoint(XCoordinate=[dedomain.End, dedomain.Start], YCoordinate="7.5", ZCoordinate=0)
move = Move(Geometry=box_2, Motion=pt)  # -> Geometry, Transform
topology_bygeometry_2 = TopologyByGeometry(Geometry=move.Geometry, Tolerance=0.0001)

# ----
# 3. Build Horizontal Slicing Planes -> Cluster of Faces
pt_2 = Point(Point(-5, -5, 0))
pt_3 = Point(Point(-5, 35, 0))
pt_4 = Point(Point(65, 35, 0))
pt_5 = Point(Point(65, -5, 0))
div = DivideDomain(Domain="20", Count="11")
pline = PolyLine(Vertices=[pt_2, pt_3, pt_4, pt_5], Closed=True)
dedomain_2 = DeconstructDomain(Domain=div)  # -> Start, End
pt_6 = ConstructPoint(XCoordinate=0, YCoordinate=0, ZCoordinate=[dedomain_2.Start, dedomain_2.End])
move_2 = Move(Geometry=pline, Motion=pt_6)  # -> Geometry, Transform
topology_bygeometry_3 = TopologyByGeometry(Geometry=move_2.Geometry, Tolerance=0.0001)
face_bywire = FaceByWire(Wire=topology_bygeometry_3)
cluster_bytopologies = ClusterByTopologies(Topologies=face_bywire)

panel_3 = Panel("Display Block (Optional)")

topology_edges = TopologyEdges(Topology=topology_bygeometry)
topology_geometry = TopologyGeometry(Topology=topology_bygeometry, Tolerance=0.0001)
rgb = ColourRGB(Alpha="100", Red="255", Green="0", Blue="0")
topology_geometry_2 = TopologyGeometry(Topology=topology_edges, Tolerance=0.0001)
preview = CustomPreview(Geometry=topology_geometry, Material=rgb)

# ----
# Set Block Dictionary (Cell Type)
panel_4 = Panel("\"type\"")
dictionary_bykeysvalues = DictionaryByKeysValues(Keys=panel_4, Values="\"office\"")
topology_setdictionary = TopologySetDictionary(Topology=topology_bygeometry, Dictionary=dictionary_bykeysvalues)

# ----
# Set Tower Dictionary (Cell Type)
panel_5 = Panel("\"type\"")
dictionary_bykeysvalues_2 = DictionaryByKeysValues(Keys=panel_5, Values="\"atrium\"")
topology_setdictionary_2 = TopologySetDictionary(Topology=topology_bygeometry_2, Dictionary=dictionary_bykeysvalues_2)
cluster_bytopologies_2 = ClusterByTopologies(Topologies=topology_setdictionary_2)

panel_6 = Panel("Display Cluster (Optional)")

topology_edges_2 = TopologyEdges(Topology=cluster_bytopologies)
topology_geometry_3 = TopologyGeometry(Topology=cluster_bytopologies, Tolerance=0.0001)
rgb_2 = ColourRGB(Alpha="100", Red="255", Green="0", Blue="0")
topology_geometry_4 = TopologyGeometry(Topology=topology_edges_2, Tolerance=0.0001)
preview_2 = CustomPreview(Geometry=topology_geometry_3, Material=rgb_2)

# ----
# Impose Towers on Block -> CellComples (Dictionaries are embedded in resulting Cells)
toggle = BooleanToggle(True)
topology_impose = TopologyImpose(Topology=topology_setdictionary, Tool=cluster_bytopologies_2, TransferDictionary=toggle)

python = GhPythonScript(key="\"type\"", inert="\"atrium\"", cellComplex=topology_impose, cluster=cluster_bytopologies)  # -> CellComplex
# ---------- python: Python ----------
"""Provides a scripting component.
    Inputs:
        key: The v script variable      
        inert: The x script variable
        cellComplex: The y script variable
        cluster: The z script variable
    Output:
        CellComplex: The a output variable"""

__author__ = "katie"
__version__ = "2020.07.06"

# Add TopologicGH directory 
import sys 
# Add TopologicGH plugin file 
import clr 
from os.path import expanduser
home = expanduser("~")
sys.path.append(home+'\\AppData\\Roaming\\Grasshopper\\Libraries\\Topologic\\')
clr.AddReferenceToFile("TopologicNET")  
# Import TopologicGH 
import Topologic 
# Import Rhino
import Rhino

# Place your code below this line
cells = cellComplex.Cells

topologies = []
output = []
for aCell in cells:
	dict = aCell.Dictionary
	val = dict[key]
	if val != inert:
		slicedTopology = Topologic.Topology.Slice(aCell, cluster, True)
		newCells = slicedTopology.Cells
		for aNewCell in newCells:
			topologies.append(aNewCell)
	else:
		topologies.append(aCell)

output = Topologic.CellComplex.ByCells(topologies)
# Assign your output to the OUT variable.
CellComplex = output
# ---------- end python ----------
panel_7 = Panel("BOOLEAN BY DICTIONARY")
panel_8 = Panel("Display Result")
panel_9 = Panel("Display Towers (Optional)")
panel_10 = Panel("Display CellComplex (Optional)")

topology_edges_3 = TopologyEdges(Topology=cluster_bytopologies_2)
topology_geometry_5 = TopologyGeometry(Topology=cluster_bytopologies_2, Tolerance=0.0001)
rgb_3 = ColourRGB(Alpha="100", Red="255", Green="0", Blue="0")
topology_geometry_6 = TopologyGeometry(Topology=topology_edges_3, Tolerance=0.0001)
preview_3 = CustomPreview(Geometry=topology_geometry_5, Material=rgb_3)

topology_edges_4 = TopologyEdges(Topology=python)
topology_geometry_7 = TopologyGeometry(Topology=python, Tolerance=0.0001)
rgb_4 = ColourRGB(Alpha="100", Red="255", Green="0", Blue="0")
topology_geometry_8 = TopologyGeometry(Topology=topology_edges_4, Tolerance=0.0001)
preview_4 = CustomPreview(Geometry=topology_geometry_7, Material=rgb_4)

topology_edges_5 = TopologyEdges(Topology=topology_impose)
topology_geometry_9 = TopologyGeometry(Topology=topology_impose, Tolerance=0.0001)
rgb_5 = ColourRGB(Alpha="100", Red="255", Green="0", Blue="0")
topology_geometry_10 = TopologyGeometry(Topology=topology_edges_5, Tolerance=0.0001)
preview_5 = CustomPreview(Geometry=topology_geometry_9, Material=rgb_5)
