# Grasshopper definition TransferDictionaries.gh (Grasshopper 1.0.7)
# plug-ins: TopologicGH, Bifocals

panel = Panel("Create base polygon")

polygon = Polygon(Plane=PlaneXY(0, 0, 0), Radius="14", Segments="24", FilletRadius=0)  # -> Polygon, Length

cluster = Cluster_2()
panel_2 = Panel("TransferDictionaries Cluster")
panel_3 = Panel("Create Cylinder C")
panel_4 = Panel("Create Cylinder B")
panel_5 = Panel("Create Cylinder A")
panel_6 = Panel("Dictionary Key")
panel_7 = Panel("Add Dictionary C")
panel_8 = Panel("Add Dictionary B")
panel_9 = Panel("Add Dictionary A")
panel_10 = Panel("Build a CellComplex")
panel_11 = Panel("Build a Cluster")
panel_12 = Panel("Transfer Dictionaries")
panel_13 = Panel("Display the Geometry")
panel_14 = Panel("Create Random Colours")

vec = VectorXYZ(XComponent="-8", YComponent=0, ZComponent=0)  # -> Vector, Length
move = Move(Geometry=polygon.Polygon, Motion=vec.Vector)  # -> Geometry, Transform
Z = UnitZ(Factor="5")
extr = Extrude(Base=move.Geometry, Direction=Z)

cap = CapHoles(Brep=extr)

topology_bygeometry = TopologyByGeometry(Geometry=cap, Tolerance=0.0001)

dictionary_bykeysvalues = DictionaryByKeysValues(Keys="\"id\"", Values="\"C\"")
topology_setdictionary = TopologySetDictionary(Topology=topology_bygeometry, Dictionary=dictionary_bykeysvalues)

vec_2 = VectorXYZ(XComponent="8", YComponent=0, ZComponent=0)  # -> Vector, Length
move_2 = Move(Geometry=polygon.Polygon, Motion=vec_2.Vector)  # -> Geometry, Transform
Z_2 = UnitZ(Factor="5")
extr_2 = Extrude(Base=move_2.Geometry, Direction=Z_2)

cap_2 = CapHoles(Brep=extr_2)

topology_bygeometry_2 = TopologyByGeometry(Geometry=cap_2, Tolerance=0.0001)

dictionary_bykeysvalues_2 = DictionaryByKeysValues(Keys="\"id\"", Values="\"B\"")
topology_setdictionary_2 = TopologySetDictionary(Topology=topology_bygeometry_2, Dictionary=dictionary_bykeysvalues_2)

vec_3 = VectorXYZ(XComponent=0, YComponent="13.84", ZComponent=0)  # -> Vector, Length
move_3 = Move(Geometry=polygon.Polygon, Motion=vec_3.Vector)  # -> Geometry, Transform
Z_3 = UnitZ(Factor="5")
extr_3 = Extrude(Base=move_3.Geometry, Direction=Z_3)

cap_3 = CapHoles(Brep=extr_3)

topology_bygeometry_3 = TopologyByGeometry(Geometry=cap_3, Tolerance=0.0001)

dictionary_bykeysvalues_3 = DictionaryByKeysValues(Keys="\"id\"", Values="\"A\"")
topology_setdictionary_3 = TopologySetDictionary(Topology=topology_bygeometry_3, Dictionary=dictionary_bykeysvalues_3)

merge = Merge(Data1=topology_setdictionary, Data2=topology_setdictionary_2, Data3=topology_setdictionary_3)
cluster_bytopologies = ClusterByTopologies(Topologies=merge)
cellcomplex_bycells = CellComplexByCells(Cells=merge)
cluster_2 = Cluster(cluster=cluster_bytopologies, topology=cellcomplex_bycells, key="\"id\"")
# Get the Cells of the Cluster
topology_cells = TopologyCells(Topology=cluster_2)

lng = ListLength(List=topology_cells)
random = Random(Range=Domain(0, 1), Number=lng, Seed=1)
random_2 = Random(Range=Domain(0, 1), Number=lng, Seed=2)
random_3 = Random(Range=Domain(0, 1), Number=lng, Seed=3)
multiplication = Multiplication(A=random, B="255")
multiplication_2 = Multiplication(A=random_2, B="255")
multiplication_3 = Multiplication(A=random_3, B="255")
rgb = ColourRGB(Alpha="200", Red=multiplication, Green=multiplication_2, Blue=multiplication_3)

# ----
# Display the Dictionary Values
cellutility_internalvertex = CellUtilityInternalVertex(Cell=topology_cells, Tolerance=0.0001)
topology_dictionary = TopologyDictionary(Topology=topology_cells)
topology_geometry = TopologyGeometry(Topology=cellutility_internalvertex, Tolerance=0.0001)
vec_4 = VectorXYZ(XComponent=0, YComponent=0, ZComponent="3")  # -> Vector, Length
dictionary_valueatkey = DictionaryValueAtKey(Dictionary=topology_dictionary, Key="\"id\"")
move_4 = Move(Geometry=topology_geometry, Motion=vec_4.Vector)  # -> Geometry, Transform
flatten = FlattenTree(Tree=move_4.Geometry, Path="{0}")
tag = TextTag(Location=flatten, Text=dictionary_valueatkey, Colour=ColourSwatch(SwatchColor=RGB(0, 0, 0)))

# ----
# Display the Edges of the Cell
topology_edges = TopologyEdges(Topology=topology_cells)
topology_geometry_2 = TopologyGeometry(Topology=topology_edges, Tolerance=0.0001)
preview = CustomPreview(Geometry=topology_geometry_2, Material=ColourSwatch(SwatchColor=RGB(0, 0, 0)))

topology_geometry_3 = TopologyGeometry(Topology=topology_cells, Tolerance=0.0001)

flatten_2 = FlattenTree(Tree=topology_geometry_3, Path="{0}")

preview_2 = CustomPreview(Geometry=flatten_2, Material=rgb)

# ==== cluster Cluster

# ---- group: Cluster Input
tolerance = ClusterInput()

topology = ClusterInput()

cluster = ClusterInput()

key = ClusterInput()

# ----
python = GhPythonScript(cluster=cluster, cellComplex=topology, key=key, tolerance=tolerance)  # -> cluster
# ---------- python: Python ----------
"""Provides a scripting component.
    Inputs:
        cluster: The x script variable
        cellComplex: The y script variable
        key: The z script variable
        tolerance: The u script variable
    Output:
        cluster: The a output variable"""

__author__ = "katie"
__version__ = "2020.07.11"

import sys 
sys.path.append('C:\\Users\\katie\\AppData\\Roaming\\Grasshopper\\Libraries\\Topologic\\') 
import clr 
clr.AddReferenceToFile("TopologicNET") 
import Topologic
import Rhino 

if tolerance == None:
	tolerance = 0.0001

try:
	clusterCells = cluster.Cells
except:
	  raise TypeError("Could not retrieve Cells from the input Cluster")
try:
	ccCells = cellComplex.Cells
except:
	  raise TypeError("Could not retrieve Cells from the input Topology")


outputCells = []
for ccCell in ccCells:
	iv = Topologic.Utilities.CellUtility.InternalVertex(ccCell, tolerance)
	for clusterCell in clusterCells:
		if Topologic.Utilities.CellUtility.Contains(clusterCell, iv, False, tolerance):
			clusterValue = clusterCell.Dictionary[key]
			if ccCell.Dictionary:
				ccValue = ccCell.Dictionary[key]
				if clusterValue != ccValue:
					newValue = clusterValue+','+ccValue
				else:
					newValue = ccValue
			else:
				newValue = clusterValue
			newDict = clusterCell.Dictionary
			newDict[key] = newValue
			ccCell = ccCell.SetDictionary(newDict)
	outputCells.append(ccCell)

try:
	newTopology = Topologic.Cluster.ByTopologies(outputCells)
except:
	newTopology = None
	raise TypeErro("Could not create final Topology")
# Assign your output to the OUT variable.
cluster = newTopology
# ---------- end python ----------

# ---- group: Cluster Output
cluster_2 = ClusterOutput(python)

# ==== cluster Cluster_2

# ---- group: Cluster Input
tolerance = ClusterInput()

topology = ClusterInput()

cluster = ClusterInput()

key = ClusterInput()

# ----
python = GhPythonScript(cluster=cluster, cellComplex=topology, key=key, tolerance=tolerance)  # -> cluster
# ---------- python: Python ----------
"""Provides a scripting component.
    Inputs:
        cluster: The x script variable
        cellComplex: The y script variable
        key: The z script variable
        tolerance: The u script variable
    Output:
        cluster: The a output variable"""

__author__ = "katie"
__version__ = "2020.07.11"

import sys 
sys.path.append('C:\\Users\\katie\\AppData\\Roaming\\Grasshopper\\Libraries\\Topologic\\') 
import clr 
clr.AddReferenceToFile("TopologicGH.gha") 
import TopologicGH 
import Rhino 

if tolerance == None:
	tolerance = 0.0001

try:
	clusterCells = cluster.Cells
except:
	  raise TypeError("Could not retrieve Cells from the input Cluster")
try:
	ccCells = cellComplex.Cells
except:
	  raise TypeError("Could not retrieve Cells from the input Topology")


outputCells = []
for ccCell in ccCells:
	iv = Topologic.Utilities.CellUtility.InternalVertex(ccCell, tolerance)
	for clusterCell in clusterCells:
		if Topologic.Utilities.CellUtility.Contains(clusterCell, iv, False, tolerance):
			clusterValue = clusterCell.Dictionary[key]
			if ccCell.Dictionary:
				ccValue = ccCell.Dictionary[key]
				if clusterValue != ccValue:
					newValue = clusterValue+','+ccValue
				else:
					newValue = ccValue
			else:
				newValue = clusterValue
			newDict = clusterCell.Dictionary
			newDict[key] = newValue
			ccCell = ccCell.SetDictionary(newDict)
	outputCells.append(ccCell)

try:
	newTopology = Topologic.Cluster.ByTopologies(outputCells)
except:
	newTopology = None
	raise TypeErro("Could not create final Topology")
# Assign your output to the OUT variable.
cluster = newTopology
# ---------- end python ----------

# ---- group: Cluster Output
cluster_2 = ClusterOutput(python)
