# Grasshopper definition Topologic-15-ContentAndDictionary.gh (Grasshopper 1.0.7)
# plug-ins: TopologicGH, Bifocals

# ----
# Create Commercial, Offices, and Residential Blocks
panel = Panel("0,0,0")
box = Box2Pt(PointA="0,0,9", PointB="5,5,11.5", Plane=PlaneXY(0, 0, 0))
box_2 = Box2Pt(PointA="0,0,5", PointB="5,10,9", Plane=PlaneXY(0, 0, 0))
box_3 = Box2Pt(PointA=panel, PointB="10,10,5", Plane=PlaneXY(0, 0, 0))
arrbox = BoxArray(Geometry=box, Cell=box, XCount="10", YCount="2", ZCount="12")  # -> Geometry, Transform
arrbox_2 = BoxArray(Geometry=box_2, Cell=box_2, XCount="10", YCount="1", ZCount="1")  # -> Geometry, Transform
arrbox_3 = BoxArray(
    Geometry=box_3,
    Cell={Plane=PlaneXY(0, 0, 0), X=Domain(0, 10), Y=Domain(0, 5), Z=Domain(0, 2)},
    XCount="5",
    YCount="1",
    ZCount="1")  # -> Geometry, Transform

panel_2 = Panel("Create Topologic Cells")

topology_bygeometry = TopologyByGeometry(Geometry=arrbox_3.Geometry, Tolerance=0.0001)
topology_bygeometry_2 = TopologyByGeometry(Geometry=arrbox_2.Geometry, Tolerance=0.0001)
topology_bygeometry_3 = TopologyByGeometry(Geometry=arrbox.Geometry, Tolerance=0.0001)

panel_3 = Panel("Get Cell Centroids")

topology_centroid = TopologyCentroid(Topology=topology_bygeometry)
topology_centroid_2 = TopologyCentroid(Topology=topology_bygeometry_2)
topology_centroid_3 = TopologyCentroid(Topology=topology_bygeometry_3)

cellcomplex_bycells = CellComplexByCells(Cells=[topology_bygeometry, topology_bygeometry_2])

# ----
# Create a Dictionary for each Space Type
panel_4 = Panel("\"Type\"")
dictionary_bykeysvalues = DictionaryByKeysValues(Keys="\"Type\"", Values="\"Offices\"")
dictionary_bykeysvalues_2 = DictionaryByKeysValues(Keys=panel_4, Values="\"Commercial\"")
dictionary_bykeysvalues_3 = DictionaryByKeysValues(Keys="\"Type\"", Values="\"Residential\"")

# ----
# Assign Dictionaries to the Centroid Vertices
topology_setdictionary = TopologySetDictionary(Topology=topology_centroid, Dictionary=dictionary_bykeysvalues_2)
topology_setdictionary_2 = TopologySetDictionary(Topology=topology_centroid_2, Dictionary=dictionary_bykeysvalues)
topology_setdictionary_3 = TopologySetDictionary(Topology=topology_centroid_3, Dictionary=dictionary_bykeysvalues_3)
merge = Merge(Data1=topology_setdictionary, Data2=topology_setdictionary_2, Data3=topology_setdictionary_3)

# ----
# Create a CellComplex from the Cells
merge_2 = Merge(Data1=topology_bygeometry, Data2=topology_bygeometry_2, Data3=topology_bygeometry_3)
cellcomplex_bycells_2 = CellComplexByCells(Cells=merge_2)

# ----
# Add the Vertices as Content to the CellComplex. Restrict to adding Content only to Cells
topology_addcontents = TopologyAddContents(Topology=cellcomplex_bycells_2, Contents=merge, TypeFilter="32")

# ----
# Draw the edges of the CellComplex
topology_edges = TopologyEdges(Topology=topology_addcontents)
topology_geometry = TopologyGeometry(Topology=topology_edges, Tolerance=0.0001)

# ----
# Derive the Cells and their Contents from the CellComplex
topology_cells = TopologyCells(Topology=topology_addcontents)
topology_contents = TopologyContents(Topology=topology_cells)

flatten = FlattenTree(Tree=topology_contents, Path="{0}")
# Filter by Space "Type" and Colour Accordingly
# Get the Dictionary of each Cell Content
topology_dictionary = TopologyDictionary(Topology=flatten)

dictionary_valueatkey = DictionaryValueAtKey(Dictionary=topology_dictionary, Key="\"Type\"")
equality = GhPythonScript(x=dictionary_valueatkey, y="\"Residential\"")  # -> out
# ---------- equality: Python ----------
"""Provides a scripting component.
    Inputs:
        x: The x script variable
        y: The y script variable
    Output:
        out: The a output variable"""

__author__ = "katie"
__version__ = "2020.07.08"

import rhinoscriptsyntax as rs

if x==y:
    out=True
else:
    out=False
# ---------- end equality ----------
equality_2 = GhPythonScript(x=dictionary_valueatkey, y="\"Offices\"")  # -> out; same code as equality
equality_3 = GhPythonScript(x=dictionary_valueatkey, y="\"Commercial\"")  # -> out; same code as equality
mindex = MemberIndex(Set=equality, Member=Toggle(True))  # -> Index, Count
mindex_2 = MemberIndex(Set=equality_2, Member=Toggle(True))  # -> Index, Count
mindex_3 = MemberIndex(Set=equality_3, Member=Toggle(True))  # -> Index, Count
item = ListItem(List=topology_cells, Index=mindex.Index, Wrap=True)
item_2 = ListItem(List=topology_cells, Index=mindex_2.Index, Wrap=True)
item_3 = ListItem(List=topology_cells, Index=mindex_3.Index, Wrap=True)
topology_geometry_2 = TopologyGeometry(Topology=item, Tolerance=0.0001)
topology_geometry_3 = TopologyGeometry(Topology=item_2, Tolerance=0.0001)
topology_geometry_4 = TopologyGeometry(Topology=item_3, Tolerance=0.0001)
rgb = ColourRGB(Alpha="100", Red="255", Green="0", Blue="0")
rgb_2 = ColourRGB(Alpha="100", Red="255", Green="255", Blue="0")
rgb_3 = ColourRGB(Alpha="100", Red="0", Green="0", Blue="255")
preview = CustomPreview(Geometry=topology_geometry_2, Material=rgb)
preview_2 = CustomPreview(Geometry=topology_geometry_3, Material=rgb_2)
preview_3 = CustomPreview(Geometry=topology_geometry_4, Material=rgb_3)
