# Grasshopper definition GraphDepth.gh (Grasshopper 1.0.7)
# plug-ins: TopologicGH, Bifocals

box = CenterBox(Base=PlaneXY(0, 0, 0), X="5", Y="5", Z="5")
vec = VectorXYZ(XComponent="10", YComponent="10", ZComponent="10")  # -> Vector, Length
vec_2 = VectorXYZ(XComponent="20", YComponent="20", ZComponent="20")  # -> Vector, Length
move = Move(Geometry=box, Motion=vec.Vector)  # -> Geometry, Transform
move_2 = Move(Geometry=box, Motion=vec_2.Vector)  # -> Geometry, Transform
arrbox = BoxArray(Geometry=box, Cell=box, XCount="6", YCount="6", ZCount="1")  # -> Geometry, Transform
arrbox_2 = BoxArray(Geometry=move.Geometry, Cell=move.Geometry, XCount="4", YCount="4", ZCount="1")  # -> Geometry, Transform
arrbox_3 = BoxArray(Geometry=move_2.Geometry, Cell=move_2.Geometry, XCount="2", YCount="2", ZCount="1")  # -> Geometry, Transform
merge = Merge(Data1=arrbox.Geometry, Data2=arrbox_2.Geometry, Data3=arrbox_3.Geometry)
topology_bygeometry = TopologyByGeometry(Geometry=merge, Tolerance=0.0001)
lng = ListLength(List=topology_bygeometry)
dom = ConstructDomain(DomainStart="0", DomainEnd=lng)
div = DivideDomain(Domain=dom, Count=lng)
dedomain = DeconstructDomain(Domain=div)  # -> Start, End
dictionary_bykeysvalues = DictionaryByKeysValues(Keys="\"id\"", Values=graft(dedomain.Start))
flatten = FlattenTree(Tree=dictionary_bykeysvalues, Path="{0}")
topology_setdictionary = TopologySetDictionary(Topology=topology_bygeometry, Dictionary=flatten)  # -> simplify(Topology)
cellcomplex_bycells = CellComplexByCells(Cells=topology_setdictionary)
graph_bytopology = GraphByTopology(
    Topology=cellcomplex_bycells,
    Direct=True,
    ViaSharedTopologies=False,
    ViaSharedApertures=False,
    ToExteriorTopologies=False,
    ToExteriorApertures=False,
    UseFaceInternalVertex=False,
    Tolerance=0.0001)
graph_vertices = GraphVertices(Graph=graph_bytopology)
topology_dictionary = TopologyDictionary(Topology=graph_vertices)
dictionary_valueatkey = DictionaryValueAtKey(Dictionary=topology_dictionary, Key="\"id\"")
number_slider = Slider(0, range=0..55)
sort = SortList(Keys=dictionary_valueatkey, ValuesA=graph_vertices)  # -> Keys, ValuesA
item = ListItem(List=sort.ValuesA, Index=number_slider, Wrap=True)
depthmap = DepthMap(graph=graph_bytopology, origin=item, vertices=sort.ValuesA, tolerance=0.0001)
topology_edges = TopologyEdges(Topology=topology_bygeometry)
colorbynumberinrange = ColorByNumberInRange(alpha="150", number=depthmap, min="0", max="10", index=number_slider)
topology_geometry = TopologyGeometry(Topology=topology_edges, Tolerance=0.0001)
preview = CustomPreview(Geometry=merge, Material=colorbynumberinrange)
preview_2 = CustomPreview(Geometry=topology_geometry, Material=ColourSwatch(SwatchColor=RGB(0, 0, 0)))

# ==== cluster DepthMap

# ---- group: Cluster Input
graph = ClusterInput()

origin = ClusterInput()

tolerance = ClusterInput()

vertices = ClusterInput()

# ----
graph_topologicaldistance = GraphTopologicalDistance(Graph=graph, StartVertex=origin, EndVertex=vertices, Tolerance=tolerance)
index = ItemIndex(List=vertices, Item=origin)
replace = ReplaceItems(List=graph_topologicaldistance, Item="0.001", Indices=index, Wrap=False)

# ---- group: Cluster Output
depths = ClusterOutput(replace)

# ==== cluster ColorByNumberInRange

# ---- group: Cluster Input
index = ClusterInput()

max = ClusterInput()

min = ClusterInput()

number = ClusterInput()

# ----
python = GhPythonScript(values=number, minVal=min, maxVal=max)  # -> output
# ---------- python: Python ----------
__author__ = "katie"
__version__ = "2020.07.16"

import rhinoscriptsyntax as rs
import sys
import clr
import math

minVal=float(minVal)
maxVal=float(maxVal)

def getColor(ratio):
	r = 0.0
	g = 0.0
	b = 0.0

	finalRatio = ratio;
	if (finalRatio < 0.0):
		finalRatio = 0.0
	elif(finalRatio > 1.0):
		finalRatio = 1.0

	if (finalRatio >= 0.0 and finalRatio <= 0.25):
		r = 0.0
		g = 4.0 * finalRatio
		b = 1.0
	elif (finalRatio > 0.25 and finalRatio <= 0.5):
		r = 0.0
		g = 1.0
		b = 1.0 - 4.0 * (finalRatio - 0.25)
	elif (finalRatio > 0.5 and finalRatio <= 0.75):
		r = 4.0*(finalRatio - 0.5);
		g = 1.0
		b = 0.0
	else:
		r = 1.0
		g = 1.0 - 4.0 * (finalRatio - 0.75)
		b = 0.0

	rcom =  math.floor(max(min(math.floor(255.0 * r), 255.0), 0.0))
	gcom =  math.floor(max(min(math.floor(255.0 * g), 255.0), 0.0))
	bcom =  math.floor(max(min(math.floor(255.0 * b), 255.0), 0.0))

	return [rcom,gcom,bcom]

if type(values) is list:
	output = []
	for i in range(len(values)):
		val = values[i]
		val = max(min(val,maxVal), minVal)
		val = (val - minVal)/(maxVal - minVal)
		rgbList = getColor(val)
		output.append(rgbList)
else:
	val = values
	val = max(min(val,maxVal), minVal)
	val = (val - minVal)/(maxVal - minVal)
	rgbList = getColor(val)
	output = rgbList
# ---------- end python ----------
item = ListItem(List=python, Index=0, Wrap=True)  # -> Item, Item1, Item2

# ---- group: Cluster Input
alpha = ClusterInput()

# ----
flatten = FlattenTree(Tree=item.Item, Path="{0}")
flatten_2 = FlattenTree(Tree=item.Item1, Path="{0}")
flatten_3 = FlattenTree(Tree=item.Item2, Path="{0}")
replace = ReplaceItems(List=flatten_3, Item="255", Indices=index, Wrap=False)
replace_2 = ReplaceItems(List=flatten, Item="0", Indices=index, Wrap=False)
rgb = ColourRGB(Alpha=alpha, Red=replace_2, Green=flatten_2, Blue=replace)

# ---- group: Cluster Output
color = ClusterOutput(rgb)
