# Grasshopper definition micha_tutorial_1.gh (Grasshopper 1.0.7)
# plug-ins: TopologicGH

geometry = Geometry(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)
geometry_2 = Geometry([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])
topology_bygeometry = TopologyByGeometry(Geometry=geometry, Tolerance=0.0001)
topology_bygeometry_2 = TopologyByGeometry(Geometry=geometry_2, Tolerance=0.0001)
cluster_bytopologies = ClusterByTopologies(Topologies=topology_bygeometry_2)
topology_slice = TopologySlice(Topology=topology_bygeometry, Tool=cluster_bytopologies, TransferDictionary=False)
cellcomplex_faces = CellComplexFaces(CellComplex=topology_slice)
topology_centroid = TopologyCentroid(Topology=cellcomplex_faces)
faceutility_parametersatvertex = FaceUtilityParametersAtVertex(Face=cellcomplex_faces, Vertex=topology_centroid)  # -> U, V
faceutility_normalatparameters = FaceUtilityNormalAtParameters(Face=cellcomplex_faces, U=faceutility_parametersatvertex.U, V=faceutility_parametersatvertex.V)  # -> X, Y, Z
absolute = Absolute(Value=faceutility_normalatparameters.Z)
geometry_3 = Geometry([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])
dispatch = Dispatch(List=cellcomplex_faces, DispatchPattern=absolute)  # -> ListA, ListB
topology_geometry = TopologyGeometry(Topology=dispatch.ListB, Tolerance=0.0001)  # -> flatten(Geometry)
area = Area(Geometry=topology_geometry)  # -> Area, Centroid
scale = Scale(Geometry=topology_geometry, Center=area.Centroid, Factor=Slider(0.5, range=0..1))  # -> Geometry, Transform
topology_bygeometry_3 = TopologyByGeometry(Geometry=geometry_3, Tolerance=0.0001)
topology_addapertures = TopologyAddApertures(Topology=dispatch.ListB, ApertureTopologies=topology_bygeometry_3)
merge = Merge(Data1=dispatch.ListA, Data2=topology_addapertures)
topology_apertures = TopologyApertures(Topology=topology_addapertures)  # -> flatten(Apertures)
topology_geometry_2 = TopologyGeometry(Topology=topology_apertures, Tolerance=0.0001)
cellcomplex_byfaces = CellComplexByFaces(Faces=merge, Tolerance=0.001)
panel = Panel(topology_apertures)

geometry_4 = Geometry(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)
geometry_5 = Geometry(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)
topology_bygeometry_4 = TopologyByGeometry(Geometry=geometry_5, Tolerance=0.0001)
topology_bygeometry_5 = TopologyByGeometry(Geometry=geometry_4, Tolerance=0.0001)
geometry_6 = Geometry(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)
topology_difference = TopologyDifference(Topology=topology_bygeometry_5, Topology_2=topology_bygeometry_4, TransferDictionary=False)
topology_bygeometry_6 = TopologyByGeometry(Geometry=geometry_6, Tolerance=0.0001)
topology_impose = TopologyImpose(Topology=topology_difference, Tool=topology_bygeometry_6, TransferDictionary=False)
cellcomplex_cells = CellComplexCells(CellComplex=topology_impose)
cellcomplex_bycells = CellComplexByCells(Cells=flatten([topology_bygeometry_4, cellcomplex_cells]))
cellcomplex_cells_2 = CellComplexCells(CellComplex=cellcomplex_bycells)
list_item = ListItem(CellComplexes=cellcomplex_cells_2, Index=Slider(0, range=0..2), Wrap=True)
list_item_2 = ListItem(CellComplexes=cellcomplex_cells_2, Index=Slider(1, range=0..2), Wrap=True)
topology_geometry_3 = TopologyGeometry(Topology=list_item, Tolerance=0.0001)
cell_adjacentcells = CellAdjacentCells(Cell=list_item)
topology_geometry_4 = TopologyGeometry(Topology=list_item_2, Tolerance=0.0001)
topology_geometry_5 = TopologyGeometry(Topology=cell_adjacentcells, Tolerance=0.0001)
cell_sharedfaces = CellSharedFaces(Cell=list_item, Cell_2=list_item_2)
topology_geometry_6 = TopologyGeometry(Topology=cell_sharedfaces, Tolerance=0.0001)
