# Grasshopper definition Triangle_from_Scratch_project.gh (Grasshopper 1.0.7)

# ---- group: Old method / Main square out of triangles
construct_point = ConstructPoint(XCoordinate=Slider(0, range=0..10), YCoordinate=Slider(10, range=0..11), ZCoordinate=0)
construct_point_2 = ConstructPoint(XCoordinate=Slider(10, range=0..10), YCoordinate=0, ZCoordinate=0)
construct_point_3 = ConstructPoint(XCoordinate=0, YCoordinate=0, ZCoordinate=0)
construct_point_4 = ConstructPoint(XCoordinate=Slider(5, range=0..10), YCoordinate=Slider(5, range=0..10), ZCoordinate=0)
construct_point_5 = ConstructPoint(XCoordinate=Slider(10, range=0..10), YCoordinate=Slider(10, range=0..11), ZCoordinate=0)
construct_point_6 = ConstructPoint(XCoordinate=Slider(5, range=0..10), YCoordinate=Slider(5, range=0..10), ZCoordinate=0)
line = Line(StartPoint=construct_point_5, EndPoint=construct_point)
line_2 = Line(StartPoint=construct_point_5, EndPoint=construct_point_6)
line_3 = Line(StartPoint=construct_point, EndPoint=construct_point_6)
line_4 = Line(StartPoint=construct_point_2, EndPoint=construct_point_3)
line_5 = Line(StartPoint=construct_point_3, EndPoint=construct_point_4)
line_6 = Line(StartPoint=construct_point_2, EndPoint=construct_point_4)
line_7 = Line(StartPoint=construct_point_3, EndPoint=construct_point)
merge = Merge(Data2=line_4, Data3=line_5, Data4=line_6)
merge_2 = Merge(Data2=line, Data3=line_3, Data4=line_2)
merge_3 = Merge(Data1=line_5, Data2=line_7, Data3=line_3)
line_8 = Line(StartPoint=construct_point_2, EndPoint=construct_point_5)
merge_4 = Merge(Data1=line_8, Data2=merge, Data3=merge_3, Data4=merge_2)

# ----
number_slider = Slider(2, range=0..10)
number_slider_2 = Slider(0.1, range=0..0.1)
polygon = Polygon(Plane=PlaneXY(0, 0, 0), Radius=Slider(0.55, range=0.1..10), Segments=Slider(3, range=0..10), FilletRadius=0)  # -> Polygon, Length
unit_y = UnitY(Factor=Slider(4, range=0..10))
move = Move(Geometry=polygon.Polygon, Motion=unit_y)  # -> Geometry, Transform
unit_x = UnitX(Factor=Slider(1, range=0..10))
move_2 = Move(Geometry=move.Geometry, Motion=unit_x)  # -> Geometry, Transform
rotate = Rotate(Geometry=move_2.Geometry, Angle=degrees(Slider(296, range=0..1000)), Plane=PlaneXY(0, 0, 0))  # -> Geometry, Transform
unit_y_2 = UnitY(Factor=Slider(3, range=0..10))
move_3 = Move(Geometry=rotate.Geometry, Motion=unit_y_2)  # -> Geometry, Transform
unit_x_2 = UnitX(Factor=Slider(3, range=0..10))
move_4 = Move(Geometry=move_3.Geometry, Motion=unit_x_2)  # -> Geometry, Transform
rotate_3d = Rotate3D(Geometry=move_4.Geometry, Angle=1.570796327, Center=Point(0, 0, 0), Axis=Vector(0, 0, 1))  # -> Geometry, Transform
unit_x_3 = UnitX(Factor=Slider(7.2, range=0..10))
move_5 = Move(Geometry=rotate_3d.Geometry, Motion=unit_x_3)  # -> Geometry, Transform
rotate_3d_2 = Rotate3D(Geometry=move_3.Geometry, Angle=1.570796327, Center=Point(0, 0, 0), Axis=Vector(0, 0, 1))  # -> Geometry, Transform
rotate_2 = Rotate(Geometry=move_5.Geometry, Angle=degrees(Slider(4, range=0..100)), Plane=PlaneXY(0, 0, 0))  # -> Geometry, Transform
unit_x_4 = UnitX(Factor=Slider(1, range=0..1))
divide_curve = DivideCurve(Curve=rotate_3d_2.Geometry, Count=10, Kinks=Toggle(True))  # -> Points, Tangents, Parameters
move_6 = Move(Geometry=rotate_2.Geometry, Motion=unit_x_4)  # -> Geometry, Transform
negative = Negative(Value=divide_curve.Points)
polyline = PolyLine(Vertices=negative, Closed=Toggle(True))
rotate_3 = Rotate(Geometry=polyline, Angle=degrees(Slider(4, range=0..100)), Plane=PlaneXY(0, 0, 0))  # -> Geometry, Transform
unit_y_3 = UnitY(Factor=Slider(7, range=0..10))
move_7 = Move(Geometry=rotate_3.Geometry, Motion=unit_y_3)  # -> Geometry, Transform
unit_x_5 = UnitX(Factor=Slider(-1.3, range=-2..10))
move_8 = Move(Geometry=move_7.Geometry, Motion=unit_x_5)  # -> Geometry, Transform
unit_y_4 = UnitY(Factor=Slider(-2, range=-10..10))
move_9 = Move(Geometry=move_8.Geometry, Motion=unit_y_4)  # -> Geometry, Transform
unit_x_6 = UnitX(Factor=1)
move_10 = Move(Geometry=move_9.Geometry, Motion=unit_x_6)  # -> Geometry, Transform
number_slider_3 = Slider(0, range=0..100)
merge_5 = Merge(Data1=move_10.Geometry, Data2=move_6.Geometry, Data3=move_4.Geometry, Data4=move_2.Geometry, Data5=move_2.Geometry)
number_slider_4 = Slider(-10, range=-100..100)
number_slider_5 = Slider(-9.8, range=-100.3..100)
scale = Scale(Geometry=merge_5, Center=Point(0, 0, 0), Factor=Slider(10, range=0..10))  # -> Geometry, Transform
unit_y_5 = UnitY(Factor=Slider(-9.7, range=-9.85..10))
move_11 = Move(Geometry=scale.Geometry, Motion=unit_y_5)  # -> Geometry, Transform

# ---- group: Old method
negative_2 = Negative(Value=Slider(12, range=0..20))
negative_3 = Negative(Value=Slider(11, range=0..20))
negative_4 = Negative(Value=Slider(1, range=0..10))
negative_5 = Negative(Value=Slider(10, range=0..10))
construct_point_7 = ConstructPoint(XCoordinate=negative_5, YCoordinate=0, ZCoordinate=0)
construct_point_8 = ConstructPoint(XCoordinate=negative_2, YCoordinate=0, ZCoordinate=0)
construct_point_9 = ConstructPoint(XCoordinate=negative_3, YCoordinate=negative_4, ZCoordinate=0)
line_9 = Line(StartPoint=construct_point_7, EndPoint=construct_point_8)
line_10 = Line(StartPoint=construct_point_8, EndPoint=construct_point_9)
line_11 = Line(StartPoint=construct_point_7, EndPoint=construct_point_9)
merge_6 = Merge(Data1=line_9, Data2=line_11, Data3=line_10)
xy_plane = XYPlane(Origin=Point(0, 0, 0))
rotate_4 = Rotate(Geometry=merge_6, Angle=degrees(Slider(90, range=0..100)), Plane=xy_plane)  # -> Geometry, Transform
unit_y_6 = UnitY(Factor=Slider(16, range=0..100))
move_12 = Move(Geometry=rotate_4.Geometry, Motion=unit_y_6)  # -> Geometry, Transform
unit_x_7 = UnitX(Factor=Slider(1, range=0..10))
unit_x_8 = UnitX(Factor=Slider(10, range=0..100))
number_slider_6 = Slider(90, range=0..100)
unit_y_7 = UnitY(Factor=Slider(10, range=0..100))
unit_y_8 = UnitY(Factor=Slider(10, range=0..100))
unit_x_9 = UnitX(Factor=Slider(10, range=0..100))

# ---- group: Old method / First triangle from left
move_13 = Move(Geometry=move_12.Geometry, Motion=unit_x_7)  # -> Geometry, Transform

# ---- group: Old method (continued)
rotate_5 = Rotate(Geometry=move_13.Geometry, Angle=degrees(Slider(180, range=0..1000)), Plane=PlaneXY(0, 0, 0))  # -> Geometry, Transform
move_14 = Move(Geometry=rotate_5.Geometry, Motion=unit_x_8)  # -> Geometry, Transform

# ---- group: Old method / First triangle from downwards
rotate_6 = Rotate(Geometry=move_14.Geometry, Angle=degrees(number_slider_6), Plane=PlaneXY(0, 0, 0))  # -> Geometry, Transform

# ---- group: Old method / First Triangle from right
move_15 = Move(Geometry=move_14.Geometry, Motion=unit_y_7)  # -> Geometry, Transform

# ---- group: Old method (continued)
rotate_7 = Rotate(Geometry=rotate_6.Geometry, Angle=degrees(Slider(180, range=0..1000)), Plane=PlaneXY(0, 0, 0))  # -> Geometry, Transform
move_16 = Move(Geometry=rotate_7.Geometry, Motion=unit_y_8)  # -> Geometry, Transform

# ---- group: Old method / First triangle from above
move_17 = Move(Geometry=move_16.Geometry, Motion=unit_x_9)  # -> Geometry, Transform

# ---- group: Old method
merge_7 = Merge(Data1=merge_4, Data2=move_15.Geometry, Data3=rotate_6.Geometry, Data4=move_17.Geometry, Data5=move_13.Geometry)
custom_preview = CustomPreview(Geometry=merge_7, Material=ColourSwatch(SwatchColor=RGB(100, 91, 164)))
