# Grasshopper definition shatter2.gh (Grasshopper 1.0.7)
# plug-ins: Kangaroo Components, Kangaroo2 Components

curve = Curve([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])
curve_2 = Curve(curve)
group = Group(Objects=curve_2)
box_corners = BoxCorners(Box=group)  # -> CornerA, CornerB, CornerC, CornerD, CornerE, CornerF, CornerG, CornerH
point = Point([box_corners.CornerA, box_corners.CornerB, box_corners.CornerC, box_corners.CornerD])
polyline = PolyLine(Vertices=point, Closed=invert(False))
offset_curve = OffsetCurve(Curve=polyline, Distance=1, Plane=PlaneXY(0, 0, 0), Corners=1)
surface_split = SurfaceSplit(Surface=offset_curve, Curves=curve_2)
sort_list = SortList(Keys=surface_split, ValuesA=surface_split)  # -> Keys, ValuesA
cull_index = CullIndex(List=sort_list.ValuesA, Indices=-1, Wrap=True)
brep_edges = BrepEdges(Brep=cull_index)  # -> Naked, Interior, NonManifold
dupln = RemoveDuplicateLines(Lines=flatten(brep_edges.Naked), Tolerance=0.01)
removeduplicatelines = RemoveDuplicateLines(Lines=brep_edges.Naked, Tolerance=0.01)
join_curves = JoinCurves(Curves=removeduplicatelines, Preserve=False)
curve_self = CurveSelf(Curve=join_curves)  # -> Points, Params
shatter = Shatter(Curve=graft(join_curves), Parameters=curve_self.Params)  # -> flatten(Segments)
list_length = ListLength(List=curve_self.Points)
equality = Equality(FirstNumber=list_length, SecondNumber="0")  # -> Equality, Inequality
closed = Closed(Curve=shatter)  # -> Closed, Periodic
cull_pattern = CullPattern(List=graft(join_curves), CullPattern=equality.Equality)
dispatch = Dispatch(List=shatter, DispatchPattern=closed.Closed)  # -> ListA, ListB
curve_3 = Curve(dispatch.ListA)
merge = Merge(Data1=curve_3, Data2=cull_pattern)
